vi "Revision Query.gvi"   [LabVIEW NXG 5.0.0]
# Queries the current instrument firmware revision and instrument driver revision.
# Refer to the Readme file for detailed driver information including modification history.
inputs:
  "VISA resource name": "VISA Instr", required
    # A reference to the instrument in use.  The reference to the resource name is created in the Initialize VI.  Therefore, before calling this VI, you need to call the Initialize VI.  To run this VI interactively, select the previously initialized resource name from the pull-down menu.  To run this VI programmatically, wire the VISA resource name out terminal of the Initialize VI to subsequent VISA resource name input terminals.  You chain instrument driver VIs together by wiring the VISA resource name out terminal to subsequent VISA resource name input terminals.
  "error in (no error)": error
outputs:
  "VISA resource name out": "VISA Instr"  # A copy of the reference to the instrument in use. The reference to the resource name is created in the Initialize VI. Wire the VISA resource name out terminal of the Initialize VI to subsequent VISA resource name input terminals. You chain instrument driver VIs together by wiring the VISA resource name out terminal to subsequent VISA resource name input terminals.
  "Instrument Driver Revision": string  # Returns the instrument driver software revision in the form of a string.
  "Instrument Firmware Revision": string  # Returns the instrument firmware revision numbers in the form of a string. This version and its capabilities are set by the instrument manufacturer.
  "error out": error
types:
  T1 = cluster{"Major": u16, "Minor": u16, "Fix": u16, "Build": u16}
uses:
  NI::VISA::Synchronous Write (Instr, Compatibility).gvi
  NI::VISA::Synchronous Read (Instr, Compatibility).gvi
  Labview_NXG_Keithley_SMU_2450_2460_2461::Utility::Error Query.gvi
diagram:
  Is Equal(x="Run Time System", y="Run Time System") -> w1
  case (w1) {
    frame False, Default {
      Property Node(instance in=T1 {all zero or empty}) -> ("Major"=w4, "Minor"=w5, "Fix"=w6, "Build"=w7)
      Format Into String(formatString="%d.%d", w4, w5) -> w8
      Format Into String(formatString=".%d", w6) -> w9
      Is Equal To 0(x=w6) -> w10
      Is Equal To 0(x=w7) -> w11
      Logical And(w10, w11) -> w12
      Select(s=w12, t="", f=w9) -> w13
      # Retrieve version information from VI library
      Format Into String(formatString=".%d", w7) -> w14
      Select(s=w11, t="", f=w14) -> w15
      Concatenate Strings(w8, w13, w15) -> w2
      w3 = $"error in (no error)"
    }
    frame True {
      w2 = "1.1.1"
      w3 = $"error in (no error)"
    }
  }
  $"Instrument Driver Revision" <- w2
  w16 = 100  # Bytes to Read
  w17 = "*IDN?"  # Revision Query Command
  call "Synchronous Write (Instr, Compatibility).gvi"(session in=$"VISA resource name", error in=w3, write buffer=w17) -> (session out=w18, error out=w19)
  call "Synchronous Read (Instr, Compatibility).gvi"(session in=w18, error in=w19, byte count=w16) -> (session out=w20, error out=w21, read buffer=w22)
  call "Error Query.gvi"(VISA resource name=w20, error in (no error)=w21) -> (VISA resource name out=w23, error out=w24)
  $"VISA resource name out" <- w23
  $"error out" <- w24
  Scan From String(formatString="%[^,], %[^,], %[^,],%[^\\r\\n]", inputString=w22) -> (out3=w25)
  $"Instrument Firmware Revision" <- w25
