vi "Main Window.gvi"   [LabVIEW NXG 5.0.0]
panel controls:
  "Main Tab control": i32
  "Advanced Config Tab": i32
  "Global Abort": bool  # Force exit either the current process or the entire app (you will be prompted)
  "New Calibration": bool
  "Load Calibration": bool
  "Save Calibration": bool
  "End Wavelength (nm)": f64 = 1100
  "Start Wavelength (nm)": f64 = 400
  "Wavelength Step (nm)": f64 = 1
  "Light Power Calibration Data": f64[][]
  "Current Date": string
  "Custom date": bool
  "Author Initials": string
  "Batch Name": string
  "Cell Number": string
  "Sample Comments": string
  "Default Data Saving Location": path = path "D:\\measurements\\EQE measurements"
  "Powermeter Averages": f64 = 3
  "Exit App": bool  # Exit the application while waiting for everything to finish
  "Current Averages": f64 = 3
  "Acquire Manual EQE": bool
  "Save current EQE TXT": bool
  "Voltage Applied (V)": f64
  "Autorange": bool = TRUE
  "Dark Current": bool = TRUE
  "Manual Current Range": f64 = 1e-08
  "Monochromator configuration file": path
  "Desired λ (nm)": f64 = 500
  "Set desired wavelength": bool
  "Max current": f64 = 0.1
  "Full EQE Data": f64[][]
  "Dark Current Averages": f64 = 30
  "Carriage Arduino Status": bool
  "Multiplexer Arduino Status": bool
  "Filter Arduino Status": bool
  "Automatic Acquire": bool
  "Current Averages": f64 = 1
  "Voltage Applied (V)": f64
  "Autorange": bool = TRUE
  "Dark Current": bool = TRUE
  "Manual Range": f64 = 1e-08
  "All": bool
  "Reset": bool
  "Cell Data Cluster": "Cell Data Cluster 2.gtype"
  "Random Cell Order": bool
  "Cell Measuring Labels": string[]
  "VISA Resource Name": "VISA Instr"
  "X position": f64
  "Z position": f64
  "Activate Arduino": bool
  "Set Postion": bool
  "Release Arduino": bool
  "Supercontinuum Status": bool
  "Laser Status": bool
  "Cell Label": T1 = "L.01"
  "Custom Position": bool
  "Automatic EQE Measurement Graph_2": cluster{"Element 1": f64[], "Element 2": f64[]}[]
  "Monochromator": bool
  "Monochromator configuration file infrared": path
  "Monochromator configuration file visible": path
  "Wavelength for peak detection": f64 = 500
  "Save Ref Coordinates": bool
  "Desired Cell": T1 = "L.01"
  "Set Multiplexor Cell": bool
  "Skip to Next Cell": bool
  "Keithley Enable Output": bool
  "Keithley Disable Output": bool
  "Manual Current Range.": f64
  "Voltage Applied (V).": f64
  "Source Limit Level.": f64 = 0.1
  "Current Averages.": i32 = 3
  "Enable Auto Range": bool = TRUE
  "R.01 Reference Coordinates": "R.01 Reference Coordinates.gtype" = {"X coordinate R.01"=145.3, "Z coordinate R.01"=2.5, "Vertical Spacing"=0}
  "R.01 Scan?": bool
  "Z scan steps": f64 = 6
  "X scan Range (mm)": f64 = 5
  "Z scan Range (mm)": f64 = 4
  "X scan steps": f64 = 8
  "Save R.01 Coordinate?": bool
  "Precheck Cells": bool = TRUE
  "Dead Current Threshold": f64 = 1e-11
panel indicators:
  "Light Calibration": cluster{"Element 1": f64[], "Element 2": f64[]}
  "EQE Measurement": cluster{"Element 1": f64[], "Element 2": f64[]}
  "Automatic EQE Measurement Graph": cluster{"Element 1": f64[], "Element 2": f64[]}[]
  "Automatic Measurement Indicators": "Automatic Measurement Indicators.gtype"
  "Light Power (W)": f64
  "Abort All": bool
  "Current Wavelength (nm)": f64
  "Sample Prefix": string
  "Label Info Missing Error": bool
  "Label Info Error Label": string
  "Current (A)": f64
  "Wavelength (nm)": f64
  "EQE (%)": f64
  "Dark Current (A)": f64
  "End Wavelength (nm) Current Calibration": f64
  "Start Wavelength (nm) Current Calibration": f64
  "Wavelength Step (nm) Current Calibration": f64
  "Current State Output": "Queue instructions.gtype"
  "Photodetector Names": string[]
  "Monochromator Name": string
  "Keithley Address": "VISA Instr"
  "Current λ (nm)": f64
  "Keythley Status": bool
  "Photodetector Status": bool
  "Monochromator Status": bool
  "Carriage Arduino Address": "VISA Instr"
  "Multiplexer Arduino Address": "VISA Instr"
  "Filter Arduino Address": "VISA Instr"
  "Cell Measuring Order": string
  "XZ Carriage Arduino Log": string
  "Arduino Multiplexer Log": string
  "Error Out": error
  "Automatic EQE Measurement Data": cluster{"Element 1": f64[], "Element 2": f64[]}[]
  "Sub states Output": "Sub states enum.gtype"
  "Carriage Active": bool
  "Supercontinuum laser Address": "VISA Instr"
  "Laser Current Power": f64
  "Initialized?": bool
  "Reference Coordinates file": path
  "Arduino Multiplexer Log.": string
  "Filter Status": bool
  "Filter Flipper Log": string
  "Progress %": f64
  "Keithley Current Measurement": string
  "XZ Scan Intensity Graph": f64[][]
  "Progress counter": f64
  "State": string
  "Substate": string
types:
  "Automatic Measurement Indicators.gtype" = cluster{"Elapsed Time (kr)": f64, "Estimated Time (kr)": f64, "Cell being measured": string, "Current Value (A)  ": f64, "EQE (%)": f64, "Dark Current (A)": f64}
  "Queue instructions.gtype" = enum{"Wrongly pointed State", "Initialize App", "Light Calibration", "Measure Photodetector", "Measure Keithley", "Instrument detection", "Single Acquire", "Multiple Acquire", "EQE Mapping", "Debugging mode", "Move Arduino", "Arduino FF flip filter", "Help routine", "Idle", "Save Calibration", "Load Calibration", "Set Wavelength", "Help Wizard", "Turn supercontinuum laser on/off", "Set Multiplex arduino cell", "Save TXT EQE file", "Load TXT EQE", "Stop or Idle", "Stop App"}
  "Cell Data Cluster 2.gtype" = cluster{"R.01": bool, "L.01": bool, "R.02": bool, "L.02": bool, "R.03": bool, "L.03": bool, "R.04": bool, "L.04": bool, "R.05": bool, "L.05": bool, "R.06": bool, "L.06": bool, "R.07": bool, "L.07": bool, "R.08": bool, "L.08": bool, "R.09": bool, "L.09": bool, "R.10": bool, "L.10": bool, "R.11": bool, "L.11": bool, "R.12": bool, "L.12": bool}
  "Sub states enum.gtype" = enum{"Not specified", "Measuring Dark Current", "Initializing Keithley", "Initializing Monochromator", "Measuring with Keithley", "Moving Arduino", "Detecting Monochromator", "Detecting Keithley", "Detecting Photodetector", "Detecting Arduinos", "Homing XZ Carriage Arduino", "Moving XZ Carriage Arduino", "Moving Filter Flipper Arduino", "Setting Pin Multiplexer Arduino", "Detecting Supercontinuum", "Scanning R.01 cell position", "Prechecking Cells"}
  T1 = enum{"L.01", "L.02", "L.03", "L.04", "L.05", "L.06", "L.07", "L.08", "L.09", "L.10", "L.11", "L.12", "R.01", "R.02", "R.03", "R.04", "R.05", "R.06", "R.07", "R.08", "R.09", "R.10", "R.11", "R.12"}
  "R.01 Reference Coordinates.gtype" = cluster{"X coordinate R.01": f64, "Z coordinate R.01": f64, "Vertical Spacing": f64}
  T2 = cluster{"L.01": bool, "R.01": bool, "L.02": bool, "R.02": bool, "L.03": bool, "R.03": bool, "L.04": bool, "R.04": bool, "L.05": bool, "R.05": bool, "L.06": bool, "R.06": bool, "L.07": bool, "R.07": bool, "L.08": bool, "R.08": bool, "L.09": bool, "R.09": bool, "L.10": bool, "R.10": bool, "L.11": bool, "R.11": bool, "L.12": bool, "R.12": bool}
  "Single Acquire Notification control.gtype" = cluster{"Wavelength (nm)": f64, "EQE (%)": f64, "Current (A)": f64, "Finnished": bool, "Progress": f64}
  "Single acquire inputs control.gtype" = cluster{"Light calibration data": f64[][], "Fiannium Configuration File": path, "Arduino Filter Flipper Address": "VISA Instr", "Filter Arduino Status": bool, "Dark Current Averages": f64, "Measure dark current?": bool, "Keithley Address": "VISA Instr", "Current Aveages": i32, "Voltage Applied (V)": f64, "Max current compliance": f64, "Manual Current Range": f64, "Enable Auto Range": bool, "Automatic measurement": bool, "Fiannium Pe Handler": u64, "Dead Cell? Current Threshold": f64, "Automatic measurement Cell Dark current": f64, "Monocrhomator": bool}
  "Multiple aquire notification constant.gtype" = cluster{"Current Value (A)  ": f64, "EQE (%)": f64, "Dark Current (A)": f64, "Cell being measured": string, "Automatic EQE Measurement Graph": cluster{"Element 1": f64[], "Element 2": f64[]}[], "Finished": bool, "Current Wavelength": f64, "Progress": f64}
  "Multiple acquire variables control.gtype" = cluster{"Monochromator configuration file ": path, "Light Power Calibration Data": f64[][], "Cell Measuring Labels": string[], "Sample Prefix": string, "Author Initials": string, "Current Date": string, "Batch Name": string, "Default Data Saving Location": path, "Filter Arduino Status": bool, "Filter Arduino Address": "VISA Instr", "Multiplexer Arduino Address": "VISA Instr", "Carriage Arduino Address": "VISA Instr", "Keithley Address": "VISA Instr", "Current Averages   ": f64, "Manual Range  ": f64, "Max current": f64, "Voltage Applied (V)  ": f64, "Autorange  ": bool, "Dark Current  ": bool, "Wavelength for peak detection": f64, "R.01 Reference Coordinates": "R.01 Reference Coordinates.gtype", "R.01 Scan?": bool, "Z scan steps": f64, "X scan Range (mm)": f64, "Z scan Range (mm)": f64, "X scan steps": f64, "Reference Coordinates file": path, "Save R.01 Coordinate?": bool, "Fianium Pe Handler": u64, "Automatic Measurement?": bool, "Dead Cell 10mV Current Threshold": f64, "Precheck cells?": bool, "Monochromator": bool}
uses:
  EQE_Measuring_Setup_NanOpto::SubVis::Main Sub Functions::Start instruction queue.gvi
  EQE_Measuring_Setup_NanOpto::SubVis::FGV::Current State FGV.gvi
  EQE_Measuring_Setup_NanOpto::SubVis::Utilities::Other::Enum reset instructions argument extract.gvi
  EQE_Measuring_Setup_NanOpto::SubVis::Main Sub Functions::Global Abort::Global Abort.gvi
  EQE_Measuring_Setup_NanOpto::SubVis::FGV::Arduino Homed FGV.gvi
  EQE_Measuring_Setup_NanOpto::SubVis::FGV::Skip To next Cell FGV.gvi
  NI::G Core::Strings::Search and Replace Pattern.gvi
  EQE_Measuring_Setup_NanOpto::SubVis::Instrument Control::Monochromator::Check Monochromator Config File.gvi
  EQE_Measuring_Setup_NanOpto::SubVis::Main Sub Functions::Check Reference coordinate file.gvi
  EQE_Measuring_Setup_NanOpto::SubVis::Main Sub Functions::Light Calibration::Light calibration.gvi
  EQE_Measuring_Setup_NanOpto::SubVis::Utilities::Other::Graph Adapter.gvi
  NI::G Core::Error::Multiplex Errors.gvi
  EQE_Measuring_Setup_NanOpto::SubVis::Utilities::Messages And Prompts::Photodetector remove message.gvi
  EQE_Measuring_Setup_NanOpto::SubVis::Instrument Control::Instrument Detection Sequence.gvi
  EQE_Measuring_Setup_NanOpto::SubVis::Utilities::Other::Wavelength Coercer.gvi
  EQE_Measuring_Setup_NanOpto::SubVis::Main Sub Functions::Laser power extractor.gvi
  EQE_Measuring_Setup_NanOpto::SubVis::Instrument Control::Supercontinuum Laser Source::Supercontinuum Shut Down Sequence.gvi
  EQE_Measuring_Setup_NanOpto::SubVis::Instrument Control::Supercontinuum Laser Source::Supercontinuum Warm Up Sequence.gvi
  EQE_Measuring_Setup_NanOpto::SubVis::Main Sub Functions::Light Calibration::Save Calibration File.gvi
  EQE_Measuring_Setup_NanOpto::SubVis::Main Sub Functions::Light Calibration::Load Calibration file.gvi
  EQE_Measuring_Setup_NanOpto::SubVis::Main Sub Functions::Acquire::Single Acquire::Single EQE Measurement Acquire.gvi
  EQE_Measuring_Setup_NanOpto::SubVis::Utilities::Messages And Prompts::Save Single EQE prompt.gvi
  EQE_Measuring_Setup_NanOpto::SubVis::Instrument Control::Monochromator::Set Desired Wavelength Slave Subroutine.gvi
  EQE_Measuring_Setup_NanOpto::SubVis::Instrument Control::Arduinos::Multiplexer Arduino::Multiplexer Arduino Control.gvi
  EQE_Measuring_Setup_NanOpto::SubVis::FGV::Arduino filter FGV current state.gvi
  EQE_Measuring_Setup_NanOpto::SubVis::Instrument Control::Arduinos::Filter Flipper Arduino::Arduino Filter Flipper Control.gvi
  EQE_Measuring_Setup_NanOpto::SubVis::Main Sub Functions::Acquire::Save EQE TXT File.gvi
  EQE_Measuring_Setup_NanOpto::SubVis::FGV::Estimated Time FGV.gvi
  EQE_Measuring_Setup_NanOpto::SubVis::FGV::Timer FGV.gvi
  EQE_Measuring_Setup_NanOpto::SubVis::Main Sub Functions::Acquire::Multiple Acquire::PreCheck Cells before measuring.gvi
  EQE_Measuring_Setup_NanOpto::SubVis::Main Sub Functions::Acquire::Multiple Acquire::Multiple acuire precheck cells.gvi
  EQE_Measuring_Setup_NanOpto::SubVis::Main Sub Functions::Acquire::Multiple Acquire::Multiple Aquire Sequence.gvi
  EQE_Measuring_Setup_NanOpto::SubVis::Utilities::Messages And Prompts::Measurement Finished.gvi
  EQE_Measuring_Setup_NanOpto::SubVis::Instrument Control::Arduinos::XZ Carriage Arduino::XZ Carriage Arduino Initialize.gvi
  EQE_Measuring_Setup_NanOpto::SubVis::Instrument Control::Arduinos::XZ Carriage Arduino::XZ Carriage Arduino Homing Sequence.gvi
  EQE_Measuring_Setup_NanOpto::SubVis::Instrument Control::Arduinos::XZ Carriage Arduino::XZ Carriage Label to Coordinate.gvi
  EQE_Measuring_Setup_NanOpto::SubVis::Instrument Control::Arduinos::XZ Carriage Arduino::XZ Coordinate to Gcode command.gvi
  EQE_Measuring_Setup_NanOpto::SubVis::Instrument Control::Arduinos::XZ Carriage Arduino::XZ Carriage Arduino Move to location.gvi
  NI::VISA::Close (Instr).gvi
  EQE_Measuring_Setup_NanOpto::SubVis::Instrument Control::Keithley::Keithley Initialization Sequence.gvi
  Keithley 2450 NXG Library::Public::Action Status::Enable Output.gvi
  Keithley 2450 NXG Library::Public::Data::Make Reading and Store in Buffer.gvi
  Keithley 2450 NXG Library::Public::Data::Read (Single Point).gvi
  Keithley 2450 NXG Library::Public::Close.gvi
  EQE_Measuring_Setup_NanOpto::SubVis::Main Sub Functions::Global Abort::Global Abort instruction subroutine.gvi
  EQE_Measuring_Setup_NanOpto::SubVis::Main Sub Functions::Light Calibration::Light Calibration Instruction Subroutine.gvi
  EQE_Measuring_Setup_NanOpto::SubVis::Main Sub Functions::Sample name check up subroutine.gvi
  EQE_Measuring_Setup_NanOpto::SubVis::FGV::Sample Prefix FGV.gvi
  EQE_Measuring_Setup_NanOpto::SubVis::Main Sub Functions::Timeout instruction subroutine.gvi
  EQE_Measuring_Setup_NanOpto::SubVis::Main Sub Functions::Exit app instruction subroutine.gvi
  EQE_Measuring_Setup_NanOpto::SubVis::Main Sub Functions::Light Calibration::Load Calibration instruction subroutine.gvi
  EQE_Measuring_Setup_NanOpto::SubVis::Main Sub Functions::Light Calibration::Save calibration check up instruction subroutine.gvi
  EQE_Measuring_Setup_NanOpto::SubVis::Utilities::Prerequisite detection::Single Acquire Prerequisite Detection.gvi
  EQE_Measuring_Setup_NanOpto::SubVis::Main Sub Functions::Set desired Wavelength subroutine.gvi
  EQE_Measuring_Setup_NanOpto::SubVis::Main Sub Functions::Acquire::Save current EQE TXT instruction subroutine.gvi
  EQE_Measuring_Setup_NanOpto::SubVis::Utilities::Prerequisite detection::Multiple Acquire Prerequisite Detection.gvi
  EQE_Measuring_Setup_NanOpto::SubVis::Main Sub Functions::Auto Measurement Cell selection subroutine.gvi
  EQE_Measuring_Setup_NanOpto::SubVis::Utilities::Prerequisite detection::Move Arduino Prerequisites.gvi
  EQE_Measuring_Setup_NanOpto::SubVis::Instrument Control::Supercontinuum Laser Source::Supercontinuum laser prerequisites and warning.gvi
  EQE_Measuring_Setup_NanOpto::SubVis::Main Sub Functions::Monochromator switch Subroutine.gvi
  EQE_Measuring_Setup_NanOpto::SubVis::Utilities::Path Manipulation::Update Reference Coordinates subroutine.gvi
  EQE_Measuring_Setup_NanOpto::SubVis::Main Sub Functions::Check If other tasks active subroutine.gvi
  EQE_Measuring_Setup_NanOpto::SubVis::Main Sub Functions::Acquire::Multiple Acquire::Skip to next cell subroutine.gvi
  EQE_Measuring_Setup_NanOpto::SubVis::Main Sub Functions::Error Detected STOP subroutine.gvi
  EQE_Measuring_Setup_NanOpto::SubVis::Main Sub Functions::Terminate Queue.gvi
diagram:
  call "Start instruction queue.gvi"() -> (Queue Out=w1, Reset Initialized=w2, Error Out=w3)
  $"Initialized?" <- w2
  s1 = w3  # shift register
  while {
    Dequeue Element(error in=s1, queue=w1) -> (element=w4, error out=w5, queue out=w6)
    case (w5) {
      frame Error, Default {
        call "Current State FGV.gvi"(Instruction Current State FGV="Set current State", Crrent State="Stop App")
        w7 = w5
        w8 = TRUE
        w9 = default
      }
      frame No Error {
        case (w4) {
          frame "Initialize App" {
            w10 = "Instrument detection"  # Enum instructions
            Enqueue Element(element=w10, error in=w5, queue=w6) -> (error out=w11, queue out=w9)
            call "Enum reset instructions argument extract.gvi"(Reset instructions="Reset Global Variables", Error In=w11) -> (Reset instruction Items=w12, Error Out=w13)
            for {
              w14 = each element of w12
              case (w14) {
                frame "Reset disabled controls", Default {
                  Property Node(instance in=reference to "Dead Current Threshold", "Disabled"=FALSE, error in=w13) -> (error out=w15)
                  Property Node(instance in=reference to "Manual Range", "Disabled"=$Autorange, error in=w15) -> (error out=w16)
                  Property Node(instance in=reference to "Dark Current Averages", "Disabled"=FALSE, error in=w16) -> (error out=w17)
                  Not(x=$"Custom date") -> w18
                  Property Node(instance in=reference to "Current Date", "Disabled"=w18, error in=w17) -> (error out=w19)
                  Property Node(instance in=reference to "Manual Current Range", "Disabled"=TRUE, error in=w19) -> (error out=w20)
                  Property Node(instance in=reference to "Skip to Next Cell", "Disabled"=TRUE, error in=w20) -> (error out=w21)
                  Property Node(instance in=reference to "Z position", "Disabled"=TRUE, error in=w21) -> (error out=w22)
                  Property Node(instance in=reference to "X position", "Disabled"=TRUE, error in=w22) -> (error out=w23)
                  Property Node(instance in=reference to "Keithley Disable Output", "Disabled"=TRUE, error in=w23) -> (error out=w7)
                }
                frame "Reset Global Variables" {
                  call "Global Abort.gvi"(Instruction="Reset Abort", Error In=w13) -> (Error Out=w24)
                  call "Arduino Homed FGV.gvi"(Arduino Homed FGV="Reset to not Homed", Error In=w24) -> (Error Out=w25)
                  call "Skip To next Cell FGV.gvi"(General instruction FGV enum="Reset State", Error In=w25) -> (Error Out=w7)
                }
                frame "Reset doubles" {
                  $"Current Averages" <- 1
                  $"Wavelength Step (nm)" <- 1
                  $"End Wavelength (nm)" <- 1100
                  $"Z scan steps" <- 6
                  $"Max current" <- 0.1
                  $"Dead Current Threshold" <- 1e-11
                  $"Current (A)" <- 0
                  $"Current Wavelength (nm)" <- 0
                  $"EQE (%)" <- 0
                  $"Progress counter" <- 0
                  $"Dark Current (A)" <- 0
                  $"Wavelength (nm)" <- 0
                  $"Voltage Applied (V)" <- 0
                  $"Current λ (nm)" <- 0
                  $"Light Power (W)" <- 0
                  $"Progress %" <- 0
                  $"Dark Current Averages" <- 30
                  $"X scan Range (mm)" <- 5
                  $"Start Wavelength (nm)" <- 400
                  $"Manual Current Range" <- 1e-05
                  $"X scan steps" <- 8
                  $"Z scan Range (mm)" <- 4
                  w7 = w13
                }
                frame "Reset Strings" {
                  $"Label Info Error Label" <- "I'm missing The Batch name and the authors initials."
                  $"Batch Name" <- ""
                  $"Sample Comments" <- ""
                  $"Author Initials" <- ""
                  $"Sample Prefix" <- ""
                  $"Cell Measuring Order" <- ""
                  $"Cell Number" <- ""
                  w7 = w13
                }
                frame "Reset Booleans" {
                  $All <- FALSE
                  $"Monochromator Status" <- FALSE
                  $"Multiplexer Arduino Status" <- FALSE
                  $"Random Cell Order" <- FALSE
                  $"Photodetector Status" <- FALSE
                  $"Carriage Arduino Status" <- FALSE
                  $Monochromator <- FALSE
                  $"Custom Position" <- FALSE
                  $"Supercontinuum Status" <- FALSE
                  $"Keythley Status" <- FALSE
                  $"R.01 Scan?" <- FALSE
                  $"Save R.01 Coordinate?" <- FALSE
                  $"Abort All" <- FALSE
                  $"Dark Current" <- TRUE
                  $Autorange <- TRUE
                  $"Precheck Cells" <- TRUE
                  $"Label Info Missing Error" <- TRUE
                  $Autorange <- TRUE
                  w7 = w13
                }
                frame "Reset arrays" {
                  $"Automatic EQE Measurement Graph" <- cluster{"Element 1": f64[], "Element 2": f64[]}[] []
                  $"Cell Measuring Labels" <- string[] []
                  $"Light Power Calibration Data" <- f64[][] []
                  $"Full EQE Data" <- f64[][] []
                  w7 = w13
                }
                frame "Reset Clusters" {
                  w26 = cluster{"Element 1": f64[], "Element 2": f64[]} {all zero or empty}
                  $"Light Calibration" <- w26
                  w27 = cluster{"Element 1": f64[], "Element 2": f64[]} {all zero or empty}
                  $"EQE Measurement" <- w27
                  $"Cell Data Cluster" <- T2 {all zero or empty}
                  $"Automatic Measurement Indicators" <- "Automatic Measurement Indicators.gtype" {all zero or empty}
                  w7 = w13
                }
                frame "Reset Current Date" {
                  Get Current Time() -> (current time=w28)
                  Get Date And Time String(time stamp=w28) -> (date string=w29)
                  call "Search and Replace Pattern.gvi"(string=w29, pattern="/", replace all=TRUE) -> (result string=w30)
                  Replace Substring(length (len. of substring)=2, offset=5, string=w30) -> (result string=w31)
                  $"Current Date" <- w31
                  w7 = w13
                }
                frame "Reset Fiannium Config file" {
                  call "Check Monochromator Config File.gvi"(Visible infrared="Visible monochromator file", error out=w13) -> (Fiannium Config file path=w32, error in=w33)
                  $"Monochromator configuration file" <- w32
                  $"Monochromator configuration file visible" <- w32
                  call "Check Monochromator Config File.gvi"(Visible infrared="Infrared monochromator file", error out=w33) -> (Fiannium Config file path=w34, error in=w35)
                  $"Monochromator configuration file infrared" <- w34
                  call "Check Reference coordinate file.gvi"(R.01 Reference Coordinates=$"R.01 Reference Coordinates", error out=w35) -> (Coordinate reference path=w36, R.01 Reference Coordinates Out=w37, error in=w7)
                  $"Reference Coordinates file" <- w36
                  $"R.01 Reference Coordinates" <- w37
                }
              }
            }
            w8 = default
          }
          frame "Light Calibration" {
            $"End Wavelength (nm) Current Calibration" <- $"End Wavelength (nm)"
            $"Wavelength Step (nm) Current Calibration" <- $"Wavelength Step (nm)"
            $"Start Wavelength (nm) Current Calibration" <- $"Start Wavelength (nm)"
            To Unsigned 16 Bit Integer(number=$"Powermeter Averages") -> w38
            call "Current State FGV.gvi"(Instruction Current State FGV="Set current State", Crrent State="Light Calibration", Error In=w5) -> (Error Out=w39)
            # 0: Light Power
            # 0: Current Wavelength
            # FALSE: Finished?
            Build Cluster(0, 0, FALSE) -> w40
            Obtain Notifier(element data type=w40, error in=w39, name="Current Wvlngth and Light") -> (error out=w41, notifier out=w42)
            call "Light calibration.gvi"(Arduino Filter Flipper Address=$"Filter Arduino Address", Filter Arduino Status=$"Filter Arduino Status", End Wavelength (nm)=$"End Wavelength (nm)", Start Wavelength (nm)=$"Start Wavelength (nm)", Wavelength Step (nm)=$"Wavelength Step (nm)", Notifier Input=w42, Powermeter Averages=w38, Configuration File=$"Monochromator configuration file", Error In=w41) -> (Light Power Calibration Data=w43, Notifier Output=w44, Error Out=w45)
            s2 = f64[][] []  # shift register
            while {
              Wait On Notification(error in (no error)=w41, notifier=w42, timeout in milliseconds=10000) -> (error out=w46, notification=w47)
              Property Node(instance in=w47) -> ("Element 1"=w48, "Element 2"=w49, "Element 3"=w50)
              $"Current Wavelength (nm)" <- w48
              $"Current λ (nm)" <- w48
              Build Array(w48, w49) -> w51
              Build Array(s2, w51) -> w52
              call "Graph Adapter.gvi"(Input XY data=w52) -> (Output Graph=w53)
              $"Light Calibration" <- w53
              $"Light Power (W)" <- w49
              next s2 = w52
              stop if w50
            }
            call "Multiplex Errors.gvi"(error in 1=w45, error in 2=w46) -> (error out=w54)
            Release Notifier(error in (no error)=w54, notifier=w44) -> (error out=w55)
            call "Global Abort.gvi"(Instruction="Read Abort State", Error In=w55) -> (Local Abort State=w56, Error Out=w57)
            case (w56) {
              frame True {
                w58 = FALSE
                w59 = w57
              }
              frame False {
                Two Button Dialog(F button name ("Cancel")="No thanks, I was just testing", T button name ("OK")="Yes, please (Recommended)", message="Do  you want to save \nthe current light calibration?") -> (T Button?=w58)
                w59 = w57
              }
            }
            case (w58) {
              frame False, Default {
                w61 = "Idle"  # Enum instructions
                Enqueue Element(element=w61, error in=w59, queue=w6) -> (error out=w60, queue out=w9)
              }
              frame True {
                w62 = "Save Calibration"  # Enum instructions
                Enqueue Element(element=w62, error in=w59, queue=w6) -> (error out=w60, queue out=w9)
              }
            }
            call "Photodetector remove message.gvi"(Error In=w60) -> (Error Out=w7)
            call "Graph Adapter.gvi"(Input XY data=w43) -> (Output Graph=w63)
            $"Light Calibration" <- w63
            $"Light Power Calibration Data" <- w43
            w8 = default
          }
          frame "Stop App" {
            $"Abort All" <- TRUE
            call "Current State FGV.gvi"(Instruction Current State FGV="Set current State", Crrent State="Stop App", Error In=w5) -> (Error Out=w7)
            w8 = TRUE
            w9 = w6
          }
          frame "Idle", Default {
            call "Global Abort.gvi"(Instruction="Reset Abort", Error In=w5) -> (Error Out=w64)
            call "Current State FGV.gvi"(Instruction Current State FGV="Set current State", Crrent State="Idle", Error In=w64) -> (Error Out=w65)
            call "Current State FGV.gvi"(Instruction Current State FGV="Set Current SubState", Current SubState="Not specified", Error In=w65) -> (Error Out=w7)
            w8 = default
            w9 = w6
          }
          frame "Instrument detection" {
            # Still missing carriage arduino and multiplexer arduino
            w66 = "Idle"  # Enum instructions
            # Detect that we have all the needed instruments connected and prompt the user if any instrument is missing.
            # Ask them if they want to continue anyway and disable all the features that cannot be performed without that instrument.
            call "Current State FGV.gvi"(Instruction Current State FGV="Set current State", Crrent State="Instrument detection", Error In=w5) -> (Error Out=w67)
            call "Instrument Detection Sequence.gvi"(Monochromator configuration file visible=$"Monochromator configuration file visible", Monochromator configuration file infrared=$"Monochromator configuration file infrared", Error In=w67) -> (Ir Monochromator?=w68, Instrument Detection Sequence control=w69, Error Out=w70)
            Property Node(instance in=w69) -> ("Photodetector Status"=w71, "Photodetector Names"=w72, "Keythley Status"=w73, "Keithley Address"=w74, "Monochromator Status"=w75, "Monochromator Name"=w76, "Multiplexer Arduino Status"=w77, "Multiplexer Arduino Address"=w78, "Carriage Arduino Status"=w79, "Carriage Arduino Address"=w80, "Filter Arduino Status"=w81, "Filter Arduino Address"=w82, "Supercontinuum Status"=w83, "Supercontinuum laser Address"=w84)
            call "Wavelength Coercer.gvi"(Start Wavelength (nm)=$"Start Wavelength (nm)", End Wavelength (nm)=$"End Wavelength (nm)", Error In=w70, Monochromator=w68) -> (Start Wavelength (nm) out=w85, End Wavelength (nm) out=w86, Error Out=w87)
            call "Laser power extractor.gvi"(Supercontinuum laser Address=w84, Error Out_2=w87) -> (Laser Status=w88, Laser Current Power=w89, error in=w90)
            Enqueue Element(element=w66, error in=w90, queue=w6) -> (error out=w7, queue out=w9)
            $"Photodetector Status" <- w71
            $"Photodetector Names" <- w72
            $"Keythley Status" <- w73
            $"Keithley Address" <- w74
            $"Monochromator Status" <- w75
            $"Monochromator Name" <- w76
            $"Multiplexer Arduino Status" <- w77
            $"Multiplexer Arduino Address" <- w78
            $"Carriage Arduino Status" <- w79
            $"Carriage Arduino Address" <- w80
            $"Filter Arduino Status" <- w81
            $"Filter Arduino Address" <- w82
            $"Supercontinuum Status" <- w83
            $"Supercontinuum laser Address" <- w84
            $"Laser Status" <- w88
            $"Laser Current Power" <- w89
            $"Start Wavelength (nm)" <- w85
            $"End Wavelength (nm)" <- w86
            Select(s=w68, t=1100, f=500) -> w91
            $"Desired λ (nm)" <- w91
            $Monochromator <- w68
            Select(s=w68, t=$"Monochromator configuration file infrared", f=$"Monochromator configuration file visible") -> w92
            $"Monochromator configuration file" <- w92
            w8 = default
          }
          frame "Turn supercontinuum laser on/off" {
            call "Current State FGV.gvi"(Instruction Current State FGV="Set current State", Crrent State="Turn supercontinuum laser on/off", Error In=w5) -> (Error Out=w93)
            case ($"Laser Status") {
              frame False, Default {
                call "Supercontinuum Shut Down Sequence.gvi"(Supercontinuum laser Address=$"Supercontinuum laser Address", Error In=w93) -> (Successful Shutdown?=w97, Error Out=w95)
                Not(x=w97) -> w96
                w94 = w6
              }
              frame True {
                call "Supercontinuum Warm Up Sequence.gvi"(Supercontinuum laser Address=$"Supercontinuum laser Address", Error In=w93) -> (Successful Warmup?=w96, Error Out=w95)
                w94 = w6
              }
            }
            $"Laser Status" <- w96
            Enqueue Element(element="Idle", error in=w95, queue=w94) -> (error out=w7, queue out=w9)
            w8 = default
          }
          frame "Save Calibration" {
            call "Current State FGV.gvi"(Instruction Current State FGV="Set current State", Crrent State="Save Calibration", Error In=w5) -> (Error Out=w98)
            call "Save Calibration File.gvi"(Default Data Saving Location=$"Default Data Saving Location", Light Power Calibration Data=$"Light Power Calibration Data", Author Initials=$"Author Initials", Sample Prefix=$"Sample Prefix", Current Date=$"Current Date", Batch Name=$"Batch Name", Error In=w98) -> (Folder to save all data=w99, Error Out=w100)
            $"Default Data Saving Location" <- w99
            w101 = "Idle"  # Enum instructions
            Enqueue Element(element=w101, error in=w100, queue=w6) -> (error out=w7, queue out=w9)
            w8 = default
          }
          frame "Load Calibration" {
            call "Current State FGV.gvi"(Instruction Current State FGV="Set current State", Crrent State="Load Calibration", Error In=w5) -> (Error Out=w102)
            call "Load Calibration file.gvi"(Light calibration data In=$"Light Power Calibration Data", Error In=w102) -> (End Wavelength (nm) Current Calibration=w103, Wavelength Step (nm) Current Calibration=w104, Start Wavelength (nm) Current Calibration=w105, Light Power Calibration Data Out=w106, Light Calibration=w107, Error Out=w108)
            $"End Wavelength (nm)" <- w103
            $"End Wavelength (nm) Current Calibration" <- w103
            $"Wavelength Step (nm) Current Calibration" <- w104
            $"Wavelength Step (nm)" <- w104
            $"Start Wavelength (nm)" <- w105
            $"Start Wavelength (nm) Current Calibration" <- w105
            $"Light Power Calibration Data" <- w106
            $"Light Calibration" <- w107
            w109 = "Idle"  # Enum instructions
            Enqueue Element(element=w109, error in=w108, queue=w6) -> (error out=w7, queue out=w9)
            w8 = default
          }
          frame "Single Acquire" {
            call "Current State FGV.gvi"(Instruction Current State FGV="Set current State", Crrent State="Single Acquire", Error In=w5) -> (Error Out=w110)
            w111 = "Single Acquire Notification control.gtype" {all zero or empty}
            Obtain Notifier(element data type=w111, error in=w110, name="Wavelength EQE and current (and done)") -> (error out=w112, notifier out=w113)
            s3 = f64[][] []  # shift register
            while {
              call "Global Abort.gvi"(Instruction="Read Abort State", Error In=w112) -> (Local Abort State=w114, Global Abort State=w115, Error Out=w116)
              Wait On Notification(error in (no error)=w116, notifier=w113, timeout in milliseconds=1000) -> (error out=w117, notification=w118, notifier out=w119, timed out?=w120)
              case (w120) {
                frame True {
                  w121 = s3
                  w122 = FALSE
                }
                frame False {
                  Property Node(instance in=w118) -> ("Wavelength (nm)"=w123, "EQE (%)"=w124, "Current (A)"=w125, "Finnished"=w122, "Progress"=w126)
                  $"Current λ (nm)" <- w123
                  $"Wavelength (nm)" <- w123
                  Build Array(w123, w124) -> w127
                  Build Array(s3, w127) -> w121
                  call "Graph Adapter.gvi"(Input XY data=w121) -> (Output Graph=w128)
                  $"EQE Measurement" <- w128
                  $"EQE (%)" <- w124
                  $"Current (A)" <- w125
                  $"Progress %" <- w126
                }
              }
              Logical Or(w122, w114, w115) -> w129
              next s3 = w121
              stop if w129
            }
            Property Node(instance in="Single acquire inputs control.gtype" {all zero or empty}, "Light calibration data"=$"Light Power Calibration Data", "Fiannium Configuration File"=$"Monochromator configuration file", "Arduino Filter Flipper Address"=$"Filter Arduino Address", "Filter Arduino Status"=$"Filter Arduino Status", "Dark Current Averages"=$"Dark Current Averages", "Measure dark current?"=$"Dark Current", "Keithley Address"=$"Keithley Address", "Current Aveages"=$"Current Averages", "Voltage Applied (V)"=$"Voltage Applied (V)", "Max current compliance"=$"Max current", "Manual Current Range"=$"Manual Current Range", "Enable Auto Range"=$Autorange, "Automatic measurement"=FALSE, "Monocrhomator"=$Monochromator) -> (instance out=w130)
            call "Single EQE Measurement Acquire.gvi"(Single acquire inputs control=w130, Notifier In=w113, Error In=w112) -> (Full EQE Data=w131, Dark Current=w132, Error Out=w133)
            call "Multiplex Errors.gvi"(error in 1=w133, error in 2=w117) -> (error out=w134)
            Release Notifier(error in (no error)=w134, notifier=w119) -> (error out=w135)
            call "Save Single EQE prompt.gvi"(Input=w6, error out_2=w135) -> (Output=w9, Output_2=w7)
            $"Full EQE Data" <- w131
            $"Dark Current (A)" <- w132
            w8 = default
          }
          frame "Set Wavelength" {
            call "Set Desired Wavelength Slave Subroutine.gvi"(Queue In=w6, Monochromator configuration file=$"Monochromator configuration file", Desired λ (nm)=$"Desired λ (nm)", Error In=w5) -> (Queue Out=w9, Error Out=w7)
            $"Current λ (nm)" <- $"Desired λ (nm)"
            w8 = default
          }
          frame "Set Multiplex arduino cell" {
            call "Current State FGV.gvi"(Instruction Current State FGV="Set current State", Crrent State="Set Multiplex arduino cell", Error In=w5) -> (Error Out=w136)
            Format Into String(errIn=w136, $"Desired Cell") -> (outString=w137, errOut=w138)
            call "Multiplexer Arduino Control.gvi"(Arduino Multiplexer Address In=$"Multiplexer Arduino Address", Cell Label=w137, Error In=w138) -> (Arduino Multiplexer Log=w139, Error Out=w140)
            $"Arduino Multiplexer Log." <- w139
            w141 = "Idle"  # Enum instructions
            Enqueue Element(element=w141, error in=w140, queue=w6) -> (error out=w7, queue out=w9)
            w8 = default
          }
          frame "Arduino FF flip filter" {
            w142 = "Idle"  # Enum instructions
            call "Current State FGV.gvi"(Instruction Current State FGV="Set current State", Crrent State="Arduino FF flip filter", Error In=w5) -> (Error Out=w143)
            call "Arduino filter FGV current state.gvi"(Arduino Filter Flipper FGV instructions="Read State", Error In=w143) -> (Flipper State Boolean=w144, Error Out=w145)
            Select(s=w144, t="Visible Pass", f="IR Pass") -> w146
            call "Arduino Filter Flipper Control.gvi"(Arduino Filter Flipper Address In=$"Filter Arduino Address", Pass Filter=w146, Error In=w145) -> (Filter Flipper Log=w147, Error Out=w148)
            call "Arduino filter FGV current state.gvi"(Arduino Filter Flipper FGV instructions="Set State", Arduino Filter Flipper Instructions In=w146, Error In=w148) -> (Error Out=w149)
            Enqueue Element(element=w142, error in=w149, queue=w6) -> (error out=w7, queue out=w9)
            $"Filter Flipper Log" <- w147
            w8 = default
          }
          frame "Save TXT EQE file" {
            call "Current State FGV.gvi"(Instruction Current State FGV="Set current State", Crrent State="Save TXT EQE file", Error In=w5) -> (Error Out=w150)
            call "Save EQE TXT File.gvi"(Dark Current=$"Dark Current (A)", Dark Current Measured?=$"Dark Current", Default Data Saving Location=$"Default Data Saving Location", Full EQE Data=$"Full EQE Data", Author Initials=$"Author Initials", Sample Prefix=$"Sample Prefix", Current Date=$"Current Date", Batch Name=$"Batch Name", Error In=w150, Path type="Single EQE") -> (Folder to save all data=w151, Error Out=w152)
            $"Default Data Saving Location" <- w151
            w153 = "Idle"  # Enum instructions
            Enqueue Element(element=w153, error in=w152, queue=w6) -> (error out=w7, queue out=w9)
            w8 = default
          }
          frame "Multiple Acquire" {
            Property Node(instance in=reference to "Skip to Next Cell", "Disabled"=FALSE, error in=w5) -> (error out=w154)
            call "Estimated Time FGV.gvi"(Estimated Time Instructions="Reset All", Error In=w154) -> (Error Out=w155)
            call "Current State FGV.gvi"(Instruction Current State FGV="Set current State", Crrent State="Multiple Acquire", Error In=w155) -> (Error Out=w156)
            call "Timer FGV.gvi"(Timer FGV Instructions="Start Timer", Error In=w156) -> (Error Out=w157)
            w158 = "Multiple aquire notification constant.gtype" {all zero or empty}
            Obtain Notifier(element data type=w158, error in=w157, name="Multiple EQE measurement Main Window") -> (error out=w159, notifier out=w160)
            s4 = w160  # shift register
            s5 = "Automatic Measurement Indicators.gtype" {all zero or empty}  # shift register
            s6 = cluster{"Element 1": f64[], "Element 2": f64[]}[] []  # shift register
            while {
              call "Global Abort.gvi"(Instruction="Read Abort State", Error In=w159) -> (Local Abort State=w161, Global Abort State=w162, Error Out=w163)
              Wait On Notification(error in (no error)=w163, notifier=s4, timeout in milliseconds=1000) -> (error out=w164, notification=w165, timed out?=w166)
              case (w166) {
                frame True {
                  w167 = FALSE
                  w168 = w164
                  w169 = s5
                  w170 = s6
                }
                frame False {
                  Property Node(instance in=w165) -> ("Current Value (A)  "=w171, "EQE (%)"=w172, "Dark Current (A)"=w173, "Cell being measured"=w174, "Automatic EQE Measurement Graph"=w175, "Finished"=w167, "Current Wavelength"=w176, "Progress"=w177)
                  call "Timer FGV.gvi"(Timer FGV Instructions="Read Time", Error In=w164) -> (Elapsed Time=w178, Error Out=w168)
                  Property Node(instance in=s5, "Cell being measured"=w174, "Current Value (A)  "=w171, "EQE (%)"=w172, "Dark Current (A)"=w173, "Elapsed Time (kr)"=w178) -> (instance out=w169)
                  Is Empty Array(array=w175) -> w179
                  Select(s=w179, t=s6, f=w175) -> w170
                  $"Current λ (nm)" <- w176
                  $"Progress %" <- w177
                  $"Progress counter" <- w177
                }
              }
              $"Automatic EQE Measurement Data" <- w170
              $"Automatic EQE Measurement Graph" <- w170
              call "Estimated Time FGV.gvi"(Estimated Time Instructions="Read Estimated Time", Error In=w168) -> (Estimated Time=w180, Error Out=w181)
              Property Node(instance in=w169, "Estimated Time (kr)"=w180) -> (instance out=w182)
              $"Automatic Measurement Indicators" <- w182
              s7 = w181  # shift register
              for (iteration -> i1) {
                w183 = each element of $"Cell Measuring Labels"
                Property Node(instance in=reference to "Automatic EQE Measurement Graph", "ActivePlot"=i1, error in=s7) -> ("Plot"=w184, error out=w185)
                Property Node(instance in=w184, "Name"=w183, error in=w185) -> (error out=w186, instance out=w187)
                next s7 = w186
              }
              Logical Or(w167, w161, w162) -> w188
              next s5 = w169
              next s6 = w170
              stop if w188
            }
            w189 = "Multiple acquire variables control.gtype" {all zero or empty}
            Property Node(instance in=w189, "Monochromator configuration file "=$"Monochromator configuration file", "Light Power Calibration Data"=$"Light Power Calibration Data", "Cell Measuring Labels"=$"Cell Measuring Labels", "Sample Prefix"=$"Sample Prefix", "Author Initials"=$"Author Initials", "Current Date"=$"Current Date", "Batch Name"=$"Batch Name", "Default Data Saving Location"=$"Default Data Saving Location", "Filter Arduino Status"=$"Filter Arduino Status", "Filter Arduino Address"=$"Filter Arduino Address", "Multiplexer Arduino Address"=$"Multiplexer Arduino Address", "R.01 Reference Coordinates"=$"R.01 Reference Coordinates", "Carriage Arduino Address"=$"Carriage Arduino Address", "Keithley Address"=$"Keithley Address", "Current Averages   "=$"Current Averages", "Manual Range  "=$"Manual Range", "Max current"=$"Max current", "Voltage Applied (V)  "=$"Voltage Applied (V)", "Autorange  "=$Autorange, "Dark Current  "=$"Dark Current", "Wavelength for peak detection"=$"Wavelength for peak detection", "R.01 Scan?"=$"R.01 Scan?", "Z scan steps"=$"Z scan steps", "X scan Range (mm)"=$"X scan Range (mm)", "Z scan Range (mm)"=$"Z scan Range (mm)", "X scan steps"=$"X scan steps", "Reference Coordinates file"=$"Reference Coordinates file", "Save R.01 Coordinate?"=$"Save R.01 Coordinate?", "Automatic Measurement?"=TRUE, "Dead Cell 10mV Current Threshold"=$"Dead Current Threshold", "Monochromator"=$Monochromator) -> (instance out=w190)
            case ($"Precheck Cells") {
              frame False, Default {
                w191 = w190
                w192 = w159
              }
              frame True {
                call "PreCheck Cells before measuring.gvi"(Multiple acquire variable Control=w190, Error In=w159) -> (Dead cells?=w193, Multiple acquire variables control out=w191, New Cell Measuring order=w194, Error Out=w192)
                Select(s=w193, t=w194, f=$"Cell Measuring Order") -> w195
                $"Cell Measuring Order" <- w195
              }
            }
            call "Multiple acuire precheck cells.gvi"(Multiple acquire variable Control=w191, Error In=w192) -> (Multiple acquire variables control Out=w196, Error Out=w197)
            call "Multiple Aquire Sequence.gvi"(Multiple acquire variables control=w196, Notifier In=w160, Error In=w197) -> (XZ Scan Intensity Graph=w198, XZ Carriage Arduino Log=w199, Arduino Multiplexer Log=w200, Error Out=w201)
            call "Multiplex Errors.gvi"(error in 1=s7, error in 2=w201) -> (error out=w202)
            Release Notifier(error in (no error)=w202, notifier=s4) -> (error out=w203)
            Enqueue Element(element="Idle", error in=w203, queue=w6) -> (error out=w204, queue out=w9)
            case (w204) {
              frame Error, Default {
                w205 = w204
              }
              frame No Error {
                $"Automatic EQE Measurement Graph" <- s6
                $"Automatic EQE Measurement Data" <- s6
                $"Automatic Measurement Indicators" <- s5
                call "Measurement Finished.gvi"(Error In=w204) -> (Error Out=w205)
              }
            }
            Property Node(instance in=reference to "Skip to Next Cell", "Disabled"=TRUE, error in=w205) -> (error out=w7)
            $"XZ Scan Intensity Graph" <- w198
            $"XZ Carriage Arduino Log" <- w199
            $"Arduino Multiplexer Log" <- w200
            w8 = default
          }
          frame "Move Arduino" {
            call "Current State FGV.gvi"(Instruction Current State FGV="Set current State", Crrent State="Move Arduino", Error In=w5) -> (Error Out=w206)
            call "XZ Carriage Arduino Initialize.gvi"(XZ Carriage Arduino Adress In=$"Carriage Arduino Address", Error In=w206) -> (XZ Carriage Arduino Open Visa Session Out=w207, XZ Carriage Arduino Log=w208, Error Out=w209)
            case (TRUE) {
              frame False, Default {
                w210 = w209
              }
              frame True {
                $"XZ Carriage Arduino Log" <- ""
                $"Carriage Active" <- TRUE
                w210 = w209
              }
            }
            call "XZ Carriage Arduino Homing Sequence.gvi"(XZ Carriage Arduino Open Visa Session In=w207, XZ Carriage Arduino Log In=w208, Error In=w210) -> (XZ Carriage Arduino Open Visa Session Out=w211, XZ Carriage Arduino Log Out=w212, Error Out=w213)
            s8 = 0  # shift register
            while {
              Wait Until Next Multiple(multiple to wait=500)
              case ($"Set Postion") {
                frame False, Default {
                  Increment(x=s8) -> w217
                  w214 = w211
                  w215 = w212
                  w216 = w213
                }
                frame True {
                  case ($"Custom Position") {
                    frame False, Default {
                      Format Into String($"Cell Label") -> w220
                      call "XZ Carriage Label to Coordinate.gvi"(Cell Label=w220, R.01 Reference Coordinates=$"R.01 Reference Coordinates", Error In=w213) -> (Gcode Instruction Out=w218, Error Out=w219)
                    }
                    frame True {
                      call "XZ Coordinate to Gcode command.gvi"(X position=$"X position", Z position=$"Z position") -> (Input Command=w218)
                      w219 = w213
                    }
                  }
                  call "XZ Carriage Arduino Move to location.gvi"(XZ Carriage Arduino open Visa session In=w211, XZ Carriage Arduino Log In=w212, Input Command=w218, Error In=w219) -> (XZ Carriage Arduino open Visa Session Out=w214, XZ Carriage Arduino Log Out=w215, Error Out=w216)
                  w217 = 0
                }
              }
              $"XZ Carriage Arduino Log" <- w215
              Is Greater(x=w217, y=120) -> w221
              call "Global Abort.gvi"(Instruction="Read Abort State") -> (Local Abort State=w222, Global Abort State=w223)
              Logical Or(w221, $"Release Arduino", w222, w223) -> w224
              next s8 = w217
              stop if w224
            }
            call "Close (Instr).gvi"(session in=w214, error in=w216) -> (error out=w225)
            case (TRUE) {
              frame False, Default {
                w226 = w225
              }
              frame True {
                $"Carriage Active" <- FALSE
                w226 = w225
              }
            }
            Enqueue Element(element="Idle", error in=w226, queue=w6) -> (error out=w7, queue out=w9)
            w8 = default
          }
          frame "Measure Keithley" {
            call "Current State FGV.gvi"(Instruction Current State FGV="Set current State", Crrent State="Move Arduino", Error In=w5) -> (Error Out=w227)
            Property Node(instance in=reference to "Keithley Disable Output", "Disabled"=FALSE, error in=w227) -> (error out=w228)
            Property Node(instance in=reference to "Keithley Enable Output", "Disabled"=TRUE, error in=w228) -> (error out=w229)
            call "Keithley Initialization Sequence.gvi"(Enable Auto Range=$"Enable Auto Range", VISA resource name=$"Keithley Address", Voltage Applied (V)=$"Voltage Applied (V).", Source Limit Level (0.1)=$"Source Limit Level.", Current Averages=$"Current Averages.", Error In=w229, Manual Current Range=$"Manual Current Range.") -> (VISA resource name out=w230, Error Out=w231)
            call "Enable Output.gvi"(VISA resource name=w230, Enable Output (T: Enable)=TRUE, error in (no error)=w231) -> (VISA resource name out=w232, error out=w233)
            s9 = w233  # shift register
            s10 = w232  # shift register
            while (iteration -> i2) {
              Wait Until Next Multiple(multiple to wait=200)
              call "Make Reading and Store in Buffer.gvi"(VISA resource name=s10, error in (no error)=s9) -> (VISA resource name out=w234, error out=w235)
              call "Read (Single Point).gvi"(VISA resource name=w234, error in (no error)=w235) -> (VISA resource name out=w236, Data out=w237, error out=w238)
              $"Keithley Current Measurement" <- w237
              Is Greater(x=i2, y=600) -> w239
              Logical Or(w239, $"Keithley Disable Output") -> w240
              next s9 = w238
              next s10 = w236
              stop if w240
            }
            call "Enable Output.gvi"(VISA resource name=s10, Enable Output (T: Enable)=FALSE, error in (no error)=s9) -> (VISA resource name out=w241, error out=w242)
            call "Close.gvi"(VISA resource name=w241, error in (no error)=w242) -> (error out=w243)
            Property Node(instance in=reference to "Keithley Disable Output", "Disabled"=TRUE, error in=w243) -> (error out=w244)
            Property Node(instance in=reference to "Keithley Enable Output", "Disabled"=FALSE, error in=w244) -> (error out=w245)
            w246 = "Idle"  # Enum instructions
            Enqueue Element(element=w246, error in=w245, queue=w6) -> (error out=w7, queue out=w9)
            w8 = default
          }
        }
      }
    }
    next s1 = w7
    stop if w8
  }
  s11 = w3  # shift register
  while {
    # Instruction loop (Master)
    event (timeout = 500) {
      on "Global Abort" Mouse up {
        call "Global Abort instruction subroutine.gvi"(Queue In=w1, Global Abort=$"Global Abort", Error In=s11) -> (Queue Out=w248, Global Abort full=w249, Error Out=w247)
      }
      on "New Calibration" Value changed {
        call "Light Calibration Instruction Subroutine.gvi"(Queue In=w1, New Calibration=$"New Calibration", Start Wavelength (nm)=$"Start Wavelength (nm)", Label Info Missing Error=$"Label Info Missing Error", End Wavelength (nm)=$"End Wavelength (nm)", Filter Arduino Status=$"Filter Arduino Status", Label Info Error Label=$"Label Info Error Label", Error In=s11) -> (Queue Out=w248, Current State Output=w250, Error Out=w247)
        $"Current State Output" <- w250
        w249 = default
      }
      on "Author Initials" Value changed; "Batch Name" Value changed; "Cell Number" Value changed; "Current Date" Value changed; "Custom date" Value changed; "Main Tab control" Value changed; "Sample Comments" Value changed; "Sample Prefix" Value changed {
        call "Sample name check up subroutine.gvi"(Current Date ref=reference to "Current Date", Cell Number ref=reference to "Cell Number", Author Initials=$"Author Initials", Custom date=$"Custom date", Current Date In=$"Current Date", Batch Name=$"Batch Name", Main Tab control=$"Main Tab control", Sample Comments=$"Sample Comments", Cell Number=$"Cell Number") -> (Current Date=w251, Sample Prefix=w252, Label Info Missing Error=w253, Label Info Error Label=w254)
        $"Current Date" <- w251
        $"Sample Prefix" <- w252
        call "Sample Prefix FGV.gvi"(General instruction FGV enum="Set State", Sample Prefix=w252, Error In=s11) -> (Error Out=w247)
        $"Label Info Missing Error" <- w253
        $"Label Info Error Label" <- w254
        w248 = w1
        w249 = default
      }
      on "Timeout" {
        call "Arduino filter FGV current state.gvi"(Arduino Filter Flipper FGV instructions="Read State", Error In=s11) -> (Flipper State Boolean=w255, Error Out=w256)
        call "Timeout instruction subroutine.gvi"(Activate Arduino Reference=reference to "Activate Arduino", Set Position Reference=reference to "Set Postion", Release arduino Reference=reference to "Release Arduino", Initialized? Reference=reference to "Initialized?", Initialized?=$"Initialized?", Carriage Active=$"Carriage Active", Error In=w256) -> (Output=w249, Current State Output=w257, Sub states Output=w258, Error Out=w259)
        $"Current State Output" <- w257
        $"Sub states Output" <- w258
        Format Into String(errIn=w259, w257) -> (outString=w260, errOut=w261)
        Format Into String(errIn=w261, w258) -> (outString=w262, errOut=w247)
        $Substate <- w262
        $"Filter Status" <- w255
        $State <- w260
        w248 = w1
      }
      on "Exit App" Value changed {
        call "Exit app instruction subroutine.gvi"(Input=w1, Exit App=$"Exit App", Input_2=s11) -> (Output_2=w248, Output=w247)
        w249 = default
      }
      on "Load Calibration" Value changed {
        call "Load Calibration instruction subroutine.gvi"(Input=w1, Current State Output=$"Current State Output", Load Calibration=$"Load Calibration", Input_2=s11) -> (Output_2=w248, Output=w247)
        w249 = default
      }
      on "Save Calibration" Value changed {
        call "Save calibration check up instruction subroutine.gvi"(Input=w1, Save Calibration=$"Save Calibration", Light Power Calibration Data=$"Light Power Calibration Data", Current State Output_2=$"Current State Output", Label Info Missing Error=$"Label Info Missing Error", Label Info Error Label=$"Label Info Error Label", Input_2=s11) -> (Output_2=w248, Current State Output=w263, Output=w247)
        $"Current State Output" <- w263
        w249 = default
      }
      on "Autorange" Value changed {
        Property Node(instance in=reference to "Manual Current Range", "Disabled"=$Autorange, error in=s11) -> (error out=w247)
        w248 = w1
        w249 = default
      }
      on "Dark Current" Value changed {
        Not(x=$"Dark Current") -> w264
        Property Node(instance in=reference to "Dark Current (A)", "Disabled"=w264, error in=s11) -> (error out=w265)
        Property Node(instance in=reference to "Dark Current Averages", "Disabled"=w264, error in=w265) -> (error out=w247)
        w248 = w1
        w249 = default
      }
      on "Acquire Manual EQE" Value changed {
        call "Single Acquire Prerequisite Detection.gvi"(Queue In=w1, Acquire Manual EQE=$"Acquire Manual EQE", Filter Arduino Status=$"Filter Arduino Status", Label Info Missing Error=$"Label Info Missing Error", Label Info Error Label=$"Label Info Error Label", Light Power Calibration Data=$"Light Power Calibration Data", Error In=s11) -> (Queue Out=w248, Current State Output=w266, Error Out=w247)
        $"Current State Output" <- w266
        w249 = default
      }
      on "Set desired wavelength" Value changed {
        call "Set desired Wavelength subroutine.gvi"(Input=w1, Set desired wavelength=$"Set desired wavelength", Current State Output=$"Current State Output", Error In=s11) -> (Queue Out=w248, Error Out=w247)
        w249 = default
      }
      on "Save current EQE TXT" Value changed {
        call "Save current EQE TXT instruction subroutine.gvi"(Queue In=w1, Full EQE Data=$"Full EQE Data", Label Info Missing Error=$"Label Info Missing Error", Save current EQE TXT=$"Save current EQE TXT", Label Info Error Label=$"Label Info Error Label", Current State Output=$"Current State Output", Error In=s11) -> (Queue Out=w248, Error Out=w247)
        w249 = default
      }
      on "Autorange" Value changed {
        Property Node(instance in=reference to "Manual Range", "Disabled"=$Autorange)
        w247 = s11
        w248 = w1
        w249 = default
      }
      on "Automatic Acquire" Value changed {
        call "Multiple Acquire Prerequisite Detection.gvi"(Filter Arduino Status=$"Filter Arduino Status", Carriage Arduino Status=$"Carriage Arduino Status", Multiplexer Arduino Status=$"Multiplexer Arduino Status", Queue In=w1, Acquire Automatic EQE=$"Automatic Acquire", Cell Measuring Labels=$"Cell Measuring Labels", Label Info Missing Error=$"Label Info Missing Error", Label Info Error Label=$"Label Info Error Label", Light Power Calibration Data=$"Light Power Calibration Data", Error In=s11) -> (Queue Out=w248, Current State Output=w267, Error Out=w247)
        $"Current State Output" <- w267
        w249 = default
      }
      on "All" Value changed; "Cell Data Cluster" Value changed; "Random Cell Order" Value changed; "Reset" Value changed {
        call "Auto Measurement Cell selection subroutine.gvi"(Queue In=reference to "All", Random Cell Order=$"Random Cell Order", Reset=$Reset, All=$All, Cell Data Cluster_2=$"Cell Data Cluster", Error In=s11) -> (Cell Measuring Order=w268, Cell Measuring Labels=w269, Cell Data Cluster=w270, Error Out=w247)
        $"Cell Measuring Order" <- w268
        $"Cell Measuring Labels" <- w269
        $"Cell Data Cluster" <- w270
        w248 = w1
        w249 = default
      }
      on "Activate Arduino" Value changed {
        call "Move Arduino Prerequisites.gvi"(Input=w1, Set Position=$"Activate Arduino", Carriage Arduino Status=$"Carriage Arduino Status", Error In=s11) -> (Output_2=w248, Error Out=w247)
        w249 = default
      }
      on "Laser Status" Value changed {
        Event Data() -> ("Old Value"=w271, "New Value"=w272)
        call "Supercontinuum laser prerequisites and warning.gvi"(Input_2=w1, Old Value=w271, New Value=w272, Supercontinuum Status=$"Supercontinuum Status", Input=s11) -> (Output=w248, Laser Status=w273, Output_2=w247)
        $"Laser Status" <- w273
        w249 = default
      }
      on "Custom Position" Value changed {
        Not(x=$"Custom Position") -> w274
        Property Node(instance in=reference to "Z position", "Disabled"=w274, error in=s11) -> (error out=w275)
        Property Node(instance in=reference to "X position", "Disabled"=w274, error in=w275) -> (error out=w247)
        w248 = w1
        w249 = default
      }
      on "Monochromator" Value changed {
        call "Monochromator switch Subroutine.gvi"(Monochromator configuration file visible=$"Monochromator configuration file visible", Monochromator configuration file infrared=$"Monochromator configuration file infrared", Monochromator=$Monochromator, Input=s11) -> (Monochromator configuration file=w276, Monochromator_2=w277, Output=w247)
        $"Monochromator configuration file" <- w276
        $Monochromator <- w277
        w248 = w1
        w249 = default
      }
      on "Desired λ (nm)" Value changed; "End Wavelength (nm)" Value changed; "Start Wavelength (nm)" Value changed {
        call "Wavelength Coercer.gvi"(Start Wavelength (nm)=$"Start Wavelength (nm)", End Wavelength (nm)=$"End Wavelength (nm)", Desired λ (nm)=$"Desired λ (nm)", Error In=s11, Monochromator=$Monochromator) -> (Start Wavelength (nm) out=w278, End Wavelength (nm) out=w279, Desired λ (nm) Out=w280, Error Out=w247)
        $"Start Wavelength (nm)" <- w278
        $"End Wavelength (nm)" <- w279
        $"Desired λ (nm)" <- w280
        w248 = w1
        w249 = default
      }
      on "Save Ref Coordinates" Value changed {
        call "Update Reference Coordinates subroutine.gvi"(Reference Coordinates file=$"Reference Coordinates file", R.01 Reference Coordinates=$"R.01 Reference Coordinates", Error In=s11) -> (Error Out=w247)
        w248 = w1
        w249 = default
      }
      on "Set Multiplexor Cell" Value changed {
        w281 = "Set Multiplex arduino cell"  # Enum instructions
        call "Check If other tasks active subroutine.gvi"(Queue In=w1, Desired Task=w281, Error In=s11) -> (Queue Out=w248, Error out=w247)
        w249 = default
      }
      on "Filter Status" Mouse up {
        call "Check If other tasks active subroutine.gvi"(Queue In=w1, Desired Task="Arduino FF flip filter", Error In=s11) -> (Queue Out=w248, Error out=w247)
        w249 = default
      }
      on "Skip to Next Cell" Value changed {
        call "Skip to next cell subroutine.gvi"(Error In=s11) -> (Error Out=w247)
        w248 = w1
        w249 = default
      }
      on "Keithley Enable Output" Value changed {
        call "Check If other tasks active subroutine.gvi"(Queue In=w1, Desired Task="Measure Keithley", Error In=s11) -> (Queue Out=w248, Error out=w247)
        w249 = default
      }
      on "Precheck Cells" Value changed {
        Event Data() -> ("New Value"=w282)
        Not(x=w282) -> w283
        Property Node(instance in=reference to "Dead Current Threshold", "Disabled"=w283, error in=s11) -> (error out=w247)
        w248 = w1
        w249 = default
      }
    }
    call "Error Detected STOP subroutine.gvi"(Input=w248, Input_2=w249, Input_3=w247) -> (Output=w284, stop=w285, Output_2=w286)
    next s11 = w286
    stop if w285
  }
  call "Terminate Queue.gvi"(Input_3=w284, selector=TRUE, Input=s11, Input_2=s1) -> (Error Out=w287)
  $"Error Out" <- w287
