vi "Estimated Time FGV.gvi"   [LabVIEW NXG 3.1.0]
inputs:
  "Estimated Time Instructions": "Estimated Time Instructions.gtype" = "Setup", required
  "Step Count": f64
  "Step Duration": f64
  "Fixed Ammount of Time": f64
  "Error In": error
outputs:
  "Estimated Time": f64
  "Error Out": error
types:
  "Estimated Time Instructions.gtype" = enum{"Setup", "Read Estimated Time", "Reset All"}
diagram:
  s1 = uninitialised  # shift register
  s2 = uninitialised  # shift register
  s3 = uninitialised  # shift register
  while {
    case ($"Estimated Time Instructions") {
      frame "Setup" {
        w1 = $"Step Count"
        w2 = $"Step Duration"
        w3 = $"Fixed Ammount of Time"
      }
      frame "Read Estimated Time", Default {
        Multiply(s1, s2) -> w4
        Add(w4, s3) -> w5
        $"Estimated Time" <- w5
        w1 = s1
        w2 = s2
        w3 = s3
      }
      frame "Reset All" {
        w1 = 0
        w2 = 0
        w3 = 0
      }
    }
    next s1 = w1
    next s2 = w2
    next s3 = w3
    stop if TRUE
  }
  $"Error Out" <- $"Error In"
