vi "Timer FGV.gvi"   [LabVIEW NXG 3.1.0]
inputs:
  "Timer FGV Instructions": "Timer FGV Instructions.gtype" = "Reset Timer"
  "Error In": error
outputs:
  "Error Out": error
  "Elapsed Time": f64
  "Paused?": bool
panel indicators:
  "Start Time": f64
  "Elapsed Time at pause": f64
types:
  "Timer FGV Instructions.gtype" = enum{"Reset Timer", "Read Time", "Pause Timer", "Resume Timer", "Start Timer"}
diagram:
  case ($"Error In") {
    frame Error, Default {
      w1 = $"Error In"
    }
    frame No Error {
      s1 = uninitialised  # shift register
      s2 = uninitialised  # shift register
      s3 = uninitialised  # shift register
      s4 = uninitialised  # shift register
      while {
        case ($"Timer FGV Instructions") {
          frame "Reset Timer", Default {
            Get Current Time() -> (current time=w6)
            Timestamp To Date Time(time stamp=w6) -> (date time rec=w7)
            Property Node(instance in=w7) -> ("fractional second"=w8, "second"=w9, "minute"=w10, "hour"=w11)
            Multiply(w11, 3600) -> w12
            Multiply(w10, 60) -> w13
            Add(w8, w9, w12, w13) -> w14
            Divide(x=w14, y=8640) -> w2
            Get Date And Time String(time stamp=w6, want seconds? (F)=TRUE)
            w3 = FALSE
            w4 = 0
            w5 = 0
          }
          frame "Read Time" {
            Get Current Time() -> (current time=w15)
            Timestamp To Date Time(time stamp=w15) -> (date time rec=w16)
            Property Node(instance in=w16) -> ("fractional second"=w17, "second"=w18, "minute"=w19, "hour"=w20)
            Multiply(w20, 3600) -> w21
            Multiply(w19, 60) -> w22
            Add(w17, w18, w21, w22) -> w23
            Divide(x=w23, y=8640) -> w24
            Subtract(x=w24, y=s1) -> w25
            Select(s=s2, t=s3, f=w25) -> w4
            Get Date And Time String(time stamp=w15, want seconds? (F)=TRUE)
            w2 = s1
            w3 = s2
            w5 = s4
          }
          frame "Pause Timer" {
            w2 = s1
            w3 = TRUE
            w4 = s3
            w5 = s3
          }
          frame "Resume Timer" {
            case (s2) {
              frame False, Default {
                w3 = FALSE
                w2 = s1
              }
              frame True {
                Get Current Time() -> (current time=w26)
                Get Date And Time String(time stamp=w26, want seconds? (F)=TRUE)
                Timestamp To Date Time(time stamp=w26) -> (date time rec=w27)
                Property Node(instance in=w27) -> ("fractional second"=w28, "second"=w29, "minute"=w30, "hour"=w31)
                Multiply(w31, 3600) -> w32
                Multiply(w30, 60) -> w33
                Add(w28, w29, w32, w33) -> w34
                Divide(x=w34, y=8640) -> w35
                Subtract(x=w35, y=s4) -> w2
                w3 = FALSE
              }
            }
            w4 = s3
            w5 = s4
          }
          frame "Start Timer" {
            Get Current Time() -> (current time=w36)
            Timestamp To Date Time(time stamp=w36) -> (date time rec=w37)
            Property Node(instance in=w37) -> ("fractional second"=w38, "second"=w39, "minute"=w40, "hour"=w41)
            Multiply(w41, 3600) -> w42
            Multiply(w40, 60) -> w43
            Add(w38, w39, w42, w43) -> w44
            Divide(x=w44, y=8640) -> w2
            Get Date And Time String(time stamp=w36, want seconds? (F)=TRUE)
            w3 = FALSE
            w4 = 0
            w5 = 0
          }
        }
        next s1 = w2
        next s2 = w3
        next s3 = w4
        next s4 = w5
        stop if TRUE
      }
      $"Elapsed Time at pause" <- s4
      $"Elapsed Time" <- s3
      $"Start Time" <- s1
      $"Paused?" <- s2
      w1 = $"Error In"
    }
  }
  $"Error Out" <- w1
