vi "Arduino Filter Flipper Control.gvi"   [LabVIEW NXG 3.1.0]
inputs:
  "Pass Filter": "Arduino Filter Flipper Instructions.gtype" = "IR Pass"
  "Error In": error
  "Arduino Filter Flipper Address In": "VISA Instr"
outputs:
  "Error Out": error
  "Filter Flipper Log": string
panel controls:
  "Stand Alone SubVI Operation": bool
types:
  "Arduino Filter Flipper Instructions.gtype" = enum{"IR Pass", "Visible Pass"}
uses:
  EQE_Measuring_Setup_NanOpto::SubVis::FGV::Current State FGV.gvi
  EQE_Measuring_Setup_NanOpto::SubVis::Instrument Control::Arduinos::Arduino Detector.gvi
  NI::VISA::Open (Instr).gvi
  NI::VISA::Read (Instr, String).gvi
  NI::VISA::Write (Instr, String).gvi
  EQE_Measuring_Setup_NanOpto::SubVis::Main Sub Functions::Global Abort::Global Abort.gvi
  NI::G Core::Error::Clear Error Cluster.gvi
  NI::VISA::Close (Instr).gvi
diagram:
  case ($"Error In") {
    frame Error, Default {
      w1 = $"Error In"
    }
    frame No Error {
      call "Current State FGV.gvi"(Instruction Current State FGV="Set Current SubState", Current SubState="Moving Filter Flipper Arduino", Error In=$"Error In") -> (Error Out=w2)
      Is Empty String Or Path(string/path=$"Arduino Filter Flipper Address In") -> w3
      Logical And($"Stand Alone SubVI Operation", w3) -> w4
      case (w4) {
        frame True {
          call "Arduino Detector.gvi"(Error In=w2) -> (Filter Arduino Address=w5, Error Out=w6)
        }
        frame False {
          w5 = $"Arduino Filter Flipper Address In"
          w6 = w2
        }
      }
      $"Arduino Filter Flipper Address In" <- w5
      call "Open (Instr).gvi"(resource name=w5, error in=w6, open timeout=1000) -> (session out=w7, error out=w8)
      call "Read (Instr, String).gvi"(session in=w7, error in=w8, byte count=50) -> (session out=w9, error out=w10, read buffer=w11)
      case ($"Pass Filter") {
        frame "IR Pass", Default {
          w12 = "left"
        }
        frame "Visible Pass" {
          w12 = "right"
        }
      }
      Concatenate Strings(w12, "\r\n") -> w13
      call "Write (Instr, String).gvi"(session in=w9, error in=w10, write buffer=w13) -> (session out=w14, error out=w15)
      s1 = w15  # shift register
      s2 = w14  # shift register
      s3 = w11  # shift register
      while (iteration -> i1) {
        call "Global Abort.gvi"(Instruction="Read Abort State", Error In=s1) -> (Local Abort State=w16, Global Abort State=w17, Error Out=w18)
        call "Read (Instr, String).gvi"(session in=s2, error in=w18, byte count=50) -> (session out=w19, error out=w20, read buffer=w21)
        call "Clear Error Cluster.gvi"(error in=w20) -> (error out=w22)
        Concatenate Strings(s3, w21) -> w23
        $"Filter Flipper Log" <- w23
        Search And Replace String(input string=w21, search string="Moved") -> (number of replacements=w24)
        Is Not Equal To 0(x=w24) -> w25
        Is Greater(x=i1, y=1000) -> w26
        Logical Or(w25, w26, w16, w17) -> w27
        Wait Until Next Multiple(multiple to wait=50)
        next s1 = w22
        next s2 = w19
        next s3 = w23
        stop if w27
      }
      call "Close (Instr).gvi"(session in=s2, error in=s1) -> (error out=w1)
    }
  }
  $"Error Out" <- w1
