vi "Filter Flipper arduino flip subroutine.gvi"   [LabVIEW NXG 3.1.0]
inputs:
  "Start Wavelength (nm) Current Calibration": f64
  "Filter Arduino Status": bool
  "Arduino Filter Flipper Address": "VISA Instr"
  "Error In": error
outputs:
  "Error Out": error
uses:
  EQE_Measuring_Setup_NanOpto::SubVis::Utilities::Messages And Prompts::Manually Place The Filter Message.gvi
  EQE_Measuring_Setup_NanOpto::SubVis::Instrument Control::Monochromator::Filter Change Wavelength.gvi
  EQE_Measuring_Setup_NanOpto::SubVis::Instrument Control::Arduinos::Filter Flipper Arduino::Arduino Filter Flipper Control.gvi
  EQE_Measuring_Setup_NanOpto::SubVis::FGV::Arduino filter FGV current state.gvi
diagram:
  # If the starting wavelength is above the Change grating wavelength we set the filter to ir pass
  # otherwise we set it to visible pass
  case ($"Filter Arduino Status") {
    frame False, Default {
      Is Greater Or Equal(x=$"Start Wavelength (nm) Current Calibration", y=650) -> w2
      call "Manually Place The Filter Message.gvi"(IR Pass filter?=w2, Error In=$"Error In") -> (Error Out=w1)
    }
    frame True {
      call "Filter Change Wavelength.gvi"() -> (Wavelength of filter Change=w3)
      Is Greater Or Equal(x=$"Start Wavelength (nm) Current Calibration", y=w3) -> w4
      Select(s=w4, t="IR Pass", f="Visible Pass") -> w5
      call "Arduino Filter Flipper Control.gvi"(Arduino Filter Flipper Address In=$"Arduino Filter Flipper Address", Pass Filter=w5, Error In=$"Error In") -> (Error Out=w6)
      call "Arduino filter FGV current state.gvi"(Arduino Filter Flipper FGV instructions="Set State", Arduino Filter Flipper Instructions In=w5, Error In=w6) -> (Error Out=w1)
    }
  }
  $"Error Out" <- w1
