vi "Filter Plipper Arduino set to IR pass.gvi"   [LabVIEW NXG 3.1.0]
inputs:
  "Arduino Filter Flipper Address": "VISA Instr"
  "Filter Arduino Status": bool
  "Error In": error
outputs:
  "Error Out": error
uses:
  EQE_Measuring_Setup_NanOpto::SubVis::Instrument Control::Arduinos::Filter Flipper Arduino::Arduino Filter Flipper Control.gvi
  EQE_Measuring_Setup_NanOpto::SubVis::FGV::Arduino filter FGV current state.gvi
diagram:
  case ($"Filter Arduino Status") {
    frame False, Default {
      w1 = $"Error In"
    }
    frame True {
      call "Arduino Filter Flipper Control.gvi"(Arduino Filter Flipper Address In=$"Arduino Filter Flipper Address", Pass Filter="IR Pass", Error In=$"Error In") -> (Error Out=w2)
      call "Arduino filter FGV current state.gvi"(Arduino Filter Flipper FGV instructions="Set State", Arduino Filter Flipper Instructions In="IR Pass", Error In=w2) -> (Error Out=w1)
    }
  }
  $"Error Out" <- w1
