vi "Multiplexer Arduino Control.gvi"   [LabVIEW NXG 3.1.0]
inputs:
  "Arduino Multiplexer Address In": "VISA Instr"
  "Error In": error
  "Cell Label": string
outputs:
  "Arduino Multiplexer Log": string
  "Error Out": error
uses:
  NI::VISA::Open (Instr).gvi
  NI::VISA::Read (Instr, String).gvi
  NI::VISA::Write (Instr, String).gvi
  NI::G Core::Error::Clear Error Cluster.gvi
  NI::VISA::Close (Instr).gvi
diagram:
  case ($"Error In") {
    frame Error, Default {
      w1 = $"Error In"
    }
    frame No Error {
      call "Open (Instr).gvi"(resource name=$"Arduino Multiplexer Address In", error in=$"Error In", open timeout=1000) -> (session out=w2, error out=w3)
      call "Read (Instr, String).gvi"(session in=w2, error in=w3, byte count=50) -> (session out=w4, error out=w5)
      call "Write (Instr, String).gvi"(session in=w4, error in=w5, write buffer=$"Cell Label") -> (session out=w6, error out=w7)
      s1 = w7  # shift register
      s2 = w6  # shift register
      s3 = ""  # shift register
      while (iteration -> i1) {
        Wait Until Next Multiple(multiple to wait=50)
        call "Read (Instr, String).gvi"(session in=s2, error in=s1, byte count=50) -> (session out=w8, error out=w9, read buffer=w10)
        call "Clear Error Cluster.gvi"(error in=w9) -> (error out=w11)
        Concatenate Strings(s3, w10) -> w12
        $"Arduino Multiplexer Log" <- w12
        Is Greater(x=i1, y=5) -> w13
        next s1 = w11
        next s2 = w8
        next s3 = w12
        stop if w13
      }
      call "Close (Instr).gvi"(session in=s2, error in=s1) -> (error out=w1)
    }
  }
  $"Error Out" <- w1
