vi "XZ Carriage Arduino Execute Command Sequence.gvi"   [LabVIEW NXG 3.1.0]
inputs:
  "XZ Carriage Arduino open Visa session In": "VISA Instr"
  "XZ Carriage Arduino Log In": string
  "Error In": error
  "Command Array": string[]
outputs:
  "XZ Carriage Arduino open Visa Session Out": "VISA Instr"
  "XZ Carriage Arduino Log Out": string
  "Error Out": error
uses:
  NI::VISA::Write (Instr, String).gvi
  EQE_Measuring_Setup_NanOpto::SubVis::Main Sub Functions::Global Abort::Global Abort.gvi
  NI::VISA::Read (Instr, String).gvi
diagram:
  case ($"Error In") {
    frame Error, Default {
      w1 = $"Error In"
    }
    frame No Error {
      for {
        w2 = each element of $"Command Array"
        Wait Until Next Multiple(multiple to wait=500)
        Concatenate Strings(w2, "\r\n") -> w3
        call "Write (Instr, String).gvi"(session in=$"XZ Carriage Arduino open Visa session In", error in=$"Error In", write buffer=w3) -> (session out=w4, error out=w5)
        s1 = 0  # shift register
        s2 = $"XZ Carriage Arduino Log In"  # shift register
        while {
          Wait Until Next Multiple(multiple to wait=100)
          call "Global Abort.gvi"(Instruction="Read Abort State", Error In=w5) -> (Local Abort State=w6, Global Abort State=w7, Error Out=w8)
          Property Node(instance in=w4, error in=w8) -> ("ASRL Bytes at Port"=w9, error out=w10, instance out=w11)
          Is Not Equal To 0(x=w9) -> w12
          case (w12) {
            frame False, Default {
              Increment(x=s1) -> w16
              w13 = ""
              w14 = w11
              w15 = w10
            }
            frame True {
              call "Read (Instr, String).gvi"(session in=w11, error in=w10, byte count=w9) -> (session out=w14, error out=w15, read buffer=w13)
              w16 = 0
            }
          }
          Concatenate Strings(s2, w13) -> w17
          Is Greater(x=s1, y=10) -> w18
          Search And Replace String(error in (no error)=w15, input string=w13, search string="Moved") -> (error out=w1, number of replacements=w19)
          Is Not Equal To 0(x=w19) -> w20
          Logical Or(w7, w6, w18, w20) -> w21
          next s1 = w16
          next s2 = w17
          stop if w21
        }
      }
      $"XZ Carriage Arduino Log Out" <- s2
      $"XZ Carriage Arduino open Visa Session Out" <- w14
    }
  }
  $"Error Out" <- w1
