vi "XZ Carriage Arduino Homing Sequence.gvi"   [LabVIEW NXG 3.1.0]
inputs:
  "XZ Carriage Arduino Open Visa Session In": "VISA Instr"
  "XZ Carriage Arduino Log In": string
  "Error In": error
outputs:
  "XZ Carriage Arduino Open Visa Session Out": "VISA Instr"
  "XZ Carriage Arduino Log Out": string
  "Error Out": error
panel controls:
  "Abort": bool
panel indicators:
  "XZ Carriage Arduino Log While": string
uses:
  EQE_Measuring_Setup_NanOpto::SubVis::Main Sub Functions::Global Abort::Global Abort.gvi
  EQE_Measuring_Setup_NanOpto::SubVis::Instrument Control::Arduinos::XZ Carriage Arduino::XZ Carriage Arduino homing.gvi
diagram:
  case ($"Error In") {
    frame Error, Default {
      w1 = $"Error In"
      w2 = $"XZ Carriage Arduino Open Visa Session In"
      w3 = $"XZ Carriage Arduino Log In"
    }
    frame No Error {
      s1 = $"Error In"  # shift register
      s2 = $"XZ Carriage Arduino Open Visa Session In"  # shift register
      s3 = $"XZ Carriage Arduino Log In"  # shift register
      while (iteration -> i1) {
        Wait Until Next Multiple(multiple to wait=50)
        call "Global Abort.gvi"(Instruction="Read Abort State", Error In=s1) -> (Local Abort State=w4, Global Abort State=w5, Error Out=w6)
        call "XZ Carriage Arduino homing.gvi"(XZ Carriage Arduino open Visa session In=s2, XZ Carriage Arduino Log In=s3, Error In=w6) -> (XZ Carriage Arduino open Visa Session Out=w7, XZ Carriage Arduino Log Out=w8, Homed?=w9, Error Out=w10)
        $"XZ Carriage Arduino Log While" <- w8
        Is Greater Or Equal(x=i1, y=1) -> w11
        case (w9) {
          frame True {
            w12 = TRUE
            w13 = w10
          }
          frame False {
            case (w11) {
              frame True {
                w14 = """The arduino Could not home
propperly, please make sure 
that the motors can move freely
and that the motor power supply 
is correctly connected"""
                Two Button Dialog(F button name ("Cancel")="Okay I will connect everything", T button name ("OK")="Continue without homing\n(TESTING ONLY!!!)", message=w14) -> (T Button?=w12)
              }
              frame False {
                w15 = """The arduino Could not home
propperly, please make sure 
that the motors can move freely
and that the motor power supply 
is correctly connected"""
                One Button Dialog(button name ("OK")="Okay I will make sure\neverything is allright", message=w15)
                w12 = default
              }
            }
            w13 = w10
          }
        }
        Logical Or(w12, $Abort, w4, w5) -> w16
        next s1 = w13
        next s2 = w7
        next s3 = w8
        stop if w16
      }
      w1 = s1
      w2 = s2
      w3 = s3
    }
  }
  $"XZ Carriage Arduino Open Visa Session Out" <- w2
  $"XZ Carriage Arduino Log Out" <- w3
  $"Error Out" <- w1
