vi "XZ Carriage Arduino Initialize.gvi"   [LabVIEW NXG 3.1.0]
inputs:
  "Error In": error
  "XZ Carriage Arduino Adress In": "VISA Instr"
outputs:
  "Error Out": error
  "XZ Carriage Arduino Log": string
  "XZ Carriage Arduino Open Visa Session Out": "VISA Instr"
uses:
  NI::VISA::Open (Instr).gvi
  NI::VISA::Read (Instr, String).gvi
diagram:
  case ($"Error In") {
    frame Error, Default {
      w1 = $"Error In"
    }
    frame No Error {
      call "Open (Instr).gvi"(resource name=$"XZ Carriage Arduino Adress In", error in=$"Error In", access mode="VISA Defaults"(0), open timeout=1000) -> (session out=w2, error out=w3)
      s1 = ""  # shift register
      while (iteration -> i1) {
        Property Node(instance in=w2, error in=w3) -> ("ASRL Bytes at Port"=w4, error out=w5, instance out=w6)
        Is Equal To 0(x=w4)
        call "Read (Instr, String).gvi"(session in=w6, error in=w5, byte count=w4) -> (session out=w7, error out=w1, read buffer=w8)
        Concatenate Strings(s1, w8) -> w9
        Wait Until Next Multiple(multiple to wait=100)
        Is Greater(x=i1, y=50) -> w10
        next s1 = w9
        stop if w10
      }
      $"XZ Carriage Arduino Open Visa Session Out" <- w7
      $"XZ Carriage Arduino Log" <- s1
    }
  }
  $"Error Out" <- w1
