vi "XZ Carriage Arduino Move to location.gvi"   [LabVIEW NXG 3.1.0]
inputs:
  "XZ Carriage Arduino open Visa session In": "VISA Instr"
  "XZ Carriage Arduino Log In": string
  "Error In": error
  "Input Command": string = "G1 X100 Z100"
  "Fast Movement?": bool
  "Basic Write": bool
outputs:
  "XZ Carriage Arduino open Visa Session Out": "VISA Instr"
  "XZ Carriage Arduino Log Out": string
  "Error Out": error
panel controls:
  "Wait Time Basic write": u32 = 200
panel indicators:
  "description": string
uses:
  EQE_Measuring_Setup_NanOpto::SubVis::FGV::Current State FGV.gvi
  NI::VISA::Write (Instr, String).gvi
  NI::VISA::Read (Instr, String).gvi
  NI::VISA::Clear (Instr).gvi
  EQE_Measuring_Setup_NanOpto::SubVis::Main Sub Functions::Global Abort::Global Abort.gvi
  NI::G Core::Error::Read Description.gvi
  NI::G Core::Error::Clear Error Cluster.gvi
  NI::G Core::Error::Display Error.gvi
diagram:
  case ($"Error In") {
    frame Error, Default {
      w1 = $"Error In"
    }
    frame No Error {
      call "Current State FGV.gvi"(Instruction Current State FGV="Set Current SubState", Current SubState="Moving XZ Carriage Arduino", Error In=$"Error In") -> (Error Out=w2)
      Concatenate Strings($"Input Command", "\r\n") -> w3
      s1 = $"XZ Carriage Arduino open Visa session In"  # shift register
      s2 = w2  # shift register
      s3 = $"XZ Carriage Arduino Log In"  # shift register
      while (iteration -> i1) {
        call "Write (Instr, String).gvi"(session in=s1, error in=s2, write buffer=w3) -> (session out=w4, error out=w5)
        case ($"Basic Write") {
          frame True {
            Wait Until Next Multiple(multiple to wait=$"Wait Time Basic write")
            Property Node(instance in=w4, error in=w5) -> ("ASRL Bytes at Port"=w10, error out=w11, instance out=w6)
            Is Not Equal To 0(x=w10) -> w12
            Is Greater(x=w10, y=300) -> w13
            case (w12) {
              frame False, Default {
                w14 = ""
                w8 = w11
              }
              frame True {
                call "Read (Instr, String).gvi"(session in=w6, error in=w11, byte count=w10) -> (session out=w15, error out=w16, read buffer=w14)
                case (w13) {
                  frame False, Default {
                    w17 = w15
                    w8 = w16
                  }
                  frame True {
                    call "Clear (Instr).gvi"(session in=w15, error in=w16) -> (session out=w17, error out=w8)
                  }
                }
              }
            }
            Concatenate Strings(s3, w14) -> w7
            w9 = TRUE
          }
          frame False {
            Is Greater(x=i1, y=5) -> w18
            case (TRUE) {
              frame False, Default {
                w19 = w5
              }
              frame True {
                Wait Until Next Multiple(multiple to wait=100)
                w19 = w5
              }
            }
            s4 = w4  # shift register
            s5 = w19  # shift register
            s6 = s3  # shift register
            while (iteration -> i2) {
              call "Global Abort.gvi"(Instruction="Read Abort State", Error In=s5) -> (Local Abort State=w21, Global Abort State=w22, Error Out=w23)
              Property Node(instance in=s4, error in=w23) -> ("ASRL Bytes at Port"=w24, error out=w25, instance out=w26)
              Is Not Equal To 0(x=w24) -> w27
              Is Greater(x=w24, y=300) -> w28
              case (w27) {
                frame False, Default {
                  w29 = ""
                  w30 = w26
                  w31 = w25
                }
                frame True {
                  call "Read (Instr, String).gvi"(session in=w26, error in=w25, byte count=w24) -> (session out=w32, error out=w33, read buffer=w29)
                  case (w28) {
                    frame False, Default {
                      w30 = w32
                      w31 = w33
                    }
                    frame True {
                      call "Clear (Instr).gvi"(session in=w32, error in=w33) -> (session out=w30, error out=w31)
                    }
                  }
                }
              }
              Search And Replace String(input string=w29, search string="Moved") -> (number of replacements=w34)
              Is Not Equal To 0(x=w34) -> w35
              Search And Replace String(input string=w29, search string="Coordinate") -> (number of replacements=w36)
              Is Not Equal To 0(x=w36) -> w37
              Logical Or(w35, w37) -> w38
              Concatenate Strings(s6, w29) -> w39
              Select(s=$"Fast Movement?", t=10, f=100) -> w40
              Wait Until Next Multiple(multiple to wait=w40)
              Select(s=$"Fast Movement?", t=10, f=30) -> w41
              Is Greater(x=i2, y=w41) -> w42
              Logical Or(w35, w42, w21, w22, w31, w37) -> w43
              append w38 to w20
              next s4 = w30
              next s5 = w31
              next s6 = w39
              stop if w43
            }
            Or Array Elements(Boolean array=w20) -> (logical OR=w44)
            Logical And(w18, not w44) -> w45
            Logical And(not $"Fast Movement?", w45) -> w46
            case (w46) {
              frame False, Default { }
              frame True {
                w47 = """XZ Carriage Arduino Moving
Mitght have Failed Please make sure the 
power cord is connected as 
qell as the USB Cable. 
(You might have to restart the 
software)"""
                One Button Dialog(button name ("OK")="Okay I will Check", message=w47)
              }
            }
            case (s5) {
              frame Error, Default {
                call "Read Description.gvi"(error in=s5) -> (description=w48)
                $description <- w48
                call "Clear Error Cluster.gvi"(error in=s5) -> (error out=w49)
                Search And Replace String(input string=w48, search string="miscellaneous") -> (number of replacements=w50)
                Is Not Equal To 0(x=w50) -> w51
                Select(s=w51, t=w49, f=s5) -> w8
                call "Display Error.gvi"(error in=s5)
              }
              frame No Error {
                w8 = s5
              }
            }
            Logical Or(w18, w44) -> w9
            w6 = s4
            w7 = s6
          }
        }
        next s1 = w6
        next s2 = w8
        next s3 = w7
        stop if w9
      }
      $"XZ Carriage Arduino Log Out" <- s3
      $"XZ Carriage Arduino open Visa Session Out" <- s1
      w1 = s2
    }
  }
  $"Error Out" <- w1
