vi "XZ Carriage Arduino homing.gvi"   [LabVIEW NXG 3.1.0]
inputs:
  "XZ Carriage Arduino open Visa session In": "VISA Instr"
  "Error In": error
  "XZ Carriage Arduino Log In": string
outputs:
  "XZ Carriage Arduino open Visa Session Out": "VISA Instr"
  "Error Out": error
  "Homed?": bool
  "XZ Carriage Arduino Log Out": string
panel controls:
  "Abort": bool
panel indicators:
  "Log while": string
uses:
  EQE_Measuring_Setup_NanOpto::SubVis::FGV::Current State FGV.gvi
  NI::VISA::Write (Instr, String).gvi
  EQE_Measuring_Setup_NanOpto::SubVis::Main Sub Functions::Global Abort::Global Abort.gvi
  NI::VISA::Read (Instr, String).gvi
diagram:
  case ($"Error In") {
    frame Error, Default {
      w1 = $"Error In"
    }
    frame No Error {
      call "Current State FGV.gvi"(Instruction Current State FGV="Set Current SubState", Current SubState="Homing XZ Carriage Arduino", Error In=$"Error In") -> (Error Out=w2)
      Concatenate Strings("G28", "\r\n") -> w3
      call "Write (Instr, String).gvi"(session in=$"XZ Carriage Arduino open Visa session In", error in=w2, write buffer=w3) -> (session out=w4, error out=w5)
      s1 = w5  # shift register
      s2 = $"XZ Carriage Arduino Log In"  # shift register
      while (iteration -> i1) {
        Wait Until Next Multiple(multiple to wait=500)
        call "Global Abort.gvi"(Instruction="Read Abort State", Error In=s1) -> (Local Abort State=w6, Global Abort State=w7, Error Out=w8)
        Property Node(instance in=w4, error in=w8) -> ("ASRL Bytes at Port"=w9, error out=w10, instance out=w11)
        Is Not Equal To 0(x=w9) -> w12
        case (w12) {
          frame False, Default {
            w13 = ""
            w14 = w11
            w15 = w10
          }
          frame True {
            call "Read (Instr, String).gvi"(session in=w11, error in=w10, byte count=w9) -> (session out=w14, error out=w15, read buffer=w13)
          }
        }
        Search And Replace String(input string=w13, search string="Failed") -> (number of replacements=w16)
        Is Not Equal To 0(x=w16) -> w17
        Not(x=w17) -> w18
        Concatenate Strings(s2, w13) -> w19
        $"Log while" <- w19
        Search And Replace String(input string=w13, search string="Homed") -> (number of replacements=w20)
        Is Not Equal To 0(x=w20) -> w21
        Is Greater(x=i1, y=60) -> w22
        Logical Or(w21, w22, w17, $Abort, w6, w7, w15) -> w23
        next s1 = w15
        next s2 = w19
        stop if w23
      }
      $"XZ Carriage Arduino open Visa Session Out" <- w14
      $"XZ Carriage Arduino Log Out" <- s2
      $"Homed?" <- w18
      w1 = s1
    }
  }
  $"Error Out" <- w1
