vi "XZ Carriage Label to Coordinate.gvi"   [LabVIEW NXG 3.1.0]
inputs:
  "Cell Label": string
  "R.01 Reference Coordinates": "R.01 Reference Coordinates.gtype" = {"X coordinate R.01"=145.3, "Z coordinate R.01"=2.5, "Vertical Spacing"=0}
  "Error In": error
outputs:
  "Error Out": error
  "Gcode Instruction Out": string
  "X coordinate out": f64
  "Z coordinate out": f64
types:
  "R.01 Reference Coordinates.gtype" = cluster{"X coordinate R.01": f64, "Z coordinate R.01": f64, "Vertical Spacing": f64}
diagram:
  case ($"Error In") {
    frame No Error {
      String Length(string=$"Cell Label") -> (length=w2)
      Is Equal(x=w2, y=4) -> w3
      Search And Replace String(input string=$"Cell Label", search string="R.") -> (number of replacements=w4)
      Is Not Equal To 0(x=w4) -> w5
      Search And Replace String(input string=$"Cell Label", search string="L.") -> (number of replacements=w6)
      Is Not Equal To 0(x=w6) -> w7
      Logical Exclusive Or(w5, w7) -> w8
      Logical And(w3, w8) -> w9
      case (w9) {
        frame False, Default {
          Wait Until Next Multiple(multiple to wait=1000)
          w10 = """There was a problem reading
the cell labels on XZ Carriage 
label to Coordinate. Please contact
Martí (minusmages@hotmail.com)
because this error is not supposed
to happen, like, ever."""
          One Button Dialog(button name ("OK")="Okay, but who is Martí?", message=w10)
        }
        frame True {
          Property Node(instance in=$"R.01 Reference Coordinates") -> ("X coordinate R.01"=w11, "Z coordinate R.01"=w12, "Vertical Spacing"=w13)
          String Subset(offset (0)=2, string=$"Cell Label") -> w14
          Decimal String To Number(string=w14) -> (number=w15)
          In Range And Coerce(lower limit=1, upper limit=13, x=w15) -> (In Range?=w16)
          case (w16) {
            frame True {
              Decrement(x=w15) -> w18
              To Double Precision Float(number=w18) -> w19
              Multiply(w19, 5.08) -> w20
              Add(w20, w11) -> w17
            }
            frame False {
              w21 = "Cell out of range,\nthere is no R.13\nthe range is from\n1 to 12"
              One Button Dialog(button name ("OK")="Oh, sorry", message=w21)
              w17 = w11
            }
          }
          $"X coordinate out" <- w17
          String Subset(length (rest)=1, string=$"Cell Label") -> w22
          case (w22) {
            frame "", Default {
              w24 = """There was a problem reading
the cell labels on XZ Carriage 
label to Coordinate. Please contact
Martí (minusmages@hotmail.com)
because this error is not supposed
to happen, like, ever."""
              One Button Dialog(button name ("OK")="Okay, but who is Martí?", message=w24)
              w23 = w12
            }
            frame "L" {
              Add(w12, w13) -> w23
            }
            frame "R" {
              w23 = w12
            }
          }
          Number To Fractional String(number=w23, precision (6)=2, use system decimal point (T)=FALSE) -> (F-format string=w25)
          Number To Fractional String(number=w17, precision (6)=2, use system decimal point (T)=FALSE) -> (F-format string=w26)
          Concatenate Strings("G1 X", w26, " Z", w25) -> w27
          $"Gcode Instruction Out" <- w27
          $"Z coordinate out" <- w23
        }
      }
      w1 = $"Error In"
    }
    frame Error {
      w1 = $"Error In"
    }
  }
  $"Error Out" <- w1
