vi "XZ Carriage test.gvi"   [LabVIEW NXG 3.1.0]
panel controls:
  "Command Array": string[] = ["G1 X100"]
  "Abort": bool
panel indicators:
  "XZ Carriage Arduino Log Out": string
  "Output": string
uses:
  EQE_Measuring_Setup_NanOpto::SubVis::Instrument Control::Arduinos::Arduino Detector.gvi
  EQE_Measuring_Setup_NanOpto::SubVis::Instrument Control::Arduinos::XZ Carriage Arduino::XZ Carriage Arduino Initialize.gvi
  EQE_Measuring_Setup_NanOpto::SubVis::Instrument Control::Arduinos::XZ Carriage Arduino::XZ Carriage Arduino Homing Sequence.gvi
  EQE_Measuring_Setup_NanOpto::SubVis::Instrument Control::Arduinos::XZ Carriage Arduino::XZ Carriage Arduino Move to location.gvi
  EQE_Measuring_Setup_NanOpto::SubVis::Instrument Control::Arduinos::XZ Carriage Arduino::XZ Carriage Arduino Execute Command Sequence.gvi
  NI::VISA::Close (Instr).gvi
diagram:
  call "Arduino Detector.gvi"() -> (Carriage Arduino Address=w1, Error Out=w2)
  call "XZ Carriage Arduino Initialize.gvi"(XZ Carriage Arduino Adress In=w1, Error In=w2) -> (XZ Carriage Arduino Open Visa Session Out=w3, XZ Carriage Arduino Log=w4, Error Out=w5)
  call "XZ Carriage Arduino Homing Sequence.gvi"(XZ Carriage Arduino Open Visa Session In=w3, XZ Carriage Arduino Log In=w4, Error In=w5) -> (XZ Carriage Arduino Open Visa Session Out=w6, XZ Carriage Arduino Log Out=w7, Error Out=w8)
  $"XZ Carriage Arduino Log Out" <- w7
  case (FALSE) {
    frame False, Default {
      s1 = w7  # shift register
      s2 = w6  # shift register
      s3 = w8  # shift register
      for (N = 100) (iteration -> i1) {
        Quotient And Remainder(x=i1, y=2) -> (x-y*floor(x/y)=w12)
        Is Equal To 0(x=w12) -> w13
        Select(s=w13, t="G1 X146.30 Z4.50", f="G1 X148.3 Z4.70") -> w14
        call "XZ Carriage Arduino Move to location.gvi"(XZ Carriage Arduino open Visa session In=s2, XZ Carriage Arduino Log In=s1, Input Command=w14, Error In=s3, Fast Movement?=TRUE) -> (XZ Carriage Arduino open Visa Session Out=w15, XZ Carriage Arduino Log Out=w16, Error Out=w17)
        $"XZ Carriage Arduino Log Out" <- w16
        next s1 = w16
        next s2 = w15
        next s3 = w17
        stop if $Abort
      }
      w9 = s2
      w10 = s3
      w11 = s1
    }
    frame True {
      call "XZ Carriage Arduino Execute Command Sequence.gvi"(XZ Carriage Arduino open Visa session In=w6, XZ Carriage Arduino Log In=w7, Error In=w8, Command Array=["G91", "G1 Z20", "G90", "G91", "G1 Z-20", "G90"]) -> (XZ Carriage Arduino open Visa Session Out=w9, XZ Carriage Arduino Log Out=w11, Error Out=w10)
    }
  }
  $Output <- w11
  call "Close (Instr).gvi"(session in=w9, error in=w10)
