vi "XZ Coordinate to Gcode command.gvi"   [LabVIEW NXG 5.0.0]
inputs:
  "X position": f64
  "Z position": f64
outputs:
  "Input Command": string
diagram:
  Number To Fractional String(number=$"X position", precision (6)=2, use system decimal point (T)=FALSE) -> (F-format string=w1)
  Search And Replace String(input string=w1, replace string ("")=".", search string=",") -> (result string=w2)
  Number To Fractional String(number=$"Z position", precision (6)=2, use system decimal point (T)=FALSE) -> (F-format string=w3)
  Search And Replace String(input string=w3, replace string ("")=".", search string=",") -> (result string=w4)
  Concatenate Strings("G1 X", w2, " Z", w4) -> w5
  $"Input Command" <- w5
