vi "2D Map geometric average.gvi"   [LabVIEW NXG 3.1.0]
inputs:
  "Power Map Array": "XZ power scan map array cluster.gtype"
  "Error In": error
  "Intensity Graph In": f64[][] = [[3.837649e-07, 6.976105e-07, 2.844063e-06, 3.823226e-06, 3.855227e-06, 3.314379e-06], [4.113241e-07, 1.084546e-06, 1.372773e-05, 1.628165e-05, 1.627607e-05, 1.443905e-05], [4.388602e-07, 1.73904e-06, 2.269013e-05, 2.362676e-05, 2.431445e-05, 2.495035e-05], [4.662466e-07, 2.130742e-06, 2.41392e-05, 2.47769e-05, 2.507398e-05, 2.58229e-05], [4.640692e-07, 2.015301e-06, 2.397019e-05, 2.421503e-05, 2.48368e-05, 2.518883e-05], [4.372693e-07, 1.48816e-06, 2.054636e-05, 2.167973e-05, 2.206708e-05, 2.29538e-05], [4.035402e-07, 8.649879e-07, 5.016715e-06, 6.132515e-06, 6.5497e-06, 7.108464e-06], [3.731328e-07, 5.686639e-07, 1.090461e-06, 1.285805e-06, 1.363798e-06, 1.424392e-06]]
outputs:
  "X Average": f64
  "Z Average": f64
  "Error Out": error
  "Best Column": i32
  "Best Row": i32
panel indicators:
  "Closest Index": i32
  "Closest coordinate": T1
types:
  T1 = cluster{"X coordinate": f64, "Z coordinate": f64, "Power Value": f64}
  "XZ power scan map array cluster.gtype" = T1[]
diagram:
  case ($"Error In") {
    frame Error, Default {
      w1 = $"Error In"
    }
    frame No Error {
      s1 = 0  # shift register
      s2 = 0  # shift register
      s3 = 0  # shift register
      for {
        w2 = each element of $"Power Map Array"
        Property Node(instance in=w2) -> ("X coordinate"=w3, "Power Value"=w4, "Z coordinate"=w5)
        Multiply(w3, w4) -> w6
        Add(s2, w6) -> w7
        Add(w4, s1) -> w8
        Multiply(w5, w4) -> w9
        Add(w9, s3) -> w10
        next s1 = w8
        next s2 = w7
        next s3 = w10
      }
      Divide(x=s2, y=s1) -> w11
      $"X Average" <- w11
      Divide(x=s3, y=s1) -> w12
      s4 = f64 default  # shift register
      s5 = uninitialised  # shift register
      s6 = uninitialised  # shift register
      s7 = f64 default  # shift register
      for (iteration -> i1) {
        w13 = each element of $"Power Map Array"
        Property Node(instance in=w13) -> ("X coordinate"=w14, "Z coordinate"=w15, instance out=w16)
        Subtract(x=w14, y=w11) -> w17
        Absolute Value(x=w17) -> w18
        Is Less(x=w18, y=s4) -> w19
        Subtract(x=w15, y=w12) -> w20
        Absolute Value(x=w20) -> w21
        Is Less(x=w21, y=s7) -> w22
        Logical And(w19, w22) -> w23
        Select(s=w23, t=w18, f=s4) -> w24
        Select(s=w23, t=i1, f=s5) -> w25
        Select(s=w23, t=w21, f=s7) -> w26
        Select(s=w23, t=w16, f=s6) -> w27
        next s4 = w24
        next s5 = w25
        next s6 = w27
        next s7 = w26
      }
      $"Closest Index" <- s5
      Property Node(instance in=s6) -> ("Power Value"=w28, instance out=w29)
      $"Closest coordinate" <- w29
      for (iteration -> i2) {
        w30 = each element of $"Intensity Graph In"
        for (iteration -> i3) {
          w32 = each element of w30
          Is Equal(x=w28, y=w32) -> w34
          w33 = i3 if w34
          stop if w34
        }
        w31 = i2 if w34
        stop if w34
      }
      $"Best Column" <- w33
      $"Best Row" <- w31
      $"Z Average" <- w12
      w1 = $"Error In"
    }
  }
  $"Error Out" <- w1
