vi "Carriage Drift Measurement.gvi"   [LabVIEW NXG 3.1.0]
panel controls:
  "X scan Range (mm)": f64 = 1
  "X scan steps": f64 = 3
  "Z scan Range (mm)": f64 = 1
  "Z scan steps": f64 = 3
  "R.01 Reference Coordinates": "R.01 Reference Coordinates.gtype" = {"X coordinate R.01"=145.3, "Z coordinate R.01"=2.5, "Vertical Spacing"=4.5}
  "stop": bool
panel indicators:
  "Estimated Time": f64
  "Elapsed Time": f64
  "Progress Bar": f64
  "Percent": f64
  "XZ Carriage Arduino Log Out": string
types:
  "R.01 Reference Coordinates.gtype" = cluster{"X coordinate R.01": f64, "Z coordinate R.01": f64, "Vertical Spacing": f64}
uses:
  EQE_Measuring_Setup_NanOpto::SubVis::Instrument Control::Arduinos::Arduino Detector.gvi
  EQE_Measuring_Setup_NanOpto::SubVis::Instrument Control::Arduinos::XZ Carriage Arduino::XZ Carriage Arduino Initialize.gvi
  EQE_Measuring_Setup_NanOpto::SubVis::Instrument Control::Arduinos::XZ Carriage Arduino::XZ Carriage Arduino Homing Sequence.gvi
  EQE_Measuring_Setup_NanOpto::SubVis::Instrument Control::Arduinos::XZ Carriage Arduino::XZ Coordinate to Gcode command.gvi
  EQE_Measuring_Setup_NanOpto::SubVis::Instrument Control::Arduinos::XZ Carriage Arduino::XZ Carriage Arduino Move to location.gvi
  EQE_Measuring_Setup_NanOpto::SubVis::Instrument Control::Arduinos::XZ Carriage Arduino::XZ Scan R.01::Carriage Scan ZX step calculation.gvi
  EQE_Measuring_Setup_NanOpto::SubVis::FGV::Timer FGV.gvi
  EQE_Measuring_Setup_NanOpto::SubVis::Utilities::Other::Current Time Kr.gvi
  EQE_Measuring_Setup_NanOpto::SubVis::FGV::Estimated Time FGV.gvi
  NI::VISA::Close (Instr).gvi
diagram:
  call "Arduino Detector.gvi"() -> (Carriage Arduino Address=w1, Error Out=w2)
  call "XZ Carriage Arduino Initialize.gvi"(XZ Carriage Arduino Adress In=w1, Error In=w2) -> (XZ Carriage Arduino Open Visa Session Out=w3, XZ Carriage Arduino Log=w4, Error Out=w5)
  call "XZ Carriage Arduino Homing Sequence.gvi"(XZ Carriage Arduino Open Visa Session In=w3, XZ Carriage Arduino Log In=w4, Error In=w5) -> (XZ Carriage Arduino Open Visa Session Out=w6, XZ Carriage Arduino Log Out=w7, Error Out=w8)
  Property Node(instance in=$"R.01 Reference Coordinates") -> ("X coordinate R.01"=w9, "Z coordinate R.01"=w10)
  call "XZ Coordinate to Gcode command.gvi"(X position=w9, Z position=w10) -> (Input Command=w11)
  call "XZ Carriage Arduino Move to location.gvi"(XZ Carriage Arduino open Visa session In=w6, XZ Carriage Arduino Log In=w7, Input Command=w11, Error In=w8) -> (XZ Carriage Arduino open Visa Session Out=w12, XZ Carriage Arduino Log Out=w13, Error Out=w14)
  w15 = $"X scan steps"
  w16 = $"Z scan steps"
  call "Carriage Scan ZX step calculation.gvi"(ZX coordinate R.01=w9, ZX scan Range (mm)=$"X scan Range (mm)", ZX scan steps=w15) -> (ZX Scan Starting Point=w17, ZX scan Step=w18)
  call "Carriage Scan ZX step calculation.gvi"(ZX coordinate R.01=w10, ZX scan Range (mm)=$"Z scan Range (mm)", ZX scan steps=w16) -> (ZX Scan Starting Point=w19, ZX scan Step=w20)
  call "Timer FGV.gvi"(Timer FGV Instructions="Start Timer", Error In=w14) -> (Error Out=w21)
  call "Current Time Kr.gvi"(Error=w21) -> (Current Time (kr)=w22, Error Out=w23)
  Multiply(w16, w15) -> w24
  s1 = w22  # shift register
  s2 = w23  # shift register
  s3 = w12  # shift register
  s4 = w13  # shift register
  s5 = 0  # shift register
  for (N = w15) (iteration -> i1) {
    Multiply(w20, i1) -> w25
    Add(w19, w25) -> w26
    call "Current Time Kr.gvi"(Error=s2) -> (Current Time (kr)=w27, Error Out=w28)
    Subtract(x=w27, y=s1) -> w29
    call "Estimated Time FGV.gvi"(Estimated Time Instructions="Setup", Step Count=w15, Step Duration=w29, Error In=w28) -> (Error Out=w30)
    s6 = w30  # shift register
    s7 = s3  # shift register
    s8 = s4  # shift register
    s9 = s5  # shift register
    for (N = w16) (iteration -> i2) {
      call "Timer FGV.gvi"(Timer FGV Instructions="Reset Timer", Error In=s6) -> (Elapsed Time=w32, Error Out=w33)
      call "Estimated Time FGV.gvi"(Estimated Time Instructions="Read Estimated Time", Error In=w33) -> (Estimated Time=w34, Error Out=w35)
      Multiply(w18, i2) -> w36
      Add(w17, w36) -> w37
      call "XZ Coordinate to Gcode command.gvi"(X position=w37, Z position=w26) -> (Input Command=w38)
      call "XZ Carriage Arduino Move to location.gvi"(XZ Carriage Arduino open Visa session In=s7, XZ Carriage Arduino Log In=s8, Input Command=w38, Error In=w35, Fast Movement?=TRUE, Basic Write=FALSE) -> (XZ Carriage Arduino open Visa Session Out=w39, XZ Carriage Arduino Log Out=w40, Error Out=w41)
      $"XZ Carriage Arduino Log Out" <- w40
      $"Elapsed Time" <- w32
      $"Estimated Time" <- w34
      Increment(x=s9) -> w42
      Divide(x=w42, y=w24) -> w43
      Multiply(w43, 100) -> w44
      $"Progress Bar" <- w44
      $Percent <- w44
      append $stop to w31
      next s6 = w41
      next s7 = w39
      next s8 = w40
      next s9 = w42
      stop if $stop
    }
    Or Array Elements(Boolean array=w31) -> (logical OR=w45)
    next s1 = w27
    next s2 = s6
    next s3 = s7
    next s4 = s8
    next s5 = s9
    stop if w45
  }
  call "Close (Instr).gvi"(session in=s3, error in=s2)
