vi "Carriage Scan ZX step calculation.gvi"   [LabVIEW NXG 3.1.0]
inputs:
  "ZX coordinate R.01": f64
  "ZX scan Range (mm)": f64 = 1
  "ZX scan steps": f64 = 3
outputs:
  "ZX Scan Starting Point": f64
  "ZX scan Step": f64
diagram:
  Decrement(x=$"ZX scan steps") -> w1
  Divide(x=$"ZX scan Range (mm)", y=w1) -> w2
  Multiply(w2, 100) -> w3
  Round Toward Negative Infinity(x=w3) -> w4
  Divide(x=w4, y=100) -> w5
  $"ZX scan Step" <- w5
  Divide(x=$"ZX scan Range (mm)", y=2) -> w6
  Subtract(x=$"ZX coordinate R.01", y=w6) -> w7
  Is Less Than 0(x=w7) -> w8
  Select(s=w8, t=0, f=w7) -> w9
  $"ZX Scan Starting Point" <- w9
