vi "XZ Carriage Scan Arduino Setups.gvi"   [LabVIEW NXG 3.1.0]
inputs:
  "Input": "VISA Instr"
  "Input_2": "VISA Instr"
  "Wavelength for peak detection": f64 = 550
  "Input_3": error
outputs:
  "Output": f64
  "Arduino Multiplexer Log": string
  "selector": error
uses:
  EQE_Measuring_Setup_NanOpto::SubVis::Instrument Control::Monochromator::Filter Change Wavelength.gvi
  EQE_Measuring_Setup_NanOpto::SubVis::Instrument Control::Arduinos::Filter Flipper Arduino::Arduino Filter Flipper Control.gvi
  EQE_Measuring_Setup_NanOpto::SubVis::Instrument Control::Arduinos::Multiplexer Arduino::Multiplexer Arduino Control.gvi
diagram:
  $Output <- $"Wavelength for peak detection"
  call "Filter Change Wavelength.gvi"() -> (Wavelength of filter Change=w1)
  Is Greater(x=$"Wavelength for peak detection", y=w1) -> w2
  Select(s=w2, t="IR Pass", f="Visible Pass") -> w3
  call "Arduino Filter Flipper Control.gvi"(Arduino Filter Flipper Address In=$Input_2, Pass Filter=w3, Error In=$Input_3) -> (Error Out=w4)
  call "Multiplexer Arduino Control.gvi"(Arduino Multiplexer Address In=$Input, Cell Label="R.01", Error In=w4) -> (Arduino Multiplexer Log=w5, Error Out=w6)
  $"Arduino Multiplexer Log" <- w5
  $selector <- w6
