vi "XZ Carriage scan routine.gvi"   [LabVIEW NXG 5.0.0]
inputs:
  "Error In": error
  "Multiple acquire variable Control": "Multiple acquire variables control.gtype" = {"Wavelength for peak detection"=500, "R.01 Reference Coordinates"={"X coordinate R.01"=145.3, "Z coordinate R.01"=2.5, "Vertical Spacing"=4.5}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}
  "Operation Mode Selection": "Operation Mode Selection.gtype" = "In program normal operation"
outputs:
  "Error Out": error
  "Multiple acquire variable Control Out": "Multiple acquire variables control.gtype"
  "Intensity Graph": f64[][]
panel controls:
  "Abort": bool
panel indicators:
  "Arduino Multiplexer Log": string
  "Power Map Array": "XZ power scan map array cluster.gtype"
  "Numeric Array Output": f64[][]
  "Carriage Log": string
  "Progress Bar": f64
  "Percent": f64
  "Estimated Time": f64
  "Elapsed Time": f64
  "Sent coordinates": string
  "Best Row": i32
  "Best Column": i32
  "X best Coordinate": f64
  "Z best Coordinate": f64
  "Pe Handle Out": u64
  "Keithley Adress Out": "VISA Instr"
  "Arduino XZ Carriage Out": "VISA Instr"
types:
  T1 = cluster{"X coordinate": f64, "Z coordinate": f64, "Power Value": f64}
  "XZ power scan map array cluster.gtype" = T1[]
  "Operation Mode Selection.gtype" = enum{"In program normal operation", "Stand Alone VI Operation"}
  "R.01 Reference Coordinates.gtype" = cluster{"X coordinate R.01": f64, "Z coordinate R.01": f64, "Vertical Spacing": f64}
  "Multiple acquire variables control.gtype" = cluster{"Monochromator configuration file ": path, "Light Power Calibration Data": f64[][], "Cell Measuring Labels": string[], "Sample Prefix": string, "Author Initials": string, "Current Date": string, "Batch Name": string, "Default Data Saving Location": path, "Filter Arduino Status": bool, "Filter Arduino Address": "VISA Instr", "Multiplexer Arduino Address": "VISA Instr", "Carriage Arduino Address": "VISA Instr", "Keithley Address": "VISA Instr", "Current Averages   ": f64, "Manual Range  ": f64, "Max current": f64, "Voltage Applied (V)  ": f64, "Autorange  ": bool, "Dark Current  ": bool, "Wavelength for peak detection": f64, "R.01 Reference Coordinates": "R.01 Reference Coordinates.gtype", "R.01 Scan?": bool, "Z scan steps": f64, "X scan Range (mm)": f64, "Z scan Range (mm)": f64, "X scan steps": f64, "Reference Coordinates file": path, "Save R.01 Coordinate?": bool, "Fianium Pe Handler": u64, "Automatic Measurement?": bool, "Dead Cell 10mV Current Threshold": f64, "Precheck cells?": bool, "Monochromator": bool}
  "power map cluster data.gtype" = cluster{"X coordinate": f64, "Z coordinate": f64, "Power Value": f64}
uses:
  EQE_Measuring_Setup_NanOpto::SubVis::Instrument Control::Instrument detector.gvi
  EQE_Measuring_Setup_NanOpto::SubVis::Instrument Control::Arduinos::Arduino Detector.gvi
  EQE_Measuring_Setup_NanOpto::SubVis::FGV::Current State FGV.gvi
  EQE_Measuring_Setup_NanOpto::SubVis::Instrument Control::Keithley::Keithley Initialization Sequence.gvi
  EQE_Measuring_Setup_NanOpto::SubVis::Instrument Control::Arduinos::XZ Carriage Arduino::XZ Carriage Arduino Initialize.gvi
  EQE_Measuring_Setup_NanOpto::SubVis::Instrument Control::Arduinos::XZ Carriage Arduino::XZ Carriage Arduino Homing Sequence.gvi
  PE_Filter_SDK::Monochromator Initialization Sequence.gvi
  EQE_Measuring_Setup_NanOpto::SubVis::Instrument Control::Arduinos::XZ Carriage Arduino::XZ Scan R.01::XZ Carriage Scan Arduino Setups.gvi
  EQE_Measuring_Setup_NanOpto::SubVis::Instrument Control::Monochromator::Fiannium wavelength correction.gvi
  PE_Filter_SDK::PE Set Wavelength On Grating.gvi
  EQE_Measuring_Setup_NanOpto::SubVis::FGV::Timer FGV.gvi
  EQE_Measuring_Setup_NanOpto::SubVis::Utilities::Other::Current Time Kr.gvi
  EQE_Measuring_Setup_NanOpto::SubVis::Instrument Control::Arduinos::XZ Carriage Arduino::XZ Scan R.01::XZ Step full calculator.gvi
  EQE_Measuring_Setup_NanOpto::SubVis::Instrument Control::Arduinos::XZ Carriage Arduino::XZ Carriage Arduino Move to location.gvi
  EQE_Measuring_Setup_NanOpto::SubVis::FGV::Estimated Time FGV.gvi
  EQE_Measuring_Setup_NanOpto::SubVis::Instrument Control::Arduinos::XZ Carriage Arduino::XZ Coordinate to Gcode command.gvi
  EQE_Measuring_Setup_NanOpto::SubVis::Main Sub Functions::Global Abort::Global Abort.gvi
  EQE_Measuring_Setup_NanOpto::SubVis::Instrument Control::Arduinos::XZ Carriage Arduino::XZ Scan R.01::Keithley measure single point.gvi
  EQE_Measuring_Setup_NanOpto::SubVis::Utilities::Other::Array Zero Trimmer.gvi
  EQE_Measuring_Setup_NanOpto::SubVis::Instrument Control::Arduinos::XZ Carriage Arduino::XZ Scan R.01::2D Map geometric average.gvi
  Labview_NXG_Keithley_SMU_2450_2460_2461::Miscelaneous::Close.gvi
  NI::VISA::Close (Instr).gvi
  PE_Filter_SDK::PE Close.gvi
  PE_Filter_SDK::PE Destroy.gvi
  EQE_Measuring_Setup_NanOpto::SubVis::Utilities::Other::Round to N Decimals.gvi
  EQE_Measuring_Setup_NanOpto::SubVis::Utilities::Path Manipulation::Update Reference Coordinates subroutine.gvi
diagram:
  case ($"Operation Mode Selection") {
    frame "Stand Alone VI Operation" {
      call "Instrument detector.gvi"(Instruments to Detect="Keythley", Error In=$"Error In") -> (Keithley Address=w1, Error Out=w6)
      call "Arduino Detector.gvi"(Error In=w6) -> (Carriage Arduino Address=w3, Multiplexer Arduino Address=w2, Filter Arduino Address=w4, Error Out=w5)
    }
    frame "In program normal operation", Default {
      call "Current State FGV.gvi"(Instruction Current State FGV="Set Current SubState", Current SubState="Scanning R.01 cell position", Error In=$"Error In") -> (Error Out=w5)
      Property Node(instance in=$"Multiple acquire variable Control") -> ("Multiplexer Arduino Address"=w2, "Filter Arduino Address"=w4, "Carriage Arduino Address"=w3, "Keithley Address"=w1)
    }
  }
  Property Node(instance in=$"Multiple acquire variable Control") -> ("Carriage Arduino Address"=w7, "Fianium Pe Handler"=w8, "Monochromator configuration file "=w9, "Manual Range  "=w10, "Voltage Applied (V)  "=w11, "Max current"=w12, "Current Averages   "=w13, "Autorange  "=w14, "Automatic Measurement?"=w15)
  case (w15) {
    frame True {
      # If it is an automatic measurement
      # both the keithley and the fiannium will have been
      # initialized
      call "Keithley Initialization Sequence.gvi"(Enable Auto Range=w14, VISA resource name=w1, Voltage Applied (V)=w11, Source Limit Level (0.1)=w12, Current Averages=w13, Error In=w5, Manual Current Range=w10) -> (VISA resource name out=w16, Error Out=w18)
      w17 = w8
      w19 = w3
      w20 = ""
    }
    frame False {
      call "XZ Carriage Arduino Initialize.gvi"(XZ Carriage Arduino Adress In=w3, Error In=w5) -> (XZ Carriage Arduino Open Visa Session Out=w21, XZ Carriage Arduino Log=w22, Error Out=w23)
      Concatenate Strings(w7, w22) -> w24
      call "XZ Carriage Arduino Homing Sequence.gvi"(XZ Carriage Arduino Open Visa Session In=w21, XZ Carriage Arduino Log In=w24, Error In=w23) -> (XZ Carriage Arduino Open Visa Session Out=w19, XZ Carriage Arduino Log Out=w20, Error Out=w25)
      call "Keithley Initialization Sequence.gvi"(Enable Auto Range=w14, VISA resource name=w1, Voltage Applied (V)=w11, Source Limit Level (0.1)=w12, Current Averages=w13, Error In=w25, Manual Current Range=w10) -> (VISA resource name out=w16, Error Out=w26)
      call "Monochromator Initialization Sequence.gvi"(Configuration File=w9, Error In=w26) -> (peHandle out=w17, Error Out=w18)
    }
  }
  Property Node(instance in=$"Multiple acquire variable Control") -> ("Wavelength for peak detection"=w27)
  call "XZ Carriage Scan Arduino Setups.gvi"(Input=w2, Input_2=w4, Wavelength for peak detection=w27, Input_3=w18) -> (Output=w28, Arduino Multiplexer Log=w29, selector=w30)
  case (w30) {
    frame Error, Default {
      w31 = w17
      w32 = w30
      w33 = w20
      w34 = w19
      w35 = w16
      w36 = "XZ power scan map array cluster.gtype" []
      w37 = default
    }
    frame No Error {
      call "Fiannium wavelength correction.gvi"(Desired wavelength=w28) -> (Grating for the system=w38, Wavelength for the system=w39)
      call "PE Set Wavelength On Grating.gvi"(peHandle=w17, gratingIndex=w38, wavelength=w39, error in (no error)=w30) -> (peHandle out=w31, error out=w40)
      call "Timer FGV.gvi"(Timer FGV Instructions="Start Timer", Error In=w40) -> (Error Out=w41)
      call "Current Time Kr.gvi"(Error=w41) -> (Current Time (kr)=w42, Error Out=w43)
      call "XZ Step full calculator.gvi"(Multiple acquire variable Control=$"Multiple acquire variable Control", Error In=w43) -> (Z Steps=w44, X Steps=w45, Total Steps=w46, R.01 Position Gcode=w47, X Starting Point=w48, X Step size=w49, Z Starting Point=w50, Z Step size=w51, Error Out=w52)
      call "XZ Carriage Arduino Move to location.gvi"(XZ Carriage Arduino open Visa session In=w19, XZ Carriage Arduino Log In=w20, Input Command=w47, Error In=w52) -> (XZ Carriage Arduino open Visa Session Out=w53, XZ Carriage Arduino Log Out=w54, Error Out=w55)
      w56 = [[0, 0, 0, 0, 0, 0, 0, 0, 0, 0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], [0, 0, 0, 0, 0, 0, 0, 0, 0, 0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], [0, 0, 0, 0, 0, 0, 0, 0, 0, 0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], [0, 0, 0, 0, 0, 0, 0, 0, 0, 0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], [0, 0, 0, 0, 0, 0, 0, 0, 0, 0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], [0, 0, 0, 0, 0, 0, 0, 0, 0, 0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], [0, 0, 0, 0, 0, 0, 0, 0, 0, 0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], [0, 0, 0, 0, 0, 0, 0, 0, 0, 0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], [0, 0, 0, 0, 0, 0, 0, 0, 0, 0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], [0, 0, 0, 0, 0, 0, 0, 0, 0, 0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]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]
      s1 = w54  # shift register
      s2 = w53  # shift register
      s3 = w16  # shift register
      s4 = "XZ power scan map array cluster.gtype" []  # shift register
      s5 = 0  # shift register
      s6 = w56  # shift register
      s7 = w42  # shift register
      for (N = w44) (iteration -> i1) {
        Multiply(w51, i1) -> w57
        Add(w50, w57) -> w58
        call "Current Time Kr.gvi"(Error=w55) -> (Current Time (kr)=w59, Error Out=w60)
        Subtract(x=w59, y=s7) -> w61
        call "Estimated Time FGV.gvi"(Estimated Time Instructions="Setup", Step Count=w44, Step Duration=w61, Error In=w60) -> (Error Out=w62)
        s8 = s1  # shift register
        s9 = s2  # shift register
        s10 = s3  # shift register
        s11 = s4  # shift register
        s12 = s5  # shift register
        s13 = s6  # shift register
        s14 = ""  # shift register
        for (N = w45) (iteration -> i2) {
          Multiply(w49, i2) -> w63
          Add(w48, w63) -> w64
          call "XZ Coordinate to Gcode command.gvi"(X position=w64, Z position=w58) -> (Input Command=w65)
          Concatenate Strings(s14, w65, "\r\n") -> w66
          $"Sent coordinates" <- w66
          call "Global Abort.gvi"(Instruction="Read Abort State", Error In=w62) -> (Local Abort State=w67, Global Abort State=w68, Error Out=w69)
          call "Timer FGV.gvi"(Timer FGV Instructions="Reset Timer", Error In=w69) -> (Elapsed Time=w70, Error Out=w71)
          $"Elapsed Time" <- w70
          call "Estimated Time FGV.gvi"(Estimated Time Instructions="Read Estimated Time", Error In=w71) -> (Estimated Time=w72, Error Out=w73)
          $"Estimated Time" <- w72
          call "XZ Carriage Arduino Move to location.gvi"(XZ Carriage Arduino open Visa session In=s9, XZ Carriage Arduino Log In=s8, Input Command=w65, Error In=w73, Fast Movement?=TRUE) -> (XZ Carriage Arduino open Visa Session Out=w74, XZ Carriage Arduino Log Out=w75, Error Out=w76)
          call "Keithley measure single point.gvi"(Keithley Address In=s10, Error In=w76) -> (Keithley address out=w77, Data=w78, Error Out=w32)
          Floating Point String To Number(string=w78, use system decimal point (T)=FALSE) -> (number=w79)
          Property Node(instance in="power map cluster data.gtype" {all zero or empty}, "X coordinate"=w64, "Z coordinate"=w58, "Power Value"=w79) -> (instance out=w80)
          Insert Into Array(inArray=s11, index0=s12, new=w80) -> w81
          Increment(x=s12) -> w82
          Divide(x=w82, y=w46) -> w83
          Multiply(w83, 100) -> w84
          $"Progress Bar" <- w84
          $Percent <- w84
          Replace Array Subset(inArray=s13, index=i1, index=i2, new=w79) -> w85
          $"Carriage Log" <- w75
          Logical Or(w67, w68) -> w86
          Logical Or(w86, $Abort) -> w87
          Logical Or(w87, w32) -> w88
          next s8 = w75
          next s9 = w74
          next s10 = w77
          next s11 = w81
          next s12 = w82
          next s13 = w85
          next s14 = w66
          stop if w88
        }
        Logical Or(w32, w87) -> w89
        next s1 = s8
        next s2 = s9
        next s3 = s10
        next s4 = s11
        next s5 = s12
        next s6 = s13
        next s7 = w59
        stop if w89
      }
      w33 = s1
      w34 = s2
      w35 = s3
      w36 = s4
      w37 = s6
    }
  }
  call "Array Zero Trimmer.gvi"(Input=w37) -> (Intensity Graph=w90)
  call "2D Map geometric average.gvi"(Power Map Array=w36, Intensity Graph In=w90, Error In=w32) -> (X Average=w91, Z Average=w92, Error Out=w93, Best Row=w94, Best Column=w95)
  Property Node(instance in=$"Multiple acquire variable Control") -> ("Save R.01 Coordinate?"=w96, "Reference Coordinates file"=w97, "R.01 Reference Coordinates"=w98, "Automatic Measurement?"=w99, instance out=w100)
  case (w99) {
    frame True {
      # If it is an automatic measurement
      # we leave the monochromator running
      call "Close.gvi"(VISA resource name=w35, error in (no error)=w93) -> (error out=w101)
      w102 = w34
      w103 = w35
      w104 = w31
    }
    frame False {
      call "Close (Instr).gvi"(session in=w34, error in=w93) -> (error out=w105)
      call "Close.gvi"(VISA resource name=w35, error in (no error)=w105) -> (error out=w106)
      call "PE Close.gvi"(peHandle=w31, error in (no error)=w106) -> (peHandle out=w107, error out=w108)
      call "PE Destroy.gvi"(peHandle=w107, error in (no error)=w108) -> (error out=w101)
      w102 = default
      w103 = default
      w104 = default
    }
  }
  $"Keithley Adress Out" <- w103
  $"Arduino Multiplexer Log" <- w29
  $"Power Map Array" <- w36
  case (w96) {
    frame False, Default {
      w109 = w101
      w110 = w100
    }
    frame True {
      call "Round to N Decimals.gvi"(To Round=w91, Decimal Places=1) -> (Rounded=w111)
      call "Round to N Decimals.gvi"(To Round=w92, Decimal Places=1) -> (Rounded=w112)
      Property Node(instance in=w98, "X coordinate R.01"=w111, "Z coordinate R.01"=w112) -> (instance out=w113)
      call "Update Reference Coordinates subroutine.gvi"(Reference Coordinates file=w97, R.01 Reference Coordinates=w113, Error In=w101) -> (Error Out=w109)
      Property Node(instance in=w100, "R.01 Reference Coordinates:X coordinate R.01"=w111, "R.01 Reference Coordinates:Z coordinate R.01"=w112) -> (instance out=w110)
    }
  }
  $"Error Out" <- w109
  $"Intensity Graph" <- w90
  $"Numeric Array Output" <- w90
  $"Arduino XZ Carriage Out" <- w102
  $"Best Row" <- w94
  $"Pe Handle Out" <- w104
  $"Best Column" <- w95
  $"Carriage Log" <- w33
  $"X best Coordinate" <- w91
  $"Z best Coordinate" <- w92
  $"Multiple acquire variable Control Out" <- w110
