vi "XZ Step full calculator.gvi"   [LabVIEW NXG 5.0.0]
inputs:
  "Multiple acquire variable Control": "Multiple acquire variables control.gtype" = {"Wavelength for peak detection"=500, "R.01 Reference Coordinates"={"X coordinate R.01"=145.3, "Z coordinate R.01"=2.5, "Vertical Spacing"=4.5}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}
  "Error In": error
outputs:
  "Z Steps": f64
  "X Steps": f64
  "Total Steps": f64
  "R.01 Position Gcode": string
  "X Starting Point": f64
  "X Step size": f64
  "Z Starting Point": f64
  "Z Step size": f64
  "Error Out": error
types:
  "R.01 Reference Coordinates.gtype" = cluster{"X coordinate R.01": f64, "Z coordinate R.01": f64, "Vertical Spacing": f64}
  "Multiple acquire variables control.gtype" = cluster{"Monochromator configuration file ": path, "Light Power Calibration Data": f64[][], "Cell Measuring Labels": string[], "Sample Prefix": string, "Author Initials": string, "Current Date": string, "Batch Name": string, "Default Data Saving Location": path, "Filter Arduino Status": bool, "Filter Arduino Address": "VISA Instr", "Multiplexer Arduino Address": "VISA Instr", "Carriage Arduino Address": "VISA Instr", "Keithley Address": "VISA Instr", "Current Averages   ": f64, "Manual Range  ": f64, "Max current": f64, "Voltage Applied (V)  ": f64, "Autorange  ": bool, "Dark Current  ": bool, "Wavelength for peak detection": f64, "R.01 Reference Coordinates": "R.01 Reference Coordinates.gtype", "R.01 Scan?": bool, "Z scan steps": f64, "X scan Range (mm)": f64, "Z scan Range (mm)": f64, "X scan steps": f64, "Reference Coordinates file": path, "Save R.01 Coordinate?": bool, "Fianium Pe Handler": u64, "Automatic Measurement?": bool, "Dead Cell 10mV Current Threshold": f64, "Precheck cells?": bool, "Monochromator": bool}
uses:
  EQE_Measuring_Setup_NanOpto::SubVis::Instrument Control::Arduinos::XZ Carriage Arduino::XZ Scan R.01::Carriage Scan ZX step calculation.gvi
  EQE_Measuring_Setup_NanOpto::SubVis::Instrument Control::Arduinos::XZ Carriage Arduino::XZ Coordinate to Gcode command.gvi
diagram:
  case ($"Error In") {
    frame Error, Default {
      w1 = $"Error In"
    }
    frame No Error {
      Property Node(instance in=$"Multiple acquire variable Control") -> ("X scan Range (mm)"=w2, "Z scan Range (mm)"=w3, "X scan steps"=w4, "Z scan steps"=w5, "R.01 Reference Coordinates:X coordinate R.01"=w6, "R.01 Reference Coordinates:Z coordinate R.01"=w7)
      call "Carriage Scan ZX step calculation.gvi"(ZX coordinate R.01=w6, ZX scan Range (mm)=w2, ZX scan steps=w4) -> (ZX Scan Starting Point=w8, ZX scan Step=w9)
      $"X Starting Point" <- w8
      $"X Step size" <- w9
      call "Carriage Scan ZX step calculation.gvi"(ZX coordinate R.01=w7, ZX scan Range (mm)=w3, ZX scan steps=w5) -> (ZX Scan Starting Point=w10, ZX scan Step=w11)
      $"Z Starting Point" <- w10
      $"Z Step size" <- w11
      $"X Steps" <- w4
      Multiply(w5, w4) -> w12
      $"Total Steps" <- w12
      $"Z Steps" <- w5
      call "XZ Coordinate to Gcode command.gvi"(X position=w6, Z position=w7) -> (Input Command=w13)
      $"R.01 Position Gcode" <- w13
      w1 = $"Error In"
    }
  }
  $"Error Out" <- w1
