vi "Instrument Detection Sequence.gvi"   [LabVIEW NXG 3.1.0]
inputs:
  "Monochromator configuration file visible": path
  "Error In": error
  "Monochromator configuration file infrared": path
outputs:
  "Instrument Detection Sequence control": "Instrument Detection Sequence control.gtype"
  "Error Out": error
  "Ir Monochromator?": bool
panel indicators:
  "Photodetector Status": bool
  "Photodetector Names": string[]
  "Keythley Status": bool
  "Keithley Address": "VISA Instr"
  "Monochromator Status": bool
  "Monochromator Name": string
  "Multiplexer Arduino Detected?": bool
  "Carriage Arduino Detected?": bool
  "Filter Arduino Detected?": bool
  "Filter Arduino Address": "VISA Instr"
  "Carriage Arduino Address": "VISA Instr"
  "Multiplexer Arduino Address": "VISA Instr"
  "Supercontinuum Status": bool
  "Supercontinuum laser Address": "VISA Instr"
types:
  "Instrument Detection Sequence control.gtype" = cluster{"Photodetector Status": bool, "Photodetector Names": string[], "Keythley Status": bool, "Keithley Address": "VISA Instr", "Monochromator Status": bool, "Monochromator Name": string, "Multiplexer Arduino Status": bool, "Multiplexer Arduino Address": "VISA Instr", "Carriage Arduino Status": bool, "Carriage Arduino Address": "VISA Instr", "Filter Arduino Status": bool, "Filter Arduino Address": "VISA Instr", "Supercontinuum Status": bool, "Supercontinuum laser Address": "VISA Instr"}
uses:
  EQE_Measuring_Setup_NanOpto::SubVis::Instrument Control::Instrument detector.gvi
diagram:
  case ($"Error In") {
    frame Error, Default {
      w1 = $"Error In"
    }
    frame No Error {
      call "Instrument detector.gvi"(Instruments to Detect="Photodetector", Error In=$"Error In") -> (Photodetector Names=w2, Error Out=w3, Detected?=w4)
      call "Instrument detector.gvi"(Instruments to Detect="Keythley", Error In=w3) -> (Keithley Address=w5, Error Out=w6, Detected?=w7)
      call "Instrument detector.gvi"(Instruments to Detect="Monochromator", Monochromator configuration file visible=$"Monochromator configuration file visible", Monochromator configuration file infrared=$"Monochromator configuration file infrared", Error In=w6) -> (Monochromator Name=w8, Error Out=w9, Detected?=w10, Ir Monochromator?=w11)
      call "Instrument detector.gvi"(Instruments to Detect="Arduinos", Error In=w9, Prompt Arduinos?=FALSE) -> (Arduino Coms Info=w12, Error Out=w13)
      call "Instrument detector.gvi"(Instruments to Detect="Supercontinuum Laser", Error In=w13) -> (Supercontinuum Laser Address=w14, Error Out=w1, Detected?=w15)
      $"Supercontinuum Status" <- w15
      $"Supercontinuum laser Address" <- w14
      Property Node(instance in=w12) -> ("Multiplexer Arduino Address"=w16, "Filter Arduino Address"=w17, "Carriage Arduino Address"=w18, "Multiplexer Arduino Detected?"=w19, "Carriage Arduino Detected?"=w20, "Filter Arduino Detected?"=w21)
      $"Multiplexer Arduino Detected?" <- w19
      w22 = "Instrument Detection Sequence control.gtype" {all zero or empty}
      Property Node(instance in=w22, "Photodetector Status"=w4, "Photodetector Names"=w2, "Keythley Status"=w7, "Keithley Address"=w5, "Monochromator Status"=w10, "Monochromator Name"=w8, "Multiplexer Arduino Status"=w19, "Multiplexer Arduino Address"=w16, "Carriage Arduino Status"=w20, "Carriage Arduino Address"=w18, "Filter Arduino Status"=w21, "Filter Arduino Address"=w17, "Supercontinuum Status"=w15, "Supercontinuum laser Address"=w14) -> (instance out=w23)
      $"Instrument Detection Sequence control" <- w23
      $"Photodetector Status" <- w4
      $"Photodetector Names" <- w2
      $"Keythley Status" <- w7
      $"Keithley Address" <- w5
      $"Monochromator Status" <- w10
      $"Ir Monochromator?" <- w11
      $"Carriage Arduino Detected?" <- w20
      $"Monochromator Name" <- w8
      $"Multiplexer Arduino Address" <- w16
      $"Filter Arduino Address" <- w17
      $"Carriage Arduino Address" <- w18
      $"Filter Arduino Detected?" <- w21
    }
  }
  $"Error Out" <- w1
