vi "Instrument detector.gvi"   [LabVIEW NXG 5.0.0]
inputs:
  "Instruments to Detect": "Instruments to Detect.gtype" = "Photodetector", required
  "Error In": error
  "Monochromator configuration file visible": path
  "Prompt Arduinos?": bool
  "Monochromator configuration file infrared": path
  "IR Monochromator? in": bool
outputs:
  "Photodetector Names": string[]
  "Monochromator Name": string
  "Error Out": error
  "Keithley Address": "VISA Instr"
  "Arduino Coms Info": T1
  "Supercontinuum Laser Address": "VISA Instr"
  "Detected?": bool
  "Ir Monochromator?": bool
types:
  "Instruments to Detect.gtype" = enum{"Photodetector", "Keythley", "Monochromator", "Arduinos", "Supercontinuum Laser"}
  T1 = cluster{"Multiplexer Arduino Address": "VISA Instr", "Filter Arduino Address": "VISA Instr", "Carriage Arduino Address": "VISA Instr", "Multiplexer Arduino Detected?": bool, "Carriage Arduino Detected?": bool, "Filter Arduino Detected?": bool}
uses:
  EQE_Measuring_Setup_NanOpto::SubVis::FGV::Current State FGV.gvi
  LabView_NXG_Thorlabs_PM100::Miscelanous::TLPM Find Resources.gvi
  NI::G Core::Error::Clear Error Cluster.gvi
  LabView_NXG_Thorlabs_PM100::Get Parameters::TLPM Get Resource Name.gvi
  NI::VISA::Find Resource (Search Resources).gvi
  EQE_Measuring_Setup_NanOpto::SubVis::Instrument Control::Supercontinuum Laser Source::Supercontinuum Detection.gvi
  PE_Filter_SDK::PE Create.gvi
  PE_Filter_SDK::PE Get System Name.gvi
  PE_Filter_SDK::PE Open.gvi
  PE_Filter_SDK::PE Close.gvi
  PE_Filter_SDK::PE Destroy.gvi
  EQE_Measuring_Setup_NanOpto::SubVis::Instrument Control::Arduinos::Arduino Detector.gvi
diagram:
  case ($"Error In") {
    frame Error, Default {
      w1 = $"Error In"
      w2 = FALSE
    }
    frame No Error {
      case ($"Instruments to Detect") {
        frame "Photodetector", Default {
          call "Current State FGV.gvi"(Instruction Current State FGV="Set Current SubState", Current SubState="Detecting Photodetector", Error In=$"Error In") -> (Error Out=w3)
          while (iteration -> i1) {
            call "TLPM Find Resources.gvi"(IVI session in="", error in (no error)=w3) -> (IVI session out=w4, Resource Count=w5, error out=w6)
            Is Greater Or Equal(x=w5, y=1) -> w7
            case (w7) {
              frame False, Default {
                while {
                  Wait Until Next Multiple(multiple to wait=500)
                  w11 = "Photodetector not detected\nPlease make sure you have \nit connected properly.\nOtherwise the software cannot\nproceed."
                  One Button Dialog(button name ("OK")="Okay i will reconnect it", message=w11) -> (true=w12)
                  stop if w12
                }
                call "Clear Error Cluster.gvi"(error in=w6) -> (error out=w9)
                w8 = default
                w10 = FALSE
                w2 = default
              }
              frame True {
                for (N = w5) (iteration -> i2) {
                  call "TLPM Get Resource Name.gvi"(IVI session in=w4, Index (0)=i2, error in (no error)=w6) -> (error out=w9, Resource Name=w13)
                  append w13 to w8
                }
                w10 = TRUE
                w2 = TRUE
              }
            }
            $"Photodetector Names" <- w8
            Is Greater(x=i1, y=5) -> w14
            case (w14) {
              frame False, Default {
                w15 = FALSE
                w1 = w9
              }
              frame True {
                w16 = """Seems you're having some trouble
connecting the photodetector, do you 
want to proceed without connecting it
and hope for the best?
(WARNING: some functionalities might
be compromized)"""
                Two Button Dialog(F button name ("Cancel")="Oh dear no, I'd rather ask for help", T button name ("OK")="Yes please, I like to live dangerously", message=w16) -> (T Button?=w15)
                w1 = w9
              }
            }
            Logical Or(w10, w15) -> w17
            stop if w17
          }
        }
        frame "Keythley" {
          call "Current State FGV.gvi"(Instruction Current State FGV="Set Current SubState", Current SubState="Detecting Keithley", Error In=$"Error In") -> (Error Out=w18)
          while (iteration -> i3) {
            call "Find Resource (Search Resources).gvi"(error in=w18) -> (found resources=w19, error out=w20)
            for {
              w21 = each element of w19
              Search And Replace String(error in (no error)=w20, input string=w21, search string="2450") -> (error out=w23, number of replacements=w24)
              Is Greater Than 0(x=w24) -> w25
              append w21 to w22 if w25
            }
            Is Empty Array(array=w22) -> w26
            Array Size(array=w22) -> (size(s)=w27)
            Is Greater(x=w27, y=1) -> w28
            Logical Or(w26, w28) -> w29
            case (w29) {
              frame False, Default {
                Array Index(array=w22) -> (out0[0]=w31)
                w30 = TRUE
                w32 = w23
                w2 = TRUE
              }
              frame True {
                Wait Until Next Multiple(multiple to wait=500)
                call "Clear Error Cluster.gvi"(error in=w23) -> (error out=w32)
                w33 = """Seems like you have connected
either more than one 2450 keithley
to this computer or none at all, 
please disconnect all of them but
one, or connect at least one
and then retry."""
                One Button Dialog(button name ("OK")="Okay, sorry.", message=w33)
                w30 = FALSE
                w31 = ""
                w2 = default
              }
            }
            Type Cast(type="VISA Instr" "", x=w31) -> w34
            $"Keithley Address" <- w34
            Is Greater(x=i3, y=5) -> w35
            case (w35) {
              frame False, Default {
                w36 = FALSE
                w1 = w32
              }
              frame True {
                w37 = """Seems you're having some trouble
connecting the keithley, do you 
want to proceed without connecting it
and hope for the best?
(WARNING: some functionalities might
be compromized, or the entire program 
can crash)"""
                Two Button Dialog(F button name ("Cancel")="Oh dear no, I'd rather ask for help", T button name ("OK")="Yes please, I like to live dangerously", message=w37) -> (T Button?=w36)
                w1 = w32
              }
            }
            Logical Or(w30, w36) -> w38
            stop if w38
          }
        }
        frame "Supercontinuum Laser" {
          call "Current State FGV.gvi"(Instruction Current State FGV="Set Current SubState", Current SubState="Detecting Supercontinuum", Error In=$"Error In") -> (Error Out=w39)
          while (iteration -> i4) {
            call "Supercontinuum Detection.gvi"(Error In=w39) -> (Supercontinuum laser Address=w40, Found?=w2, Error Out=w41)
            case (w2) {
              frame True {
                w42 = TRUE
                w43 = w41
                w44 = w40
              }
              frame False {
                Wait Until Next Multiple(multiple to wait=500)
                w45 = """Seems like the supercontinuum 
laser source is not connected 
propperly to the computer please
connect it propperly and try again."""
                One Button Dialog(button name ("OK")="Okay, sorry.", message=w45)
                w42 = FALSE
                w43 = w41
                w44 = default
              }
            }
            $"Supercontinuum Laser Address" <- w44
            Is Greater(x=i4, y=0) -> w46
            case (w46) {
              frame False, Default {
                w47 = FALSE
                w1 = w43
              }
              frame True {
                w48 = """Seems you're having some trouble
connecting the supercontinuum laser,
do you want to proceed without connecting it
with either an external source or no source at all?
(WARNING: some functionalities might
be disabled)"""
                Two Button Dialog(F button name ("Cancel")="Oh dear no, I'd rather ask for help", T button name ("OK")="Yes please, I like to live dangerously", message=w48) -> (T Button?=w47)
                w1 = w43
              }
            }
            Logical Or(w42, w47) -> w49
            stop if w49
          }
        }
        frame "Monochromator" {
          call "Current State FGV.gvi"(Instruction Current State FGV="Set Current SubState", Current SubState="Detecting Monochromator", Error In=$"Error In") -> (Error Out=w50)
          s1 = $"IR Monochromator? in"  # shift register
          while (iteration -> i5) {
            Select(s=s1, t=$"Monochromator configuration file infrared", f=$"Monochromator configuration file visible") -> w51
            Path To String(path=w51) -> (string=w52)
            Is Empty String Or Path(string/path=w52) -> w53
            case (w53) {
              frame True {
                while {
                  Wait Until Next Multiple(multiple to wait=500)
                  w57 = "Monochromator config file not loaded, please load the propper file"
                  One Button Dialog(button name ("OK")="Okay i will load it", message=w57) -> (true=w58)
                  stop if w58
                }
                call "Clear Error Cluster.gvi"(error in=w50) -> (error out=w54)
                w55 = FALSE
                w2 = default
                w56 = s1
              }
              frame False {
                call "PE Create.gvi"(conffile=w52, error in (no error)=w50) -> (peHandle out=w59, error out=w60)
                call "PE Get System Name.gvi"(peHandle=w59, index=0, error in (no error)=w60) -> (peHandle out=w61, name=w62, error out=w63)
                call "PE Open.gvi"(peHandle=w61, name=w62, error in (no error)=w63) -> (peHandle out=w64, Open Fail=w65, error out=w66)
                case (w65) {
                  frame True {
                    s2 = s1  # shift register
                    while {
                      Not(x=s2) -> w70
                      Not(x=s2) -> w71
                      Select(s=w71, t="Visible", f="IR") -> w72
                      Select(s=s2, t="Visible", f="IR") -> w73
                      w74 = """ Monochromator not detected
Please make sure you have it connected
properly. Otherwise the software cannot
proceed. Try to disconnect it and reconnect it.
If you are trying to use the """
                      Concatenate Strings(w72, w74, w73, " monocrhomator\nchose the option below.") -> w75
                      Concatenate Strings("I want to use the ", w73, " Monochromator") -> w76
                      Two Button Dialog(F button name ("Cancel")=w76, T button name ("OK")="Okay i will reconnect it", message=w75) -> (T Button?=w77)
                      Select(s=w77, t=s2, f=w70) -> w78
                      Logical Or(w77, not w77) -> w79
                      Wait Until Next Multiple(multiple to wait=500)
                      next s2 = w78
                      stop if w79
                    }
                    w67 = default
                    w68 = w66
                    w55 = FALSE
                    w69 = w64
                    w2 = default
                    w56 = s2
                  }
                  frame False {
                    w67 = w62
                    w68 = w66
                    w55 = TRUE
                    w69 = w64
                    w2 = TRUE
                    w56 = s1
                  }
                }
                call "PE Close.gvi"(peHandle=w69, error in (no error)=w68) -> (peHandle out=w80, error out=w81)
                call "PE Destroy.gvi"(peHandle=w80, error in (no error)=w81) -> (error out=w54)
                $"Monochromator Name" <- w67
              }
            }
            Is Greater(x=i5, y=5) -> w82
            case (w82) {
              frame False, Default {
                w83 = FALSE
                w1 = w54
              }
              frame True {
                w84 = """Seems you're having some trouble
connecting the monochromator, do you 
want to proceed without connecting it
and hope for the best?
(WARNING: some functionalities might
be compromized, or the entire program 
can crash)"""
                Two Button Dialog(F button name ("Cancel")="Oh dear no, I'd rather ask for help", T button name ("OK")="Yes please, I like to live dangerously", message=w84) -> (T Button?=w83)
                Wait Until Next Multiple(multiple to wait=500)
                w1 = w54
              }
            }
            Logical Or(w55, w83) -> w85
            next s1 = w56
            stop if w85
          }
          $"Ir Monochromator?" <- s1
        }
        frame "Arduinos" {
          call "Current State FGV.gvi"(Instruction Current State FGV="Set Current SubState", Current SubState="Detecting Arduinos", Error In=$"Error In") -> (Error Out=w86)
          while (iteration -> i6) {
            call "Arduino Detector.gvi"(Error In=w86) -> (Carriage Arduino Detected?=w87, Carriage Arduino Address=w88, Multiplexer Arduino Detected?=w89, Multiplexer Arduino Address=w90, Filter Arduino Detected?=w91, Filter Arduino Address=w92, Error Out=w93)
            Property Node(instance in=T1 {all zero or empty}, "Carriage Arduino Detected?"=w87, "Carriage Arduino Address"=w88, "Multiplexer Arduino Detected?"=w89, "Multiplexer Arduino Address"=w90, "Filter Arduino Detected?"=w91, "Filter Arduino Address"=w92) -> (instance out=w94)
            $"Arduino Coms Info" <- w94
            Logical And(w87, w89, w91) -> w2
            Logical Or(w2, not $"Prompt Arduinos?") -> w95
            case (w95) {
              frame False, Default {
                Wait Until Next Multiple(multiple to wait=500)
                case (w87) {
                  frame False, Default {
                    w98 = """It looks like the XZ Stage Arduino is not
connected or the connection is failing,
please connect it and make sure no other
software is using the connection (i.e. the 
arduino software, cura ...)"""
                    One Button Dialog(button name ("OK")="Okay I will Reconnect it", message=w98)
                  }
                  frame True { }
                }
                case (w89) {
                  frame False, Default {
                    w99 = """It looks like the Multiplexer Arduino is not
connected or the connection is failing,
please connect it and make sure no other
software is using the connection (i.e. the 
arduino software, cura ...)"""
                    One Button Dialog(button name ("OK")="Okay I will Reconnect it", message=w99)
                  }
                  frame True { }
                }
                case (w91) {
                  frame False, Default {
                    w100 = """It looks like the Filter Arduino is not
connected or the connection is failing,
please connect it and make sure no other
software is using the connection (i.e. the 
arduino software, cura ...)"""
                    One Button Dialog(button name ("OK")="Okay I will Reconnect it", message=w100)
                  }
                  frame True { }
                }
                w96 = default
                w97 = w93
              }
              frame True {
                w96 = TRUE
                w97 = w93
              }
            }
            Is Greater(x=i6, y=1) -> w101
            case (w101) {
              frame False, Default {
                w102 = FALSE
                w1 = w97
              }
              frame True {
                w103 = """Seems you're having some trouble
connecting the photodetector, do you 
want to proceed without connecting it
and hope for the best?
(WARNING: some functionalities might
be compromized)"""
                Two Button Dialog(F button name ("Cancel")="Oh dear no, I'd rather ask for help", T button name ("OK")="Yes please, I like to live dangerously", message=w103) -> (T Button?=w102)
                w1 = w97
              }
            }
            Logical Or(w102, w96) -> w104
            stop if w104
          }
        }
      }
    }
  }
  $"Error Out" <- w1
  $"Detected?" <- w2
