vi "Dark current Measurement.gvi"   [LabVIEW NXG 5.0.0]
inputs:
  "Keithley Address": "VISA Instr"
  "Fiannium Pe Handler": u64
  "Close Coms after finish?": bool
  "Monochromator": bool
  "Dark Current Aveages": i32 = 3
  "Error In": error
outputs:
  "Pe Handle out": u64
  "Dark current Value": f64
  "Error Out": error
  "Keythley address out": "VISA Instr"
panel indicators:
  "Dark current measurements": f64[]
uses:
  Labview_NXG_Keithley_SMU_2450_2460_2461::Configure::Set Measurement Count.gvi
  Labview_NXG_Keithley_SMU_2450_2460_2461::Configure::Clear Buffer.gvi
  Labview_NXG_Keithley_SMU_2450_2460_2461::Action Status::Enable Output.gvi
  EQE_Measuring_Setup_NanOpto::SubVis::FGV::Current State FGV.gvi
  EQE_Measuring_Setup_NanOpto::SubVis::Instrument Control::Monochromator::Set Wavelength Function.gvi
  Labview_NXG_Keithley_SMU_2450_2460_2461::Data::Make Reading and Store in Buffer.gvi
  Labview_NXG_Keithley_SMU_2450_2460_2461::Data::Read (Multiple Points).gvi
  EQE_Measuring_Setup_NanOpto::SubVis::Instrument Control::Keithley::Dark current timeout notification.gvi
  NI::Analysis::Statistics::Mean (DBL).gvi
  Labview_NXG_Keithley_SMU_2450_2460_2461::Miscelaneous::Close.gvi
  EQE_Measuring_Setup_NanOpto::SubVis::Instrument Control::Monochromator::Fiannium wavelength correction.gvi
  PE_Filter_SDK::PE Set Wavelength On Grating.gvi
  PE_Filter_SDK::PE Close.gvi
  PE_Filter_SDK::PE Destroy.gvi
diagram:
  case ($"Error In") {
    frame Error, Default {
      w1 = $"Error In"
    }
    frame No Error {
      call "Set Measurement Count.gvi"(VISA resource name=$"Keithley Address", Measurement Count=$"Dark Current Aveages", error in (no error)=$"Error In") -> (VISA resource name out=w2, error out=w3)
      call "Clear Buffer.gvi"(VISA resource name=w2, error in (no error)=w3) -> (VISA resource name out=w4, error out=w5)
      call "Enable Output.gvi"(VISA resource name=w4, Enable Output (T: Enable)=TRUE, error in (no error)=w5) -> (VISA resource name out=w6, error out=w7)
      call "Current State FGV.gvi"(Instruction Current State FGV="Set Current SubState", Current SubState="Measuring Dark Current", Error In=w7) -> (Error Out=w8)
      call "Set Wavelength Function.gvi"(PE Fiannium Handle In=$"Fiannium Pe Handler", Wavelength=350, Monochromator=$Monochromator, Error In=w8) -> (PE Fiannium Handle Out=w9, Error Out=w10)
      call "Make Reading and Store in Buffer.gvi"(VISA resource name=w6, error in (no error)=w10) -> (VISA resource name out=w11, error out=w12)
      call "Read (Multiple Points).gvi"(VISA resource name=w11, Timeout (10000 ms)=60000, Start Index (1)=1, End Index (1)=$"Dark Current Aveages", error in (no error)=w12) -> (VISA resource name out=w13, Data out=w14, error out=w15)
      Spreadsheet String To Array(array type=f64[] [], delimiter=",", format string="%g", spreadsheet string=w14) -> (array=w16)
      $"Dark current measurements" <- w16
      call "Dark current timeout notification.gvi"(error out_2=w15) -> (error in_2=w17)
      call "Mean (DBL).gvi"(x=w16, error in=w17) -> (mean=w18, error out=w19)
      call "Enable Output.gvi"(VISA resource name=w13, Enable Output (T: Enable)=FALSE, error in (no error)=w19) -> (VISA resource name out=w20, error out=w21)
      call "Clear Buffer.gvi"(VISA resource name=w20, error in (no error)=w21) -> (VISA resource name out=w22, error out=w23)
      case ($"Close Coms after finish?") {
        frame False, Default {
          $"Pe Handle out" <- w9
          $"Keythley address out" <- w22
          w1 = w23
        }
        frame True {
          call "Close.gvi"(VISA resource name=w22, error in (no error)=w23) -> (error out=w24)
          call "Fiannium wavelength correction.gvi"(Desired wavelength=550) -> (Grating for the system=w25, Wavelength for the system=w26)
          call "PE Set Wavelength On Grating.gvi"(peHandle=w9, gratingIndex=w25, wavelength=w26, error in (no error)=w24) -> (peHandle out=w27, error out=w28)
          call "PE Close.gvi"(peHandle=w27, error in (no error)=w28) -> (peHandle out=w29, error out=w30)
          call "PE Destroy.gvi"(peHandle=w29, error in (no error)=w30) -> (error out=w1)
        }
      }
      $"Dark current Value" <- w18
    }
  }
  $"Error Out" <- w1
