vi "Dark current timeout notification.gvi"   [LabVIEW NXG 3.1.0]
inputs:
  "error out_2": error
outputs:
  "error in_2": error
uses:
  NI::G Core::Error::Read Description.gvi
  NI::G Core::Error::Clear Error Cluster.gvi
diagram:
  case ($"error out_2") {
    frame Error, Default {
      call "Read Description.gvi"(error in=$"error out_2") -> (description=w2)
      Search And Replace String(input string=w2, search string="imeou") -> (number of replacements=w3)
      Is Greater Than 0(x=w3) -> w4
      case (w4) {
        frame False, Default {
          w1 = $"error out_2"
        }
        frame True {
          w5 = """The dark current measurement
has timed out. Please make sure that
there is something connected to the 
keithley and retry (The measurement
will continue without the dark current). """
          One Button Dialog(button name ("OK")="Oh, sorry i will", message=w5)
          call "Clear Error Cluster.gvi"(error in=$"error out_2") -> (error out=w1)
        }
      }
    }
    frame No Error {
      w1 = $"error out_2"
    }
  }
  $"error in_2" <- w1
