vi "Keithley Initialization Sequence.gvi"   [LabVIEW NXG 5.0.0]
inputs:
  "Error In": error
  "VISA resource name": "VISA Instr"
    # Specifies which instrument to use.  Instruments that are powered on and connected to your computer are visible in the VISA resource name pull-down menu.  Select the resource name from the VISA resource name pull-down menu.  If your instrument does not appear in this list, enter the instrument descriptor using the following format:
    # Interface Type[board index]::Address::INSTR.
    # Examples:
    # GPIB:  GPIB::22::INSTR,  GPIB board 0, primary address 22
    # Serial:  COM1
    # TCP/IP Instr:  TCPIP::10.0.32.48::INSTR
    # TCP/IP Socket: TCPIP::10.0.32.45::3800::SOCKET
    # USB Instr:  selectable from VISA Resource Name pull-down menu
    # USB Raw:  You must first link VISA to non-USBTMC instruments by using the VISA Driver Development Wizard
    # VISA Alias:  "SampleInstr" - Alias names are configured in MAX
    # Refer to the LabVIEW Help for more information about specifying a VISA resource name.
  "Voltage Applied (V)": f64
  "Source Limit Level (0.1)": f64 = 0.1
  "Enable Auto Range": bool = TRUE
  "Manual Current Range": f64
  "Current Averages": i32 = 3
outputs:
  "VISA resource name out": "VISA Instr"
  "Error Out": error
uses:
  EQE_Measuring_Setup_NanOpto::SubVis::FGV::Current State FGV.gvi
  EQE_Measuring_Setup_NanOpto::SubVis::Utilities::Other::Order of magnitude extractor.gvi
  Labview_NXG_Keithley_SMU_2450_2460_2461::Miscelaneous::Initialize.gvi
  Labview_NXG_Keithley_SMU_2450_2460_2461::Configure::Configure Measurement Range.gvi
  Labview_NXG_Keithley_SMU_2450_2460_2461::Configure::Configure Output.gvi
  Labview_NXG_Keithley_SMU_2450_2460_2461::Configure::Configure Source Function.gvi
  Labview_NXG_Keithley_SMU_2450_2460_2461::Configure::Configure Measurement Function.gvi
  Labview_NXG_Keithley_SMU_2450_2460_2461::Configure::Set Measurement Count.gvi
diagram:
  case ($"Error In") {
    frame Error, Default {
      w1 = $"Error In"
    }
    frame No Error {
      call "Current State FGV.gvi"(Instruction Current State FGV="Set Current SubState", Current SubState="Initializing Keithley", Error In=$"Error In") -> (Error Out=w2)
      In Range And Coerce(lower limit=1e-08, upper limit=1, x=$"Manual Current Range") -> (coerced(x)=w3)
      call "Order of magnitude extractor.gvi"(Number to extract order of magnitude=w3, Error In=w2) -> (Order of magnitude=w4, Error Out=w5)
      # Configure the output
      # and the source function.
      Select(s=$"Enable Auto Range", t=$"Source Limit Level (0.1)", f=w4) -> w6
      call "Initialize.gvi"(VISA resource name=$"VISA resource name", error in (no error)=w5) -> (VISA resource name out=w7, error out=w8)
      call "Configure Measurement Range.gvi"(VISA resource name=w7, Function (0: Volts)="Volts"(0), Enable Auto Range (T:Enable)=TRUE, error in (no error)=w8) -> (VISA resource name out=w9, error out=w10)
      # Configure each of the three measurements.
      call "Configure Measurement Range.gvi"(Manual Range (1.0)=w4, VISA resource name=w9, Function (0: Volts)="Current"(1), Enable Auto Range (T:Enable)=$"Enable Auto Range", error in (no error)=w10) -> (VISA resource name out=w11, error out=w12)
      call "Configure Output.gvi"(VISA resource name=w11, Source Level (0)=$"Voltage Applied (V)", Source Mode (0: Voltage)="Voltage"(0), Source Limit Level (0.1)=w6, error in (no error)=w12) -> (VISA resource name out=w13, error out=w14)
      call "Configure Source Function.gvi"(VISA resource name=w13, Function (0: Volts)="Voltage"(0), error in (no error)=w14) -> (VISA resource name out=w15, error out=w16)
      call "Configure Measurement Function.gvi"(VISA resource name=w15, Function (0: Volts)="Current"(1), error in (no error)=w16) -> (VISA resource name out=w17, error out=w18)
      call "Set Measurement Count.gvi"(VISA resource name=w17, Measurement Count=$"Current Averages", error in (no error)=w18) -> (VISA resource name out=w19, error out=w1)
      $"VISA resource name out" <- w19
    }
  }
  $"Error Out" <- w1
