vi "Check Monochromator Config File.gvi"   [LabVIEW NXG 3.1.0]
inputs:
  "error out": error
  "Visible infrared": "Visible infrared enum.gtype" = "Visible monochromator file"
outputs:
  "error in": error
  "Fiannium Config file path": path
types:
  "Visible infrared enum.gtype" = enum{"Visible monochromator file", "Infrared monochromator file"}
uses:
  NI::G Core::File IO (General)::Check if File or Folder Exists.gvi
  EQE_Measuring_Setup_NanOpto::SubVis::Utilities::Messages And Prompts::Select file prompt.gvi
diagram:
  case ($"error out") {
    frame Error, Default {
      w1 = $"error out"
    }
    frame No Error {
      case ($"Visible infrared") {
        frame "Infrared monochromator file" {
          w3 = "Extra installers\\Fiannium\\LLTF\\PHySpec Installer (M000010103)\\configuration\\Devices\\M000010103.xml"
          Get Component Directory() -> (Path=w4)
          Strip Path(path=w4) -> (stripped path=w5)
          Build Path(base path=w5, name or relative path=w3) -> (appended path=w6)
          s1 = w6  # shift register
          while (iteration -> i1) {
            Wait Until Next Multiple(multiple to wait=500)
            call "Check if File or Folder Exists.gvi"(file or folder=s1, error in=$"error out") -> (file or folder exists?=w7, error out=w8)
            case (w7) {
              frame False, Default {
                w12 = "I will make sure\nthe file is placed\nback where it \nbelongs"
                Path To String(path=s1) -> (string=w13)
                w14 = "\nPlease make sure that the file is put back on that\nlocation or provide an alternative path with the file."
                w15 = "I could not find the Fiannium Configuration file in \nthis location:\n"
                Concatenate Strings(w15, w13, w14) -> w16
                Two Button Dialog(F button name ("Cancel")=w12, T button name ("OK")="I will provide an\nalternative path", message=w16) -> (T Button?=w17)
                case (w17) {
                  frame False, Default {
                    w10 = w8
                    w11 = s1
                  }
                  frame True {
                    w18 = "It can also be this one if you use the IR fiannium: M000010103.xml"
                    w19 = "Please select the fiannium configuration file\nI t looks like this: M000010092.xml"
                    call "Select file prompt.gvi"(Main Message=w19, Sub message=w18, Error In=w8) -> (New Path=w11, Error Out=w10)
                  }
                }
                w9 = FALSE
              }
              frame True {
                w9 = TRUE
                w10 = w8
                w11 = s1
              }
            }
            Is Greater(x=i1, y=5) -> w20
            case (w20) {
              frame False, Default {
                w1 = w10
                w21 = FALSE
              }
              frame True {
                w22 = """Seems you're having some trouble
finding the monochromator config
file, do you want to proceed without it
and hope for the best?
(WARNING: some functionalities might
be compromized, or the entire program 
can crash)"""
                Two Button Dialog(F button name ("Cancel")="Oh dear no, I'd rather ask for help", T button name ("OK")="Yes please, I like to live dangerously", message=w22) -> (T Button?=w21)
                w1 = w10
              }
            }
            Logical Or(w21, w9) -> w23
            next s1 = w11
            stop if w23
          }
          w2 = s1
        }
        frame "Visible monochromator file", Default {
          w24 = "Extra installers\\Fiannium\\LLTF\\PHySpec Installer (M000010103)\\configuration\\Devices\\M000010092.xml"
          Get Component Directory() -> (Path=w25)
          Strip Path(path=w25) -> (stripped path=w26)
          Build Path(base path=w26, name or relative path=w24) -> (appended path=w27)
          s2 = w27  # shift register
          while (iteration -> i2) {
            Wait Until Next Multiple(multiple to wait=500)
            call "Check if File or Folder Exists.gvi"(file or folder=s2, error in=$"error out") -> (file or folder exists?=w28, error out=w29)
            case (w28) {
              frame False, Default {
                w33 = "I will make sure\nthe file is placed\nback where it \nbelongs"
                Path To String(path=s2) -> (string=w34)
                w35 = "\nPlease make sure that the file is put back on that\nlocation or provide an alternative path with the file."
                w36 = "I could not find the Fiannium Configuration file in \nthis location:\n"
                Concatenate Strings(w36, w34, w35) -> w37
                Two Button Dialog(F button name ("Cancel")=w33, T button name ("OK")="I will provide an\nalternative path", message=w37) -> (T Button?=w38)
                case (w38) {
                  frame False, Default {
                    Wait Until Next Multiple(multiple to wait=5000)
                    w31 = w29
                    w32 = s2
                  }
                  frame True {
                    w39 = "It can also be this one if you use the IR fiannium: M000010103.xml"
                    w40 = "Please select the fiannium configuration file\nI t looks like this: M000010092.xml"
                    call "Select file prompt.gvi"(Main Message=w40, Sub message=w39, Error In=w29) -> (New Path=w32, Error Out=w31)
                  }
                }
                w30 = FALSE
              }
              frame True {
                w30 = TRUE
                w31 = w29
                w32 = s2
              }
            }
            Is Greater(x=i2, y=5) -> w41
            case (w41) {
              frame False, Default {
                w1 = w31
                w42 = FALSE
              }
              frame True {
                w43 = """Seems you're having some trouble
finding the monochromator config
file, do you want to proceed without it
and hope for the best?
(WARNING: some functionalities might
be compromized, or the entire program 
can crash)"""
                Two Button Dialog(F button name ("Cancel")="Oh dear no, I'd rather ask for help", T button name ("OK")="Yes please, I like to live dangerously", message=w43) -> (T Button?=w42)
                w1 = w31
              }
            }
            Logical Or(w42, w30) -> w44
            next s2 = w32
            stop if w44
          }
          w2 = s2
        }
      }
      $"Fiannium Config file path" <- w2
    }
  }
  $"error in" <- w1
