vi "Fiannium Wavelength Calibration.gvi"   [LabVIEW NXG 3.1.0]
panel controls:
  "Wavelength Step (nm)": f64 = 1
  "End Wavelength (nm)": f64 = 1100
  "Start Wavelength (nm)": f64 = 400
  "stop": bool
  "millisecond multiple": u32 = 1
  "Powermeter Averages": u16 = 5
  "Calibration types": T1 = "Grating Calibration"
panel indicators:
  "Current Wavelength": f64
  "Calibration Graph Power": cluster{"Wavelength": f64[], "Power": f64[]}[]
  "Power W": f64
  "Output Power": cluster{"Wavelength": f64[], "Power": f64[]}[]
  "Current A": f64
  "Calibration Graph Current": cluster{"Wavelength": f64[], "Current": f64[]}[]
  "Output Current": cluster{"Wavelength": f64[], "Power": f64[]}[]
  "EQE %": f64
  "Calibration Graph EQE": cluster{"Wavelength": f64[], "EQE": f64[]}[]
  "Output EQE": cluster{"Wavelength": f64[], "Power": f64[]}[]
types:
  T1 = enum{"Grating Calibration", "Filter Calibration", "Final Check"}
uses:
  EQE_Measuring_Setup_NanOpto::SubVis::Instrument Control::Arduinos::Arduino Detector.gvi
  PE_Filter_SDK::Monochromator Initialization Sequence.gvi
  EQE_Measuring_Setup_NanOpto::SubVis::Utilities::Other::Wavelength loop calculation.gvi
  Main::Photodetector initialization Sequence with prompt.gvi
  PE_Filter_SDK::PE Set Wavelength On Grating.gvi
  Main::TLPM Set Wavelength.gvi
  Main::TLPM Set Average Count.gvi
  Main::TLPM Measure Power.gvi
  EQE_Measuring_Setup_NanOpto::SubVis::Instrument Control::Arduinos::Filter Flipper Arduino::Arduino Filter Flipper Control.gvi
  EQE_Measuring_Setup_NanOpto::SubVis::Instrument Control::Monochromator::Fiannium wavelength correction.gvi
  EQE_Measuring_Setup_NanOpto::SubVis::Instrument Control::Monochromator::Filter Change Wavelength.gvi
  Main::TLPM Measure Current.gvi
  Main::TLPM Close.gvi
  PE_Filter_SDK::PE Close.gvi
  PE_Filter_SDK::PE Destroy.gvi
diagram:
  call "Arduino Detector.gvi"() -> (Filter Arduino Address=w1, Error Out=w2)
  w3 = path "C:\\Users\\Agustín\\Desktop\\EQE_ASD\\LLTF\\PHySpec Installer (M000010103)\\configuration\\Devices\\M000010092.xml"
  call "Monochromator Initialization Sequence.gvi"(Configuration File=w3, Error In=w2) -> (peHandle out=w4, Error Out=w5)
  w6 = $"Wavelength Step (nm)"
  w7 = $"Start Wavelength (nm)"
  call "Wavelength loop calculation.gvi"(Wavelength Step (nm)=w6, End Wavelength (nm)=$"End Wavelength (nm)", Start Wavelength (nm)=w7) -> (Ammount of steps +1 (for the loop)=w8, Positive or negative steps=w9)
  call "Photodetector initialization Sequence with prompt.gvi"(Error In=w5) -> (Photodetector IVI session=w10, Error Out=w11)
  case ($"Calibration types") {
    frame "Grating Calibration", Default {
      s1 = w10  # shift register
      for {
        w19 = each element of [0, 1]
        s2 = s1  # shift register
        for (N = w8) (iteration -> i1) {
          Wait Until Next Multiple(multiple to wait=$"millisecond multiple")
          Multiply(w9, i1, w6) -> w22
          Add(w22, w7) -> w23
          call "PE Set Wavelength On Grating.gvi"(peHandle=w4, gratingIndex=w19, wavelength=w23, error in (no error)=w11) -> (peHandle out=w16, error out=w24)
          call "TLPM Set Wavelength.gvi"(IVI session in=s2, Wavelength (0.0)=w23, error in (no error)=w24) -> (IVI session out=w25, error out=w26)
          call "TLPM Set Average Count.gvi"(IVI session in=w25, Average Count (1)=$"Powermeter Averages", error in (no error)=w26) -> (IVI session out=w27, error out=w28)
          call "TLPM Measure Power.gvi"(IVI session in=w27, error in (no error)=w28) -> (IVI session out=w29, Power=w30, error out=w14)
          $"Power W" <- w30
          $"Current Wavelength" <- w23
          append w23 to w20
          append w30 to w21
          next s2 = w29
          stop if $stop
        }
        w31 = cluster{"Wavelength": f64[], "Power": f64[]} {all zero or empty}
        Property Node(instance in=w31, "Wavelength"=w20, "Power"=w21) -> (instance out=w32)
        append w32 to w12
        append w32 to w15
        next s1 = s2
      }
      w13 = s1
      w17 = default
      w18 = default
    }
    frame "Filter Calibration" {
      s3 = w10  # shift register
      for {
        w33 = each element of ["Visible Pass", "IR Pass"]
        call "Arduino Filter Flipper Control.gvi"(Arduino Filter Flipper Address In=w1, Pass Filter=w33, Error In=w11) -> (Error Out=w34)
        s4 = s3  # shift register
        for (N = w8) (iteration -> i2) {
          Wait Until Next Multiple(multiple to wait=$"millisecond multiple")
          Multiply(w9, i2, w6) -> w37
          Add(w37, w7) -> w38
          call "Fiannium wavelength correction.gvi"(Desired wavelength=w38) -> (Grating for the system=w39, Wavelength for the system=w40)
          call "PE Set Wavelength On Grating.gvi"(peHandle=w4, gratingIndex=w39, wavelength=w40, error in (no error)=w34) -> (peHandle out=w16, error out=w41)
          call "TLPM Set Wavelength.gvi"(IVI session in=s4, Wavelength (0.0)=w38, error in (no error)=w41) -> (IVI session out=w42, error out=w43)
          call "TLPM Set Average Count.gvi"(IVI session in=w42, Average Count (1)=$"Powermeter Averages", error in (no error)=w43) -> (IVI session out=w44, error out=w45)
          call "TLPM Measure Power.gvi"(IVI session in=w44, error in (no error)=w45) -> (IVI session out=w46, Power=w47, error out=w14)
          $"Power W" <- w47
          $"Current Wavelength" <- w38
          append w38 to w35
          append w47 to w36
          next s4 = w46
          stop if $stop
        }
        w48 = cluster{"Wavelength": f64[], "Power": f64[]} {all zero or empty}
        Property Node(instance in=w48, "Wavelength"=w35, "Power"=w36) -> (instance out=w49)
        append w49 to w12
        append w49 to w15
        next s3 = s4
      }
      w13 = s3
      w17 = default
      w18 = default
    }
    frame "Final Check" {
      call "Arduino Filter Flipper Control.gvi"(Arduino Filter Flipper Address In=w1, Pass Filter="Visible Pass", Error In=w11) -> (Error Out=w50)
      s5 = w10  # shift register
      s6 = w7  # shift register
      for (N = w8) (iteration -> i3) {
        Wait Until Next Multiple(multiple to wait=$"millisecond multiple")
        Multiply(w9, i3, w6) -> w55
        Add(w55, w7) -> w56
        $"Current Wavelength" <- w56
        call "Filter Change Wavelength.gvi"() -> (Wavelength of filter Change=w57)
        Is Greater Or Equal(x=w56, y=w57) -> w58
        Is Greater Or Equal(x=s6, y=w57) -> w59
        Logical Exclusive Or(w58, w59) -> w60
        case (w60) {
          frame False, Default {
            w61 = w50
          }
          frame True {
            Is Greater(x=w56, y=s6) -> w62
            Select(s=w62, t="IR Pass", f="Visible Pass") -> w63
            call "Arduino Filter Flipper Control.gvi"(Arduino Filter Flipper Address In=w1, Pass Filter=w63, Error In=w50) -> (Error Out=w61)
          }
        }
        call "Fiannium wavelength correction.gvi"(Desired wavelength=w56) -> (Grating for the system=w64, Wavelength for the system=w65)
        call "PE Set Wavelength On Grating.gvi"(peHandle=w4, gratingIndex=w64, wavelength=w65, error in (no error)=w61) -> (peHandle out=w16, error out=w66)
        call "TLPM Set Wavelength.gvi"(IVI session in=s5, Wavelength (0.0)=w56, error in (no error)=w66) -> (IVI session out=w67, error out=w68)
        call "TLPM Set Average Count.gvi"(IVI session in=w67, Average Count (1)=$"Powermeter Averages", error in (no error)=w68) -> (IVI session out=w69, error out=w70)
        call "TLPM Measure Current.gvi"(IVI session in=w69, error in (no error)=w70) -> (IVI session out=w71, Current=w72, error out=w73)
        $"Current A" <- w72
        Divide(x=1240, y=w56) -> w74
        call "TLPM Measure Power.gvi"(IVI session in=w71, error in (no error)=w73) -> (IVI session out=w75, Power=w76, error out=w14)
        Divide(x=w72, y=w76) -> w77
        Multiply(w77, w74, 100) -> w78
        Absolute Value(x=w78) -> w79
        $"EQE %" <- w79
        $"Power W" <- w76
        append w56 to w51
        append w76 to w52
        append w72 to w53
        append w79 to w54
        next s5 = w75
        next s6 = w56
        stop if $stop
      }
      w80 = cluster{"Wavelength": f64[], "Current": f64[]} {all zero or empty}
      Property Node(instance in=w80, "Wavelength"=w51, "Current"=w53) -> (instance out=w81)
      Build Array(w81) -> w17
      w82 = cluster{"Wavelength": f64[], "EQE": f64[]} {all zero or empty}
      Property Node(instance in=w82, "Wavelength"=w51, "EQE"=w54) -> (instance out=w83)
      Build Array(w83) -> w18
      w84 = cluster{"Wavelength": f64[], "Power": f64[]} {all zero or empty}
      Property Node(instance in=w84, "Wavelength"=w51, "Power"=w52) -> (instance out=w85)
      Build Array(w85) -> w12
      w13 = s5
      w15 = w12
    }
  }
  call "TLPM Close.gvi"(IVI session in=w13, error in (no error)=w14) -> (error out=w86)
  call "PE Close.gvi"(peHandle=w16, error in (no error)=w86) -> (peHandle out=w87, error out=w88)
  call "PE Destroy.gvi"(peHandle=w87, error in (no error)=w88)
  $"Calibration Graph Current" <- w17
  $"Output Current" <- w17
  $"Calibration Graph Power" <- w12
  $"Calibration Graph EQE" <- w18
  $"Output EQE" <- w18
  $"Output Power" <- w15
