vi "Fiannium wavelength correction.gvi"   [LabVIEW NXG 5.0.0]
inputs:
  "Desired wavelength": f64
  "Monocrhomator": bool
outputs:
  "Wavelength for the system": f64
  "Grating for the system": i64
uses:
  EQE_Measuring_Setup_NanOpto::SubVis::Instrument Control::Monochromator::Grating Change Wavelength IR.gvi
  EQE_Measuring_Setup_NanOpto::SubVis::Instrument Control::Monochromator::Grating Change Wavelength Visible.gvi
diagram:
  case (TRUE) {
    frame False, Default {
      w1 = $"Desired wavelength"
      w2 = 0
    }
    frame True {
      Add($"Desired wavelength", 1.3) -> w3
      Subtract(x=$"Desired wavelength", y=4.7) -> w4
      call "Grating Change Wavelength IR.gvi"() -> (Grating Change Wavelength=w5)
      call "Grating Change Wavelength Visible.gvi"() -> (Grating Change Wavelength=w6)
      Select(s=$Monocrhomator, t=w5, f=w6) -> w7
      Is Greater(x=$"Desired wavelength", y=w7) -> w8
      Select(s=w8, t=w3, f=w4) -> w1
      Select(s=w8, t=1, f=0) -> w2
    }
  }
  $"Wavelength for the system" <- w1
  $"Grating for the system" <- w2
