vi "Filter Wavelength crossing ligth cal ka.gvi"   [LabVIEW NXG 3.1.0]
inputs:
  "Start Wavelength": f64
  "End Wavelength": f64
outputs:
  "Crosses the filter change wavelength?": bool
uses:
  EQE_Measuring_Setup_NanOpto::SubVis::Instrument Control::Monochromator::Filter Change Wavelength.gvi
diagram:
  call "Filter Change Wavelength.gvi"() -> (Wavelength of filter Change=w1)
  Is Less(x=$"Start Wavelength", y=w1) -> w2
  Is Less(x=$"End Wavelength", y=w1) -> w3
  Logical And(w2, w3) -> w4
  Is Greater Or Equal(x=$"Start Wavelength", y=w1) -> w5
  Is Greater Or Equal(x=$"End Wavelength", y=w1) -> w6
  Logical And(w5, w6) -> w7
  Logical Exclusive Or[output inverted](w4, w7) -> w8
  $"Crosses the filter change wavelength?" <- w8
