vi "Filter Wavelength nm Crossing ka.gvi"   [LabVIEW NXG 3.1.0]
inputs:
  "Light Power Calibration Data": f64[][]
outputs:
  "Crosses the Change Grating Wavelength Frontier?": bool
uses:
  EQE_Measuring_Setup_NanOpto::SubVis::Instrument Control::Monochromator::Filter Change Wavelength.gvi
diagram:
  for {
    w1 = each element of $"Light Power Calibration Data"
    call "Filter Change Wavelength.gvi"() -> (Wavelength of filter Change=w4)
    Array Index(array=w1) -> (out0[0]=w5)
    Is Less(x=w5, y=w4) -> w6
    Is Greater Or Equal(x=w5, y=w4) -> w7
    append w6 to w2
    append w7 to w3
  }
  Or Array Elements(Boolean array=w2) -> (logical OR=w8)
  Or Array Elements(Boolean array=w3) -> (logical OR=w9)
  Logical And(w8, w9) -> w10
  $"Crosses the Change Grating Wavelength Frontier?" <- w10
