vi "Set Desired Wavelength Slave Subroutine.gvi"   [LabVIEW NXG 3.1.0]
inputs:
  "Queue In": Queue<"Queue instructions.gtype">
  "Monochromator configuration file": path
  "Desired λ (nm)": f64 = 500
  "Error In": error
outputs:
  "Queue Out": Queue<"Queue instructions.gtype">
  "Error Out": error
types:
  "Queue instructions.gtype" = enum{"Initialize App", "Light Calibration", "Measure Photodetector", "Measure Keithley", "Instrument detection", "Single Acquire", "Multiple Acquire", "EQE Mapping", "Debugging mode", "Move Arduino", "Arduino FF flip filter", "Help routine", "Idle", "Save Calibration", "Load Calibration", "Set Wavelength", "Turn supercontinuum laser on/off", "Set Multiplex arduino cell", "Save TXT EQE file", "Load TXT EQE", "Stop or Idle", "Stop App"}
uses:
  EQE_Measuring_Setup_NanOpto::SubVis::FGV::Current State FGV.gvi
  PE_Filter_SDK::Monochromator Initialization Sequence.gvi
  EQE_Measuring_Setup_NanOpto::SubVis::Instrument Control::Monochromator::Fiannium wavelength correction.gvi
  PE_Filter_SDK::PE Set Wavelength On Grating.gvi
  PE_Filter_SDK::PE Close.gvi
  PE_Filter_SDK::PE Destroy.gvi
diagram:
  # This SubVi Sets any desired wavelength on the monochromator
  case ($"Error In") {
    frame Error, Default {
      w1 = $"Error In"
      w2 = $"Queue In"
    }
    frame No Error {
      w3 = "Idle"  # Enum instructions
      call "Current State FGV.gvi"(Instruction Current State FGV="Set current State", Crrent State="Set Wavelength", Error In=$"Error In") -> (Error Out=w4)
      call "Monochromator Initialization Sequence.gvi"(Configuration File=$"Monochromator configuration file", Error In=w4) -> (peHandle out=w5, Error Out=w6)
      call "Fiannium wavelength correction.gvi"(Desired wavelength=$"Desired λ (nm)") -> (Grating for the system=w7, Wavelength for the system=w8)
      call "PE Set Wavelength On Grating.gvi"(peHandle=w5, gratingIndex=w7, wavelength=w8, error in (no error)=w6) -> (peHandle out=w9, error out=w10)
      call "PE Close.gvi"(peHandle=w9, error in (no error)=w10) -> (peHandle out=w11, error out=w12)
      call "PE Destroy.gvi"(peHandle=w11, error in (no error)=w12) -> (error out=w13)
      Enqueue Element(element=w3, error in=w13, queue=$"Queue In") -> (error out=w1, queue out=w2)
    }
  }
  $"Queue Out" <- w2
  $"Error Out" <- w1
