vi "Set Wavelength Function.gvi"   [LabVIEW NXG 5.0.0]
inputs:
  "PE Fiannium Handle In": u64
  "Wavelength": f64
  "Error In": error
  "Monochromator": bool
outputs:
  "PE Fiannium Handle Out": u64
  "Error Out": error
uses:
  EQE_Measuring_Setup_NanOpto::SubVis::Instrument Control::Monochromator::Fiannium wavelength correction.gvi
  PE_Filter_SDK::PE Set Wavelength On Grating.gvi
  PE_Filter_SDK::PE Set Wavelength.gvi
diagram:
  # This function sets the wavelength depending on which monochromator
  # we are using
  case ($"Error In") {
    frame Error, Default {
      w1 = $"PE Fiannium Handle In"
      w2 = $"Error In"
    }
    frame No Error {
      case ($Monochromator) {
        frame False, Default {
          call "Fiannium wavelength correction.gvi"(Desired wavelength=$Wavelength, Monocrhomator=$Monochromator) -> (Grating for the system=w3, Wavelength for the system=w4)
          call "PE Set Wavelength On Grating.gvi"(peHandle=$"PE Fiannium Handle In", gratingIndex=w3, wavelength=w4, error in (no error)=$"Error In") -> (peHandle out=w1, error out=w2)
        }
        frame True {
          call "Fiannium wavelength correction.gvi"(Desired wavelength=$Wavelength, Monocrhomator=$Monochromator) -> (Wavelength for the system=w5)
          call "PE Set Wavelength.gvi"(peHandle=$"PE Fiannium Handle In", wavelength=w5, error in (no error)=$"Error In") -> (peHandle out=w1, error out=w2)
        }
      }
    }
  }
  $"PE Fiannium Handle Out" <- w1
  $"Error Out" <- w2
