vi "Supercontinuum Current Power Detection.gvi"   [LabVIEW NXG 3.1.0]
inputs:
  "Error In": error
  "Supercontinuum Laser Address In": "VISA Instr"
outputs:
  "Is Laser Turned On?": bool
  "Laser Current Power": f64
  "Error Out": error
uses:
  NI::VISA::Configure Serial Port (Instr).gvi
  NI::VISA::Open (Instr).gvi
  NI::VISA::Write (Instr, String).gvi
  NI::VISA::Read (Instr, String).gvi
  NI::VISA::Close (Instr).gvi
diagram:
  case ($"Error In") {
    frame Error, Default {
      w1 = $"Error In"
    }
    frame No Error {
      call "Configure Serial Port (Instr).gvi"(stop bits="1.0"(10), flow control="None"(0), session in=$"Supercontinuum Laser Address In", error in=$"Error In", baud rate=19200, data bits=8, parity="None"(0)) -> (session out=w2, error out=w3)
      call "Open (Instr).gvi"(resource name=w2, error in=w3, access mode="Load Configured Settings"(4)) -> (session out=w4, error out=w5)
      Concatenate Strings("Q?", "\r\n") -> w6
      call "Write (Instr, String).gvi"(session in=w4, error in=w5, write buffer=w6) -> (session out=w7, error out=w8)
      call "Read (Instr, String).gvi"(session in=w7, error in=w8, byte count=256) -> (session out=w9, error out=w10, read buffer=w11)
      call "Close (Instr).gvi"(session in=w9, error in=w10) -> (error out=w12)
      Search And Replace String(error in (no error)=w12, input string=w11, search string="Puma drive is 0") -> (error out=w13, number of replacements=w14)
      Search And Replace String(error in (no error)=w13, input string=w11, search string="Puma drive is") -> (error out=w15, number of replacements=w16)
      Is Not Equal To 0(x=w16) -> w17
      Search And Replace String(error in (no error)=w15, input string=w11, search string="q0") -> (error out=w18, number of replacements=w19)
      Search And Replace String(error in (no error)=w18, input string=w11, search string="q") -> (error out=w1, number of replacements=w20)
      Is Not Equal To 0(x=w20) -> w21
      Logical And(not w21, not w17) -> w22
      case (w22) {
        frame False, Default { }
        frame True {
          w23 = """There seems to be a problem
contacting the laser, please 
plug it in correctly and restart
the application. 
If the problem persists arsk for 
help.
minusmagis@hotmail.com"""
          One Button Dialog(button name ("OK")="Okay I'll try again", message=w23)
        }
      }
      Select(s=w21, t=1, f=14) -> w24
      Is Not Equal To 0(x=w19) -> w25
      Is Not Equal To 0(x=w14) -> w26
      Logical Or(w25, w26) -> w27
      Select(s=w27, t=1, f=4) -> w28
      String Subset(length (rest)=w28, offset (0)=w24, string=w11) -> w29
      Floating Point String To Number(string=w29) -> (number=w30)
      $"Laser Current Power" <- w30
      Logical And(w17, not w26) -> w31
      Logical And(not w25, w21) -> w32
      Logical Or(w32, w31) -> w33
      Logical And(w33, not w1) -> w34
      $"Is Laser Turned On?" <- w34
    }
  }
  $"Error Out" <- w1
