vi "Supercontinuum Detection.gvi"   [LabVIEW NXG 5.0.0]
inputs:
  "Error In": error
outputs:
  "Supercontinuum laser Address": "VISA Instr"
  "Found?": bool
  "Error Out": error
panel indicators:
  "found resources": string[]
  "Coms list": string[]
uses:
  NI::VISA::Find Resource (Search Resources).gvi
  NI::VISA::Configure Serial Port (Instr).gvi
  NI::VISA::Open (Instr).gvi
  NI::VISA::Write (Instr, String).gvi
  NI::VISA::Read (Instr, String).gvi
  NI::VISA::Close (Instr).gvi
  NI::G Core::Error::Clear Error Cluster.gvi
diagram:
  case ($"Error In") {
    frame Error, Default {
      w1 = $"Error In"
    }
    frame No Error {
      call "Find Resource (Search Resources).gvi"(error in=$"Error In") -> (found resources=w2, error out=w3)
      $"found resources" <- w2
      for {
        w4 = each element of w2
        Search And Replace String(error in (no error)=w3, input string=w4, search string="ASRL") -> (error out=w8, number of replacements=w9)
        Is Not Equal To 0(x=w9) -> w10
        case (w10) {
          frame False, Default {
            w11 = w8
            w12 = ""
            w13 = ""
          }
          frame True {
            Type Cast(type="VISA Instr" "", x=w4) -> w14
            call "Configure Serial Port (Instr).gvi"(stop bits="1.0"(10), flow control="None"(0), session in=w14, error in=w8, baud rate=19200, data bits=8, parity="None"(0)) -> (session out=w15, error out=w16)
            call "Open (Instr).gvi"(resource name=w15, error in=w16, access mode="Load Configured Settings"(4)) -> (session out=w17, error out=w18)
            Concatenate Strings("V?", "\r\n") -> w19
            call "Write (Instr, String).gvi"(session in=w17, error in=w18, write buffer=w19) -> (session out=w20, error out=w21)
            call "Read (Instr, String).gvi"(session in=w20, error in=w21, byte count=256) -> (session out=w13, error out=w22, read buffer=w12)
            call "Close (Instr).gvi"(session in=w13, error in=w22) -> (error out=w23)
            call "Clear Error Cluster.gvi"(error in=w23) -> (error out=w11)
          }
        }
        Search And Replace String(error in (no error)=w11, input string=w12, search string="Issue") -> (error out=w1, number of replacements=w24)
        Is Not Equal To 0(x=w24) -> w25
        append w12 to w5
        w6 = w13 if w25
        append w25 to w7
        stop if w25
      }
      $"Supercontinuum laser Address" <- w6
      Or Array Elements(Boolean array=w7) -> (logical OR=w26)
      $"Found?" <- w26
      $"Coms list" <- w5
    }
  }
  $"Error Out" <- w1
