vi "Supercontinuum Shut Down Sequence.gvi"   [LabVIEW NXG 3.1.0]
inputs:
  "Error In": error
  "Supercontinuum laser Address": "VISA Instr"
outputs:
  "Successful Shutdown?": bool
  "Error Out": error
panel indicators:
  "Supercontinuum Log": string
  "Linear Progress Bar": f64
  "Current Power": f64
uses:
  NI::VISA::Configure Serial Port (Instr).gvi
  NI::VISA::Open (Instr).gvi
  NI::VISA::Write (Instr, String).gvi
  NI::VISA::Read (Instr, String).gvi
  EQE_Measuring_Setup_NanOpto::SubVis::Utilities::Messages And Prompts::Beating Star.gvi
  NI::VISA::Close (Instr).gvi
diagram:
  Property Node(instance in=reference to unnamed native front panel, error in=$"Error In") -> ("Window"=w1, error out=w2)
  Open Window(reference in=w1, error in=w2) -> (reference out=w3, error out=w4)
  case (w4) {
    frame Error, Default {
      w5 = w4
    }
    frame No Error {
      call "Configure Serial Port (Instr).gvi"(stop bits="1.0"(10), flow control="None"(0), session in=$"Supercontinuum laser Address", error in=w4, baud rate=19200, data bits=8, parity="None"(0)) -> (session out=w6, error out=w7)
      call "Open (Instr).gvi"(resource name=w6, error in=w7, access mode="Load Configured Settings"(4)) -> (session out=w8, error out=w9)
      for (N = 480) (iteration -> i1) {
        Wait Until Next Multiple(multiple to wait=50)
        Multiply(i1, 2.5) -> w11
        Subtract(x=1190, y=w11) -> w12
        Round To Nearest(number=w12) -> w13
        In Range And Coerce(lower limit=0, upper limit=1190, x=w13) -> (coerced(x)=w14)
        Number To Decimal String(number=w14) -> (decimal integer string=w15)
        Concatenate Strings("Q=", w15, "\r\n") -> w16
        call "Write (Instr, String).gvi"(session in=w8, error in=w9, write buffer=w16) -> (session out=w17, error out=w18)
        call "Read (Instr, String).gvi"(session in=w17, error in=w18, byte count=256) -> (session out=w19, error out=w20, read buffer=w21)
        Search And Replace String(error in (no error)=w20, input string=w21, search string="disable") -> (error out=w22, number of replacements=w23)
        Is Not Equal To 0(x=w23) -> w24
        case (w24) {
          frame False, Default { }
          frame True {
            w25 = """The supercontinuum Laser
source seems to be disabled
please make sure you have
turned the key and pressed the 
green button (a green light 
should be lit)."""
            One Button Dialog(button name ("OK")="Oh sorry I will check it \nis propperly turned on.", message=w25)
          }
        }
        call "Beating Star.gvi"(Input=reference to unnamed path, loop iteration=i1, Speed Divider=10)
        Divide(x=i1, y=480) -> w26
        Multiply(w26, 100) -> w27
        $"Linear Progress Bar" <- w27
        $"Current Power" <- w14
        $"Supercontinuum Log" <- w21
        append w24 to w10
        stop if w24
      }
      Or Array Elements(Boolean array=w10) -> (logical OR=w28)
      Not(x=w28) -> w29
      $"Successful Shutdown?" <- w29
      call "Close (Instr).gvi"(session in=w19, error in=w22) -> (error out=w5)
    }
  }
  Close Window(reference in=w3, error in=w5) -> (error out=w30)
  $"Error Out" <- w30
