vi "Supercontinuum Warm Up Sequence.gvi"   [LabVIEW NXG 3.1.0]
inputs:
  "Supercontinuum laser Address": "VISA Instr"
  "Error In": error
outputs:
  "Error Out": error
  "Successful Warmup?": bool
panel indicators:
  "Supercontinuum Log": string
  "Linear Progress Bar": f64
  "Current Power": f64
uses:
  NI::VISA::Configure Serial Port (Instr).gvi
  NI::VISA::Open (Instr).gvi
  NI::VISA::Write (Instr, String).gvi
  NI::VISA::Read (Instr, String).gvi
  EQE_Measuring_Setup_NanOpto::SubVis::Utilities::Messages And Prompts::Beating Star.gvi
  NI::VISA::Close (Instr).gvi
diagram:
  Property Node(instance in=reference to unnamed native front panel, error in=$"Error In") -> ("Window"=w1, error out=w2)
  Open Window(reference in=w1, error in=w2) -> (reference out=w3, error out=w4)
  case (w4) {
    frame Error, Default {
      w5 = w4
    }
    frame No Error {
      call "Configure Serial Port (Instr).gvi"(stop bits="1.0"(10), flow control="None"(0), session in=$"Supercontinuum laser Address", error in=w4, baud rate=19200, data bits=8, parity="None"(0)) -> (session out=w6, error out=w7)
      call "Open (Instr).gvi"(resource name=w6, error in=w7, access mode="Load Configured Settings"(4)) -> (session out=w8, error out=w9)
      for (N = 480) (iteration -> i1) {
        Wait Until Next Multiple(multiple to wait=50)
        Multiply(i1, 2.5) -> w11
        Number To Decimal String(number=w11) -> (decimal integer string=w12)
        Concatenate Strings("Q=", w12, "\r\n") -> w13
        call "Write (Instr, String).gvi"(session in=w8, error in=w9, write buffer=w13) -> (session out=w14, error out=w15)
        call "Read (Instr, String).gvi"(session in=w14, error in=w15, byte count=256) -> (session out=w16, error out=w17, read buffer=w18)
        Search And Replace String(error in (no error)=w17, input string=w18, search string="disable") -> (error out=w19, number of replacements=w20)
        Is Not Equal To 0(x=w20) -> w21
        case (w21) {
          frame False, Default { }
          frame True {
            w22 = """The supercontinuum Laser
source seems to be disabled
please make sure you have
turned the key and pressed the 
green button (a green light 
should be lit)."""
            One Button Dialog(button name ("OK")="Oh sorry I will check it \nis propperly turned on.", message=w22)
          }
        }
        Divide(x=i1, y=480) -> w23
        Multiply(w23, 100) -> w24
        $"Linear Progress Bar" <- w24
        $"Current Power" <- w11
        call "Beating Star.gvi"(Input=reference to unnamed path, loop iteration=i1)
        $"Supercontinuum Log" <- w18
        append w21 to w10
        stop if w21
      }
      Or Array Elements(Boolean array=w10) -> (logical OR=w25)
      Not(x=w25) -> w26
      $"Successful Warmup?" <- w26
      call "Close (Instr).gvi"(session in=w16, error in=w19) -> (error out=w5)
    }
  }
  Close Window(reference in=w3, error in=w5) -> (error out=w27)
  $"Error Out" <- w27
