vi "Supercontinuum laser prerequisites and warning.gvi"   [LabVIEW NXG 3.1.0]
inputs:
  "Input_2": Queue<"Queue instructions.gtype">
  "Old Value": bool
  "New Value": bool
  "Supercontinuum Status": bool
  "Input": error
outputs:
  "Output": Queue<"Queue instructions.gtype">
  "Laser Status": bool
  "Output_2": error
types:
  "Queue instructions.gtype" = enum{"Initialize App", "Light Calibration", "Measure Photodetector", "Measure Keithley", "Instrument detection", "Single Acquire", "Multiple Acquire", "EQE Mapping", "Debugging mode", "Move Arduino", "Help routine", "Idle", "Save Calibration", "Load Calibration", "Set Wavelength", "Turn supercontinuum laser on/off", "Set Multiplex arduino cell", "Save TXT EQE file", "Load TXT EQE", "Stop or Idle", "Stop App"}
diagram:
  case ($"Supercontinuum Status") {
    frame False, Default {
      w4 = """It seems that the Supercontinuum Laser
Is not Propperly connected. Please connect
it propperly and restart the application."""
      One Button Dialog(button name ("OK")="Okay I will do that.", message=w4)
      w1 = $Input_2
      w2 = $Input
      w3 = FALSE
    }
    frame True {
      w5 = """?
Turning the laser on and off 
too many times damages the laser
so please just turn it on when you want 
to use it and off when you have 
COMPLETELY finnished using it.
(For a more reliable measurement, please
leave the laser 30 min after turning it on
to heat up and stabilize)"""
      Select(s=$"New Value", t="On", f="Off") -> w6
      Concatenate Strings("Are you sure you want to turn the \nSupercontinuum laser ", w6, w5) -> w7
      Concatenate Strings("Yes please turn the laser ", w6) -> w8
      w9 = "Oh no, I still have other\nthings I want to do before\nturning the laser "
      Concatenate Strings(w9, w6) -> w10
      Two Button Dialog(F button name ("Cancel")=w10, T button name ("OK")=w8, message=w7) -> (T Button?=w11)
      Select(s=w11, t=$"New Value", f=$"Old Value") -> w3
      Select(s=w11, t="Turn supercontinuum laser on/off", f="Idle") -> w12
      Enqueue Element(element=w12, error in=$Input, queue=$Input_2) -> (error out=w2, queue out=w1)
    }
  }
  $"Laser Status" <- w3
  $Output <- w1
  $Output_2 <- w2
