vi "Automatic Measurement Graph Postprocessor.gvi"   [LabVIEW NXG 5.0.0]
inputs:
  "Automatic EQE Measurement Graph Reference": "Graph reference"
  "Automatic Measurement Indicators In": "Automatic Measurement Indicators.gtype"
  "Cell Measuring Labels": string[]
  "Error In": error
outputs:
  "Automatic Measurement Indicators": "Automatic Measurement Indicators.gtype"
  "Error Out": error
types:
  "Automatic Measurement Indicators.gtype" = cluster{"Elapsed Time (kr)": f64, "Estimated Time (kr)": f64, "Cell being measured": string, "Current Value (A)  ": f64, "EQE (%)": f64, "Dark Current (A)": f64}
uses:
  EQE_Measuring_Setup_NanOpto::SubVis::FGV::Estimated Time FGV.gvi
diagram:
  # This VI Writes the name of the cells on the plot and extracts the extimated measuring time
  case ($"Error In") {
    frame Error, Default {
      w1 = $"Error In"
      w2 = $"Automatic Measurement Indicators In"
    }
    frame No Error {
      call "Estimated Time FGV.gvi"(Estimated Time Instructions="Read Estimated Time", Error In=$"Error In") -> (Estimated Time=w3, Error Out=w4)
      Property Node(instance in=$"Automatic Measurement Indicators In", "Estimated Time (kr)"=w3) -> (instance out=w2)
      s1 = w4  # shift register
      for (iteration -> i1) {
        w5 = each element of $"Cell Measuring Labels"
        Property Node(instance in=$"Automatic EQE Measurement Graph Reference", "ActivePlot"=i1, error in=s1) -> ("Plot"=w6, error out=w7)
        Property Node(instance in=w6, "Name"=w5, error in=w7) -> (error out=w8, instance out=w9)
        next s1 = w8
      }
      w1 = s1
    }
  }
  $"Automatic Measurement Indicators" <- w2
  $"Error Out" <- w1
