vi "Dead Cell Check.gvi"   [LabVIEW NXG 5.0.0]
inputs:
  "Precheck Cells": bool = TRUE
  "multiple acquire variables control out": "Multiple acquire variables control.gtype" = {"Wavelength for peak detection"=500, "R.01 Reference Coordinates"={"X coordinate R.01"=145.3, "Z coordinate R.01"=2.5, "Vertical Spacing"=4.5}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}
  "Cell Measuring Order": string
  "error out_2": error
outputs:
  "Multiple acquire variable Control": "Multiple acquire variables control.gtype"
  "Cell Measuring Order_2": string
  "Error In": error
types:
  "R.01 Reference Coordinates.gtype" = cluster{"X coordinate R.01": f64, "Z coordinate R.01": f64, "Vertical Spacing": f64}
  "Multiple acquire variables control.gtype" = cluster{"Monochromator configuration file ": path, "Light Power Calibration Data": f64[][], "Cell Measuring Labels": string[], "Sample Prefix": string, "Author Initials": string, "Current Date": string, "Batch Name": string, "Default Data Saving Location": path, "Filter Arduino Status": bool, "Filter Arduino Address": "VISA Instr", "Multiplexer Arduino Address": "VISA Instr", "Carriage Arduino Address": "VISA Instr", "Keithley Address": "VISA Instr", "Current Averages   ": f64, "Manual Range  ": f64, "Max current": f64, "Voltage Applied (V)  ": f64, "Autorange  ": bool, "Dark Current  ": bool, "Wavelength for peak detection": f64, "R.01 Reference Coordinates": "R.01 Reference Coordinates.gtype", "R.01 Scan?": bool, "Z scan steps": f64, "X scan Range (mm)": f64, "Z scan Range (mm)": f64, "X scan steps": f64, "Reference Coordinates file": path, "Save R.01 Coordinate?": bool, "Fianium Pe Handler": u64, "Automatic Measurement?": bool, "Dead Cell 10mV Current Threshold": f64, "Precheck cells?": bool, "Monochromator": bool}
uses:
  EQE_Measuring_Setup_NanOpto::SubVis::Main Sub Functions::Acquire::Multiple Acquire::PreCheck Cells before measuring.gvi
diagram:
  case ($"Precheck Cells") {
    frame False, Default {
      w1 = $"multiple acquire variables control out"
      w2 = $"error out_2"
      w3 = $"Cell Measuring Order"
    }
    frame True {
      call "PreCheck Cells before measuring.gvi"(Multiple acquire variable Control=$"multiple acquire variables control out", Error In=$"error out_2") -> (Dead cells?=w4, Multiple acquire variables control out=w1, New Cell Measuring order=w5, Error Out=w2)
      Select(s=w4, t=w5, f=$"Cell Measuring Order") -> w3
    }
  }
  $"Multiple acquire variable Control" <- w1
  $"Error In" <- w2
  $"Cell Measuring Order_2" <- w3
