vi "Multiple Acquire Dark current Measurement.gvi"   [LabVIEW NXG 5.0.0]
inputs:
  "Error In": error
  "Multiple acquire variables control": "Multiple acquire variables control.gtype"
  "Multiplexer arduino Log In": string
outputs:
  "Error Out": error
  "All Dark Currents": "Multiple Acquire Dark Current cluster.gtype"
  "Multiplexer arduino log out": string
panel indicators:
  "Dark Current": f64
types:
  "R.01 Reference Coordinates.gtype" = cluster{"X coordinate R.01": f64, "Z coordinate R.01": f64, "Vertical Spacing": f64}
  "Multiple acquire variables control.gtype" = cluster{"Monochromator configuration file ": path, "Light Power Calibration Data": f64[][], "Cell Measuring Labels": string[], "Sample Prefix": string, "Author Initials": string, "Current Date": string, "Batch Name": string, "Default Data Saving Location": path, "Filter Arduino Status": bool, "Filter Arduino Address": "VISA Instr", "Multiplexer Arduino Address": "VISA Instr", "Carriage Arduino Address": "VISA Instr", "Keithley Address": "VISA Instr", "Current Averages   ": f64, "Manual Range  ": f64, "Max current": f64, "Voltage Applied (V)  ": f64, "Autorange  ": bool, "Dark Current  ": bool, "Wavelength for peak detection": f64, "R.01 Reference Coordinates": "R.01 Reference Coordinates.gtype", "R.01 Scan?": bool, "Z scan steps": f64, "X scan Range (mm)": f64, "Z scan Range (mm)": f64, "X scan steps": f64, "Reference Coordinates file": path, "Save R.01 Coordinate?": bool, "Fianium Pe Handler": u64, "Automatic Measurement?": bool, "Dead Cell 10mV Current Threshold": f64, "Precheck cells?": bool, "Monochromator": bool}
  T1 = cluster{"Cell Label": string, "Dark Current": f64}
  "Multiple Acquire Dark Current cluster.gtype" = T1[]
uses:
  EQE_Measuring_Setup_NanOpto::SubVis::Instrument Control::Keithley::Keithley Initialization Sequence.gvi
  EQE_Measuring_Setup_NanOpto::SubVis::FGV::Current State FGV.gvi
  EQE_Measuring_Setup_NanOpto::SubVis::Instrument Control::Arduinos::Filter Flipper Arduino::Filter Plipper Arduino set to IR pass.gvi
  EQE_Measuring_Setup_NanOpto::SubVis::Instrument Control::Arduinos::Multiplexer Arduino::Multiplexer Arduino Control.gvi
  EQE_Measuring_Setup_NanOpto::SubVis::Utilities::Other::Wait In line ms.gvi
  EQE_Measuring_Setup_NanOpto::SubVis::Instrument Control::Keithley::Dark current Measurement.gvi
  EQE_Measuring_Setup_NanOpto::SubVis::Main Sub Functions::Global Abort::Global Abort.gvi
  Labview_NXG_Keithley_SMU_2450_2460_2461::Miscelaneous::Close.gvi
diagram:
  Property Node(instance in=$"Multiple acquire variables control") -> ("Current Averages   "=w1, "Keithley Address"=w2, "Multiplexer Arduino Address"=w3, "Cell Measuring Labels"=w4, "Filter Arduino Address"=w5, "Filter Arduino Status"=w6, "Current Averages   "=w7, "Fianium Pe Handler"=w8, "Manual Range  "=w9, "Voltage Applied (V)  "=w10, "Max current"=w11, "Current Averages   "=w12, "Autorange  "=w13)
  Multiply(w1, 5) -> w14
  case ($"Error In") {
    frame Error, Default {
      w15 = $"Error In"
    }
    frame No Error {
      call "Keithley Initialization Sequence.gvi"(Enable Auto Range=w13, VISA resource name=w2, Voltage Applied (V)=w10, Source Limit Level (0.1)=w11, Current Averages=w12, Error In=$"Error In", Manual Current Range=w9) -> (VISA resource name out=w16, Error Out=w17)
      call "Current State FGV.gvi"(Instruction Current State FGV="Set Current SubState", Current SubState="Measuring Dark Current", Error In=w17) -> (Error Out=w18)
      call "Filter Plipper Arduino set to IR pass.gvi"(Arduino Filter Flipper Address=w5, Filter Arduino Status=w6, Error In=w18) -> (Error Out=w19)
      s1 = $"Multiplexer arduino Log In"  # shift register
      s2 = "Multiple Acquire Dark Current cluster.gtype" []  # shift register
      s3 = w16  # shift register
      for (iteration -> i1) {
        w20 = each element of w4
        call "Multiplexer Arduino Control.gvi"(Arduino Multiplexer Address In=w3, Cell Label=w20, Error In=w19) -> (Arduino Multiplexer Log=w21, Error Out=w22)
        Concatenate Strings(s1, w21) -> w23
        call "Wait In line ms.gvi"(Error In=w22, milliseconds to wait=200) -> (Error Out=w24)
        call "Dark current Measurement.gvi"(Keithley Address=s3, Fiannium Pe Handler=w8, Error In=w24, Dark Current Aveages=w14) -> (Dark current Value=w25, Keythley address out=w26, Error Out=w27)
        $"Dark Current" <- w25
        call "Global Abort.gvi"(Instruction="Read Abort State", Error In=w27) -> (Local Abort State=w28, Global Abort State=w29, Error Out=w30)
        Logical Or(w30, w28, w29) -> w31
        Property Node(instance in=T1 {all zero or empty}, "Cell Label"=w20, "Dark Current"=w25) -> (instance out=w32)
        Insert Into Array(inArray=s2, index0=i1, new=w32) -> w33
        next s1 = w23
        next s2 = w33
        next s3 = w26
        stop if w31
      }
      $"Multiplexer arduino log out" <- s1
      call "Close.gvi"(VISA resource name=s3, error in (no error)=w30) -> (error out=w15)
      $"All Dark Currents" <- s2
    }
  }
  $"Error Out" <- w15
