vi "Multiple Acquire Graph update and close.gvi"   [LabVIEW NXG 5.0.0]
inputs:
  "Queue In": Queue<"Queue instructions.gtype">
  "Notification Reference In": Notifier<"Multiple aquire notification constant.gtype">
  "Skip To Next Cell Reference": "BooleanControl reference"
  "Automatic Measurement Indicators In 2": "Automatic Measurement Indicators.gtype"
  "Automatic EQE Measurement Data 2": cluster{"Element 1": f64[], "Element 2": f64[]}[]
  "Automatic Measurement Indicators In 1": "Automatic Measurement Indicators.gtype"
  "Automatic EQE Measurement Data 1": cluster{"Element 1": f64[], "Element 2": f64[]}[]
  "Error In 2": error
  "Error In 1": error
outputs:
  "Queue Out": Queue<"Queue instructions.gtype">
  "Automatic Measurement Indicators Out": "Automatic Measurement Indicators.gtype"
  "Automatic EQE Measurement Graph Out": cluster{"Element 1": f64[], "Element 2": f64[]}[]
  "Automatic EQE Measurement Data Out": cluster{"Element 1": f64[], "Element 2": f64[]}[]
  "Error Out": error
types:
  "Automatic Measurement Indicators.gtype" = cluster{"Elapsed Time (kr)": f64, "Estimated Time (kr)": f64, "Cell being measured": string, "Current Value (A)  ": f64, "EQE (%)": f64, "Dark Current (A)": f64}
  "Queue instructions.gtype" = enum{"Wrongly pointed State", "Initialize App", "Light Calibration", "Measure Photodetector", "Measure Keithley", "Instrument detection", "Single Acquire", "Multiple Acquire", "EQE Mapping", "Debugging mode", "Move Arduino", "Arduino FF flip filter", "Help routine", "Idle", "Save Calibration", "Load Calibration", "Set Wavelength", "Help Wizard", "Turn supercontinuum laser on/off", "Set Multiplex arduino cell", "Save TXT EQE file", "Load TXT EQE", "Stop or Idle", "Stop App"}
  "Multiple aquire notification constant.gtype" = cluster{"Current Value (A)  ": f64, "EQE (%)": f64, "Dark Current (A)": f64, "Cell being measured": string, "Automatic EQE Measurement Graph": cluster{"Element 1": f64[], "Element 2": f64[]}[], "Finished": bool, "Current Wavelength": f64, "Progress": f64}
uses:
  NI::G Core::Error::Multiplex Errors.gvi
  EQE_Measuring_Setup_NanOpto::SubVis::Utilities::Messages And Prompts::Measurement Finished.gvi
diagram:
  call "Multiplex Errors.gvi"(error in 1=$"Error In 1", error in 2=$"Error In 2") -> (error out=w1)
  Release Notifier(error in (no error)=w1, notifier=$"Notification Reference In") -> (error out=w2)
  Enqueue Element(element="Idle", error in=w2, queue=$"Queue In") -> (error out=w3, queue out=w4)
  $"Queue Out" <- w4
  case (w3) {
    frame Error, Default {
      w5 = w3
      w6 = $"Automatic EQE Measurement Data 1"
      w7 = $"Automatic EQE Measurement Data 1"
      w8 = $"Automatic Measurement Indicators In 1"
    }
    frame No Error {
      call "Measurement Finished.gvi"(Error In=w3) -> (Error Out=w5)
      w6 = $"Automatic EQE Measurement Data 2"
      w7 = $"Automatic EQE Measurement Data 2"
      w8 = $"Automatic Measurement Indicators In 2"
    }
  }
  $"Automatic Measurement Indicators Out" <- w8
  $"Automatic EQE Measurement Graph Out" <- w7
  $"Automatic EQE Measurement Data Out" <- w6
  Property Node(instance in=$"Skip To Next Cell Reference", "Disabled"=TRUE, error in=w5) -> (error out=w9)
  $"Error Out" <- w9
