vi "Multiple Acquire Notification Builder.gvi"   [LabVIEW NXG 5.0.0]
inputs:
  "Input_7": Notifier<"Multiple aquire notification constant.gtype">
  "Input_4": f64[][][]
  "Current Step": i32
  "Wavelength EQE Single Array": f64[][]
  "Input_6": string
  "Single Acquire notification in": "Single Acquire Notification control.gtype"
  "Dark Current": f64
  "Error In": error
  "External Progress Bar": f64
  "Total Steps": f64
outputs:
  "Output": Notifier<"Multiple aquire notification constant.gtype">
  "Output_4": f64[][][]
  "Output_3": f64[][]
  "Current (A)": f64
  "EQE (%)": f64
  "Auto EQE Measurement": cluster{"Element 1": f64[], "Element 2": f64[]}[]
  "Wavelength (nm)": f64
  "Output_2": bool
  "Error Out": error
types:
  "Multiple aquire notification constant.gtype" = cluster{"Current Value (A)  ": f64, "EQE (%)": f64, "Dark Current (A)": f64, "Cell being measured": string, "Automatic EQE Measurement Graph": cluster{"Element 1": f64[], "Element 2": f64[]}[], "Finished": bool, "Current Wavelength": f64, "Progress": f64}
  "Single Acquire Notification control.gtype" = cluster{"Wavelength (nm)": f64, "EQE (%)": f64, "Current (A)": f64, "Finnished": bool, "Progress": f64}
uses:
  EQE_Measuring_Setup_NanOpto::SubVis::Utilities::Other::Graph Adapter Multi plot.gvi
diagram:
  Property Node(instance in=$"Single Acquire notification in") -> ("Wavelength (nm)"=w1, "EQE (%)"=w2, "Current (A)"=w3, "Finnished"=w4, "Progress"=w5)
  Build Array(w1, w2) -> w6
  Build Array($"Wavelength EQE Single Array", w6) -> w7
  $Output_3 <- w7
  Insert Into Array(inArray=$Input_4, index0=$"Current Step", new=w7) -> w8
  $Output_4 <- w8
  call "Graph Adapter Multi plot.gvi"(Input XY data Multi Page=w8) -> (Output Multi Graph=w9)
  $"Auto EQE Measurement" <- w9
  $"Current (A)" <- w3
  Divide(x=w5, y=$"Total Steps") -> w10
  Multiply($"External Progress Bar", 100) -> w11
  Add(w10, w11) -> w12
  w13 = "Multiple aquire notification constant.gtype" {all zero or empty}
  Property Node(instance in=w13, "Current Value (A)  "=w3, "EQE (%)"=w2, "Automatic EQE Measurement Graph"=w9, "Cell being measured"=$Input_6, "Finished"=FALSE, "Dark Current (A)"=$"Dark Current", "Current Wavelength"=w1, "Progress"=w12) -> (instance out=w14)
  Send Notification(error in (no error)=$"Error In", notification=w14, notifier=$Input_7) -> (error out=w15, notifier out=w16)
  $Output <- w16
  $"Error Out" <- w15
  $"EQE (%)" <- w2
  $"Wavelength (nm)" <- w1
  $Output_2 <- w4
