vi "Multiple Acquire initialize.gvi"   [LabVIEW NXG 5.0.0]
inputs:
  "Skip to next cell reference": "BooleanControl reference"
  "Error In": error
outputs:
  "Error Out": error
uses:
  EQE_Measuring_Setup_NanOpto::SubVis::FGV::Estimated Time FGV.gvi
  EQE_Measuring_Setup_NanOpto::SubVis::FGV::Current State FGV.gvi
  EQE_Measuring_Setup_NanOpto::SubVis::FGV::Timer FGV.gvi
diagram:
  Property Node(instance in=$"Skip to next cell reference", "Disabled"=FALSE, error in=$"Error In") -> (error out=w1)
  call "Estimated Time FGV.gvi"(Estimated Time Instructions="Reset All", Error In=w1) -> (Error Out=w2)
  call "Current State FGV.gvi"(Instruction Current State FGV="Set current State", Crrent State="Multiple Acquire", Error In=w2) -> (Error Out=w3)
  call "Timer FGV.gvi"(Timer FGV Instructions="Start Timer", Error In=w3) -> (Error Out=w4)
  $"Error Out" <- w4
