vi "Multiple Aquire Sequence.gvi"   [LabVIEW NXG 3.1.0]
inputs:
  "Multiple acquire variables control": "Multiple acquire variables control.gtype"
  "Error In": error
  "Notifier In": Notifier<"Multiple aquire notification constant.gtype">
outputs:
  "Error Out": error
  "XZ Carriage Arduino Log": string
  "Arduino Multiplexer Log": string
  "XZ Scan Intensity Graph": f64[][]
panel indicators:
  "Auto EQE Measurement": cluster{"Element 1": f64[], "Element 2": f64[]}[]
  "EQE (%)": f64
  "Wavelength (nm)": f64
  "Current (A)": f64
  "notifier name": string
  "Full Multiple EQE Data": f64[][][]
  "Output Multi Graph": cluster{"Element 1": f64[], "Element 2": f64[]}[]
  "Dark Current": f64
types:
  "Multiple aquire notification constant.gtype" = cluster{"Current Value (A)  ": f64, "EQE (%)": f64, "Dark Current (A)": f64, "Cell being measured": string, "Automatic EQE Measurement Graph": cluster{"Element 1": f64[], "Element 2": f64[]}[], "Finished": bool, "Current Wavelength": f64, "Progress": f64}
  "R.01 Reference Coordinates.gtype" = cluster{"X coordinate R.01": f64, "Z coordinate R.01": f64, "Vertical Spacing": f64}
  "Multiple acquire variables control.gtype" = cluster{"Monochromator configuration file ": path, "Light Power Calibration Data": f64[][], "Cell Measuring Labels": string[], "Sample Prefix": string, "Author Initials": string, "Current Date": string, "Batch Name": string, "Default Data Saving Location": path, "Filter Arduino Status": bool, "Filter Arduino Address": "VISA Instr", "Multiplexer Arduino Address": "VISA Instr", "Carriage Arduino Address": "VISA Instr", "Keithley Address": "VISA Instr", "Current Averages   ": f64, "Manual Range  ": f64, "Max current": f64, "Voltage Applied (V)  ": f64, "Autorange  ": bool, "Dark Current  ": bool, "Wavelength for peak detection": f64, "R.01 Reference Coordinates": "R.01 Reference Coordinates.gtype", "R.01 Scan?": bool, "Z scan steps": f64, "X scan Range (mm)": f64, "Z scan Range (mm)": f64, "X scan steps": f64, "Reference Coordinates file": path, "Save R.01 Coordinate?": bool, "Fianium Pe Handler": u64, "Automatic Measurement?": bool, "Dead Cell 10mV Current Threshold": f64, "Precheck cells?": bool}
  T1 = cluster{"Cell Label": string, "Dark Current": f64}
  "Multiple Acquire Dark Current cluster.gtype" = T1[]
  "Single Acquire Notification control.gtype" = cluster{"Wavelength (nm)": f64, "EQE (%)": f64, "Current (A)": f64, "Finnished": bool, "Progress": f64}
  "Single acquire inputs control.gtype" = cluster{"Light calibration data": f64[][], "Fiannium Configuration File": path, "Arduino Filter Flipper Address": "VISA Instr", "Filter Arduino Status": bool, "Dark Current Averages": f64, "Measure dark current?": bool, "Keithley Address": "VISA Instr", "Current Aveages": i32, "Voltage Applied (V)": f64, "Max current compliance": f64, "Manual Current Range": f64, "Enable Auto Range": bool, "Automatic measurement": bool, "Fiannium Pe Handler": u64, "Dead Cell? Current Threshold": f64, "Automatic measurement Cell Dark current": f64}
uses:
  EQE_Measuring_Setup_NanOpto::SubVis::Utilities::Other::Current Time Kr.gvi
  EQE_Measuring_Setup_NanOpto::SubVis::Instrument Control::Arduinos::XZ Carriage Arduino::XZ Carriage Arduino Initialize.gvi
  EQE_Measuring_Setup_NanOpto::SubVis::Instrument Control::Arduinos::XZ Carriage Arduino::XZ Carriage Arduino Homing Sequence.gvi
  EQE_Measuring_Setup_NanOpto::SubVis::Instrument Control::Keithley::Keithley Initialization Sequence.gvi
  PE_Filter_SDK::Monochromator Initialization Sequence.gvi
  EQE_Measuring_Setup_NanOpto::SubVis::Main Sub Functions::Acquire::Multiple Acquire::Multiple Acquire Dark current Measurement.gvi
  EQE_Measuring_Setup_NanOpto::SubVis::Instrument Control::Arduinos::XZ Carriage Arduino::XZ Scan R.01::XZ Carriage scan routine.gvi
  EQE_Measuring_Setup_NanOpto::SubVis::FGV::Estimated Time FGV.gvi
  EQE_Measuring_Setup_NanOpto::SubVis::FGV::Current State FGV.gvi
  EQE_Measuring_Setup_NanOpto::SubVis::Main Sub Functions::Global Abort::Global Abort.gvi
  EQE_Measuring_Setup_NanOpto::SubVis::Instrument Control::Arduinos::XZ Carriage Arduino::XZ Carriage Label to Coordinate.gvi
  EQE_Measuring_Setup_NanOpto::SubVis::Instrument Control::Arduinos::XZ Carriage Arduino::XZ Carriage Arduino Move to location.gvi
  EQE_Measuring_Setup_NanOpto::SubVis::Instrument Control::Arduinos::Multiplexer Arduino::Multiplexer Arduino Control.gvi
  EQE_Measuring_Setup_NanOpto::SubVis::Main Sub Functions::Acquire::Single Acquire::Single EQE Measurement Acquire.gvi
  EQE_Measuring_Setup_NanOpto::SubVis::Main Sub Functions::Acquire::Multiple Acquire::Multiple Acquire Notification Builder.gvi
  NI::G Core::Error::Multiplex Errors.gvi
  NI::G Core::Error::Clear Error Cluster.gvi
  EQE_Measuring_Setup_NanOpto::SubVis::FGV::Sample Prefix FGV.gvi
  EQE_Measuring_Setup_NanOpto::SubVis::Main Sub Functions::Acquire::Save EQE TXT File.gvi
  NI::VISA::Close (Instr).gvi
  Keithley 2450 NXG Library::Public::Close.gvi
  PE_Filter_SDK::PE Close.gvi
  PE_Filter_SDK::PE Destroy.gvi
diagram:
  case ($"Error In") {
    frame Error, Default {
      w1 = $"Error In"
    }
    frame No Error {
      Property Node(instance in=$"Multiple acquire variables control") -> ("Carriage Arduino Address"=w2, "Keithley Address"=w3, "Current Averages   "=w4, "Manual Range  "=w5, "Max current"=w6, "Voltage Applied (V)  "=w7, "Autorange  "=w8, "Dark Current  "=w9, "Monochromator configuration file "=w10, "R.01 Scan?"=w11)
      case (TRUE) {
        frame False, Default {
          w12 = $"Error In"
        }
        frame True {
          w13 = "Automatic Acquire Started!\nPlease wait while the Carriage is \nhoming and positioning itself."
          One Button Dialog(button name ("OK")="Okay I'll be patient", message=w13)
          w12 = $"Error In"
        }
      }
      call "Current Time Kr.gvi"(Error=w12) -> (Current Time (kr)=w14, Error Out=w15)
      call "XZ Carriage Arduino Initialize.gvi"(XZ Carriage Arduino Adress In=w2, Error In=w15) -> (XZ Carriage Arduino Open Visa Session Out=w16, XZ Carriage Arduino Log=w17, Error Out=w18)
      $"XZ Carriage Arduino Log" <- w17
      call "XZ Carriage Arduino Homing Sequence.gvi"(XZ Carriage Arduino Open Visa Session In=w16, XZ Carriage Arduino Log In=w17, Error In=w18) -> (XZ Carriage Arduino Open Visa Session Out=w19, XZ Carriage Arduino Log Out=w20, Error Out=w21)
      call "Keithley Initialization Sequence.gvi"(Enable Auto Range=w8, VISA resource name=w3, Voltage Applied (V)=w7, Source Limit Level (0.1)=w6, Current Averages=w4, Error In=w21, Manual Current Range=w5) -> (Error Out=w22)
      call "Monochromator Initialization Sequence.gvi"(Configuration File=w10, Error In=w22) -> (peHandle out=w23, Error Out=w24)
      Property Node(instance in=$"Multiple acquire variables control", "Fianium Pe Handler"=w23) -> (instance out=w25)
      case (w9) {
        frame False, Default {
          w26 = w24
          w27 = "Multiple Acquire Dark Current cluster.gtype" []
          w28 = w25
        }
        frame True {
          call "Multiple Acquire Dark current Measurement.gvi"(Multiple acquire variables control=w25, Multiplexer arduino Log In=$"Arduino Multiplexer Log", Error In=w24) -> (All Dark Currents=w27, Multiplexer arduino log out=w29, Error Out=w26)
          $"Arduino Multiplexer Log" <- w29
          w28 = w25
        }
      }
      case (w11) {
        frame False, Default {
          w30 = w26
          w31 = w28
        }
        frame True {
          call "XZ Carriage scan routine.gvi"(Multiple acquire variables control=w28, Operation Mode Selection="In program normal operation", Error In=w26) -> (Multiple acquire variables control out=w31, Intensity Graph=w32, Error Out=w30)
          $"XZ Scan Intensity Graph" <- w32
        }
      }
      call "Current Time Kr.gvi"(Error=w30) -> (Current Time (kr)=w33, Error Out=w34)
      Property Node(instance in=w31) -> ("R.01 Reference Coordinates"=w35, instance out=w36)
      Property Node(instance in=w31) -> ("Cell Measuring Labels"=w37)
      Subtract(x=w33, y=w14) -> w38
      s1 = w34  # shift register
      s2 = w19  # shift register
      s3 = w20  # shift register
      s4 = f64[][][] []  # shift register
      s5 = $"Notifier In"  # shift register
      s6 = w36  # shift register
      for (iteration -> i1) {
        w39 = each element of w37
        w40 = each element of w27
        Property Node(instance in=$"Multiple acquire variables control") -> ("Multiplexer Arduino Address"=w42)
        call "Current Time Kr.gvi"(Error=s1) -> (Current Time (kr)=w43, Error Out=w44)
        Array Size(array=w37) -> (size(s)=w45)
        Feedback Node(initial value=w14, input=w43) -> w46
        Subtract(x=w43, y=w46) -> w47
        call "Estimated Time FGV.gvi"(Estimated Time Instructions="Setup", Fixed Ammount of Time=w38, Step Count=w45, Step Duration=w47, Error In=w44) -> (Error Out=w48)
        call "Current State FGV.gvi"(Instruction Current State FGV="Set current State", Crrent State="Multiple Acquire", Error In=w48) -> (Error Out=w49)
        call "Global Abort.gvi"(Instruction="Read Abort State", Error In=w49) -> (Local Abort State=w50, Global Abort State=w51, Error Out=w52)
        call "XZ Carriage Label to Coordinate.gvi"(Cell Label=w39, R.01 Reference Coordinates=w35, Error In=w52) -> (Gcode Instruction Out=w53, Error Out=w54)
        call "XZ Carriage Arduino Move to location.gvi"(XZ Carriage Arduino open Visa session In=s2, XZ Carriage Arduino Log In=s3, Input Command=w53, Error In=w54) -> (XZ Carriage Arduino open Visa Session Out=w55, XZ Carriage Arduino Log Out=w56, Error Out=w57)
        call "Multiplexer Arduino Control.gvi"(Arduino Multiplexer Address In=w42, Cell Label=w39, Error In=w57) -> (Arduino Multiplexer Log=w58, Error Out=w59)
        Concatenate Strings($"Arduino Multiplexer Log", w58) -> w60
        $"Arduino Multiplexer Log" <- w60
        $"XZ Carriage Arduino Log" <- s3
        call "Dark Current cell label Sanity Check.gvi"(Cel label=w39, Current cell Dark Current Info=w40, Multiple acquire variables control=s6) -> (Dark Current=w61)
        w62 = "Single Acquire Notification control.gtype" {all zero or empty}
        Obtain Notifier(element data type=w62, error in=w59, name="Multi acquire single measurement") -> (error out=w63, notifier out=w64)
        Property Node(instance in=s6) -> ("Monochromator configuration file "=w65, "Light Power Calibration Data"=w66, "Filter Arduino Status"=w67, "Filter Arduino Address"=w68, "Dark Current  "=w69, "Keithley Address"=w70, "Current Averages   "=w71, "Voltage Applied (V)  "=w72, "Max current"=w73, "Manual Range  "=w74, "Fianium Pe Handler"=w75, "Autorange  "=w76, "Dead Cell 10mV Current Threshold"=w77, instance out=w78)
        Property Node(instance in="Single acquire inputs control.gtype" {all zero or empty}, "Light calibration data"=w66, "Fiannium Configuration File"=w65, "Arduino Filter Flipper Address"=w68, "Filter Arduino Status"=w67, "Measure dark current?"=w69, "Keithley Address"=w70, "Current Aveages"=w71, "Voltage Applied (V)"=w72, "Max current compliance"=w73, "Manual Current Range"=w74, "Enable Auto Range"=w76, "Automatic measurement"=TRUE, "Fiannium Pe Handler"=w75, "Dead Cell? Current Threshold"=w77) -> (instance out=w79)
        call "Single EQE Measurement Acquire.gvi"(Single acquire inputs control=w79, Notifier In=w64, Error In=w63) -> (Full EQE Data=w80, Error Out=w81)
        Property Node(instance in=$"Multiple acquire variables control") -> ("Default Data Saving Location"=w82, "Author Initials"=w83, "Current Date"=w84, "Batch Name"=w85, "Dark Current  "=w86)
        Divide(x=i1, y=w45) -> w87
        s7 = w64  # shift register
        s8 = s5  # shift register
        s9 = w63  # shift register
        s10 = f64[][] []  # shift register
        while {
          call "Global Abort.gvi"(Instruction="Read Abort State", Error In=s9) -> (Local Abort State=w88, Global Abort State=w89, Error Out=w90)
          Logical Or(w88, w89) -> w91
          Wait On Notification(error in (no error)=w90, notifier=s7, timeout in milliseconds=1000) -> (error out=w92, notification=w93, notifier out=w94, timed out?=w95)
          case (w95) {
            frame True {
              w96 = s10
              w97 = FALSE
              w98 = s4
              w99 = w92
              w100 = s8
            }
            frame False {
              call "Multiple Acquire Notification Builder.gvi"(Input_7=s8, Input_4=s4, Current Step=i1, Input_3=s10, Input_6=w39, Single Acquire notification in=w93, Dark Current=$"Dark Current", Error In=w92, External Progress Bar=w87, Total Steps=w45) -> (Output=w100, Output_4=w98, Output_3=w96, Current (A)=w101, EQE (%)=w102, Auto EQE Measurement=w103, Wavelength (nm)=w104, Output_2=w97, Error Out=w99)
              $"Current (A)" <- w101
              $"EQE (%)" <- w102
              $"Auto EQE Measurement" <- w103
              $"Output Multi Graph" <- w103
              $"Wavelength (nm)" <- w104
            }
          }
          Logical Or(w97, w91) -> w105
          next s7 = w94
          next s8 = w100
          next s9 = w99
          next s10 = w96
          stop if w105
        }
        Logical Or(w50, w51) -> w106
        Decrement(x=w45) -> w107
        Is Greater Or Equal(x=i1, y=w107) -> w108
        Logical Or(w108, w106) -> w109
        w110 = "Multiple aquire notification constant.gtype" {all zero or empty}
        Property Node(instance in=w110, "Finished"=w109) -> (instance out=w111)
        call "Multiplex Errors.gvi"(error in 1=w81, error in 2=s9) -> (error out=w112)
        Send Notification(error in (no error)=w112, notification=w111, notifier=s8) -> (error out=w113, notifier out=w114)
        call "Clear Error Cluster.gvi"(error in=w113) -> (error out=w115)
        Release Notifier(error in (no error)=w115, notifier=s7) -> (error out=w116, notifier name=w117)
        call "Current State FGV.gvi"(Instruction Current State FGV="Set current State", Crrent State="Save TXT EQE file", Error In=w116) -> (Error Out=w118)
        call "Sample Prefix FGV.gvi"(General instruction FGV enum="Read state", Error In=w118) -> (Sample Prefix Out=w119, Error Out=w120)
        call "Save EQE TXT File.gvi"(Dark Current=w61, Dark Current Measured?=w86, Default Data Saving Location=w82, Full EQE Data=w80, Author Initials=w83, Sample Prefix=w119, Current Date=w84, Batch Name=w85, Error In=w120, Path type="Multiple EQE", Cell Label=w39) -> (Error Out=w121)
        $"notifier name" <- w117
        $"Dark Current" <- w61
        append w80 to w41
        next s1 = w121
        next s2 = w55
        next s3 = w56
        next s4 = w98
        next s5 = w114
        next s6 = w78
        stop if w106
      }
      Property Node(instance in=s6) -> ("Keithley Address"=w122, "Fianium Pe Handler"=w123)
      call "Close (Instr).gvi"(session in=s2, error in=s1) -> (error out=w124)
      call "Close.gvi"(VISA resource name=w122, error in (no error)=w124) -> (error out=w125)
      call "PE Close.gvi"(peHandle=w123, error in (no error)=w125) -> (peHandle out=w126, error out=w127)
      call "PE Destroy.gvi"(peHandle=w126, error in (no error)=w127) -> (error out=w128)
      case (TRUE) {
        frame False, Default {
          w1 = w128
        }
        frame True {
          One Button Dialog(button name ("OK")="Okay Thanks", message="Automatic Acquire finished!")
          w1 = w128
        }
      }
      $"XZ Carriage Arduino Log" <- w20
      $"Full Multiple EQE Data" <- w41
    }
  }
  $"Error Out" <- w1
