vi "Multiple acuire precheck cells.gvi"   [LabVIEW NXG 5.0.0]
inputs:
  "Multiple acquire variable Control": "Multiple acquire variables control.gtype" = {"Wavelength for peak detection"=500, "R.01 Reference Coordinates"={"X coordinate R.01"=145.3, "Z coordinate R.01"=2.5, "Vertical Spacing"=4.5}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}
  "Error In": error
outputs:
  "Multiple acquire variables control Out": "Multiple acquire variables control.gtype"
  "Error Out": error
panel indicators:
  "New Cell Measuring order": string
types:
  "R.01 Reference Coordinates.gtype" = cluster{"X coordinate R.01": f64, "Z coordinate R.01": f64, "Vertical Spacing": f64}
  "Multiple acquire variables control.gtype" = cluster{"Monochromator configuration file ": path, "Light Power Calibration Data": f64[][], "Cell Measuring Labels": string[], "Sample Prefix": string, "Author Initials": string, "Current Date": string, "Batch Name": string, "Default Data Saving Location": path, "Filter Arduino Status": bool, "Filter Arduino Address": "VISA Instr", "Multiplexer Arduino Address": "VISA Instr", "Carriage Arduino Address": "VISA Instr", "Keithley Address": "VISA Instr", "Current Averages   ": f64, "Manual Range  ": f64, "Max current": f64, "Voltage Applied (V)  ": f64, "Autorange  ": bool, "Dark Current  ": bool, "Wavelength for peak detection": f64, "R.01 Reference Coordinates": "R.01 Reference Coordinates.gtype", "R.01 Scan?": bool, "Z scan steps": f64, "X scan Range (mm)": f64, "Z scan Range (mm)": f64, "X scan steps": f64, "Reference Coordinates file": path, "Save R.01 Coordinate?": bool, "Fianium Pe Handler": u64, "Automatic Measurement?": bool, "Dead Cell 10mV Current Threshold": f64, "Precheck cells?": bool, "Monochromator": bool}
uses:
  EQE_Measuring_Setup_NanOpto::SubVis::Main Sub Functions::Acquire::Multiple Acquire::PreCheck Cells before measuring.gvi
diagram:
  Property Node(instance in=$"Multiple acquire variable Control") -> ("Precheck cells?"=w1, instance out=w2)
  case (w1) {
    frame False, Default {
      w3 = w2
      w4 = $"Error In"
    }
    frame True {
      call "PreCheck Cells before measuring.gvi"(Multiple acquire variable Control=w2, Error In=$"Error In") -> (Multiple acquire variables control out=w3, New Cell Measuring order=w5, Error Out=w4)
      $"New Cell Measuring order" <- w5
    }
  }
  $"Multiple acquire variables control Out" <- w3
  $"Error Out" <- w4
