vi "PreCheck Cells before measuring.gvi"   [LabVIEW NXG 5.0.0]
inputs:
  "Multiple acquire variable Control": "Multiple acquire variables control.gtype" = {"Wavelength for peak detection"=500, "R.01 Reference Coordinates"={"X coordinate R.01"=145.3, "Z coordinate R.01"=2.5, "Vertical Spacing"=4.5}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}
  "Multiplexer arduino Log In": string
  "Error In": error
outputs:
  "Multiple acquire variables control out": "Multiple acquire variables control.gtype"
  "Multiplexer arduino log out": string
  "New Cell Measuring order": string
  "Error Out": error
  "Dead cells?": bool
panel controls:
  "Stand Alone Operation": bool
  "Current Threshold": f64 = 1e-09
panel indicators:
  "-10 mV Current": f64
  "Precheck Cells Data array": "Precheck Cells Data array.gtype"
types:
  T1 = cluster{"Cell Label": string, "-10mV Current": f64, "Dead?": bool}
  "Precheck Cells Data array.gtype" = T1[]
  "R.01 Reference Coordinates.gtype" = cluster{"X coordinate R.01": f64, "Z coordinate R.01": f64, "Vertical Spacing": f64}
  "Multiple acquire variables control.gtype" = cluster{"Monochromator configuration file ": path, "Light Power Calibration Data": f64[][], "Cell Measuring Labels": string[], "Sample Prefix": string, "Author Initials": string, "Current Date": string, "Batch Name": string, "Default Data Saving Location": path, "Filter Arduino Status": bool, "Filter Arduino Address": "VISA Instr", "Multiplexer Arduino Address": "VISA Instr", "Carriage Arduino Address": "VISA Instr", "Keithley Address": "VISA Instr", "Current Averages   ": f64, "Manual Range  ": f64, "Max current": f64, "Voltage Applied (V)  ": f64, "Autorange  ": bool, "Dark Current  ": bool, "Wavelength for peak detection": f64, "R.01 Reference Coordinates": "R.01 Reference Coordinates.gtype", "R.01 Scan?": bool, "Z scan steps": f64, "X scan Range (mm)": f64, "Z scan Range (mm)": f64, "X scan steps": f64, "Reference Coordinates file": path, "Save R.01 Coordinate?": bool, "Fianium Pe Handler": u64, "Automatic Measurement?": bool, "Dead Cell 10mV Current Threshold": f64, "Precheck cells?": bool, "Monochromator": bool}
uses:
  EQE_Measuring_Setup_NanOpto::SubVis::Instrument Control::Keithley::Keithley Initialization Sequence.gvi
  EQE_Measuring_Setup_NanOpto::SubVis::Instrument Control::Instrument detector.gvi
  EQE_Measuring_Setup_NanOpto::SubVis::Instrument Control::Arduinos::Arduino Detector.gvi
  EQE_Measuring_Setup_NanOpto::SubVis::FGV::Current State FGV.gvi
  EQE_Measuring_Setup_NanOpto::SubVis::Instrument Control::Arduinos::Multiplexer Arduino::Multiplexer Arduino Control.gvi
  EQE_Measuring_Setup_NanOpto::SubVis::Utilities::Other::Wait In line ms.gvi
  EQE_Measuring_Setup_NanOpto::SubVis::Main Sub Functions::Acquire::Multiple Acquire::Precheck measurement.gvi
  EQE_Measuring_Setup_NanOpto::SubVis::Main Sub Functions::Global Abort::Global Abort.gvi
  Labview_NXG_Keithley_SMU_2450_2460_2461::Miscelaneous::Close.gvi
diagram:
  case ($"Stand Alone Operation") {
    frame False, Default {
      Property Node(instance in=$"Multiple acquire variable Control") -> ("Current Averages   "=w6, "Multiplexer Arduino Address"=w2, "Cell Measuring Labels"=w3, "Dead Cell 10mV Current Threshold"=w4, "Autorange  "=w7, "Manual Range  "=w8, "Max current"=w9, "Keithley Address"=w10, instance out=w1)
      To Signed 32 Bit Integer(number=w6) -> w11
      call "Keithley Initialization Sequence.gvi"(Enable Auto Range=w7, VISA resource name=w10, Voltage Applied (V)=-0.01, Source Limit Level (0.1)=w9, Current Averages=w11, Error In=$"Error In", Manual Current Range=w8) -> (Error Out=w5)
    }
    frame True {
      call "Instrument detector.gvi"(Instruments to Detect="Keythley", Error In=$"Error In") -> (Keithley Address=w12, Error Out=w13)
      Property Node(instance in=$"Multiple acquire variable Control", "Max current"=0.05, "Current Averages   "=3, "Keithley Address"=w12) -> (instance out=w1)
      To Signed 32 Bit Integer(number=3) -> w14
      call "Keithley Initialization Sequence.gvi"(VISA resource name=w12, Voltage Applied (V)=-0.01, Source Limit Level (0.1)=0.05, Current Averages=w14, Error In=w13) -> (Error Out=w15)
      call "Arduino Detector.gvi"(Error In=w15) -> (Multiplexer Arduino Address=w2, Error Out=w5)
      w3 = ["L.03"]
      w4 = $"Current Threshold"
    }
  }
  case (w5) {
    frame Error, Default {
      w16 = w5
      w17 = w1
    }
    frame No Error {
      call "Current State FGV.gvi"(Instruction Current State FGV="Set Current SubState", Current SubState="Prechecking Cells", Error In=w5) -> (Error Out=w18)
      s1 = $"Multiplexer arduino Log In"  # shift register
      s2 = "Precheck Cells Data array.gtype" []  # shift register
      for (iteration -> i1) {
        w19 = each element of w3
        call "Multiplexer Arduino Control.gvi"(Arduino Multiplexer Address In=w2, Cell Label=w19, Error In=w18) -> (Arduino Multiplexer Log=w21, Error Out=w22)
        Concatenate Strings(s1, w21) -> w23
        call "Wait In line ms.gvi"(Error In=w22, milliseconds to wait=200) -> (Error Out=w24)
        call "Precheck measurement.gvi"(Multiple acquire variables control=w1, Error In=w24, Close Coms after finish?=FALSE) -> (Keythley address out=w25, -10mV current Value=w26, Error Out=w27)
        Absolute Value(x=w4) -> w28
        Absolute Value(x=w26) -> w29
        Is Less(x=w29, y=w28) -> w30
        Property Node(instance in=T1 {all zero or empty}, "Cell Label"=w19, "-10mV Current"=w26, "Dead?"=w30) -> (instance out=w31)
        Insert Into Array(inArray=s2, index0=i1, new=w31) -> w32
        $"-10 mV Current" <- w26
        call "Global Abort.gvi"(Instruction="Read Abort State", Error In=w27) -> (Local Abort State=w33, Global Abort State=w34, Error Out=w35)
        Logical Or(w35, w33, w34) -> w36
        append w30 to w20
        next s1 = w23
        next s2 = w32
        stop if w36
      }
      $"Multiplexer arduino log out" <- s1
      call "Close.gvi"(VISA resource name=w25, error in (no error)=w35) -> (error out=w37)
      Or Array Elements(Boolean array=w20) -> (logical OR=w38)
      case (w38) {
        frame False, Default {
          w17 = w1
          w16 = w37
        }
        frame True {
          w39 = "The following cells are below the \nspecified threshold (dead)\nhence they will not be measured:"
          Concatenate Strings(w39, "\r\n", "\r\n") -> w40
          s3 = w40  # shift register
          s4 = ""  # shift register
          for (iteration -> i2) {
            w41 = each element of s2
            Property Node(instance in=w41) -> ("Cell Label"=w43, "-10mV Current"=w44, "Dead?"=w45)
            case (w45) {
              frame False, Default {
                w46 = s3
              }
              frame True {
                Number To Exponential String(number=w44, use system decimal point (T)=FALSE) -> (E-format string=w47)
                Concatenate Strings(s3, w43, " ", "Current: ", w47, " A", " ", "\r\n") -> w46
              }
            }
            Not(x=w45) -> w48
            Select(s=w45, t="†", f="") -> w49
            Increment(x=i2) -> w50
            Quotient And Remainder(x=w50, y=5) -> (x-y*floor(x/y)=w51)
            Is Equal To 0(x=w51) -> w52
            Select(s=w52, t="\r\n", f="") -> w53
            Concatenate Strings(s4, w43, w49, " -> ", w53) -> w54
            append w43 to w42 if w48
            next s3 = w46
            next s4 = w54
          }
          w55 = "\nIf you consider they should be\nfunctional, try removing ang reinseting\nthe cell, or lowering the specified threshold."
          Concatenate Strings(s3, w55) -> w56
          Two Button Dialog(F button name ("Cancel")="Okay, do not bother measuring them", T button name ("OK")="Measure them anyway please.", message=w56) -> (T Button?=w57)
          case (w57) {
            frame True {
              w17 = w1
              w16 = w37
            }
            frame False {
              Is Empty Array(array=w42) -> w58
              case (w58) {
                frame True {
                  w59 = "No cells have been selected for measuring.\nFinishing Measurement."
                  One Button Dialog(button name ("OK")="Okay, thanks.", message=w59)
                  call "Global Abort.gvi"(Instruction="Abort Local", Error In=w37) -> (Error Out=w16)
                  w17 = w1
                }
                frame False {
                  Property Node(instance in=w1, "Cell Measuring Labels"=w42) -> (instance out=w17)
                  w16 = w37
                }
              }
            }
          }
          $"New Cell Measuring order" <- s4
        }
      }
      $"Precheck Cells Data array" <- s2
      $"Dead cells?" <- w38
    }
  }
  $"Multiple acquire variables control out" <- w17
  $"Error Out" <- w16
