vi "Precheck measurement.gvi"   [LabVIEW NXG 5.0.0]
inputs:
  "Close Coms after finish?": bool
  "Error In": error
  "Multiple acquire variables control": "Multiple acquire variables control.gtype" = {"Wavelength for peak detection"=500, "R.01 Reference Coordinates"={"X coordinate R.01"=145.3, "Z coordinate R.01"=2.5, "Vertical Spacing"=4.5}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}
outputs:
  "-10mV current measurements": f64[]
  "-10mV current Value": f64
  "Keythley address out": "VISA Instr"
  "Error Out": error
types:
  "R.01 Reference Coordinates.gtype" = cluster{"X coordinate R.01": f64, "Z coordinate R.01": f64, "Vertical Spacing": f64}
  "Multiple acquire variables control.gtype" = cluster{"Monochromator configuration file ": path, "Light Power Calibration Data": f64[][], "Cell Measuring Labels": string[], "Sample Prefix": string, "Author Initials": string, "Current Date": string, "Batch Name": string, "Default Data Saving Location": path, "Filter Arduino Status": bool, "Filter Arduino Address": "VISA Instr", "Multiplexer Arduino Address": "VISA Instr", "Carriage Arduino Address": "VISA Instr", "Keithley Address": "VISA Instr", "Current Averages   ": f64, "Manual Range  ": f64, "Max current": f64, "Voltage Applied (V)  ": f64, "Autorange  ": bool, "Dark Current  ": bool, "Wavelength for peak detection": f64, "R.01 Reference Coordinates": "R.01 Reference Coordinates.gtype", "R.01 Scan?": bool, "Z scan steps": f64, "X scan Range (mm)": f64, "Z scan Range (mm)": f64, "X scan steps": f64, "Reference Coordinates file": path, "Save R.01 Coordinate?": bool, "Fianium Pe Handler": u64, "Automatic Measurement?": bool, "Dead Cell 10mV Current Threshold": f64, "Precheck cells?": bool, "Monochromator": bool}
uses:
  Labview_NXG_Keithley_SMU_2450_2460_2461::Configure::Clear Buffer.gvi
  Labview_NXG_Keithley_SMU_2450_2460_2461::Action Status::Enable Output.gvi
  Labview_NXG_Keithley_SMU_2450_2460_2461::Data::Make Reading and Store in Buffer.gvi
  Labview_NXG_Keithley_SMU_2450_2460_2461::Data::Read (Multiple Points).gvi
  NI::Analysis::Statistics::Mean (DBL).gvi
  Labview_NXG_Keithley_SMU_2450_2460_2461::Miscelaneous::Close.gvi
diagram:
  Property Node(instance in=$"Multiple acquire variables control") -> ("Current Averages   "=w1, "Keithley Address"=w2)
  case ($"Error In") {
    frame Error, Default {
      w3 = $"Error In"
    }
    frame No Error {
      call "Clear Buffer.gvi"(VISA resource name=w2, error in (no error)=$"Error In") -> (VISA resource name out=w4, error out=w5)
      call "Enable Output.gvi"(VISA resource name=w4, Enable Output (T: Enable)=TRUE, error in (no error)=w5) -> (VISA resource name out=w6, error out=w7)
      call "Make Reading and Store in Buffer.gvi"(VISA resource name=w6, error in (no error)=w7) -> (VISA resource name out=w8, error out=w9)
      call "Read (Multiple Points).gvi"(VISA resource name=w8, Timeout (10000 ms)=60000, End Index (1)=w1, error in (no error)=w9) -> (VISA resource name out=w10, Data out=w11, error out=w12)
      Spreadsheet String To Array(array type=f64[] [], delimiter=",", format string="%g", spreadsheet string=w11) -> (array=w13)
      $"-10mV current measurements" <- w13
      call "Mean (DBL).gvi"(x=w13, error in=w12) -> (mean=w14, error out=w15)
      call "Enable Output.gvi"(VISA resource name=w10, Enable Output (T: Enable)=FALSE, error in (no error)=w15) -> (VISA resource name out=w16, error out=w17)
      call "Clear Buffer.gvi"(VISA resource name=w16, error in (no error)=w17) -> (VISA resource name out=w18, error out=w19)
      case ($"Close Coms after finish?") {
        frame False, Default {
          $"Keythley address out" <- w18
          w3 = w19
        }
        frame True {
          call "Close.gvi"(VISA resource name=w18, error in (no error)=w19) -> (error out=w3)
        }
      }
      $"-10mV current Value" <- w14
    }
  }
  $"Error Out" <- w3
