vi "Skip to next cell subroutine.gvi"   [LabVIEW NXG 3.1.0]
inputs:
  "Error In": error
outputs:
  "Error Out": error
uses:
  EQE_Measuring_Setup_NanOpto::SubVis::FGV::Current State FGV.gvi
  EQE_Measuring_Setup_NanOpto::SubVis::FGV::Skip To next Cell FGV.gvi
diagram:
  call "Current State FGV.gvi"(Instruction Current State FGV="Read Current State", Error In=$"Error In") -> (Current State Output=w1, Error Out=w2)
  Is Equal(x=w1, y="Multiple Acquire")
  case (TRUE) {
    frame False, Default {
      w4 = "The cell can only be skipped while measuring it\nright now I'm doing this: "
      Format Into String(initString=w4, errIn=w2, w1) -> (outString=w5, errOut=w3)
      Concatenate Strings(w5, "\nPlease try skipping during the active measurement.") -> w6
      One Button Dialog(button name ("OK")="Okay I'll try", message=w6)
    }
    frame True {
      call "Skip To next Cell FGV.gvi"(General instruction FGV enum="Set State", Skip cell?=TRUE, Error In=w2) -> (Error Out=w3)
    }
  }
  $"Error Out" <- w3
