vi "Save EQE TXT File.gvi"   [LabVIEW NXG 3.1.0]
inputs:
  "Default Data Saving Location": path
  "Cell Label": string
  "Full EQE Data": f64[][]
  "Author Initials": string
  "Sample Prefix": string
  "Current Date": string
  "Batch Name": string
  "Error In": error
  "Path type": "Path type.gtype" = "Calibration"
  "Dark Current": f64
  "Dark Current Measured?": bool
outputs:
  "Error Out": error
  "Folder to save all data": path
panel indicators:
  "Spreadsheet String": string
types:
  "Path type.gtype" = enum{"Calibration", "Single EQE", "Multiple EQE"}
uses:
  EQE_Measuring_Setup_NanOpto::SubVis::Utilities::Path Manipulation::Path Generator and Checker.gvi
  NI::G Core::File IO (General)::Check if File or Folder Exists.gvi
  EQE_Measuring_Setup_NanOpto::SubVis::Utilities::Other::Header info merger.gvi
  EQE_Measuring_Setup_NanOpto::SubVis::Utilities::Path Manipulation::Rename Window.gvi
diagram:
  case ($"Error In") {
    frame Error, Default {
      w1 = $"Error In"
    }
    frame No Error {
      call "Path Generator and Checker.gvi"(Default Data Saving Location=$"Default Data Saving Location", Author Initials=$"Author Initials", Current Date=$"Current Date", Batch Name=$"Batch Name", Sample Prefix=$"Sample Prefix", Error In=$"Error In", Path type=$"Path type", Cell Label=$"Cell Label") -> (File path=w2, Folder to save data=w3, Error Out=w4)
      $"Folder to save all data" <- w3
      call "Check if File or Folder Exists.gvi"(file or folder=w2, error in=w4) -> (file or folder exists?=w5, error out=w6)
      case (w5) {
        frame False, Default {
          w7 = w6
          w8 = "left button"
        }
        frame True {
          w9 = "The file you're trying to save already exists, do you want to:"
          Three Button Dialog(Allow user to close window? (TRUE)=FALSE, Center Button Text ("No")="Rename the file \nso that they are both safe", Justify Message (Left)="center", Left Button Text ("Yes")="Replace the already\nexisting file!", Right Button Text ("Cancel")="Do not save the\ncurrent file", message=w9) -> (Which Button?=w8)
          w7 = w6
        }
      }
      case (w8) {
        frame "left button" {
          Open Or Create Or Replace File(error in=w7, file path (use dialog)=w2, operation (0:open)="replace or create") -> (error out=w11, refnum out=w12)
          case ($"Dark Current Measured?") {
            frame False, Default {
              w13 = ["Wavelength (nm)", "EQE (%)", "Current (A)"]
            }
            frame True {
              Number To Engineering String(number=$"Dark Current", precision (6)=9) -> (Eng-format string=w14)
              Insert Into Array(inArray=["Wavelength (nm)", "EQE (%)", "Current (A)"], new="Dark Current (A) -> ", new=w14) -> w13
            }
          }
          Array To Spreadsheet String(array=$"Full EQE Data", format string="%g") -> (spreadsheet string=w10)
          call "Header info merger.gvi"(Column info array=w13, Spreadsheet String=w10) -> (Spreadsheet String With Header=w15)
          Write To Text File(error in=w11, file (use dialog)=w12, text=w15) -> (error out=w16, refnum out=w17)
          Close File(error in=w16, refnum=w17) -> (error out=w1)
        }
        frame "center button", Default {
          Strip Path(path=w2) -> (name=w18, stripped path=w19)
          call "Rename Window.gvi"(Original Filename=w18, Error In=w7) -> (Output=w20, Error Out=w21)
          Build Path(base path=w19, name or relative path=w20) -> (appended path=w22)
          Open Or Create Or Replace File(error in=w21, file path (use dialog)=w22, operation (0:open)="replace or create") -> (error out=w23, refnum out=w24)
          case ($"Dark Current Measured?") {
            frame False, Default {
              w25 = ["Wavelength (nm)", "EQE (%)", "Current (A)"]
            }
            frame True {
              Number To Engineering String(number=$"Dark Current", precision (6)=9) -> (Eng-format string=w26)
              Insert Into Array(inArray=["Wavelength (nm)", "EQE (%)", "Current (A)"], new="Dark Current (A) ->", new=w26) -> w25
            }
          }
          Array To Spreadsheet String(array=$"Full EQE Data", format string="%g") -> (spreadsheet string=w10)
          call "Header info merger.gvi"(Column info array=w25, Spreadsheet String=w10) -> (Spreadsheet String With Header=w27)
          Write To Text File(error in=w23, file (use dialog)=w24, text=w27) -> (error out=w28, refnum out=w29)
          Close File(error in=w28, refnum=w29) -> (error out=w1)
        }
        frame "right button" {
          w1 = w7
          w10 = ""
        }
      }
      $"Spreadsheet String" <- w10
    }
  }
  $"Error Out" <- w1
