vi "Save current EQE TXT instruction subroutine.gvi"   [LabVIEW NXG 3.1.0]
inputs:
  "Queue In": Queue<"Queue instructions.gtype">
  "Full EQE Data": f64[][]
  "Label Info Missing Error": bool
  "Save current EQE TXT": bool
  "Label Info Error Label": string
  "Current State Output": "Queue instructions.gtype" = "Initialize App"
  "Error In": error
outputs:
  "Queue Out": Queue<"Queue instructions.gtype">
  "Error Out": error
types:
  "Queue instructions.gtype" = enum{"Wrongly pointed State", "Initialize App", "Light Calibration", "Measure Photodetector", "Measure Keithley", "Instrument detection", "Single Acquire", "Multiple Acquire", "EQE Mapping", "Debugging mode", "Move Arduino", "Arduino FF flip filter", "Help routine", "Idle", "Save Calibration", "Load Calibration", "Set Wavelength", "Turn supercontinuum laser on/off", "Set Multiplex arduino cell", "Save TXT EQE file", "Load TXT EQE", "Stop or Idle", "Stop App"}
uses:
  EQE_Measuring_Setup_NanOpto::SubVis::FGV::Current State FGV.gvi
diagram:
  call "Current State FGV.gvi"(Instruction Current State FGV="Read Current State", Error In=$"Error In") -> (Current State Output=w1, Error Out=w2)
  Is Not Equal(x=w1, y="Idle") -> w3
  Is Empty Array(array=$"Full EQE Data") -> w4
  Logical Or(w4, $"Label Info Missing Error", w3) -> w5
  case (w5) {
    frame True {
      case ($"Label Info Missing Error") {
        frame False, Default { }
        frame True {
          One Button Dialog(button name ("OK")="Okay, sorry, I will fix it right now", message=$"Label Info Error Label")
        }
      }
      case (w4) {
        frame False, Default { }
        frame True {
          w8 = "Oops I forgot I was supposed to\ngenerate data before saving :')"
          One Button Dialog(button name ("OK")=w8, message="There is no EQE data to save!!!")
        }
      }
      case (w3) {
        frame False, Default { }
        frame True {
          Format Into String($"Current State Output") -> w9
          w10 = "Please wait until all tasks have been finished.\nCurrent task: "
          Concatenate Strings(w10, w9) -> w11
          One Button Dialog(button name ("OK")="Okay, sorry, I will wait", message=w11)
        }
      }
      w6 = $"Queue In"
      w7 = w2
    }
    frame False {
      w12 = "Save TXT EQE file"  # Enum instructions
      Enqueue Element(element=w12, error in=w2, queue=$"Queue In") -> (error out=w7, queue out=w6)
    }
  }
  $"Queue Out" <- w6
  $"Error Out" <- w7
