vi "Keithley adaptative measurement setup.gvi"   [LabVIEW NXG 5.0.0]
inputs:
  "Last Measurement": f64
  "2nd Last Measurement": f64
  "3nd Last Measurement": f64
  "threshold": f64
  "Error Out": error
  "Keithley address in": "VISA Instr"
  "loop iteration": i32
  "Single acquire inputs control": "Single acquire inputs control.gtype"
outputs:
  "Keythley address out": "VISA Instr"
  "Error In": error
types:
  "Single acquire inputs control.gtype" = cluster{"Light calibration data": f64[][], "Fiannium Configuration File": path, "Arduino Filter Flipper Address": "VISA Instr", "Filter Arduino Status": bool, "Dark Current Averages": f64, "Measure dark current?": bool, "Keithley Address": "VISA Instr", "Current Aveages": i32, "Voltage Applied (V)": f64, "Max current compliance": f64, "Manual Current Range": f64, "Enable Auto Range": bool, "Automatic measurement": bool, "Fiannium Pe Handler": u64, "Dead Cell? Current Threshold": f64, "Automatic measurement Cell Dark current": f64, "Monocrhomator": bool}
uses:
  Labview_NXG_Keithley_SMU_2450_2460_2461::Configure::Enable Source Auto Range.gvi
  Labview_NXG_Keithley_SMU_2450_2460_2461::Configure::Configure Measurement Range.gvi
diagram:
  case ($"Error In") {
    frame Error, Default {
      w1 = $"Error In"
      w2 = $"Keithley address in"
    }
    frame No Error {
      Is Greater(x=$"Last Measurement", y=$threshold) -> w3
      Is Greater(x=$"2nd Last Measurement", y=$threshold) -> w4
      Is Greater(x=$"3nd Last Measurement", y=$threshold) -> w5
      Logical Or(w3, w4, w5) -> w6
      Is Less(x=$"loop iteration", y=3) -> w7
      Logical Or(w6, w7) -> w8
      Feedback Node(initial value=FALSE, input=w8) -> w9
      Is Not Equal(x=w9, y=w8) -> w10
      case (w10) {
        frame False, Default {
          w2 = $"Keithley address in"
          w1 = $"Error In"
        }
        frame True {
          case (w8) {
            frame True {
              Property Node(instance in=$"Single acquire inputs control") -> ("Enable Auto Range"=w11)
              call "Enable Source Auto Range.gvi"(VISA resource name=$"Keithley address in", Function (0: Volts)="Current"(1), Enable Auto Range (T:Enable)=w11, error in (no error)=$"Error In") -> (VISA resource name out=w2, error out=w1)
            }
            frame False {
              call "Configure Measurement Range.gvi"(Manual Range (1.0)=1e-08, VISA resource name=$"Keithley address in", Function (0: Volts)="Current"(1), Enable Auto Range (T:Enable)=FALSE, error in (no error)=$"Error In") -> (VISA resource name out=w2, error out=w1)
            }
          }
        }
      }
    }
  }
  $"Keythley address out" <- w2
  $"Error Out" <- w1
