vi "Single Acquire Close Subroutine.gvi"   [LabVIEW NXG 5.0.0]
inputs:
  "Input": Queue<"Queue instructions.gtype">
  "Input_2": Notifier<"Single Acquire Notification control.gtype">
  "Error Out_2": error
  "Input_3": error
outputs:
  "Output": Queue<"Queue instructions.gtype">
  "Output_2": error
types:
  "Single Acquire Notification control.gtype" = cluster{"Wavelength (nm)": f64, "EQE (%)": f64, "Current (A)": f64, "Finnished": bool, "Progress": f64}
  "Queue instructions.gtype" = enum{"Wrongly pointed State", "Initialize App", "Light Calibration", "Measure Photodetector", "Measure Keithley", "Instrument detection", "Single Acquire", "Multiple Acquire", "EQE Mapping", "Debugging mode", "Move Arduino", "Arduino FF flip filter", "Help routine", "Idle", "Save Calibration", "Load Calibration", "Set Wavelength", "Help Wizard", "Turn supercontinuum laser on/off", "Set Multiplex arduino cell", "Save TXT EQE file", "Load TXT EQE", "Stop or Idle", "Stop App"}
uses:
  NI::G Core::Error::Multiplex Errors.gvi
  EQE_Measuring_Setup_NanOpto::SubVis::Utilities::Messages And Prompts::Save Single EQE prompt.gvi
diagram:
  call "Multiplex Errors.gvi"(error in 1=$"Error Out_2", error in 2=$Input_3) -> (error out=w1)
  Release Notifier(error in (no error)=w1, notifier=$Input_2) -> (error out=w2)
  call "Save Single EQE prompt.gvi"(Input=$Input, error out_2=w2) -> (Output=w3, Output_2=w4)
  $Output <- w3
  $Output_2 <- w4
