vi "Single EQE Measurement Acquire.gvi"   [LabVIEW NXG 3.1.0]
inputs:
  "Single acquire inputs control": "Single acquire inputs control.gtype"
  "Notifier In": Notifier<"Single Acquire Notification control.gtype">
  "Error In": error
outputs:
  "Error Out": error
  "Dark Current": f64
  "Full EQE Data": f64[][]
  "Notifier Out": Notifier<"Single Acquire Notification control.gtype">
panel indicators:
  "Current measurements": f64[]
  "spreadsheet string": string
  "Voltage Auto Range Enabled?": bool
  "Current Auto Range Enabled?": bool
  "Resistance Auto Range Enabled?": bool
types:
  "Single acquire inputs control.gtype" = cluster{"Light calibration data": f64[][], "Fiannium Configuration File": path, "Arduino Filter Flipper Address": "VISA Instr", "Filter Arduino Status": bool, "Dark Current Averages": f64, "Measure dark current?": bool, "Keithley Address": "VISA Instr", "Current Aveages": i32, "Voltage Applied (V)": f64, "Max current compliance": f64, "Manual Current Range": f64, "Enable Auto Range": bool, "Automatic measurement": bool, "Fiannium Pe Handler": u64, "Dead Cell? Current Threshold": f64, "Automatic measurement Cell Dark current": f64}
  "Single Acquire Notification control.gtype" = cluster{"Wavelength (nm)": f64, "EQE (%)": f64, "Current (A)": f64, "Finnished": bool, "Progress": f64}
uses:
  EQE_Measuring_Setup_NanOpto::SubVis::Instrument Control::Keithley::Keithley Initialization Sequence.gvi
  PE_Filter_SDK::Monochromator Initialization Sequence.gvi
  EQE_Measuring_Setup_NanOpto::SubVis::FGV::Current State FGV.gvi
  EQE_Measuring_Setup_NanOpto::SubVis::Instrument Control::Arduinos::Filter Flipper Arduino::Filter Plipper Arduino set to IR pass.gvi
  EQE_Measuring_Setup_NanOpto::SubVis::Instrument Control::Keithley::Dark current Measurement.gvi
  Keithley 2450 NXG Library::Public::Configure::Set Measurement Count.gvi
  EQE_Measuring_Setup_NanOpto::SubVis::Utilities::Other::Light Calibration parameters extractor.gvi
  EQE_Measuring_Setup_NanOpto::SubVis::Utilities::Other::Wavelength loop calculation.gvi
  EQE_Measuring_Setup_NanOpto::SubVis::Instrument Control::Monochromator::Filter Wavelength nm Crossing ka.gvi
  Keithley 2450 NXG Library::Public::Configure::Enable Measurement Auto Range.gvi
  Keithley 2450 NXG Library::Public::Configure::Get Measurement Auto Range.gvi
  EQE_Measuring_Setup_NanOpto::SubVis::Instrument Control::Arduinos::Filter Flipper Arduino::Filter Flipper arduino flip subroutine.gvi
  Keithley 2450 NXG Library::Public::Configure::Clear Buffer.gvi
  Keithley 2450 NXG Library::Public::Configure::Configure Integration Filter.gvi
  Keithley 2450 NXG Library::Public::Action Status::Enable Output.gvi
  EQE_Measuring_Setup_NanOpto::SubVis::Instrument Control::Monochromator::Fiannium wavelength correction.gvi
  EQE_Measuring_Setup_NanOpto::SubVis::Utilities::Other::Wavelength detection filter flipper routine.gvi
  PE_Filter_SDK::PE Set Wavelength On Grating.gvi
  EQE_Measuring_Setup_NanOpto::SubVis::Main Sub Functions::Global Abort::Global Abort.gvi
  EQE_Measuring_Setup_NanOpto::SubVis::FGV::Skip To next Cell FGV.gvi
  Keithley 2450 NXG Library::Public::Data::Make Reading and Store in Buffer.gvi
  Keithley 2450 NXG Library::Public::Data::Read (Multiple Points).gvi
  NI::Analysis::Statistics::Mean (DBL).gvi
  EQE_Measuring_Setup_NanOpto::SubVis::Utilities::Messages And Prompts::Erase Notification Error.gvi
  Keithley 2450 NXG Library::Public::Close.gvi
  PE_Filter_SDK::PE Close.gvi
  PE_Filter_SDK::PE Destroy.gvi
diagram:
  Property Node(instance in=$"Single acquire inputs control") -> ("Enable Auto Range"=w1, "Fiannium Configuration File"=w2, "Arduino Filter Flipper Address"=w3, "Filter Arduino Status"=w4, "Dark Current Averages"=w5, "Measure dark current?"=w6, "Keithley Address"=w7, "Current Aveages"=w8, "Voltage Applied (V)"=w9, "Max current compliance"=w10, "Manual Current Range"=w11, "Automatic measurement"=w12, "Fiannium Pe Handler"=w13)
  Logical And(not w12, w6) -> w14
  case (w12) {
    frame True {
      # If it is an automatic measurement
      # both the keithley and the fiannium will have been
      # initialized
      w15 = w7
      w16 = w13
      w17 = $"Error In"
    }
    frame False {
      call "Keithley Initialization Sequence.gvi"(Enable Auto Range=w1, VISA resource name=w7, Voltage Applied (V)=w9, Source Limit Level (0.1)=w10, Current Averages=w8, Error In=$"Error In", Manual Current Range=w11) -> (VISA resource name out=w15, Error Out=w18)
      call "Monochromator Initialization Sequence.gvi"(Configuration File=w2, Error In=w18) -> (peHandle out=w16, Error Out=w17)
    }
  }
  case (w14) {
    frame False, Default {
      # If It is an automatic measurement or we do not want
      # to measure the dark current we just pass the info
      w19 = w15
      w20 = w17
      w21 = w16
    }
    frame True {
      call "Current State FGV.gvi"(Instruction Current State FGV="Set Current SubState", Current SubState="Measuring Dark Current", Error In=w17) -> (Error Out=w22)
      call "Filter Plipper Arduino set to IR pass.gvi"(Arduino Filter Flipper Address=w3, Filter Arduino Status=w4, Error In=w22) -> (Error Out=w23)
      call "Dark current Measurement.gvi"(Keithley Address=w15, Fiannium Pe Handler=w16, Close Coms after finish?=FALSE, Error In=w23, Dark Current Aveages=w5) -> (Dark current Value=w24, Pe Handle out=w21, Keythley address out=w25, Error Out=w26)
      $"Dark Current" <- w24
      call "Set Measurement Count.gvi"(VISA resource name=w25, Measurement Count=w8, error in (no error)=w26) -> (VISA resource name out=w19, error out=w20)
    }
  }
  case (w20) {
    frame Error, Default {
      w28 = "Single Acquire Notification control.gtype" {all zero or empty}
      Send Notification(notification=w28, notifier=$"Notifier In")
      w27 = w20
    }
    frame No Error {
      Property Node(instance in=$"Single acquire inputs control") -> ("Filter Arduino Status"=w29, "Arduino Filter Flipper Address"=w30, "Light calibration data"=w31, "Dead Cell? Current Threshold"=w32, "Enable Auto Range"=w33)
      call "Light Calibration parameters extractor.gvi"(Light calibration data=w31) -> (End Wavelength (nm) Current Calibration=w34, Wavelength Step (nm) Current Calibration=w35, Start Wavelength (nm) Current Calibration=w36)
      call "Wavelength loop calculation.gvi"(Wavelength Step (nm)=w35, End Wavelength (nm)=w34, Start Wavelength (nm)=w36) -> (Ammount of steps +1 (for the loop)=w37, Positive or negative steps=w38, Exact ammount of steps=w39)
      call "Filter Wavelength nm Crossing ka.gvi"(Light Power Calibration Data=w31) -> (Crosses the Change Grating Wavelength Frontier?=w40)
      call "Enable Measurement Auto Range.gvi"(VISA resource name=w19, Function (0: Volts)="Current"(1), Enable Auto Range (T:Enable)=w33, error in (no error)=w20) -> (VISA resource name out=w41, error out=w42)
      call "Get Measurement Auto Range.gvi"(VISA resource name=w41, error in (no error)=w42) -> (VISA resource name out=w43, Voltage Auto Range Enabled?=w44, Current Auto Range Enabled?=w45, Resistance Auto Range Enabled?=w46, error out=w47)
      call "Filter Flipper arduino flip subroutine.gvi"(Start Wavelength (nm) Current Calibration=w36, Filter Arduino Status=w29, Arduino Filter Flipper Address=w30, Error In=w47) -> (Error Out=w48)
      call "Clear Buffer.gvi"(VISA resource name=w43, error in (no error)=w48) -> (VISA resource name out=w49, error out=w50)
      call "Configure Integration Filter.gvi"(VISA resource name=w49, Measurement Speed (1 PLC)=0.5, error in (no error)=w50) -> (VISA resource name out=w51, error out=w52)
      call "Enable Output.gvi"(VISA resource name=w51, Enable Output (T: Enable)=TRUE, error in (no error)=w52) -> (VISA resource name out=w53, error out=w54)
      s1 = w54  # shift register
      s2 = w21  # shift register
      s3 = w53  # shift register
      s4 = f64[][] []  # shift register
      s5 = $"Notifier In"  # shift register
      s6 = uninitialised  # shift register
      s6.prev1 = uninitialised  # shift register
      s6.prev2 = uninitialised  # shift register
      for (N = w37) (iteration -> i1) {
        Wait Until Next Multiple(multiple to wait=5)
        # w55: Light power at current wavelength
        Property Node(instance in=$"Single acquire inputs control") -> ("Current Aveages"=w56, "Filter Arduino Status"=w57, "Arduino Filter Flipper Address"=w58)
        Multiply(i1, w56) -> w59
        Increment(x=w59) -> w60
        Add(w59, w56) -> w61
        call "Current State FGV.gvi"(Instruction Current State FGV="Set Current SubState", Current SubState="Measuring with Keithley", Error In=s1) -> (Error Out=w62)
        call "Keithley adaptative measurement setup.gvi"(Keithley address in=s3, Last Measurement=s6, 2nd Last Measurement=s6.prev1, 3nd Last Measurement=s6.prev2, threshold=w32, loop iteration=i1, Error Out=w62, Single acquire inputs control=$"Single acquire inputs control") -> (Keythley address out=w63, Error In=w64)
        Multiply(w35, i1, w38) -> w65
        Add(w65, w36) -> w66
        call "Fiannium wavelength correction.gvi"(Desired wavelength=w66) -> (Grating for the system=w67, Wavelength for the system=w68)
        call "Wavelength detection filter flipper routine.gvi"(Current Wavelength=w66, Arduino Filter Flipper Status=w57, Arduino Filter Flipper Address=w58, Crossing Ka=w40, Error In=w64) -> (Error Out=w69)
        call "PE Set Wavelength On Grating.gvi"(peHandle=s2, gratingIndex=w67, wavelength=w68, error in (no error)=w69) -> (peHandle out=w70, error out=w71)
        # w60: Buffer start index
        # w61: Buffer end index
        call "Global Abort.gvi"(Instruction="Read Abort State", Error In=w71) -> (Local Abort State=w72, Global Abort State=w73, Error Out=w74)
        call "Skip To next Cell FGV.gvi"(General instruction FGV enum="Read state", Error In=w74) -> (Skip cell? out=w75, Error Out=w76)
        call "Make Reading and Store in Buffer.gvi"(VISA resource name=w63, error in (no error)=w76) -> (VISA resource name out=w77, error out=w78)
        call "Read (Multiple Points).gvi"(VISA resource name=w77, Timeout (10000 ms)=30000, Start Index (1)=w60, End Index (1)=w61, error in (no error)=w78) -> (VISA resource name out=w79, Data out=w80, error out=w81)
        Spreadsheet String To Array(array type=f64[] [], delimiter=",", format string="%g", spreadsheet string=w80) -> (array=w82)
        $"Current measurements" <- w82
        $"spreadsheet string" <- w80
        call "Mean (DBL).gvi"(x=w82, error in=w81) -> (mean=w83, error out=w84)
        Divide(x=i1, y=w37) -> w85
        Multiply(w85, 100) -> w86
        Is Greater Or Equal(x=i1, y=w39) -> w87
        Logical Or(w72, w73, w75) -> w88
        Logical Or(w87, w88) -> w89
        Divide(x=1240, y=w66) -> w90
        Array Index(array=w31) -> (out0[i1, 1]=w55)
        Divide(x=w83, y=w55) -> w91
        Multiply(w91, w90, 100) -> w92
        Absolute Value(x=w92) -> w93
        w94 = "Single Acquire Notification control.gtype" {all zero or empty}
        Property Node(instance in=w94, "Wavelength (nm)"=w66, "EQE (%)"=w93, "Current (A)"=w83, "Finnished"=w89, "Progress"=w86) -> (instance out=w95)
        Send Notification(error in (no error)=w84, notification=w95, notifier=s5) -> (error out=w96, notifier out=w97)
        call "Erase Notification Error.gvi"(error out_2=w96) -> (Output=w98)
        Absolute Value(x=w83) -> w99
        # w93: EQE (%)
        # w83: Current (A)
        Build Array(w66, w93, w83) -> w100
        Insert Into Array(inArray=s4, index0=i1, new=w100) -> w101
        next s1 = w98
        next s2 = w70
        next s3 = w79
        next s4 = w101
        next s5 = w97
        next s6 = w99
        stop if w88
      }
      Property Node(instance in=$"Single acquire inputs control") -> ("Automatic measurement"=w102)
      call "Skip To next Cell FGV.gvi"(General instruction FGV enum="Reset State", Error In=s1) -> (Error Out=w103)
      call "Enable Output.gvi"(VISA resource name=s3, Enable Output (T: Enable)=FALSE, error in (no error)=w103) -> (VISA resource name out=w104, error out=w105)
      call "Clear Buffer.gvi"(VISA resource name=w104, error in (no error)=w105) -> (VISA resource name out=w106, error out=w107)
      case (w102) {
        frame True {
          # If it is an automatic measurement
          # we leave the keithley running
          # and also the monochromator
          w27 = w107
        }
        frame False {
          call "Close.gvi"(VISA resource name=w106, error in (no error)=w107) -> (error out=w108)
          call "PE Close.gvi"(peHandle=s2, error in (no error)=w108) -> (peHandle out=w109, error out=w110)
          call "PE Destroy.gvi"(peHandle=w109, error in (no error)=w110) -> (error out=w27)
        }
      }
      $"Notifier Out" <- s5
      $"Voltage Auto Range Enabled?" <- w44
      $"Current Auto Range Enabled?" <- w45
      $"Resistance Auto Range Enabled?" <- w46
      $"Full EQE Data" <- s4
    }
  }
  $"Error Out" <- w27
