vi "Auto Measurement Cell selection subroutine.gvi"   [LabVIEW NXG 3.1.0]
inputs:
  "Queue In": "BooleanControl reference"
  "Random Cell Order": bool
  "Reset": bool
  "All": bool
  "Cell Data Cluster_2": "Cell Data Cluster 2.gtype"
  "Error In": error
outputs:
  "Cell Measuring Order": string
  "Cell Measuring Labels": string[]
  "Cell Data Cluster": "Cell Data Cluster 2.gtype"
  "Error Out": error
types:
  "Cell Data Cluster 2.gtype" = cluster{"R.01": bool, "L.01": bool, "R.02": bool, "L.02": bool, "R.03": bool, "L.03": bool, "R.04": bool, "L.04": bool, "R.05": bool, "L.05": bool, "R.06": bool, "L.06": bool, "R.07": bool, "L.07": bool, "R.08": bool, "L.08": bool, "R.09": bool, "L.09": bool, "R.10": bool, "L.10": bool, "R.11": bool, "L.11": bool, "R.12": bool, "L.12": bool}
uses:
  EQE_Measuring_Setup_NanOpto::SubVis::Utilities::Other::Cell Randomizer.gvi
diagram:
  case ($Reset) {
    frame False, Default {
      case ($All) {
        frame False, Default {
          w1 = $"Error In"
          w2 = $"Cell Data Cluster_2"
        }
        frame True {
          Property Node(instance in=$"Cell Data Cluster_2", "L.01"=TRUE, "R.01"=TRUE, "L.02"=TRUE, "R.02"=TRUE, "L.03"=TRUE, "R.03"=TRUE, "L.04"=TRUE, "R.04"=TRUE, "L.05"=TRUE, "R.05"=TRUE, "L.06"=TRUE, "R.06"=TRUE, "L.07"=TRUE, "R.07"=TRUE, "L.08"=TRUE, "R.08"=TRUE, "L.09"=TRUE, "R.09"=TRUE, "L.10"=TRUE, "R.10"=TRUE, "L.11"=TRUE, "R.11"=TRUE, "L.12"=TRUE, "R.12"=TRUE) -> (instance out=w2)
          w1 = $"Error In"
        }
      }
    }
    frame True {
      Property Node(instance in=$"Cell Data Cluster_2", "L.01"=FALSE, "R.01"=FALSE, "L.02"=FALSE, "R.02"=FALSE, "L.03"=FALSE, "R.03"=FALSE, "L.04"=FALSE, "R.04"=FALSE, "L.05"=FALSE, "R.05"=FALSE, "L.06"=FALSE, "R.06"=FALSE, "L.07"=FALSE, "R.07"=FALSE, "L.08"=FALSE, "R.08"=FALSE, "L.09"=FALSE, "R.09"=FALSE, "L.10"=FALSE, "R.10"=FALSE, "L.11"=FALSE, "R.11"=FALSE, "L.12"=FALSE, "R.12"=FALSE) -> (instance out=w2)
      Property Node(instance in=$"Queue In", "Value"=FALSE)
      w1 = $"Error In"
    }
  }
  call "Cell Randomizer.gvi"(Random Cell Order=$"Random Cell Order", Cell Data Cluster=w2, Error In=w1) -> (Cell Measuring Order=w3, Cell Measuring labels=w4, Error Out=w5)
  $"Cell Measuring Order" <- w3
  $"Cell Measuring Labels" <- w4
  $"Error Out" <- w5
  $"Cell Data Cluster" <- w2
