vi "Check If other tasks active subroutine.gvi"   [LabVIEW NXG 3.1.0]
inputs:
  "Queue In": Queue<"Queue instructions.gtype">
  "Desired Task": "Queue instructions.gtype" = "Set Multiplex arduino cell"
  "Error In": error
outputs:
  "Queue Out": Queue<"Queue instructions.gtype">
  "Error out": error
types:
  "Queue instructions.gtype" = enum{"Wrongly pointed State", "Initialize App", "Light Calibration", "Measure Photodetector", "Measure Keithley", "Instrument detection", "Single Acquire", "Multiple Acquire", "EQE Mapping", "Debugging mode", "Move Arduino", "Arduino FF flip filter", "Help routine", "Idle", "Save Calibration", "Load Calibration", "Set Wavelength", "Turn supercontinuum laser on/off", "Set Multiplex arduino cell", "Save TXT EQE file", "Load TXT EQE", "Stop or Idle", "Stop App"}
uses:
  EQE_Measuring_Setup_NanOpto::SubVis::FGV::Current State FGV.gvi
diagram:
  call "Current State FGV.gvi"(Instruction Current State FGV="Read Current State", Error In=$"Error In") -> (Current State Output=w1, Error Out=w2)
  Is Not Equal(x=w1, y="Idle") -> w3
  case (w3) {
    frame True {
      Format Into String(w1) -> w6
      w7 = "Please wait until all tasks have been finished.\nCurrent task: "
      Concatenate Strings(w7, w6) -> w8
      One Button Dialog(button name ("OK")="Okay, sorry, I will wait", message=w8)
      w4 = w2
      w5 = $"Queue In"
    }
    frame False {
      Enqueue Element(element=$"Desired Task", error in=w2, queue=$"Queue In") -> (error out=w4, queue out=w5)
    }
  }
  $"Queue Out" <- w5
  $"Error out" <- w4
