vi "Check Reference coordinate file.gvi"   [LabVIEW NXG 3.1.0]
inputs:
  "error out": error
  "R.01 Reference Coordinates": "R.01 Reference Coordinates.gtype" = {"X coordinate R.01"=145.3, "Z coordinate R.01"=2.5, "Vertical Spacing"=0}
outputs:
  "error in": error
  "Coordinate reference path": path
  "R.01 Reference Coordinates Out": "R.01 Reference Coordinates.gtype"
types:
  "R.01 Reference Coordinates.gtype" = cluster{"X coordinate R.01": f64, "Z coordinate R.01": f64, "Vertical Spacing": f64}
uses:
  NI::G Core::File IO (General)::Check if File or Folder Exists.gvi
  EQE_Measuring_Setup_NanOpto::SubVis::Utilities::Messages And Prompts::Select file prompt.gvi
  NI::G Core::File IO (General)::Create Directory Recursive.gvi
  EQE_Measuring_Setup_NanOpto::SubVis::Utilities::Path Manipulation::Write Reference Coordinate File.gvi
  EQE_Measuring_Setup_NanOpto::SubVis::Utilities::Path Manipulation::Read Coordinate Reference file.gvi
diagram:
  case ($"error out") {
    frame Error, Default {
      w1 = $"error out"
    }
    frame No Error {
      Get Component Directory() -> (Path=w2)
      Strip Path(path=w2) -> (stripped path=w3)
      Build Path(base path=w3, name or relative path="Extra installers\\Reference_Coordinates.txt") -> (appended path=w4)
      s1 = w4  # shift register
      while (iteration -> i1) {
        Wait Until Next Multiple(multiple to wait=500)
        call "Check if File or Folder Exists.gvi"(file or folder=s1, error in=$"error out") -> (file or folder exists?=w5, error out=w6)
        case (w5) {
          frame False, Default {
            w10 = "I will make sure\nthe file is placed\nback where it \nbelongs"
            Path To String(path=s1) -> (string=w11)
            w12 = """
Please make sure that the file is put back on that
location, provide an alternative path with the file or,
if you want, we can generate a file with the default 
coordinates."""
            w13 = "I could not find the Reference_Coordinates file in \nthis location:\n"
            Concatenate Strings(w13, w11, w12) -> w14
            Three Button Dialog(Allow user to close window? (TRUE)=FALSE, Center Button Text ("No")=w10, Left Button Text ("Yes")="I will provide an\nalternative path", Right Button Text ("Cancel")="Create a New File, i\ndo not know where the\nother is.", Window Title (" ")="Reference_Coordinates.txt not found", message=w14) -> (Which Button?=w15)
            case (w15) {
              frame "center button" {
                Wait Until Next Multiple(multiple to wait=5000)
                w8 = w6
                w9 = s1
              }
              frame "left button", Default {
                call "Select file prompt.gvi"(Main Message="Please select the Reference_Coordinates.txt file.", Sub message="It is usually on the extra installers folder", Error In=w6) -> (New Path=w9, Error Out=w8)
              }
              frame "right button" {
                Strip Path(path=s1) -> (stripped path=w16)
                call "Create Directory Recursive.gvi"(folder=w16, error in=w6) -> (error out=w17)
                call "Write Reference Coordinate File.gvi"(Input=s1, R.01 Reference Coordinates=$"R.01 Reference Coordinates", operation="create", error out_2=w17) -> (Output=w9, Output_2=w8)
              }
            }
            w7 = FALSE
          }
          frame True {
            w7 = TRUE
            w8 = w6
            w9 = s1
          }
        }
        Is Greater(x=i1, y=5) -> w18
        case (w18) {
          frame False, Default {
            w19 = w8
            w20 = FALSE
          }
          frame True {
            w21 = """Seems you're having some trouble
finding the monochromator config
file, do you want to proceed without it
and hope for the best?
(WARNING: some functionalities might
be compromized, or the entire program 
can crash)"""
            Two Button Dialog(F button name ("Cancel")="Oh dear no, I'd rather ask for help", T button name ("OK")="Yes please, I like to live dangerously", message=w21) -> (T Button?=w20)
            w19 = w8
          }
        }
        Logical Or(w20, w7) -> w22
        next s1 = w9
        stop if w22
      }
      call "Read Coordinate Reference file.gvi"(Input_2=s1, R.01 Reference Coordinates In=$"R.01 Reference Coordinates", Input=w19) -> (Coordinate reference path=w23, R.01 Reference Coordinates Out=w24, Output=w1)
      $"R.01 Reference Coordinates Out" <- w24
      $"Coordinate reference path" <- w23
    }
  }
  $"error in" <- w1
