vi "Dark Current cell label Sanity Check.gvi"   [LabVIEW NXG 3.1.0]
inputs:
  "Cel label": string
  "Current cell Dark Current Info": T1
  "Multiple acquire variables control": "Multiple acquire variables control.gtype"
outputs:
  "Dark Current": f64
types:
  "R.01 Reference Coordinates.gtype" = cluster{"X coordinate R.01": f64, "Z coordinate R.01": f64, "Vertical Spacing": f64}
  "Multiple acquire variables control.gtype" = cluster{"Monochromator configuration file ": path, "Light Power Calibration Data": f64[][], "Cell Measuring Labels": string[], "Sample Prefix": string, "Author Initials": string, "Current Date": string, "Batch Name": string, "Default Data Saving Location": path, "Filter Arduino Status": bool, "Filter Arduino Address": "VISA Instr", "Multiplexer Arduino Address": "VISA Instr", "Carriage Arduino Address": "VISA Instr", "Keithley Address": "VISA Instr", "Current Averages   ": f64, "Manual Range  ": f64, "Max current": f64, "Voltage Applied (V)  ": f64, "Autorange  ": bool, "Dark Current  ": bool, "Wavelength for peak detection": f64, "R.01 Reference Coordinates": "R.01 Reference Coordinates.gtype", "R.01 Scan?": bool, "Z scan steps": f64, "X scan Range (mm)": f64, "Z scan Range (mm)": f64, "X scan steps": f64, "Reference Coordinates file": path, "Save R.01 Coordinate?": bool, "Fianium Pe Handler": u64, "Automatic Measurement?": bool, "Dead Cell 10mV Current Threshold": f64}
  T1 = cluster{"Cell Label": string, "Dark Current": f64}
diagram:
  Property Node(instance in=$"Multiple acquire variables control") -> ("Dark Current  "=w1)
  Property Node(instance in=$"Current cell Dark Current Info") -> ("Cell Label"=w2, "Dark Current"=w3)
  Is Equal(x=w2, y=$"Cel label") -> w4
  Logical Or(w4, not w1) -> w5
  case (w5) {
    frame False, Default {
      w6 = "Dark current cell label\nand current cell label are not the \nSAMEE!!!"
      One Button Dialog(message=w6)
    }
    frame True {
      # Sanity check for dark current
    }
  }
  $"Dark Current" <- w3
