vi "Error Detected STOP subroutine.gvi"   [LabVIEW NXG 3.1.0]
inputs:
  "Input": Queue<"Queue instructions.gtype">
  "Input_2": bool
  "Input_3": error
outputs:
  "Output": Queue<"Queue instructions.gtype">
  "stop": bool
  "Output_2": error
types:
  "Queue instructions.gtype" = enum{"Initialize App", "Light Calibration", "Measure Photodetector", "Measure Keithley", "Instrument detection", "Single Acquire", "Multiple Acquire", "EQE Mapping", "Debugging mode", "Move Arduino", "Arduino FF flip filter", "Help routine", "Idle", "Save Calibration", "Load Calibration", "Set Wavelength", "Turn supercontinuum laser on/off", "Set Multiplex arduino cell", "Save TXT EQE file", "Load TXT EQE", "Stop or Idle", "Stop App"}
uses:
  EQE_Measuring_Setup_NanOpto::SubVis::Main Sub Functions::Global Abort::Global Abort.gvi
diagram:
  case ($Input_3) {
    frame Error, Default {
      w3 = "Stop App"  # Enum instructions
      Enqueue Element At Opposite End(element=w3, error in=$Input_3, queue=$Input) -> (error out=w1, queue out=w2)
    }
    frame No Error {
      w1 = $Input_3
      w2 = $Input
    }
  }
  $Output <- w2
  call "Global Abort.gvi"(Instruction="Read Abort State", Error In=w1) -> (Global Abort State=w4, Error Out=w5)
  $Output_2 <- w5
  Property Node(instance in=w5) -> ("status"=w6)
  Logical Or(w6, $Input_2, w4) -> w7
  $stop <- w7
