vi "Exit app instruction subroutine.gvi"   [LabVIEW NXG 3.1.0]
inputs:
  "Input": Queue<"Queue instructions.gtype">
  "Exit App": bool  # Exit the application while waiting for everything to finish
  "Input_2": error
outputs:
  "Output_2": Queue<"Queue instructions.gtype">
  "Output": error
types:
  "Queue instructions.gtype" = enum{"Initialize App", "Light Calibration", "Measure Photodetector", "Measure Keithley", "Instrument detection", "Single Acquire", "Multiple Acquire", "EQE Mapping", "Debugging mode", "Move Arduino", "Help routine", "Idle", "Save Calibration", "Load Calibration", "Set Wavelength", "Turn supercontinuum laser on/off", "Set Multiplex arduino cell", "Save TXT EQE file", "Load TXT EQE", "Stop or Idle", "Stop App"}
diagram:
  Two Button Dialog(F button name ("Cancel")="No please I want to\nwork more :3", T button name ("OK")="Yes (The app will close\nonce everything is finished)", message="Are you sure you want to exit?") -> (T Button?=w1)
  case (w1) {
    frame False, Default {
      w2 = $Input
      w3 = $Input_2
    }
    frame True {
      w4 = "Stop App"  # Enum instructions
      Enqueue Element(element=w4, error in=$Input_2, queue=$Input) -> (error out=w3, queue out=w2)
    }
  }
  $Output_2 <- w2
  $Output <- w3
