vi "Global Abort instruction subroutine.gvi"   [LabVIEW NXG 3.1.0]
inputs:
  "Queue In": Queue<"Queue instructions.gtype">
  "Global Abort": bool  # Force exit either the current process or the entire app (you will be prompted)
  "Error In": error
outputs:
  "Queue Out": Queue<"Queue instructions.gtype">
  "Global Abort full": bool
  "Error Out": error
types:
  "Queue instructions.gtype" = enum{"Wrongly pointed State", "Initialize App", "Light Calibration", "Measure Photodetector", "Measure Keithley", "Instrument detection", "Single Acquire", "Multiple Acquire", "EQE Mapping", "Debugging mode", "Move Arduino", "Arduino FF flip filter", "Help routine", "Idle", "Save Calibration", "Load Calibration", "Set Wavelength", "Turn supercontinuum laser on/off", "Set Multiplex arduino cell", "Save TXT EQE file", "Load TXT EQE", "Stop or Idle", "Stop App"}
uses:
  EQE_Measuring_Setup_NanOpto::SubVis::Main Sub Functions::Global Abort::Global Abort.gvi
diagram:
  w1 = """Do you want to abort the current measurement or do
you want to close the app? (Warning, everything not 
saved will be lost) """
  w2 = "Oh my god, please\ncontinue, I pressed\nglobal abort by mistake!"
  w3 = "No please do not\nclose the app just\nabort the current\nmeasurement."
  Three Button Dialog(Allow user to close window? (TRUE)=FALSE, Center Button Text ("No")="Close everything,\nI'm outta here!", Left Button Text ("Yes")=w3, Right Button Text ("Cancel")=w2, Window Title (" ")="Are you Sure?", message=w1) -> (Which Button?=w4)
  case (w4) {
    frame "left button" {
      w8 = "Idle"  # Enum instructions
      call "Global Abort.gvi"(Instruction="Abort Local", Error In=$"Error In") -> (Error Out=w9)
      Flush Queue(error in=w9, queue=$"Queue In") -> (error out=w10, queue out=w11)
      Enqueue Element At Opposite End(element=w8, error in=w10, queue=w11) -> (error out=w7, queue out=w6)
      w5 = FALSE
    }
    frame "center button", Default {
      w12 = "Stop App"  # Enum instructions
      call "Global Abort.gvi"(Instruction="Abort Global", Error In=$"Error In") -> (Error Out=w13)
      Enqueue Element At Opposite End(element=w12, error in=w13, queue=$"Queue In") -> (error out=w7, queue out=w6)
      w5 = TRUE
    }
    frame "right button" {
      w5 = FALSE
      w6 = $"Queue In"
      w7 = $"Error In"
    }
  }
  $"Global Abort full" <- w5
  $"Queue Out" <- w6
  $"Error Out" <- w7
