vi "Reset Disabled Controls Subroutine.gvi"   [LabVIEW NXG 5.0.0]
inputs:
  "Reset Disabled Controls Cluster": "Reset Disabled Controls Cluster.gtype"
  "Error In": error
outputs:
  "Error Out": error
types:
  "Reset Disabled Controls Cluster.gtype" = cluster{"Custom date": bool, "Autorange ": bool, "Dead Current Threshold Reference": "NumericTextBoxDouble reference", "Manual Range Reference": "NumericTextBoxDouble reference", "Dark Current Averages Reference": "NumericTextBoxDouble reference", "Current Date Reference": "StringControl reference", "Manual Current Range Reference": "NumericTextBoxDouble reference", "Skip To Next Cell Reference": "BooleanControl reference", "Z position Reference": "NumericTextBoxDouble reference", "Keithley Disable Output Reference": "BooleanControl reference", "X position Reference": "NumericTextBoxDouble reference"}
diagram:
  Property Node(instance in=$"Reset Disabled Controls Cluster") -> ("Custom date"=w1, "Autorange "=w2, "Dead Current Threshold Reference"=w3, "Manual Range Reference"=w4, "Dark Current Averages Reference"=w5, "Current Date Reference"=w6, "Manual Current Range Reference"=w7, "Skip To Next Cell Reference"=w8, "Z position Reference"=w9, "Keithley Disable Output Reference"=w10, "X position Reference"=w11)
  Not(x=w1) -> w12
  Property Node(instance in=w3, "Disabled"=FALSE, error in=$"Error In") -> (error out=w13)
  # w4: Manual Range
  Property Node(instance in=w4, "Disabled"=w2, error in=w13) -> (error out=w14)
  # w5: Dark Current Averages
  Property Node(instance in=w5, "Disabled"=FALSE, error in=w14) -> (error out=w15)
  # w6: Current Date
  Property Node(instance in=w6, "Disabled"=w12, error in=w15) -> (error out=w16)
  # w7: Manual Current Range
  Property Node(instance in=w7, "Disabled"=TRUE, error in=w16) -> (error out=w17)
  # w8: Skip To Next cell
  Property Node(instance in=w8, "Disabled"=TRUE, error in=w17) -> (error out=w18)
  # w9: Z position
  Property Node(instance in=w9, "Disabled"=TRUE, error in=w18) -> (error out=w19)
  # w10: Keithley Disable Output
  # w11: X position
  Property Node(instance in=w11, "Disabled"=TRUE, error in=w19) -> (error out=w20)
  Property Node(instance in=w10, "Disabled"=TRUE, error in=w20) -> (error out=w21)
  $"Error Out" <- w21
