vi "Light Calibration Closing Subroutine.gvi"   [LabVIEW NXG 5.0.0]
inputs:
  "Queue In": Queue<"Queue instructions.gtype">
  "Notifier Output": Notifier<T1>
  "Error In 2": error
  "Error In 1": error
outputs:
  "Queue Out": Queue<"Queue instructions.gtype">
  "Error Out": error
types:
  T1 = cluster{"Element 1": f64, "Element 2": f64, "Element 3": bool}
  "Queue instructions.gtype" = enum{"Wrongly pointed State", "Initialize App", "Light Calibration", "Measure Photodetector", "Measure Keithley", "Instrument detection", "Single Acquire", "Multiple Acquire", "EQE Mapping", "Debugging mode", "Move Arduino", "Arduino FF flip filter", "Help routine", "Idle", "Save Calibration", "Load Calibration", "Set Wavelength", "Help Wizard", "Turn supercontinuum laser on/off", "Set Multiplex arduino cell", "Save TXT EQE file", "Load TXT EQE", "Stop or Idle", "Stop App"}
uses:
  NI::G Core::Error::Multiplex Errors.gvi
  EQE_Measuring_Setup_NanOpto::SubVis::Main Sub Functions::Global Abort::Global Abort.gvi
  EQE_Measuring_Setup_NanOpto::SubVis::Utilities::Messages And Prompts::Photodetector remove message.gvi
diagram:
  call "Multiplex Errors.gvi"(error in 1=$"Error In 1", error in 2=$"Error In 2") -> (error out=w1)
  Release Notifier(error in (no error)=w1, notifier=$"Notifier Output") -> (error out=w2)
  call "Global Abort.gvi"(Instruction="Read Abort State", Error In=w2) -> (Local Abort State=w3, Error Out=w4)
  case (w3) {
    frame True {
      w5 = FALSE
      w6 = w4
    }
    frame False {
      Two Button Dialog(F button name ("Cancel")="No thanks, I was just testing", T button name ("OK")="Yes, please (Recommended)", message="Do  you want to save \nthe current light calibration?") -> (T Button?=w5)
      w6 = w4
    }
  }
  case (w5) {
    frame False, Default {
      Enqueue Element(element="Idle", error in=w6, queue=$"Queue In") -> (error out=w7, queue out=w8)
    }
    frame True {
      Enqueue Element(element="Save Calibration", error in=w6, queue=$"Queue In") -> (error out=w7, queue out=w8)
    }
  }
  $"Queue Out" <- w8
  call "Photodetector remove message.gvi"(Error In=w7) -> (Error Out=w9)
  $"Error Out" <- w9
