vi "Light Calibration Initialization Sequence.gvi"   [LabVIEW NXG 5.0.0]
inputs:
  "Input": error
outputs:
  "Output": Notifier<T1>
  "Output_2": error
types:
  T1 = cluster{"Element 1": f64, "Element 2": f64, "Element 3": bool}
uses:
  EQE_Measuring_Setup_NanOpto::SubVis::FGV::Current State FGV.gvi
diagram:
  call "Current State FGV.gvi"(Instruction Current State FGV="Set current State", Crrent State="Light Calibration", Error In=$Input) -> (Error Out=w1)
  # 0: Light Power
  # 0: Current Wavelength
  # FALSE: Finished?
  Build Cluster(0, 0, FALSE) -> w2
  Obtain Notifier(element data type=w2, error in=w1, name="Current Wvlngth and Light") -> (error out=w3, notifier out=w4)
  $Output <- w4
  $Output_2 <- w3
