vi "Light Calibration Instruction Subroutine.gvi"   [LabVIEW NXG 3.1.0]
inputs:
  "Queue In": Queue<"Queue instructions.gtype">
  "New Calibration": bool
  "Start Wavelength (nm)": f64 = 400
  "Label Info Missing Error": bool
  "End Wavelength (nm)": f64 = 1100
  "Filter Arduino Status": bool
  "Label Info Error Label": string
  "Error In": error
outputs:
  "Queue Out": Queue<"Queue instructions.gtype">
  "Current State Output": "Queue instructions.gtype"
  "Error Out": error
types:
  "Queue instructions.gtype" = enum{"Wrongly pointed State", "Initialize App", "Light Calibration", "Measure Photodetector", "Measure Keithley", "Instrument detection", "Single Acquire", "Multiple Acquire", "EQE Mapping", "Debugging mode", "Move Arduino", "Arduino FF flip filter", "Help routine", "Idle", "Save Calibration", "Load Calibration", "Set Wavelength", "Turn supercontinuum laser on/off", "Set Multiplex arduino cell", "Save TXT EQE file", "Load TXT EQE", "Stop or Idle", "Stop App"}
uses:
  EQE_Measuring_Setup_NanOpto::SubVis::FGV::Current State FGV.gvi
  EQE_Measuring_Setup_NanOpto::SubVis::Instrument Control::Monochromator::Filter Wavelength crossing ligth cal ka.gvi
  EQE_Measuring_Setup_NanOpto::SubVis::Utilities::Prerequisite detection::Light Calibration Prerequisites.gvi
  EQE_Measuring_Setup_NanOpto::SubVis::Utilities::Messages And Prompts::Photodetector put message.gvi
diagram:
  call "Current State FGV.gvi"(Instruction Current State FGV="Read Current State", Error In=$"Error In") -> (Current State Output=w1, Error Out=w2)
  call "Filter Wavelength crossing ligth cal ka.gvi"(Start Wavelength=$"Start Wavelength (nm)", End Wavelength=$"End Wavelength (nm)") -> (Crosses the filter change wavelength?=w3)
  Is Not Equal(x=w1, y="Idle") -> w4
  call "Light Calibration Prerequisites.gvi"(Input=$"Queue In", New Calibration=$"New Calibration", Cross 650 nm frontier?=w3, Other task active?=w4, Label Info Missing Error=$"Label Info Missing Error", Label Info Error Label=$"Label Info Error Label", Filter Arduino Status=$"Filter Arduino Status", Error In=w2) -> (Output=w5, All prerequisites fulfilled=w6, Error out=w7)
  $"Queue Out" <- w5
  call "Photodetector put message.gvi"(Error In=w7, Prerequisits fulfilled?=w6) -> (Error Out=w8)
  $"Error Out" <- w8
  $"Current State Output" <- w1
