vi "Light Calibration Notification Handler.gvi"   [LabVIEW NXG 5.0.0]
inputs:
  "Input": f64[][]
  "notification": T1
outputs:
  "Output": f64[][]
  "Current λ (nm)": f64
  "Light Calibration": cluster{"Element 1": f64[], "Element 2": f64[]}
  "Light Power (W)": f64
  "stop": bool
types:
  T1 = cluster{"Element 1": f64, "Element 2": f64, "Element 3": bool}
uses:
  EQE_Measuring_Setup_NanOpto::SubVis::Utilities::Other::Graph Adapter.gvi
diagram:
  Property Node(instance in=$notification) -> ("Element 1"=w1, "Element 2"=w2, "Element 3"=w3)
  Build Array(w1, w2) -> w4
  Build Array($Input, w4) -> w5
  $Output <- w5
  $"Current λ (nm)" <- w1
  call "Graph Adapter.gvi"(Input XY data=w5) -> (Output Graph=w6)
  $"Light Calibration" <- w6
  $"Light Power (W)" <- w2
  $stop <- w3
