vi "Light calibration.gvi"   [LabVIEW NXG 5.0.0]
inputs:
  "Light Calibration Input Parameters": "Light Calibration Input Parameters.gtype"
  "Error In": error
outputs:
  "Error Out": error
  "Notifier Output": Notifier<T1>
  "Light Power Calibration Data": f64[][]
panel indicators:
  "Current Power": f64
  "Current System": string
types:
  T1 = cluster{"Element 1": f64, "Element 2": f64, "Element 3": bool}
  "Light Calibration Input Parameters.gtype" = cluster{"Notifier Input": Notifier<T1>, "Wavelength Step (nm)": f64, "End Wavelength (nm)": f64, "Start Wavelength (nm)": f64, "Filter Arduino Status": bool, "Arduino Filter Flipper Address": "VISA Instr", "Monochromator": bool, "Powermeter Averages": u16, "Configuration File": path}
uses:
  LabView_NXG_Thorlabs_PM100::Examples::Photodetector initialization Sequence with prompt.gvi
  PE_Filter_SDK::Monochromator Initialization Sequence.gvi
  EQE_Measuring_Setup_NanOpto::SubVis::Utilities::Messages And Prompts::Manually Place The Filter Message.gvi
  EQE_Measuring_Setup_NanOpto::SubVis::Instrument Control::Monochromator::Filter Change Wavelength.gvi
  EQE_Measuring_Setup_NanOpto::SubVis::Instrument Control::Arduinos::Filter Flipper Arduino::Arduino Filter Flipper Control.gvi
  EQE_Measuring_Setup_NanOpto::SubVis::FGV::Arduino filter FGV current state.gvi
  EQE_Measuring_Setup_NanOpto::SubVis::Instrument Control::Monochromator::Filter Wavelength crossing ligth cal ka.gvi
  EQE_Measuring_Setup_NanOpto::SubVis::Utilities::Other::Wavelength loop calculation.gvi
  EQE_Measuring_Setup_NanOpto::SubVis::Utilities::Other::Wavelength detection filter flipper routine.gvi
  EQE_Measuring_Setup_NanOpto::SubVis::Instrument Control::Monochromator::Set Wavelength Function.gvi
  LabView_NXG_Thorlabs_PM100::Set Parameters::TLPM Set Wavelength.gvi
  LabView_NXG_Thorlabs_PM100::Set Parameters::TLPM Set Average Count.gvi
  LabView_NXG_Thorlabs_PM100::Measure::TLPM Measure Power.gvi
  EQE_Measuring_Setup_NanOpto::SubVis::Main Sub Functions::Global Abort::Global Abort.gvi
  NI::G Core::Error::Clear Error Cluster.gvi
  NI::G Core::Error::Read Location.gvi
  NI::G Core::Error::Read Error Code.gvi
  LabView_NXG_Thorlabs_PM100::Miscelanous::TLPM Close.gvi
  PE_Filter_SDK::PE Close.gvi
  PE_Filter_SDK::PE Destroy.gvi
diagram:
  call "Photodetector initialization Sequence with prompt.gvi"(Error In=$"Error In") -> (Photodetector IVI session=w1, Error Out=w2)
  Property Node(instance in=$"Light Calibration Input Parameters") -> ("Notifier Input"=w3, "Wavelength Step (nm)"=w4, "End Wavelength (nm)"=w5, "Start Wavelength (nm)"=w6, "Filter Arduino Status"=w7, "Arduino Filter Flipper Address"=w8, "Configuration File"=w9, instance out=w10)
  call "Monochromator Initialization Sequence.gvi"(Configuration File=w9, Error In=w2) -> (peHandle out=w11, Current System=w12, Error Out=w13)
  $"Current System" <- w12
  case (w13) {
    frame Error, Default {
      w14 = w13
      w15 = f64[][] []
      w16 = w3
    }
    frame No Error {
      case (w7) {
        frame False, Default {
          Is Greater Or Equal(x=w6, y=650) -> w18
          call "Manually Place The Filter Message.gvi"(IR Pass filter?=w18, Error In=w13) -> (Error Out=w17)
        }
        frame True {
          call "Filter Change Wavelength.gvi"() -> (Wavelength of filter Change=w19)
          Is Greater Or Equal(x=w6, y=w19) -> w20
          Select(s=w20, t="IR Pass", f="Visible Pass") -> w21
          call "Arduino Filter Flipper Control.gvi"(Arduino Filter Flipper Address In=w8, Pass Filter=w21, Error In=w13) -> (Error Out=w22)
          call "Arduino filter FGV current state.gvi"(Arduino Filter Flipper FGV instructions="Set State", Arduino Filter Flipper Instructions In=w21, Error In=w22) -> (Error Out=w17)
        }
      }
      call "Filter Wavelength crossing ligth cal ka.gvi"(Start Wavelength=w5, End Wavelength=w6) -> (Crosses the filter change wavelength?=w23)
      call "Wavelength loop calculation.gvi"(Wavelength Step (nm)=w4, End Wavelength (nm)=w5, Start Wavelength (nm)=w6) -> (Ammount of steps +1 (for the loop)=w24, Positive or negative steps=w25, Exact ammount of steps=w26)
      # Initialize Photodetector
      # Initialize monochromator
      s1 = f64[][] []  # shift register
      s2 = w3  # shift register
      s3 = w17  # shift register
      s4 = w1  # shift register
      s5 = w11  # shift register
      for (N = w24) (iteration -> i1) {
        Wait Until Next Multiple(multiple to wait=5)
        # Set monochromator wavelength
        Property Node(instance in=w10) -> ("Filter Arduino Status"=w27, "Arduino Filter Flipper Address"=w28, "Monochromator"=w29, "Powermeter Averages"=w30)
        Multiply(w4, i1, w25) -> w31
        Add(w31, w6) -> w32
        # w32: Current Wavelength
        call "Wavelength detection filter flipper routine.gvi"(Current Wavelength=w32, Arduino Filter Flipper Status=w27, Arduino Filter Flipper Address=w28, Crossing Ka=w23, Error In=s3) -> (Error Out=w33)
        call "Set Wavelength Function.gvi"(PE Fiannium Handle In=s5, Wavelength=w32, Monochromator=w29, Error In=w33) -> (PE Fiannium Handle Out=w34, Error Out=w35)
        call "TLPM Set Wavelength.gvi"(IVI session in=s4, Wavelength (0.0)=w32, error in (no error)=w35) -> (IVI session out=w36, error out=w37)
        call "TLPM Set Average Count.gvi"(IVI session in=w36, Average Count (1)=w30, error in (no error)=w37) -> (IVI session out=w38, error out=w39)
        call "TLPM Measure Power.gvi"(IVI session in=w38, error in (no error)=w39) -> (IVI session out=w40, Power=w41, error out=w42)
        call "Global Abort.gvi"(Instruction="Read Abort State", Error In=w42) -> (Local Abort State=w43, Global Abort State=w44, Error Out=w45)
        # Set photodetector wavelength
        Is Greater Or Equal(x=i1, y=w26) -> w46
        Logical Or(w43, w44) -> w47
        Logical Or(w46, w47) -> w48
        Build Cluster(w32, w41, w48) -> w49
        Send Notification(error in (no error)=w45, notification=w49, notifier=s2) -> (error out=w50, notifier out=w51)
        case (w50) {
          frame Error, Default {
            call "Clear Error Cluster.gvi"(error in=w50) -> (error out=w53)
            call "Read Location.gvi"(error in=w50) -> (location=w54)
            Search And Replace String(input string=w54, search string="Send Notification") -> (number of replacements=w55)
            Is Greater Than 0(x=w55) -> w56
            call "Read Error Code.gvi"(error in=w50) -> (code=w57)
            Is Equal(x=w57, y=1) -> w58
            Logical And(w56, w58) -> w59
            Select(s=w59, t=w53, f=w50) -> w52
          }
          frame No Error {
            w52 = w50
          }
        }
        $"Current Power" <- w41
        Build Array(w32, w41) -> w60
        # Measure photodetector power
        Insert Into Array(inArray=s1, index0=i1, new=w60) -> w61
        next s1 = w61
        next s2 = w51
        next s3 = w52
        next s4 = w40
        next s5 = w34
        stop if w47
      }
      call "TLPM Close.gvi"(IVI session in=s4, error in (no error)=s3) -> (error out=w62)
      call "PE Close.gvi"(peHandle=s5, error in (no error)=w62) -> (peHandle out=w63, error out=w64)
      call "PE Destroy.gvi"(peHandle=w63, error in (no error)=w64) -> (error out=w14)
      w15 = s1
      w16 = s2
    }
  }
  $"Error Out" <- w14
  $"Light Power Calibration Data" <- w15
  $"Notifier Output" <- w16
