vi "Load Calibration file.gvi"   [LabVIEW NXG 3.1.0]
inputs:
  "Error In": error
  "Light calibration data In": f64[][]
outputs:
  "End Wavelength (nm) Current Calibration": f64
  "Wavelength Step (nm) Current Calibration": f64
  "Start Wavelength (nm) Current Calibration": f64
  "Light Power Calibration Data Out": f64[][]
  "Light Calibration": cluster{"Element 1": f64[], "Element 2": f64[]}
  "Error Out": error
uses:
  EQE_Measuring_Setup_NanOpto::SubVis::Utilities::Other::Light Calibration parameters extractor.gvi
  EQE_Measuring_Setup_NanOpto::SubVis::Utilities::Other::Graph Adapter.gvi
  NI::G Core::Error::Clear Error Cluster.gvi
  EQE_Measuring_Setup_NanOpto::SubVis::Utilities::Other::Header extractor.gvi
diagram:
  Open Or Create Or Replace File(error in=$"Error In", operation (0:open)="open", prompt="Choose or enter path of the calibration file to open...") -> (cancelled=w1, error out=w2, refnum out=w3)
  case (w1) {
    frame True {
      Is Empty Array(array=$"Light calibration data In") -> w10
      case (w10) {
        frame True {
          w11 = cluster{"Element 1": f64[], "Element 2": f64[]} {all zero or empty}
          w8 = 1100
          w5 = 1
          w9 = 400
          w6 = w11
          w7 = f64[][] []
        }
        frame False {
          call "Light Calibration parameters extractor.gvi"(Light calibration data=$"Light calibration data In") -> (End Wavelength (nm) Current Calibration=w8, Wavelength Step (nm) Current Calibration=w5, Start Wavelength (nm) Current Calibration=w9)
          call "Graph Adapter.gvi"(Input XY data=$"Light calibration data In") -> (Output Graph=w6)
          w7 = $"Light calibration data In"
        }
      }
      call "Clear Error Cluster.gvi"(error in=w2) -> (error out=w4)
    }
    frame False {
      Read From Text File(error in=w2, file (use dialog)=w3) -> (error out=w12, refnum out=w13, text=w14)
      Close File(error in=w12, refnum=w13) -> (error out=w15)
      call "Header extractor.gvi"(Spreadsheet String=w14, Error In=w15) -> (Spreadsheet string without header=w16, Error Out=w4)
      Spreadsheet String To Array(format string="%f", spreadsheet string=w16) -> (array=w7)
      call "Light Calibration parameters extractor.gvi"(Light calibration data=w7) -> (End Wavelength (nm) Current Calibration=w8, Wavelength Step (nm) Current Calibration=w5, Start Wavelength (nm) Current Calibration=w9)
      call "Graph Adapter.gvi"(Input XY data=w7) -> (Output Graph=w6)
    }
  }
  $"End Wavelength (nm) Current Calibration" <- w8
  $"Wavelength Step (nm) Current Calibration" <- w5
  $"Start Wavelength (nm) Current Calibration" <- w9
  $"Light Calibration" <- w6
  $"Error Out" <- w4
  $"Light Power Calibration Data Out" <- w7
