vi "Load Calibration instruction subroutine.gvi"   [LabVIEW NXG 3.1.0]
inputs:
  "Input": Queue<"Queue instructions.gtype">
  "Current State Output": "Queue instructions.gtype" = "Initialize App"
  "Load Calibration": bool
  "Input_2": error
outputs:
  "Output_2": Queue<"Queue instructions.gtype">
  "Output": error
types:
  "Queue instructions.gtype" = enum{"Initialize App", "Light Calibration", "Measure Photodetector", "Measure Keithley", "Instrument detection", "Single Acquire", "Multiple Acquire", "EQE Mapping", "Debugging mode", "Move Arduino", "Arduino FF flip filter", "Help routine", "Idle", "Save Calibration", "Load Calibration", "Set Wavelength", "Turn supercontinuum laser on/off", "Set Multiplex arduino cell", "Save TXT EQE file", "Load TXT EQE", "Stop or Idle", "Stop App"}
uses:
  EQE_Measuring_Setup_NanOpto::SubVis::FGV::Current State FGV.gvi
diagram:
  call "Current State FGV.gvi"(Instruction Current State FGV="Read Current State", Error In=$Input_2) -> (Current State Output=w1, Error Out=w2)
  Is Not Equal(x=w1, y="Idle") -> w3
  case (w3) {
    frame True {
      Format Into String($"Current State Output") -> w6
      w7 = "Please wait until all tasks have been finished.\nCurrent task: "
      Concatenate Strings(w7, w6) -> w8
      One Button Dialog(button name ("OK")="Okay, sorry, I will wait", message=w8)
      w4 = w2
      w5 = $Input
    }
    frame False {
      w9 = "Load Calibration"  # Enum instructions
      Enqueue Element(element=w9, error in=w2, queue=$Input) -> (error out=w4, queue out=w5)
    }
  }
  $Output_2 <- w5
  $Output <- w4
