vi "Save Calibration File.gvi"   [LabVIEW NXG 3.1.0]
inputs:
  "Default Data Saving Location": path
  "Light Power Calibration Data": f64[][]
  "Author Initials": string
  "Sample Prefix": string
  "Current Date": string
  "Batch Name": string
  "Error In": error
outputs:
  "Error Out": error
  "Folder to save all data": path
panel indicators:
  "Spreadsheet String": string
uses:
  EQE_Measuring_Setup_NanOpto::SubVis::Utilities::Path Manipulation::Path Generator and Checker.gvi
  NI::G Core::File IO (General)::Check if File or Folder Exists.gvi
  EQE_Measuring_Setup_NanOpto::SubVis::Utilities::Other::Header info merger.gvi
  EQE_Measuring_Setup_NanOpto::SubVis::Utilities::Path Manipulation::Rename Window.gvi
diagram:
  case ($"Error In") {
    frame Error, Default {
      w1 = $"Error In"
    }
    frame No Error {
      call "Path Generator and Checker.gvi"(Default Data Saving Location=$"Default Data Saving Location", Author Initials=$"Author Initials", Current Date=$"Current Date", Batch Name=$"Batch Name", Sample Prefix=$"Sample Prefix", Error In=$"Error In") -> (File path=w2, Folder to save data=w3, Error Out=w4)
      call "Check if File or Folder Exists.gvi"(file or folder=w2, error in=w4) -> (file or folder exists?=w5, error out=w6)
      case (w5) {
        frame False, Default {
          w7 = w6
          w8 = "left button"
        }
        frame True {
          w9 = "The file you're trying to save already exists, do you want to:"
          Three Button Dialog(Allow user to close window? (TRUE)=FALSE, Center Button Text ("No")="Rename the file \nso that they are both safe", Justify Message (Left)="center", Left Button Text ("Yes")="Replace the already\nexisting file!", Right Button Text ("Cancel")="Do not save the\ncurrent file", message=w9) -> (Which Button?=w8)
          w7 = w6
        }
      }
      case (w8) {
        frame "left button" {
          Open Or Create Or Replace File(error in=w7, file path (use dialog)=w2, operation (0:open)="replace or create") -> (error out=w11, refnum out=w12)
          Array To Spreadsheet String(array=$"Light Power Calibration Data", format string="%g") -> (spreadsheet string=w10)
          call "Header info merger.gvi"(Column info array=["Wavelength (nm)", "Light Power (W)"], Spreadsheet String=w10, Error In=w11) -> (Spreadsheet String With Header=w13, Error Out=w14)
          Write To Text File(error in=w14, file (use dialog)=w12, text=w13) -> (error out=w15, refnum out=w16)
          Close File(error in=w15, refnum=w16) -> (error out=w1)
        }
        frame "center button", Default {
          Strip Path(path=w2) -> (name=w17, stripped path=w18)
          call "Rename Window.gvi"(Original Filename=w17, Error In=w7) -> (Output=w19, Error Out=w20)
          Build Path(base path=w18, name or relative path=w19) -> (appended path=w21)
          Open Or Create Or Replace File(error in=w20, file path (use dialog)=w21, operation (0:open)="replace or create") -> (error out=w22, refnum out=w23)
          Array To Spreadsheet String(array=$"Light Power Calibration Data", format string="%g") -> (spreadsheet string=w10)
          call "Header info merger.gvi"(Column info array=["Wavelength (nm)", "Light Power (W)"], Spreadsheet String=w10, Error In=w22) -> (Spreadsheet String With Header=w24, Error Out=w25)
          Write To Text File(error in=w25, file (use dialog)=w23, text=w24) -> (error out=w26, refnum out=w27)
          Close File(error in=w26, refnum=w27) -> (error out=w1)
        }
        frame "right button" {
          w1 = w7
          w10 = ""
        }
      }
      $"Spreadsheet String" <- w10
      $"Folder to save all data" <- w3
    }
  }
  $"Error Out" <- w1
