vi "Save calibration check up instruction subroutine.gvi"   [LabVIEW NXG 3.1.0]
inputs:
  "Input": Queue<"Queue instructions.gtype">
  "Save Calibration": bool
  "Light Power Calibration Data": f64[][]
  "Current State Output_2": "Queue instructions.gtype" = "Initialize App"
  "Label Info Missing Error": bool
  "Label Info Error Label": string
  "Input_2": error
outputs:
  "Output_2": Queue<"Queue instructions.gtype">
  "Current State Output": "Queue instructions.gtype"
  "Output": error
types:
  "Queue instructions.gtype" = enum{"Initialize App", "Light Calibration", "Measure Photodetector", "Measure Keithley", "Instrument detection", "Single Acquire", "Multiple Acquire", "EQE Mapping", "Debugging mode", "Move Arduino", "Help routine", "Idle", "Save Calibration", "Load Calibration", "Set Wavelength", "Turn supercontinuum laser on/off", "Set Multiplex arduino cell", "Save TXT EQE file", "Load TXT EQE", "Stop or Idle", "Stop App"}
uses:
  EQE_Measuring_Setup_NanOpto::SubVis::FGV::Current State FGV.gvi
diagram:
  call "Current State FGV.gvi"(Instruction Current State FGV="Read Current State", Error In=$Input_2) -> (Current State Output=w1, Error Out=w2)
  Is Not Equal(x=w1, y="Idle") -> w3
  Is Empty Array(array=$"Light Power Calibration Data") -> w4
  Logical Or(w4, $"Label Info Missing Error", w3) -> w5
  case (w5) {
    frame True {
      case (w3) {
        frame False, Default { }
        frame True {
          w8 = "Please wait until all tasks have been finished.\nCurrent task: "
          Format Into String($"Current State Output_2") -> w9
          Concatenate Strings(w8, w9) -> w10
          One Button Dialog(button name ("OK")="Okay, sorry, I will wait", message=w10)
        }
      }
      case (w4) {
        frame False, Default { }
        frame True {
          w11 = "Oops I forgot I was supposed to\ngenerate data before saving :')"
          One Button Dialog(button name ("OK")=w11, message="There is no calibration data to save!!!")
        }
      }
      case ($"Label Info Missing Error") {
        frame False, Default { }
        frame True {
          One Button Dialog(button name ("OK")="Okay, sorry, I will fix it right now", message=$"Label Info Error Label")
        }
      }
      w6 = $Input
      w7 = w2
    }
    frame False {
      w12 = "Save Calibration"  # Enum instructions
      Enqueue Element(element=w12, error in=w2, queue=$Input) -> (error out=w7, queue out=w6)
    }
  }
  $Output_2 <- w6
  $"Current State Output" <- w1
  $Output <- w7
