vi "Monochromator switch Subroutine.gvi"   [LabVIEW NXG 3.1.0]
inputs:
  "Monochromator configuration file visible": path
  "Monochromator configuration file infrared": path
  "Monochromator": bool
  "Input": error
outputs:
  "Monochromator configuration file": path
  "Monochromator_2": bool
  "Output": error
uses:
  EQE_Measuring_Setup_NanOpto::SubVis::Instrument Control::Instrument detector.gvi
diagram:
  call "Instrument detector.gvi"(IR Monochromator? in=$Monochromator, Instruments to Detect="Monochromator", Monochromator configuration file visible=$"Monochromator configuration file visible", Monochromator configuration file infrared=$"Monochromator configuration file infrared", Error In=$Input) -> (Error Out=w1, Ir Monochromator?=w2)
  $Monochromator_2 <- w2
  $Output <- w1
  Select(s=w2, t=$"Monochromator configuration file infrared", f=$"Monochromator configuration file visible") -> w3
  $"Monochromator configuration file" <- w3
