vi "Move Arduino Close Subroutine.gvi"   [LabVIEW NXG 5.0.0]
inputs:
  "Input": Queue<"Queue instructions.gtype">
  "Input_2": "VISA Instr"
  "Input_3": error
outputs:
  "Output": Queue<"Queue instructions.gtype">
  "Carriage Active": bool
  "Output_2": error
types:
  "Queue instructions.gtype" = enum{"Wrongly pointed State", "Initialize App", "Light Calibration", "Measure Photodetector", "Measure Keithley", "Instrument detection", "Single Acquire", "Multiple Acquire", "EQE Mapping", "Debugging mode", "Move Arduino", "Arduino FF flip filter", "Help routine", "Idle", "Save Calibration", "Load Calibration", "Set Wavelength", "Help Wizard", "Turn supercontinuum laser on/off", "Set Multiplex arduino cell", "Save TXT EQE file", "Load TXT EQE", "Stop or Idle", "Stop App"}
uses:
  NI::VISA::Close (Instr).gvi
diagram:
  call "Close (Instr).gvi"(session in=$Input_2, error in=$Input_3) -> (error out=w1)
  Enqueue Element(element="Idle", error in=w1, queue=$Input) -> (error out=w2, queue out=w3)
  $Output <- w3
  $Output_2 <- w2
  $"Carriage Active" <- FALSE
