vi "Sample name check up subroutine.gvi"   [LabVIEW NXG 5.0.0]
inputs:
  "Current Date ref": "StringControl reference"
  "Cell Number ref": "StringControl reference"
  "Author Initials": string
  "Custom date": bool
  "Current Date In": string
  "Batch Name": string
  "Main Tab control": i32
  "Sample Comments": string
  "Cell Number": string
outputs:
  "Current Date": string
  "Sample Prefix": string
  "Label Info Missing Error": bool
  "Label Info Error Label": string
panel controls:
  "Light Calibration": cluster{"Element 1": f64[], "Element 2": f64[]}
  "New Calibration": bool
  "Load Calibration": bool
  "Save Calibration": bool
  "Light Power (W)": f64
  "End Wavelength (nm)": f64 = 1100
  "Start Wavelength (nm)": f64 = 400
  "Wavelength Step (nm)": f64 = 1
  "Current Wavelength (nm)": f64
  "Powermeter Averages": f64 = 3
  "EQE Measurement": cluster{"Element 1": f64[], "Element 2": f64[]}
  "Current Averages": f64 = 3
  "Acquire Manual EQE": bool
  "Save current EQE TXT": bool
  "Voltage Applied (V)": f64
  "Autorange": bool = TRUE
  "Dark Current": bool = TRUE
  "Manual Current Range": f64 = 1e-08
  "Current (A)": f64
  "Wavelength (nm)": f64
  "EQE (%)": f64
  "Dark Current (A)": f64
  "Dark Current Averages": f64 = 30
  "Automatic EQE Measurement Graph": cluster{"Element 1": f64[], "Element 2": f64[]}[]
  "Automatic Measurement Indicators": "Automatic Measurement Indicators.gtype"
  "Automatic Acquire": bool
  "Current Averages": f64 = 3
  "Voltage Applied (V)": f64
  "Autorange": bool = TRUE
  "Dark Current": bool = TRUE
  "Manual Range": f64 = 1e-08
  "All": bool
  "Reset": bool
  "Cell Data Cluster": T1
  "Cell Measuring Order": string
  "Random Cell Order": bool
  "Advanced Config Tab": i32
  "X position": f64
  "Z position": f64
  "Activate Arduino": bool
  "XZ Carriage Arduino Log": string
  "Set Postion": bool
  "Release Arduino": bool
  "Carriage Active": bool
  "Cell Label": T2 = "L.01"
  "Custom Position": bool
  "Default Data Saving Location": path = path "D:\\measurements\\EQE measurements"
  "Monochromator configuration file": path
  "Monochromator configuration file infrared": path
  "Monochromator configuration file visible": path
  "Keithley Address": string
  "Monochromator Name": string
  "Photodetector Names": string[]
  "Carriage Arduino Address": "VISA Instr"
  "Filter Arduino Address": "VISA Instr"
  "Multiplexer Arduino Address": "VISA Instr"
  "VISA Resource Name": "VISA Instr"
  "Supercontinuum laser Address": "VISA Instr"
  "Abort All": bool
  "Light Power Calibration Data": f64[][]
  "End Wavelength (nm) Current Calibration": f64 = 1100
  "Start Wavelength (nm) Current Calibration": f64 = 400
  "Wavelength Step (nm) Current Calibration": f64 = 1
  "Current State Output": "Queue instructions.gtype" = "Initialize App"
  "Max current": f64 = 0.1
  "Full EQE Data": f64[][]
  "Keythley Status": bool
  "Photodetector Status": bool
  "Monochromator Status": bool
  "Carriage Arduino Status": bool
  "Multiplexer Arduino Status": bool
  "Filter Arduino Status": bool
  "R.01 Reference Coordinates": T3 = {"X coordinate R.01"=145.3, "Z coordinate R.01"=2.5}
  "Sub states Output": "Sub states enum.gtype" = "Not specified"
  "Supercontinuum Status": bool
  "Automatic EQE Measurement Data": cluster{"Element 1": f64[], "Element 2": f64[]}[]
types:
  "Automatic Measurement Indicators.gtype" = cluster{"Elapsed Time (kr)": f64, "Estimated Time (kr)": f64, "Cell being measured": string, "Current Value (A)  ": f64, "EQE (%)": f64, "Dark Current (A)": f64}
  T1 = cluster{"R.01": bool, "L.01": bool, "R.02": bool, "L.02": bool, "R.03": bool, "L.03": bool, "R.04": bool, "L.04": bool, "R.05": bool, "L.05": bool, "R.06": bool, "L.06": bool, "R.07": bool, "L.07": bool, "R.08": bool, "L.08": bool, "R.09": bool, "L.09": bool, "R.10": bool, "L.10": bool, "R.11": bool, "L.11": bool, "R.12": bool, "L.12": bool}
  T2 = enum{"L.01", "L.02", "L.03", "L.04", "L.05", "L.06", "L.07", "L.08", "L.09", "L.10", "L.11", "L.12", "R.01", "R.02", "R.03", "R.04", "R.05", "R.06", "R.07", "R.08", "R.09", "R.10", "R.11", "R.12"}
  "Queue instructions.gtype" = enum{"Wrongly pointed State", "Initialize App", "Light Calibration", "Measure Photodetector", "Measure Keithley", "Instrument detection", "Single Acquire", "Multiple Acquire", "EQE Mapping", "Debugging mode", "Move Arduino", "Arduino FF flip filter", "Help routine", "Idle", "Save Calibration", "Load Calibration", "Set Wavelength", "Help Wizard", "Turn supercontinuum laser on/off", "Set Multiplex arduino cell", "Save TXT EQE file", "Load TXT EQE", "Stop or Idle", "Stop App"}
  T3 = cluster{"X coordinate R.01": f64, "Z coordinate R.01": f64}
  "Sub states enum.gtype" = enum{"Not specified", "Measuring Dark Current", "Initializing Keithley", "Initializing Monochromator", "Measuring with Keithley", "Moving Arduino", "Detecting Monochromator", "Detecting Keithley", "Detecting Photodetector", "Detecting Arduinos", "Homing XZ Carriage Arduino", "Moving XZ Carriage Arduino", "Moving Filter Flipper Arduino", "Setting Pin Multiplexer Arduino", "Detecting Supercontinuum", "Scanning R.01 cell position", "Prechecking Cells"}
uses:
  EQE_Measuring_Setup_NanOpto::SubVis::Utilities::Other::Get date YYMMDD.gvi
  EQE_Measuring_Setup_NanOpto::SubVis::Utilities::Other::Create Cell Prefix.gvi
diagram:
  case ($"Custom date") {
    frame True {
      Property Node(instance in=$"Current Date ref", "Disabled"=FALSE)
      w1 = $"Current Date In"
    }
    frame False {
      Property Node(instance in=$"Current Date ref", "Disabled"=TRUE)
      call "Get date YYMMDD.gvi"() -> (Date YYMMDD=w1)
    }
  }
  $"Current Date" <- w1
  Is Equal(x=$"Main Tab control", y=1) -> w2
  case (w2) {
    frame False, Default {
      Property Node(instance in=$"Cell Number ref", "Disabled"=TRUE)
      w3 = ""
      w4 = FALSE
    }
    frame True {
      Property Node(instance in=$"Cell Number ref", "Disabled"=FALSE)
      w3 = $"Cell Number"
      w4 = TRUE
    }
  }
  call "Create Cell Prefix.gvi"(Cell number required?=w4, Author Initials=$"Author Initials", Current Date=w1, Batch Name=$"Batch Name", Sample Comments=$"Sample Comments", Cell Number=w3) -> (Sample Prefix=w5, Missing Error=w6, Error Label=w7)
  $"Sample Prefix" <- w5
  $"Label Info Missing Error" <- w6
  $"Label Info Error Label" <- w7
