vi "Start instruction queue.gvi"   [LabVIEW NXG 3.1.0]
outputs:
  "Queue Out": Queue<"Queue instructions.gtype">
  "Error Out": error
  "Reset Initialized": bool
types:
  "Queue instructions.gtype" = enum{"Wrongly pointed State", "Initialize App", "Light Calibration", "Measure Photodetector", "Measure Keithley", "Instrument detection", "Single Acquire", "Multiple Acquire", "EQE Mapping", "Debugging mode", "Move Arduino", "Arduino FF flip filter", "Help routine", "Idle", "Save Calibration", "Load Calibration", "Set Wavelength", "Turn supercontinuum laser on/off", "Set Multiplex arduino cell", "Save TXT EQE file", "Load TXT EQE", "Stop or Idle", "Stop App"}
uses:
  EQE_Measuring_Setup_NanOpto::SubVis::FGV::Current State FGV.gvi
diagram:
  w1 = "Queue instructions.gtype" "Initialize App"  # Enum instructions
  call "Current State FGV.gvi"(Instruction Current State FGV="Set current State", Crrent State="Initialize App") -> (Error Out=w2)
  Obtain Queue(element data type=w1, error in=w2, name="Instruction queue") -> (error out=w3, queue out=w4)
  Enqueue Element(element=w1, error in=w3, queue=w4) -> (error out=w5, queue out=w6)
  $"Queue Out" <- w6
  $"Error Out" <- w5
  $"Reset Initialized" <- FALSE
