vi "Terminate Queue.gvi"   [LabVIEW NXG 3.1.0]
inputs:
  "Input_3": Queue<"Queue instructions.gtype">
  "selector": bool = TRUE
  "Input_2": error
  "Input": error
outputs:
  "Error Out": error
types:
  "Queue instructions.gtype" = enum{"Initialize App", "Light Calibration", "Measure Photodetector", "Measure Keithley", "Instrument detection", "Single Acquire", "Multiple Acquire", "EQE Mapping", "Debugging mode", "Move Arduino", "Help routine", "Idle", "Save Calibration", "Load Calibration", "Set Wavelength", "Turn supercontinuum laser on/off", "Set Multiplex arduino cell", "Save TXT EQE file", "Load TXT EQE", "Stop or Idle", "Stop App"}
uses:
  NI::G Core::Error::Multiplex Errors.gvi
  NI::G Core::Error::Display Error.gvi
diagram:
  case ($selector) {
    frame False, Default {
      call "Multiplex Errors.gvi"(error in 1=$Input, error in 2=$Input_2) -> (error out=w1)
    }
    frame True {
      Release Queue(error in=$Input_2, force destroy=TRUE, queue=$Input_3) -> (error out=w2)
      call "Multiplex Errors.gvi"(error in 1=w2, error in 2=$Input) -> (error out=w1)
      call "Display Error.gvi"(error in=w1)
    }
  }
  $"Error Out" <- w1
