vi "Timeout instruction subroutine.gvi"   [LabVIEW NXG 3.1.0]
inputs:
  "Activate Arduino Reference": "BooleanControl reference"
  "Set Position Reference": "BooleanControl reference"
  "Release arduino Reference": "BooleanControl reference"
  "Initialized? Reference": "BooleanControl reference"
  "Initialized?": bool = TRUE
  "Carriage Active": bool
  "Error In": error
outputs:
  "Output": bool
  "Current State Output": "Queue instructions.gtype"
  "Sub states Output": "Sub states enum.gtype"
  "Error Out": error
types:
  "Queue instructions.gtype" = enum{"Wrongly pointed State", "Initialize App", "Light Calibration", "Measure Photodetector", "Measure Keithley", "Instrument detection", "Single Acquire", "Multiple Acquire", "EQE Mapping", "Debugging mode", "Move Arduino", "Arduino FF flip filter", "Help routine", "Idle", "Save Calibration", "Load Calibration", "Set Wavelength", "Turn supercontinuum laser on/off", "Set Multiplex arduino cell", "Save TXT EQE file", "Load TXT EQE", "Stop or Idle", "Stop App"}
  "Sub states enum.gtype" = enum{"Not specified", "Measuring Dark Current", "Initializing Keithley", "Initializing Monochromator", "Measuring with Keithley", "Moving Arduino", "Detecting Monochromator", "Detecting Keithley", "Detecting Photodetector", "Detecting Arduinos", "Homing XZ Carriage Arduino", "Moving XZ Carriage Arduino", "Moving Filter Flipper Arduino", "Setting Pin Multiplexer Arduino", "Detecting Supercontinuum", "Scanning R.01 cell position"}
uses:
  EQE_Measuring_Setup_NanOpto::SubVis::FGV::Current State FGV.gvi
  EQE_Measuring_Setup_NanOpto::SubVis::Utilities::Messages And Prompts::Initializing app prompt.gvi
  EQE_Measuring_Setup_NanOpto::SubVis::Utilities::Other::Enable-disable arduino move controls.gvi
diagram:
  call "Current State FGV.gvi"(Instruction Current State FGV="Read Current State", Error In=$"Error In") -> (Current State Output=w1, Sub states Output=w2, Error Out=w3)
  Is Equal(x=w1, y="Initialize App") -> w4
  Logical And(w4, not $"Initialized?") -> w5
  case (w5) {
    frame False, Default {
      w6 = w3
    }
    frame True {
      call "Initializing app prompt.gvi"(Error In=w3) -> (Error Out=w7)
      Property Node(instance in=$"Initialized? Reference", "Value"=TRUE, error in=w7) -> (error out=w6)
    }
  }
  call "Enable-disable arduino move controls.gvi"(Input_2=$"Activate Arduino Reference", Input_4=$"Set Position Reference", Input=$"Release arduino Reference", Carriage Active=$"Carriage Active", Error In=w6) -> (Error Out=w8)
  call "Current State FGV.gvi"(Instruction Current State FGV="Read Current State", Error In=w8) -> (Current State Output=w9, Error Out=w10)
  Is Equal(x=w9, y="Stop App") -> w11
  $Output <- w11
  $"Current State Output" <- w1
  $"Error Out" <- w10
  $"Sub states Output" <- w2
