vi "Erase Notification Error.gvi"   [LabVIEW NXG 3.1.0]
inputs:
  "error out_2": error
outputs:
  "Output": error
uses:
  NI::G Core::Error::Clear Error Cluster.gvi
  NI::G Core::Error::Read Error Code.gvi
  NI::G Core::Error::Read Location.gvi
diagram:
  case ($"error out_2") {
    frame Error, Default {
      call "Clear Error Cluster.gvi"(error in=$"error out_2") -> (error out=w2)
      call "Read Error Code.gvi"(error in=$"error out_2") -> (code=w3)
      Is Equal(x=w3, y=1) -> w4
      call "Read Location.gvi"(error in=$"error out_2") -> (location=w5)
      Search And Replace String(input string=w5, search string="Send Notification") -> (number of replacements=w6)
      Is Greater Than 0(x=w6) -> w7
      Logical And(w7, w4) -> w8
      Select(s=w8, t=w2, f=$"error out_2") -> w1
    }
    frame No Error {
      w1 = $"error out_2"
    }
  }
  $Output <- w1
