vi "Initializing app prompt.gvi"   [LabVIEW NXG 5.0.0]
inputs:
  "Error In": error
outputs:
  "Error Out": error
panel indicators:
  "Linear Progress Bar": f64
  "Steps": "Queue instructions.gtype"[]
  "Sub Steps": "Sub states enum.gtype"[]
  "sin": f64
types:
  "Queue instructions.gtype" = enum{"Wrongly pointed State", "Initialize App", "Light Calibration", "Measure Photodetector", "Measure Keithley", "Instrument detection", "Single Acquire", "Multiple Acquire", "EQE Mapping", "Debugging mode", "Move Arduino", "Arduino FF flip filter", "Help routine", "Idle", "Save Calibration", "Load Calibration", "Set Wavelength", "Help Wizard", "Turn supercontinuum laser on/off", "Save R.01 Coordinates", "Set Multiplex arduino cell", "Save TXT EQE file", "Load TXT EQE", "Stop or Idle", "Stop App"}
  "Sub states enum.gtype" = enum{"Not specified", "Measuring Dark Current", "Initializing Keithley", "Initializing Monochromator", "Measuring with Keithley", "Moving Arduino", "Detecting Monochromator", "Detecting Keithley", "Detecting Photodetector", "Detecting Arduinos", "Homing XZ Carriage Arduino", "Moving XZ Carriage Arduino", "Moving Filter Flipper Arduino", "Setting Pin Multiplexer Arduino", "Detecting Supercontinuum", "Scanning R.01 cell position", "Prechecking Cells"}
uses:
  EQE_Measuring_Setup_NanOpto::SubVis::FGV::Current State FGV.gvi
  EQE_Measuring_Setup_NanOpto::SubVis::Utilities::Messages And Prompts::Beating Star.gvi
diagram:
  Property Node(instance in=reference to unnamed native front panel, error in=$"Error In") -> ("Window"=w1, error out=w2)
  Open Window(reference in=w1, error in=w2) -> (reference out=w3, error out=w4)
  s1 = uninitialised  # shift register
  s2 = 0  # shift register
  s3 = uninitialised  # shift register
  s4 = 0  # shift register
  while (iteration -> i1) {
    Wait Until Next Multiple(multiple to wait=50)
    Multiply(s2, 15) -> w7
    Increment(x=s4) -> w8
    Add(w7, 15) -> w9
    In Range And Coerce(lower limit=0, upper limit=w9, x=w8) -> (coerced(x)=w10)
    call "Current State FGV.gvi"(Instruction Current State FGV="Read Current State", Error In=w4) -> (Current State Output=w11, Sub states Output=w12, Error Out=w13)
    Is Not Equal(x=w12, y=s3) -> w14
    Select(s=w14, t=w7, f=w10) -> w15
    $"Linear Progress Bar" <- w15
    Increment(x=s2) -> w16
    Select(s=w14, t=w16, f=s2) -> w17
    call "Beating Star.gvi"(Input=reference to unnamed path, loop iteration=i1, Speed Divider=10) -> (sin=w18)
    $sin <- w18
    Format Into String(errIn=w13, w11) -> (outString=w19, errOut=w20)
    Property Node(instance in=reference to unnamed text, "Text"=w19, error in=w20) -> (error out=w21)
    Is Not Equal(x=w11, y=s1) -> w22
    Is Greater(x=i1, y=20000) -> w23
    Is Equal(x=w11, y="Idle") -> w24
    Is Equal(x=w11, y="Stop App") -> w25
    Logical Or(w23, w24, w25) -> w26
    append w11 to w5 if w22
    append w12 to w6 if w14
    next s1 = w11
    next s2 = w17
    next s3 = w12
    next s4 = w15
    stop if w26
  }
  $"Sub Steps" <- w6
  Close Window(reference in=w3, error in=w21) -> (error out=w27)
  $"Error Out" <- w27
  $Steps <- w5
