vi "Manually Place The Filter Message.gvi"   [LabVIEW NXG 3.1.0]
inputs:
  "IR Pass filter?": bool
  "Error In": error
outputs:
  "Error Out": error
diagram:
  case ($"Error In") {
    frame Error, Default {
      w1 = $"Error In"
    }
    frame No Error {
      while {
        w2 = "in the path of the beam\nbefore continuing the measurement."
        Select(s=$"IR Pass filter?", t="the IR pass filter ", f="the Visible pass filter ") -> w3
        Concatenate Strings("Please place the ", w3, w2) -> w4
        One Button Dialog(button name ("OK")="Okay I will do it and then continue", message=w4) -> (true=w5)
        Wait Until Next Multiple(multiple to wait=500)
        stop if w5
      }
      w1 = $"Error In"
    }
  }
  $"Error Out" <- w1
