vi "Save Single EQE prompt.gvi"   [LabVIEW NXG 3.1.0]
inputs:
  "Input": Queue<"Queue instructions.gtype">
  "error out_2": error
outputs:
  "Output": Queue<"Queue instructions.gtype">
  "Output_2": error
types:
  "Queue instructions.gtype" = enum{"Initialize App", "Light Calibration", "Measure Photodetector", "Measure Keithley", "Instrument detection", "Single Acquire", "Multiple Acquire", "EQE Mapping", "Debugging mode", "Move Arduino", "Arduino FF flip filter", "Help routine", "Idle", "Save Calibration", "Load Calibration", "Set Wavelength", "Turn supercontinuum laser on/off", "Set Multiplex arduino cell", "Save TXT EQE file", "Load TXT EQE", "Stop or Idle", "Stop App"}
uses:
  EQE_Measuring_Setup_NanOpto::SubVis::Main Sub Functions::Global Abort::Global Abort.gvi
diagram:
  call "Global Abort.gvi"(Instruction="Read Abort State", Error In=$"error out_2") -> (Local Abort State=w1, Error Out=w2)
  case (w1) {
    frame True {
      w3 = FALSE
      w4 = w2
    }
    frame False {
      Two Button Dialog(F button name ("Cancel")="No thanks, I was just testing", T button name ("OK")="Yes, please (Recommended)", message="Do  you want to save \nthe current EQE measure file?") -> (T Button?=w3)
      w4 = w2
    }
  }
  case (w3) {
    frame False, Default {
      w7 = "Idle"  # Enum instructions
      Enqueue Element(element=w7, error in=w4, queue=$Input) -> (error out=w5, queue out=w6)
    }
    frame True {
      w8 = "Save TXT EQE file"  # Enum instructions
      Enqueue Element(element=w8, error in=w4, queue=$Input) -> (error out=w5, queue out=w6)
    }
  }
  $Output <- w6
  $Output_2 <- w5
