vi "Array Zero Trimmer.gvi"   [LabVIEW NXG 3.1.0]
inputs:
  "Input": f64[][]
outputs:
  "Intensity Graph": f64[][]
panel indicators:
  "Output": f64[][]
  "Output_2": f64[][]
diagram:
  Array Size(array=$Input) -> (size(s)=w1)
  Array Index(array=w1) -> (out0[0]=w2, out1[1]=w3)
  for (N = w2) (iteration -> i1) {
    Array Index(array=$Input) -> (out0[i1, _]=w5)
    for {
      w6 = each element of w5
      Is Equal To 0(x=w6) -> w8
      append w8 to w7
    }
    And Array Elements(Boolean array=w7) -> (logical AND=w9)
    Not(x=w9) -> w10
    append w5 to w4 if w10
  }
  $Output_2 <- w4
  s1 = f64[][] []  # shift register
  s2 = 0  # shift register
  for (N = w3) (iteration -> i2) {
    Array Index(array=w4) -> (out0[_, i2]=w11)
    Reverse 1D Array(array=w11) -> (reversed array=w12)
    for {
      w13 = each element of w11
      Is Equal To 0(x=w13) -> w15
      append w15 to w14
    }
    And Array Elements(Boolean array=w14) -> (logical AND=w16)
    Not(x=w16) -> w17
    case (w17) {
      frame False, Default {
        w18 = s1
        w19 = s2
      }
      frame True {
        Insert Into Array(inArray=s1, index0=s2, new=w12) -> w18
        Increment(x=s2) -> w19
      }
    }
    next s1 = w18
    next s2 = w19
  }
  $Output <- s1
  $"Intensity Graph" <- s1
