vi "Cell Randomizer.gvi"   [LabVIEW NXG 3.1.0]
inputs:
  "Random Cell Order": bool
  "Cell Data Cluster": T1
  "Error In": error
outputs:
  "Cell Measuring Order": string
  "Cell Measuring labels": string[]
  "Error Out": error
types:
  T1 = cluster{"L.01": bool, "R.01": bool, "L.02": bool, "R.02": bool, "L.03": bool, "R.03": bool, "L.04": bool, "R.04": bool, "L.05": bool, "R.05": bool, "L.06": bool, "R.06": bool, "L.07": bool, "R.07": bool, "L.08": bool, "R.08": bool, "L.09": bool, "R.09": bool, "L.10": bool, "R.10": bool, "L.11": bool, "R.11": bool, "L.12": bool, "R.12": bool}
diagram:
  case ($"Error In") {
    frame Error, Default {
      w1 = $"Error In"
    }
    frame No Error {
      Property Node(instance in=$"Cell Data Cluster") -> ("L.01"=w2, "R.01"=w3, "L.02"=w4, "R.02"=w5, "L.03"=w6, "R.03"=w7, "L.04"=w8, "R.04"=w9, "L.05"=w10, "R.05"=w11, "L.06"=w12, "R.06"=w13, "L.07"=w14, "R.07"=w15, "L.08"=w16, "R.08"=w17, "L.09"=w18, "R.09"=w19, "L.10"=w20, "R.10"=w21, "L.11"=w22, "R.11"=w23, "L.12"=w24, "R.12"=w25)
      Build Array(w2, w3, w4, w5, w6, w7, w8, w9, w10, w11, w12, w13, w14, w15, w16, w17, w18, w19, w20, w21, w22, w23, w24, w25) -> w26
      for (iteration -> i1) {
        w27 = each element of w26
        Add(i1, 2) -> w29
        Quotient And Remainder(x=w29, y=2) -> (floor(x/y)=w30)
        Quotient And Remainder(x=i1, y=2) -> (x-y*floor(x/y)=w31)
        Is Equal To 0(x=w31) -> w32
        Select(s=w32, t="R.", f="L.") -> w33
        Is Less(x=w30, y=10) -> w34
        Select(s=w34, t="0", f="") -> w35
        Concatenate Strings(w33, w35) -> w36
        Format Into String(formatString="%d", initString=w36, w30) -> w37
        append w37 to w28 if w27
      }
      for {
        w38 = each element of w28
        String Subset(length (rest)=1, string=w38) -> w41
        Is Equal(x=w41, y="L") -> w42
        Is Equal(x=w41, y="R") -> w43
        append w38 to w39 if w43
        append w38 to w40 if w42
      }
      Build Array(w40, w39) -> w44
      # This Part takes the Already created cell labels and asociates a random number to them,
      # then they are sorted according to the random number and extracted from the cluster
      # with the new order
      case ($"Random Cell Order") {
        frame False, Default {
          s1 = ""  # shift register
          for (iteration -> i2) {
            w47 = each element of w44
            Increment(x=i2) -> w48
            Quotient And Remainder(x=w48, y=6) -> (x-y*floor(x/y)=w49)
            Is Equal To 0(x=w49) -> w50
            Select(s=w50, t="\r\n", f="") -> w51
            Concatenate Strings(s1, w47, " -> ", w51) -> w52
            next s1 = w52
          }
          w45 = w44
          w46 = s1
        }
        frame True {
          for {
            w53 = each element of w44
            Random Number() -> (number (0 to 1)=w55)
            Build Cluster(w55, w53) -> w56
            append w56 to w54
          }
          Sort 1D Array(array=w54) -> (sorted array=w57)
          s2 = ""  # shift register
          for (iteration -> i3) {
            w58 = each element of w57
            Property Node(instance in=w58) -> ("Element 2"=w59)
            Increment(x=i3) -> w60
            Quotient And Remainder(x=w60, y=6) -> (x-y*floor(x/y)=w61)
            Is Equal To 0(x=w61) -> w62
            Select(s=w62, t="\r\n", f="") -> w63
            Concatenate Strings(s2, w59, " -> ", w63) -> w64
            append w59 to w45
            next s2 = w64
          }
          w46 = s2
        }
      }
      $"Cell Measuring labels" <- w45
      $"Cell Measuring Order" <- w46
      w1 = $"Error In"
    }
  }
  $"Error Out" <- w1
