vi "Clear All Visa.gvi"   [LabVIEW NXG 3.1.0]
inputs:
  "Error In": error
outputs:
  "Error Out": error
uses:
  NI::VISA::Find Resource (Search Resources).gvi
  NI::VISA::Open (Instr).gvi
  NI::VISA::Clear (Instr).gvi
  NI::VISA::Close (Instr).gvi
diagram:
  call "Find Resource (Search Resources).gvi"(error in=$"Error In") -> (found resources=w1, error out=w2)
  for {
    w3 = each element of w1
    call "Open (Instr).gvi"(resource name=w3, error in=w2) -> (session out=w4, error out=w5)
    call "Clear (Instr).gvi"(session in=w4, error in=w5) -> (session out=w6, error out=w7)
    call "Close (Instr).gvi"(session in=w6, error in=w7) -> (error out=w8)
  }
  $"Error Out" <- w8
