vi "Cluster erased.gvi"   [LabVIEW NXG 3.1.0]
panel controls:
  "Input": cluster{"Element 1": f64[], "Element 2": f64[]}[]
panel indicators:
  "Output": cluster{"Element 1": f64[], "Element 2": f64[]}[]
diagram:
  s1 = $Input  # shift register
  while (iteration -> i1) {
    Wait Until Next Multiple(multiple to wait=50)
    Quotient And Remainder(x=i1, y=2) -> (x-y*floor(x/y)=w1)
    Is Equal To 0(x=w1) -> w2
    case (w2) {
      frame False, Default {
        w3 = [{"Element 1"=[10], "Element 2"=[10]}]
      }
      frame True {
        $Output <- s1
        w3 = s1
      }
    }
    next s1 = w3
    stop if FALSE
  }
