vi "Create Cell Prefix.gvi"   [LabVIEW NXG 3.1.0]
inputs:
  "Author Initials": string
  "Current Date": string
  "Batch Name": string
  "Sample Comments": string
  "Cell Number": string
  "Cell number required?": bool
outputs:
  "Sample Prefix": string
  "Missing Error": bool
  "Error Label": string
diagram:
  Is Empty String Or Path(string/path=$"Author Initials") -> w1
  Is Empty String Or Path(string/path=$"Current Date") -> w2
  Is Empty String Or Path(string/path=$"Batch Name") -> w3
  Build Array($"Author Initials", $"Current Date", $"Batch Name", $"Sample Comments", $"Cell Number") -> w4
  s1 = ""  # shift register
  for {
    w5 = each element of w4
    Is Empty String Or Path(string/path=w5) -> w6
    case (w6) {
      frame False, Default {
        Concatenate Strings(s1, w5, ".") -> w7
      }
      frame True {
        w7 = s1
      }
    }
    next s1 = w7
  }
  for {
    w8 = each element of ["/", "\\", "*", ":", "?", "\"", ">", "<", "|"]
    Search And Replace String(input string=s1, replace all (F)=TRUE, search string=w8) -> (number of replacements=w10, result string=w11)
    Is Greater Than 0(x=w10) -> w12
    append w12 to w9
  }
  Or Array Elements(Boolean array=w9) -> (logical OR=w13)
  Is Empty String Or Path(string/path=$"Cell Number") -> w14
  Logical And($"Cell number required?", w14) -> w15
  Logical Or(w1, w2, w3, w13, w15) -> w16
  $"Missing Error" <- w16
  $"Sample Prefix" <- w11
  case (w1) {
    frame False, Default {
      w17 = ""
    }
    frame True {
      w17 = "I'm missing the author's initials.\n"
    }
  }
  case (w2) {
    frame False, Default {
      w18 = ""
    }
    frame True {
      w18 = "I'm missing the Current Date.\n"
    }
  }
  case (w3) {
    frame False, Default {
      w19 = ""
    }
    frame True {
      w19 = "I'm missing the Batch Name.\n"
    }
  }
  case (w13) {
    frame False, Default {
      w20 = ""
    }
    frame True {
      w21 = """You used one of these characters,
which cannot be used for naming files and folders:
 \ / * : ? " < > |
If you do not fix it, your files will NOT be saved.
"""
      w20 = w21
    }
  }
  case (w15) {
    frame False, Default {
      w22 = ""
    }
    frame True {
      w22 = "I'm missing the Cell Name.\n"
    }
  }
  Concatenate Strings(w17, w18, w19, w20, w22) -> w23
  $"Error Label" <- w23
