vi "Current Time Kr.gvi"   [LabVIEW NXG 3.1.0]
inputs:
  "Error": error
outputs:
  "Current Time (kr)": f64
  "Error Out": error
diagram:
  Get Current Time() -> (current time=w1)
  Timestamp To Date Time(time stamp=w1) -> (date time rec=w2)
  Property Node(instance in=w2) -> ("fractional second"=w3, "second"=w4, "minute"=w5, "hour"=w6)
  Multiply(w6, 3600) -> w7
  Multiply(w5, 60) -> w8
  Add(w3, w4, w7, w8) -> w9
  Divide(x=w9, y=8640) -> w10
  $"Current Time (kr)" <- w10
  Get Date And Time String(time stamp=w1, want seconds? (F)=TRUE)
  $"Error Out" <- $Error
