vi "Enable-disable arduino move controls.gvi"   [LabVIEW NXG 3.1.0]
inputs:
  "Input_2": "BooleanControl reference"
  "Input_4": "BooleanControl reference"
  "Input": "BooleanControl reference"
  "Carriage Active": bool
  "Error In": error
outputs:
  "Error Out": error
diagram:
  Not(x=$"Carriage Active") -> w1
  Property Node(instance in=$Input_2, "Disabled"=$"Carriage Active", error in=$"Error In") -> (error out=w2)
  Property Node(instance in=$Input_4, "Disabled"=w1, error in=w2) -> (error out=w3)
  Property Node(instance in=$Input, "Disabled"=w1, error in=w3) -> (error out=w4)
  $"Error Out" <- w4
