vi "Enum reset instructions argument extract.gvi"   [LabVIEW NXG 5.0.0]
inputs:
  "Error In": error
  "Reset instructions": "Reset instructions.gtype" = "Reset Global Variables"
outputs:
  "Error Out": error
  "Reset instruction Items": "Reset instructions.gtype"[]
types:
  "Reset instructions.gtype" = enum{"Reset Global Variables", "Reset doubles", "Reset Strings", "Reset Booleans", "Reset arrays", "Reset Clusters", "Reset Current Date", "Reset Fiannium Config file", "Reset disabled controls"}
diagram:
  case ($"Error In") {
    frame Error, Default {
      w1 = $"Error In"
    }
    frame No Error {
      s1 = uninitialised  # shift register
      while (iteration -> i1) {
        Is Not Equal To 0(x=i1) -> w3
        To Unsigned 16 Bit Integer(number=i1) -> w4
        Type Cast(type=$"Reset instructions", x=w4) -> w5
        case (w3) {
          frame False, Default {
            w6 = FALSE
          }
          frame True {
            Is Equal(x=s1, y=w5) -> w6
          }
        }
        Not(x=w6) -> w7
        append w5 to w2 if w7
        next s1 = w5
        stop if w6
      }
      $"Reset instruction Items" <- w2
      w1 = $"Error In"
    }
  }
  $"Error Out" <- w1
