vi "Get date YYMMDD.gvi"   [LabVIEW NXG 3.1.0]
outputs:
  "Date YYMMDD": string
uses:
  NI::G Core::Strings::Search and Replace Pattern.gvi
diagram:
  Get Current Time() -> (current time=w1)
  Get Date And Time String(time stamp=w1) -> (date string=w2)
  call "Search and Replace Pattern.gvi"(string=w2, pattern="/", replace all=TRUE) -> (result string=w3)
  Replace Substring(length (len. of substring)=2, offset=5, string=w3) -> (result string=w4)
  Replace Substring(length (len. of substring)=2, offset=4, string=w4) -> (replaced substring=w5)
  Replace Substring(length (len. of substring)=2, string=w4) -> (replaced substring=w6)
  Replace Substring(length (len. of substring)=2, offset=2, string=w4) -> (replaced substring=w7)
  Concatenate Strings(w5, w6, w7) -> w8
  $"Date YYMMDD" <- w8
