vi "Graph Adapter Multi plot.gvi"   [LabVIEW NXG 3.1.0]
inputs:
  "Input XY data Multi Page": f64[][][]
outputs:
  "Output Multi Graph": cluster{"Element 1": f64[], "Element 2": f64[]}[]
diagram:
  for {
    w1 = each element of $"Input XY data Multi Page"
    Array Index(array=w1) -> (out0[_, 0]=w3, out1[_, 1]=w4)
    for {
      w5 = each element of w3
      w6 = each element of w4
      Is Not Equal To 0(x=w5) -> w9
      append w5 to w7 if w9
      append w6 to w8 if w9
    }
    Build Cluster(w7, w8) -> w10
    append w10 to w2
  }
  $"Output Multi Graph" <- w2
