vi "Graph Adapter.gvi"   [LabVIEW NXG 5.0.0]
inputs:
  "Input XY data": f64[][]
outputs:
  "Output Graph": cluster{"Element 1": f64[], "Element 2": f64[]}
diagram:
  Array Index(array=$"Input XY data") -> (out0[_, 0]=w1, out1[_, 1]=w2)
  Build Cluster(w1, w2) -> w3
  $"Output Graph" <- w3
