vi "Light Calibration parameters extractor.gvi"   [LabVIEW NXG 3.1.0]
inputs:
  "Light calibration data": f64[][]
outputs:
  "End Wavelength (nm) Current Calibration": f64
  "Wavelength Step (nm) Current Calibration": f64
  "Start Wavelength (nm) Current Calibration": f64
diagram:
  Array Size(array=$"Light calibration data") -> (size(s)=w1)
  Array Index(array=w1) -> (out0[0]=w2)
  Decrement(x=w2) -> w3
  Array Index(array=$"Light calibration data") -> (out0[0, 0]=w4, out1[w3, 0]=w5, out2[1, 0]=w6)
  $"End Wavelength (nm) Current Calibration" <- w5
  Subtract(x=w6, y=w4) -> w7
  Absolute Value(x=w7) -> w8
  $"Wavelength Step (nm) Current Calibration" <- w8
  $"Start Wavelength (nm) Current Calibration" <- w4
