vi "Plot Labels fixer.gvi"   [LabVIEW NXG 3.1.0]
inputs:
  "Automatic EQE Measurement Graph": cluster{"Element 1": f64[], "Element 2": f64[]}[]
  "Cell Measuring Labels": string[]
  "Error In": error
outputs:
  "Error Out": error
diagram:
  case ($"Error In") {
    frame Error, Default {
      w1 = $"Error In"
    }
    frame No Error {
      s1 = $"Error In"  # shift register
      for (iteration -> i1) (after $"Automatic EQE Measurement Graph") {
        w2 = each element of $"Cell Measuring Labels"
        Property Node(instance in=reference to "Automatic EQE Measurement Graph", "ActivePlot"=i1, error in=s1) -> ("Plot"=w3, error out=w4)
        Property Node(instance in=w3, "Name"=w2, error in=w4) -> (error out=w5, instance out=w6)
        next s1 = w5
      }
      w1 = s1
    }
  }
  $"Error Out" <- w1
