vi "Round to N Decimals.gvi"   [LabVIEW NXG 3.1.0]
inputs:
  "To Round": f64
  "Decimal Places": u8 = 1
outputs:
  "Rounded": f64
panel indicators:
  "nearest integer value": f64
  "Power": f64
diagram:
  Power Of X(x=10, y=$"Decimal Places") -> w1
  Multiply($"To Round", w1) -> w2
  Round To Nearest(number=w2) -> w3
  $"nearest integer value" <- w3
  Divide(x=w3, y=w1) -> w4
  $Rounded <- w4
  $Power <- w1
