vi "Wavelength Coercer.gvi"   [LabVIEW NXG 3.1.0]
inputs:
  "Start Wavelength (nm)": f64 = 400
  "Monochromator": bool
  "End Wavelength (nm)": f64 = 1100
  "Error In": error
  "Desired λ (nm)": f64 = 500
outputs:
  "Start Wavelength (nm) out": f64
  "End Wavelength (nm) out": f64
  "Error Out": error
  "Desired λ (nm) Out": f64
diagram:
  case ($"Error In") {
    frame Error, Default {
      w1 = $"Error In"
    }
    frame No Error {
      Select(s=$Monochromator, t=2599, f=1099) -> w2
      Select(s=$Monochromator, t=800, f=350) -> w3
      In Range And Coerce(lower limit=w3, upper limit=w2, x=$"Start Wavelength (nm)") -> (coerced(x)=w4)
      $"Start Wavelength (nm) out" <- w4
      Select(s=$Monochromator, t=2600, f=1100) -> w5
      Select(s=$Monochromator, t=800, f=350) -> w6
      In Range And Coerce(lower limit=w6, upper limit=w5, x=$"Desired λ (nm)") -> (coerced(x)=w7)
      $"Desired λ (nm) Out" <- w7
      Select(s=$Monochromator, t=2600, f=1100) -> w8
      Select(s=$Monochromator, t=801, f=351) -> w9
      In Range And Coerce(lower limit=w9, upper limit=w8, x=$"End Wavelength (nm)") -> (coerced(x)=w10)
      $"End Wavelength (nm) out" <- w10
      w1 = $"Error In"
    }
  }
  $"Error Out" <- w1
