vi "Wavelength detection filter flipper routine.gvi"   [LabVIEW NXG 3.1.0]
inputs:
  "Current Wavelength": f64
  "Arduino Filter Flipper Status": bool
  "Arduino Filter Flipper Address": "VISA Instr"
  "Crossing Ka": bool
  "Error In": error
outputs:
  "Error Out": error
uses:
  EQE_Measuring_Setup_NanOpto::SubVis::Instrument Control::Monochromator::Filter Change Wavelength.gvi
  EQE_Measuring_Setup_NanOpto::SubVis::Utilities::Messages And Prompts::Manually Place The Filter Message.gvi
  EQE_Measuring_Setup_NanOpto::SubVis::Instrument Control::Arduinos::Filter Flipper Arduino::Arduino Filter Flipper Control.gvi
  EQE_Measuring_Setup_NanOpto::SubVis::FGV::Arduino filter FGV current state.gvi
diagram:
  # If the wavelength crosses the grating set barrier then ask for the filter to be flipped either manually or automatically
  case ($"Error In") {
    frame Error, Default {
      w1 = $"Error In"
    }
    frame No Error {
      case ($"Crossing Ka") {
        frame False, Default {
          w1 = $"Error In"
        }
        frame True {
          s1 = uninitialised  # shift register
          while {
            call "Filter Change Wavelength.gvi"() -> (Wavelength of filter Change=w2)
            Is Greater Or Equal(x=$"Current Wavelength", y=w2) -> w3
            Is Greater Or Equal(x=s1, y=w2) -> w4
            Logical Exclusive Or(w3, w4) -> w5
            case (w5) {
              frame False, Default {
                w1 = $"Error In"
              }
              frame True {
                case ($"Arduino Filter Flipper Status") {
                  frame False, Default {
                    Is Greater(x=$"Current Wavelength", y=s1) -> w6
                    call "Manually Place The Filter Message.gvi"(IR Pass filter?=w6, Error In=$"Error In") -> (Error Out=w1)
                  }
                  frame True {
                    Is Greater(x=$"Current Wavelength", y=s1) -> w7
                    Select(s=w7, t="IR Pass", f="Visible Pass") -> w8
                    call "Arduino Filter Flipper Control.gvi"(Arduino Filter Flipper Address In=$"Arduino Filter Flipper Address", Pass Filter=w8, Error In=$"Error In") -> (Error Out=w9)
                    call "Arduino filter FGV current state.gvi"(Arduino Filter Flipper FGV instructions="Set State", Arduino Filter Flipper Instructions In=w8, Error In=w9) -> (Error Out=w1)
                  }
                }
              }
            }
            next s1 = $"Current Wavelength"
            stop if TRUE
          }
        }
      }
    }
  }
  $"Error Out" <- w1
