vi "Wavelength loop calculation.gvi"   [LabVIEW NXG 3.1.0]
inputs:
  "Wavelength Step (nm)": f64 = 2
  "End Wavelength (nm)": f64 = 1100
  "Start Wavelength (nm)": f64 = 400
outputs:
  "Ammount of steps +1 (for the loop)": i32
  "Positive or negative steps": f64
  "Exact ammount of steps": i32
diagram:
  Subtract(x=$"End Wavelength (nm)", y=$"Start Wavelength (nm)") -> w1
  Sign(number=w1) -> (-1, 0, 1=w2)
  $"Positive or negative steps" <- w2
  Absolute Value(x=w1) -> w3
  Divide(x=w3, y=$"Wavelength Step (nm)") -> w4
  To Long Integer(number=w4) -> w5
  $"Exact ammount of steps" <- w5
  Increment(x=w5) -> w6
  $"Ammount of steps +1 (for the loop)" <- w6
