vi "Path Generator and Checker.gvi"   [LabVIEW NXG 3.1.0]
inputs:
  "Default Data Saving Location": path
  "Author Initials": string
  "Current Date": string
  "Batch Name": string
  "Sample Prefix": string
  "Error In": error
  "Path type": "Path type.gtype" = "Calibration"
  "Cell Label": string
outputs:
  "File path": path
  "Error Out": error
  "Folder to save data": path
types:
  "Path type.gtype" = enum{"Calibration", "Single EQE", "Multiple EQE"}
uses:
  NI::G Core::File IO (General)::Check if File or Folder Exists.gvi
  EQE_Measuring_Setup_NanOpto::SubVis::Utilities::Messages And Prompts::Select path prompt.gvi
diagram:
  case ($"Error In") {
    frame Error, Default {
      w1 = $"Error In"
    }
    frame No Error {
      call "Check if File or Folder Exists.gvi"(file or folder=$"Default Data Saving Location", error in=$"Error In") -> (file or folder exists?=w2, error out=w3)
      Is Empty String Or Path(string/path=$"Default Data Saving Location") -> w4
      Logical Or(w4, not w2) -> w5
      case (w5) {
        frame False {
          w6 = $"Default Data Saving Location"
          w7 = w3
        }
        frame True {
          w8 = "Please specify the path where you want to save all EQE measurements:"
          call "Select path prompt.gvi"(Main Message=w8, Sub message="Sub paths with your name, date and device will be created", Error In=w3) -> (New Path=w6, Error Out=w7)
        }
      }
      $"Folder to save data" <- w6
      Build Path(base path=w6, name or relative path=$"Author Initials") -> (appended path=w9)
      call "Check if File or Folder Exists.gvi"(file or folder=w9, error in=w7) -> (file or folder exists?=w10, error out=w11)
      case (w10) {
        frame True {
          w12 = w11
          w13 = w9
        }
        frame False {
          Create Folder(error in=w11, path (use dialog)=w9) -> (created path=w13, error out=w12)
        }
      }
      Build Path(base path=w13, name or relative path=$"Current Date") -> (appended path=w14)
      call "Check if File or Folder Exists.gvi"(file or folder=w14, error in=w12) -> (file or folder exists?=w15, error out=w16)
      case (w15) {
        frame True {
          w17 = w16
          w18 = w14
        }
        frame False {
          Create Folder(error in=w16, path (use dialog)=w14) -> (created path=w18, error out=w17)
        }
      }
      Concatenate Strings("Device ", $"Batch Name") -> w19
      Build Path(base path=w18, name or relative path=w19) -> (appended path=w20)
      call "Check if File or Folder Exists.gvi"(file or folder=w20, error in=w17) -> (file or folder exists?=w21, error out=w22)
      case (w21) {
        frame True {
          w23 = w22
          w24 = w20
        }
        frame False {
          Create Folder(error in=w22, path (use dialog)=w20) -> (created path=w24, error out=w23)
        }
      }
      Build Path(base path=w24, name or relative path="TXT files") -> (appended path=w25)
      call "Check if File or Folder Exists.gvi"(file or folder=w25, error in=w23) -> (file or folder exists?=w26, error out=w27)
      case (w26) {
        frame True {
          w1 = w27
          w28 = w25
        }
        frame False {
          Create Folder(error in=w27, path (use dialog)=w25) -> (created path=w28, error out=w1)
        }
      }
      case ($"Path type") {
        frame "Calibration", Default {
          w29 = "Calibration"
        }
        frame "Single EQE" {
          w29 = ""
        }
        frame "Multiple EQE" {
          w29 = $"Cell Label"
        }
      }
      Concatenate Strings($"Sample Prefix", w29) -> w30
      String Length(string=w30) -> (length=w31)
      Decrement(x=w31) -> w32
      String Subset(length (rest)=1, offset (0)=w32, string=w30) -> w33
      Is Equal(x=w33, y=".") -> w34
      Select(s=w34, t="txt", f=".txt") -> w35
      Concatenate Strings(w30, w35) -> w36
      Build Path(base path=w28, name or relative path=w36) -> (appended path=w37)
      $"File path" <- w37
    }
  }
  $"Error Out" <- w1
