vi "Read Coordinate Reference file.gvi"   [LabVIEW NXG 3.1.0]
inputs:
  "Input_2": path
  "R.01 Reference Coordinates In": "R.01 Reference Coordinates.gtype" = {"X coordinate R.01"=145.3, "Z coordinate R.01"=2.5, "Vertical Spacing"=0}
  "Input": error
outputs:
  "Coordinate reference path": path
  "R.01 Reference Coordinates Out": "R.01 Reference Coordinates.gtype"
  "Output": error
types:
  "R.01 Reference Coordinates.gtype" = cluster{"X coordinate R.01": f64, "Z coordinate R.01": f64, "Vertical Spacing": f64}
diagram:
  Open Or Create Or Replace File(error in=$Input, file path (use dialog)=$Input_2, operation (0:open)="open") -> (error out=w1, refnum out=w2)
  Read From Text File(error in=w1, file (use dialog)=w2) -> (error out=w3, refnum out=w4, text=w5)
  Cluster To Array(cluster=$"R.01 Reference Coordinates In") -> (array=w6)
  Spreadsheet String To Array(array type=w6, format string="%g", spreadsheet string=w5) -> (array=w7)
  Array To Cluster[NumberOfClusterElements=9](array=w7) -> (cluster=w8)
  Property Node(instance in=w8) -> ("Element 0"=w9, "Element 1"=w10, "Element 2"=w11)
  Property Node(instance in=$"R.01 Reference Coordinates In", "X coordinate R.01"=w9, "Z coordinate R.01"=w10, "Vertical Spacing"=w11) -> (instance out=w12)
  $"R.01 Reference Coordinates Out" <- w12
  Close File(error in=w3, refnum=w4) -> (error out=w13, path=w14)
  $"Coordinate reference path" <- w14
  $Output <- w13
