vi "Update Reference Coordinates subroutine.gvi"   [LabVIEW NXG 3.1.0]
inputs:
  "Reference Coordinates file": path
  "R.01 Reference Coordinates": "R.01 Reference Coordinates.gtype" = {"X coordinate R.01"=145.3, "Z coordinate R.01"=2.5, "Vertical Spacing"=0}
  "Error In": error
outputs:
  "Error Out": error
types:
  "R.01 Reference Coordinates.gtype" = cluster{"X coordinate R.01": f64, "Z coordinate R.01": f64, "Vertical Spacing": f64}
uses:
  EQE_Measuring_Setup_NanOpto::SubVis::FGV::Current State FGV.gvi
  EQE_Measuring_Setup_NanOpto::SubVis::Utilities::Path Manipulation::Write Reference Coordinate File.gvi
diagram:
  call "Current State FGV.gvi"(Instruction Current State FGV="Read Current State", Error In=$"Error In") -> (Current State Output=w1, Error Out=w2)
  Is Not Equal(x=w1, y="Idle") -> w3
  case (w3) {
    frame False, Default {
      call "Write Reference Coordinate File.gvi"(Input=$"Reference Coordinates file", R.01 Reference Coordinates=$"R.01 Reference Coordinates", operation="open", error out_2=w2) -> (Output_2=w4)
    }
    frame True {
      Format Into String(w1) -> w5
      w6 = "Please wait until all tasks have been finished.\nCurrent task: "
      Concatenate Strings(w6, w5) -> w7
      One Button Dialog(button name ("OK")="Okay, sorry, I will wait", message=w7)
      w4 = w2
    }
  }
  $"Error Out" <- w4
