vi "Write Reference Coordinate File.gvi"   [LabVIEW NXG 3.1.0]
inputs:
  "Input": path
  "R.01 Reference Coordinates": "R.01 Reference Coordinates.gtype" = {"X coordinate R.01"=145.3, "Z coordinate R.01"=2.5, "Vertical Spacing"=0}
  "operation": T1 = "create"
  "error out_2": error
outputs:
  "Output": path
  "Output_2": error
types:
  T1 = enum{"open", "replace", "create", "open or create", "replace or create", "replace or create with confirmation"}
  "R.01 Reference Coordinates.gtype" = cluster{"X coordinate R.01": f64, "Z coordinate R.01": f64, "Vertical Spacing": f64}
diagram:
  Open Or Create Or Replace File(error in=$"error out_2", file path (use dialog)=$Input, operation (0:open)=$operation) -> (error out=w1, refnum out=w2)
  Cluster To Array(cluster=$"R.01 Reference Coordinates") -> (array=w3)
  Array To Spreadsheet String(array=w3, format string="%g") -> (spreadsheet string=w4)
  Write To Text File(error in=w1, file (use dialog)=w2, text=w4) -> (error out=w5, refnum out=w6)
  Close File(error in=w5, refnum=w6) -> (error out=w7, path=w8)
  $Output <- w8
  $Output_2 <- w7
