vi "Light Calibration Prerequisites.gvi"   [LabVIEW NXG 3.1.0]
inputs:
  "Queue In": Queue<"Queue instructions.gtype">
  "New Calibration": bool
  "Cross 650 nm frontier?": bool
  "Other task active?": bool
  "Label Info Missing Error": bool
  "Label Info Error Label": string
  "Filter Arduino Status": bool
  "Error In": error
outputs:
  "Queue Out": Queue<"Queue instructions.gtype">
  "Error out": error
  "All prerequisites fulfilled": bool
types:
  "Queue instructions.gtype" = enum{"Wrongly pointed State", "Initialize App", "Light Calibration", "Measure Photodetector", "Measure Keithley", "Instrument detection", "Single Acquire", "Multiple Acquire", "EQE Mapping", "Debugging mode", "Move Arduino", "Arduino FF flip filter", "Help routine", "Idle", "Save Calibration", "Load Calibration", "Set Wavelength", "Turn supercontinuum laser on/off", "Set Multiplex arduino cell", "Save TXT EQE file", "Load TXT EQE", "Stop or Idle", "Stop App"}
uses:
  EQE_Measuring_Setup_NanOpto::SubVis::FGV::Current State FGV.gvi
diagram:
  Logical And(not $"Filter Arduino Status", $"Cross 650 nm frontier?") -> w1
  Feedback Node(input=w2) -> w3
  Logical And(w1, not w3) -> w4
  Logical Or($"Other task active?", $"Label Info Missing Error", w4) -> w5
  case (w5) {
    frame False, Default {
      w8 = "Light Calibration"  # Enum instructions
      Enqueue Element(element=w8, error in=$"Error In", queue=$"Queue In") -> (error out=w6, queue out=w7)
      w2 = default
    }
    frame True {
      case ($"Label Info Missing Error") {
        frame False, Default { }
        frame True {
          One Button Dialog(button name ("OK")="Okay, sorry, I will fix it right now", message=$"Label Info Error Label")
        }
      }
      case (w4) {
        frame False, Default {
          w2 = default
        }
        frame True {
          w9 = """It looks like the Filter Flipper Arduino
is not connected, yet your light calibration
data crosses the 650 nm frontier. Do you
want to insert the IR pass filter manually
in the middle of the measurement? (You
will have to click Acquire again either way)"""
          w10 = "Yes I place it in front of the beam\nmanually amidst measurement."
          w11 = "No please I will connect\nfilter flipper arduino correctly\nor ask for help"
          Two Button Dialog(F button name ("Cancel")=w11, T button name ("OK")=w10, message=w9) -> (T Button?=w2)
        }
      }
      case ($"Other task active?") {
        frame False, Default {
          w6 = $"Error In"
        }
        frame True {
          w12 = "Please wait until all tasks have been finished.\nCurrent task: "
          call "Current State FGV.gvi"(Instruction Current State FGV="Read Current State", Error In=$"Error In") -> (Current State Output=w13, Error Out=w6)
          Format Into String(w13) -> w14
          Concatenate Strings(w12, w14) -> w15
          One Button Dialog(button name ("OK")="Okay, sorry, I will wait", message=w15)
        }
      }
      w7 = $"Queue In"
    }
  }
  $"Queue Out" <- w7
  $"Error out" <- w6
  Logical Or[output inverted]($"Label Info Missing Error", w4, $"Other task active?") -> w16
  $"All prerequisites fulfilled" <- w16
