vi "Move Arduino Prerequisites.gvi"   [LabVIEW NXG 3.1.0]
inputs:
  "Input": Queue<"Queue instructions.gtype">
  "Set Position": bool
  "Carriage Arduino Status": bool
  "Error In": error
outputs:
  "Output_2": Queue<"Queue instructions.gtype">
  "Error Out": error
types:
  "Queue instructions.gtype" = enum{"Initialize App", "Light Calibration", "Measure Photodetector", "Measure Keithley", "Instrument detection", "Single Acquire", "Multiple Acquire", "EQE Mapping", "Debugging mode", "Move Arduino", "Help routine", "Idle", "Save Calibration", "Load Calibration", "Set Wavelength", "Turn supercontinuum laser on/off", "Set Multiplex arduino cell", "Save TXT EQE file", "Load TXT EQE", "Stop or Idle", "Stop App"}
diagram:
  case ($"Carriage Arduino Status") {
    frame False, Default {
      w3 = "The Carriage Arduino has not\nbeen detected please connect\nit propperly restart the app\nand try again."
      One Button Dialog(button name ("OK")="Okay I'll do that", message=w3)
      w1 = $Input
      w2 = $"Error In"
    }
    frame True {
      Enqueue Element(element="Move Arduino", error in=$"Error In", queue=$Input) -> (error out=w2, queue out=w1)
    }
  }
  $Output_2 <- w1
  $"Error Out" <- w2
