vi "Multiple Acquire Prerequisite Detection.gvi"   [LabVIEW NXG 3.1.0]
inputs:
  "Queue In": Queue<"Queue instructions.gtype">
  "Acquire Automatic EQE": bool
  "Cell Measuring Labels": string[]
  "Label Info Missing Error": bool
  "Label Info Error Label": string
  "Light Power Calibration Data": f64[][]
  "Error In": error
  "Filter Arduino Status": bool
  "Carriage Arduino Status": bool
  "Multiplexer Arduino Status": bool
outputs:
  "Queue Out": Queue<"Queue instructions.gtype">
  "Current State Output": "Queue instructions.gtype"
  "Error Out": error
types:
  "Queue instructions.gtype" = enum{"Initialize App", "Light Calibration", "Measure Photodetector", "Measure Keithley", "Instrument detection", "Single Acquire", "Multiple Acquire", "EQE Mapping", "Debugging mode", "Move Arduino", "Arduino FF flip filter", "Help routine", "Idle", "Save Calibration", "Load Calibration", "Set Wavelength", "Turn supercontinuum laser on/off", "Set Multiplex arduino cell", "Save TXT EQE file", "Load TXT EQE", "Stop or Idle", "Stop App"}
uses:
  EQE_Measuring_Setup_NanOpto::SubVis::FGV::Current State FGV.gvi
  EQE_Measuring_Setup_NanOpto::SubVis::Instrument Control::Monochromator::Filter Wavelength nm Crossing ka.gvi
diagram:
  call "Current State FGV.gvi"(Instruction Current State FGV="Read Current State", Error In=$"Error In") -> (Current State Output=w1, Error Out=w2)
  $"Current State Output" <- w1
  Is Empty Array(array=$"Cell Measuring Labels") -> w3
  Is Empty Array(array=$"Light Power Calibration Data") -> w4
  call "Filter Wavelength nm Crossing ka.gvi"(Light Power Calibration Data=$"Light Power Calibration Data") -> (Crosses the Change Grating Wavelength Frontier?=w5)
  Logical And(w5, not $"Filter Arduino Status") -> w6
  Is Not Equal(x=w1, y="Idle") -> w7
  Logical Or(w7, $"Label Info Missing Error", w4, w3, w6, not $"Multiplexer Arduino Status", not $"Carriage Arduino Status") -> w8
  case (w8) {
    frame False, Default {
      w11 = "Multiple Acquire"  # Enum instructions
      Enqueue Element(element=w11, error in=w2, queue=$"Queue In") -> (error out=w9, queue out=w10)
    }
    frame True {
      case (w3) {
        frame False, Default { }
        frame True {
          w12 = """It looks like you are trying 
to measure no cells at all. 
Please, select at least one cell
before starting the measurement.
If you wanted to make a manual EQE
measurement without using the carriages
please go to the Manual EQE measurement tab."""
          One Button Dialog(button name ("OK")="Oh, sorry I did not realise", message=w12)
        }
      }
      case (w4) {
        frame False, Default { }
        frame True {
          w13 = """It looks like there is no light
calibration data loaded. Please
perform a light calibration or load 
a light calibration file before trying 
to measure any EQE"""
          w14 = "Okay, sorry, I will perform\na light calibration right now."
          One Button Dialog(button name ("OK")=w14, message=w13)
        }
      }
      case (w6) {
        frame False, Default { }
        frame True {
          w15 = """It looks like the Filter Flipper Arduino
is not connected, yet your light calibration
data crosses the 650 nm frontier. Please
make sure that the aduino is correctly connected."""
          w16 = "Oh sorry I will connect\nfilter flipper arduino correctly\nor ask for help"
          One Button Dialog(button name ("OK")=w16, message=w15)
        }
      }
      case ($"Multiplexer Arduino Status") {
        frame True { }
        frame False {
          w17 = """It looks like the Multiplexer Arduino
is not connected, without it the automatic
EQE measurement is impossible so please
connect it or seek some help."""
          w18 = "Oh sorry I will connect\nthe multiplexer arduino correctly\nor ask for help"
          One Button Dialog(button name ("OK")=w18, message=w17)
        }
      }
      case (w7) {
        frame False, Default { }
        frame True {
          w19 = "Please wait until all tasks have been finished.\nCurrent task: "
          Format Into String($"Current State Output") -> w20
          Concatenate Strings(w19, w20) -> w21
          One Button Dialog(button name ("OK")="Okay, sorry, I will wait", message=w21)
        }
      }
      case ($"Label Info Missing Error") {
        frame False, Default { }
        frame True {
          One Button Dialog(button name ("OK")="Okay, sorry, I will fix it right now", message=$"Label Info Error Label")
        }
      }
      case ($"Carriage Arduino Status") {
        frame True { }
        frame False {
          w22 = """It looks like the XZ Carriage Arduino
is not connected, without it the automatic
EQE measurement is impossible so please
connect it and make sure it has power
or seek some help."""
          w23 = "Oh sorry I will connect\nthe XZ Carriage arduino correctly\nor ask for help"
          One Button Dialog(button name ("OK")=w23, message=w22)
        }
      }
      w9 = w2
      w10 = $"Queue In"
    }
  }
  $"Queue Out" <- w10
  $"Error Out" <- w9
