vi "Single Acquire Prerequisite Detection.gvi"   [LabVIEW NXG 3.1.0]
inputs:
  "Queue In": Queue<"Queue instructions.gtype">
  "Acquire Manual EQE": bool
  "Filter Arduino Status": bool
  "Label Info Missing Error": bool
  "Label Info Error Label": string
  "Light Power Calibration Data": f64[][]
  "Error In": error
outputs:
  "Queue Out": Queue<"Queue instructions.gtype">
  "Current State Output": "Queue instructions.gtype"
  "Error Out": error
types:
  "Queue instructions.gtype" = enum{"Initialize App", "Light Calibration", "Measure Photodetector", "Measure Keithley", "Instrument detection", "Single Acquire", "Multiple Acquire", "EQE Mapping", "Debugging mode", "Move Arduino", "Arduino FF flip filter", "Help routine", "Idle", "Save Calibration", "Load Calibration", "Set Wavelength", "Turn supercontinuum laser on/off", "Set Multiplex arduino cell", "Save TXT EQE file", "Load TXT EQE", "Stop or Idle", "Stop App"}
uses:
  EQE_Measuring_Setup_NanOpto::SubVis::FGV::Current State FGV.gvi
  EQE_Measuring_Setup_NanOpto::SubVis::Instrument Control::Monochromator::Filter Wavelength nm Crossing ka.gvi
diagram:
  call "Current State FGV.gvi"(Instruction Current State FGV="Read Current State", Error In=$"Error In") -> (Current State Output=w1, Error Out=w2)
  Is Empty Array(array=$"Light Power Calibration Data") -> w3
  call "Filter Wavelength nm Crossing ka.gvi"(Light Power Calibration Data=$"Light Power Calibration Data") -> (Crosses the Change Grating Wavelength Frontier?=w4)
  Logical And(w4, not $"Filter Arduino Status") -> w5
  Feedback Node(input=w6) -> w7
  Logical Or[output inverted](not w5, w7) -> w8
  Is Not Equal(x=w1, y="Idle") -> w9
  Logical Or(w9, $"Label Info Missing Error", w3, w8) -> w10
  case (w10) {
    frame False, Default {
      w13 = "Single Acquire"  # Enum instructions
      Enqueue Element(element=w13, error in=w2, queue=$"Queue In") -> (error out=w11, queue out=w12)
      w6 = default
    }
    frame True {
      case ($"Label Info Missing Error") {
        frame False, Default { }
        frame True {
          One Button Dialog(button name ("OK")="Okay, sorry, I will fix it right now", message=$"Label Info Error Label")
        }
      }
      case (w3) {
        frame False, Default { }
        frame True {
          w14 = """It looks like there is no light
calibration data loaded. Please
perform a light calibration or load 
a light calibration file before trying 
to measure any EQE"""
          w15 = "Okay, sorry, I will perform\na light calibration right now."
          One Button Dialog(button name ("OK")=w15, message=w14)
        }
      }
      case (w8) {
        frame False, Default {
          w6 = default
        }
        frame True {
          w16 = """It looks like the Filter Flipper Arduino
is not connected, yet your light calibration
data crosses the 650 nm frontier. Do you
want to insert the IR pass filter manually
in the middle of the measurement? (You
will have to click Acquire again either way)"""
          w17 = "Yes I place it in front of the beam\nmanually amidst measurement."
          w18 = "No please I will connect\nfilter flipper arduino correctly\nor ask for help"
          Two Button Dialog(F button name ("Cancel")=w18, T button name ("OK")=w17, message=w16) -> (T Button?=w6)
        }
      }
      case (w9) {
        frame False, Default { }
        frame True {
          w19 = "Please wait until all tasks have been finished.\nCurrent task: "
          Format Into String($"Current State Output") -> w20
          Concatenate Strings(w19, w20) -> w21
          One Button Dialog(button name ("OK")="Okay, sorry, I will wait", message=w21)
        }
      }
      w11 = w2
      w12 = $"Queue In"
    }
  }
  $"Queue Out" <- w12
  $"Current State Output" <- w1
  $"Error Out" <- w11
