vi "Save Reference Coordinate R.01 Enqueue.gvi"   [LabVIEW NXG 5.0.0]
inputs:
  "Queue In": Queue<"Queue instructions.gtype">
  "Current State Output": "Queue instructions.gtype" = "Initialize App"
  "Load Calibration": bool
  "Error In": error
outputs:
  "Queue Out": Queue<"Queue instructions.gtype">
  "Error Out": error
types:
  "Queue instructions.gtype" = enum{"Wrongly pointed State", "Initialize App", "Light Calibration", "Measure Photodetector", "Measure Keithley", "Instrument detection", "Single Acquire", "Multiple Acquire", "EQE Mapping", "Debugging mode", "Move Arduino", "Arduino FF flip filter", "Help routine", "Idle", "Save Calibration", "Load Calibration", "Set Wavelength", "Help Wizard", "Turn supercontinuum laser on/off", "Save R.01 Coordinates", "Set Multiplex arduino cell", "Save TXT EQE file", "Load TXT EQE", "Stop or Idle", "Stop App"}
uses:
  EQE_Measuring_Setup_NanOpto::SubVis::FGV::Current State FGV.gvi
diagram:
  call "Current State FGV.gvi"(Instruction Current State FGV="Read Current State", Error In=$"Error In") -> (Current State Output=w1, Error Out=w2)
  Is Not Equal(x=w1, y="Idle") -> w3
  case (w3) {
    frame True {
      Format Into String($"Current State Output") -> w6
      w7 = "Please wait until all tasks have been finished.\nCurrent task: "
      Concatenate Strings(w7, w6) -> w8
      One Button Dialog(button name ("OK")="Okay, sorry, I will wait", message=w8)
      w4 = w2
      w5 = $"Queue In"
    }
    frame False {
      w9 = "Save R.01 Coordinates"  # Enum instructions
      Enqueue Element(element=w9, error in=w2, queue=$"Queue In") -> (error out=w4, queue out=w5)
    }
  }
  $"Queue Out" <- w5
  $"Error Out" <- w4
