vi "Test Array.gvi"   [LabVIEW NXG 3.1.0]
panel indicators:
  "Output": f64[][][]
  "Output_3": i32[][]
  "output array": f64[][][]
diagram:
  s1 = f64[][][] []  # shift register
  for (N = 5) (iteration -> i1) {
    s2 = i32[][] []  # shift register
    while (iteration -> i2) {
      Wait Until Next Multiple(multiple to wait=500)
      Build Array(i2, i2) -> w1
      Build Array(s2, w1) -> w2
      Insert Into Array(inArray=s1, index0=i1, new=w2) -> w3
      $"output array" <- w3
      Is Greater(x=i2, y=10) -> w4
      next s2 = w2
      stop if w4
    }
    $Output_3 <- s2
    next s1 = w3
  }
  $Output <- s1
