vi "Test notification subve.gvi"   [LabVIEW NXG 3.1.0]
inputs:
  "Notifier in": Notifier<T1>
  "Input": error
outputs:
  "Output": error
types:
  T1 = cluster{"Current Value (A)  ": f64, "EQE (%)": f64, "Dark Current (A)": f64, "Cell being measured": string, "Automatic EQE Measurement Graph": cluster{"Element 1": f64[], "Element 2": f64[]}[], "Finnished": bool}
diagram:
  s1 = $Input  # shift register
  while (iteration -> i1) {
    Wait Until Next Multiple(multiple to wait=1000)
    Property Node(instance in=T1 {all zero or empty}, "Current Value (A)  "=i1, "EQE (%)"=0, "Dark Current (A)"=0, "Cell being measured"="", "Automatic EQE Measurement Graph"=cluster{"Element 1": f64[], "Element 2": f64[]}[] []) -> (instance out=w1)
    Send Notification(error in (no error)=s1, notification=w1, notifier=$"Notifier in") -> (error out=w2, notifier out=w3)
    Is Greater(x=i1, y=2) -> w4
    next s1 = w2
    stop if w4
  }
  $Output <- s1
