vi "Test notification.gvi"   [LabVIEW NXG 3.1.0]
panel indicators:
  "notification": T1
types:
  T1 = cluster{"Current Value (A)  ": f64, "EQE (%)": f64, "Dark Current (A)": f64, "Cell being measured": string, "Automatic EQE Measurement Graph": cluster{"Element 1": f64[], "Element 2": f64[]}[], "Finnished": bool}
uses:
  EQE_Measuring_Setup_NanOpto::SubVis::Utilities::Tests::Test notification subve.gvi
  NI::G Core::Error::Display Error.gvi
diagram:
  Obtain Notifier(element data type=T1 {all zero or empty}) -> (error out=w1, notifier out=w2)
  call "Test notification subve.gvi"(Notifier in=w2, Input=w1) -> (Output=w3)
  call "Display Error.gvi"(error in=w3)
  while (after w1) {
    Wait On Notification(notifier=w2, timeout in milliseconds=1000) -> (notification=w4, notifier out=w5, timed out?=w6)
    $notification <- w4
    stop if w6
  }
