vi "Welcome tab.gvi"   [LabVIEW NXG 3.1.0]
outputs:
  "Help": bool
panel controls:
  "No help": bool
  "Please help": bool
diagram:
  while {
    Wait Until Next Multiple(multiple to wait=50)
    Logical And($"No help", $"Please help") -> w1
    Logical Or(w1, $"Please help") -> w2
    Logical Or($"No help", $"Please help") -> w3
    stop if w3
  }
  $Help <- w2
