vi "Plot Labels test.gvi"   [LabVIEW NXG 3.1.0]
panel indicators:
  "Automatic EQE Measurement Graph": cluster{"Element 1": f64[], "Element 2": f64[]}[]
diagram:
  w1 = [{"Element 1"=[10, 120, 20, 30], "Element 2"=[20, 120, 320, 40]}, {"Element 1"=[20, 540, 30, 540], "Element 2"=[30, 50, 60, 70]}, {"Element 1"=[10, 2, 30, 40], "Element 2"=[40, 50, 60, 70]}, {"Element 1"=[10, 30, 50, 70], "Element 2"=[10, 20, 30, 40]}]
  $"Automatic EQE Measurement Graph" <- w1
  Array Size(array=w1) -> (size(s)=w2)
  for (N = w2) (iteration -> i1) {
    Property Node(instance in=reference to "Automatic EQE Measurement Graph", "ActivePlot"=i1) -> ("Plot"=w3)
    Format Into String(initString="TEST", i1) -> w4
    Property Node(instance in=w3, "Name"=w4)
  }
