vi "LLTF_Contrast_Demo.gvi"   [LabVIEW NXG 3.1.0]
panel controls:
  "Configuration File": path
  "Wavelength": f64 = 600
  "Stop": bool
panel indicators:
  "Current System": string
  "Minimum Wavelength": f64  # double
  "Maximum Wavelength": f64  # double
uses:
  PE_Filter_SDK::PE Create.gvi
  PE_Filter_SDK::PE Get System Name.gvi
  PE_Filter_SDK::PE Open.gvi
  PE_Filter_SDK::PE Get Wavelength Range.gvi
  PE_Filter_SDK::PE Set Wavelength.gvi
  PE_Filter_SDK::PE Close.gvi
  PE_Filter_SDK::PE Destroy.gvi
diagram:
  sequence {
    frame 0 {
      Path To String(path=$"Configuration File") -> (string=w1)
      # Create system using specified
      # configuration file
      call "PE Create.gvi"(conffile=w1) -> (peHandle out=w2, error out=w3)
    }
    frame 1 {
      # Connect to first available system
      call "PE Get System Name.gvi"(peHandle=w2, index=0, error in (no error)=w3) -> (peHandle out=w4, name=w5, error out=w6)
      $"Current System" <- w5
    }
    frame 2 {
      # Open selected system
      call "PE Open.gvi"(peHandle=w4, name=w5, error in (no error)=w6) -> (peHandle out=w7, error out=w8)
    }
    frame 3 {
      # Get filter wavelength range
      call "PE Get Wavelength Range.gvi"(peHandle=w7, error in (no error)=w8) -> (peHandle out=w9, maximum=w10, minimum=w11, error out=w12)
      $"Maximum Wavelength" <- w10
      call "PE Set Wavelength.gvi"(peHandle=w9, wavelength=500, error in (no error)=w12) -> (peHandle out=w13, error out=w14)
      $"Minimum Wavelength" <- w11
    }
    frame 4 {
      # Move filter wavelength
      while {
        event {
          on Timeout {
            w15 = default
            w16 = w13
            w17 = w14
          }
          on "Wavelength" Value changed {
            Event Data() -> ("New Value"=w18)
            call "PE Set Wavelength.gvi"(peHandle=w13, wavelength=w18, error in (no error)=w14) -> (peHandle out=w16, error out=w17)
            w15 = default
          }
          on "Stop" Value changed {
            Event Data() -> ("New Value"=w15)
            w16 = w13
            w17 = w14
          }
        }
        stop if w15
      }
    }
    frame 5 {
      # Close system
      call "PE Close.gvi"(peHandle=w16, error in (no error)=w17) -> (peHandle out=w19, error out=w20)
    }
    frame 6 {
      call "PE Destroy.gvi"(peHandle=w19, error in (no error)=w20)
    }
  }
