vi "LLTF_Contrast_Demo_Advanced.gvi"   [LabVIEW NXG 3.1.0]
panel controls:
  "Configuration File": path
  "Stop": bool
  "Move Filter": bool
  "Wavelength": f64 = 600
  "Grating": i64 = 4
panel indicators:
  "Current System": string
  "Grating Count": i64  # double
  "Max Ext. Wavelength": f64  # double
  "Min Ext. Wavelength": f64  # double
  "Grating Name": string
uses:
  PE_Filter_SDK::PE Create.gvi
  PE_Filter_SDK::PE Get System Name.gvi
  PE_Filter_SDK::PE Open.gvi
  PE_Filter_SDK::PE Get Grating Count.gvi
  PE_Filter_SDK::PE Get Grating.gvi
  PE_Filter_SDK::PE Get Grating Name.gvi
  PE_Filter_SDK::PE Get Grating Wavelength Extended Range.gvi
  PE_Filter_SDK::PE Get Wavelength.gvi
  PE_Filter_SDK::PE Set Wavelength On Grating.gvi
  PE_Filter_SDK::PE Close.gvi
  PE_Filter_SDK::PE Destroy.gvi
diagram:
  sequence {
    frame 0 {
      Path To String(path=$"Configuration File") -> (string=w1)
      # Create system using specified
      # configuration file
      call "PE Create.gvi"(conffile=w1) -> (peHandle out=w2, error out=w3)
    }
    frame 1 {
      # Connect to first
      # available system
      call "PE Get System Name.gvi"(peHandle=w2, index=0, error in (no error)=w3) -> (peHandle out=w4, name=w5, error out=w6)
      $"Current System" <- w5
    }
    frame 2 {
      # Open
      # selected system
      call "PE Open.gvi"(peHandle=w4, name=w5, error in (no error)=w6) -> (peHandle out=w7, error out=w8)
    }
    frame 3 {
      call "PE Get Grating Count.gvi"(peHandle=w7, error in (no error)=w8) -> (peHandle out=w9, count=w10, error out=w11)
      $"Grating Count" <- w10
    }
    frame 4 {
      call "PE Get Grating.gvi"(peHandle=w9, error in (no error)=w11) -> (peHandle out=w12, gratingIndex=w13, error out=w14)
      # Get filter grating index
      Property Node(instance in=reference to "Grating", "Value"=w13)  # NumericTextBox properties
      call "PE Get Grating Name.gvi"(peHandle=w12, gratingIndex=w13, error in (no error)=w14) -> (peHandle out=w15, name=w16, error out=w17)
      $"Grating Name" <- w16
    }
    frame 5 {
      call "PE Get Grating Wavelength Extended Range.gvi"(peHandle=w15, gratingIndex=w13, error in (no error)=w17) -> (peHandle out=w18, extMaximum=w19, extMinimum=w20, error out=w21)
      $"Max Ext. Wavelength" <- w19
      # Get wavelength extended range
      $"Min Ext. Wavelength" <- w20
    }
    frame 6 {
      call "PE Get Wavelength.gvi"(peHandle=w18, error in (no error)=w21) -> (peHandle out=w22, wavelength=w23, error out=w24)
      # Get wavelength
      Property Node(instance in=reference to "Wavelength", "Value"=w23)  # NumericTextBox properties
    }
    frame 7 {
      # Configure Filter
      while {
        event {
          on "Move Filter" Value changed {
            call "PE Set Wavelength On Grating.gvi"(peHandle=w22, gratingIndex=$Grating, wavelength=$Wavelength, error in (no error)=w24) -> (peHandle out=w27, error out=w26)
            w25 = default
          }
          on "Stop" Value changed {
            Event Data() -> ("New Value"=w25)
            w26 = w24
            w27 = w22
          }
          on "Grating" Value changed {
            Event Data() -> ("New Value"=w28)
            call "PE Get Grating Name.gvi"(peHandle=w22, gratingIndex=w28, error in (no error)=w24) -> (peHandle out=w29, name=w30, error out=w31)
            $"Grating Name" <- w30
            call "PE Get Grating Wavelength Extended Range.gvi"(peHandle=w29, gratingIndex=w28, error in (no error)=w31) -> (peHandle out=w27, extMaximum=w32, extMinimum=w33, error out=w26)
            $"Max Ext. Wavelength" <- w32
            $"Min Ext. Wavelength" <- w33
            w25 = default
          }
        }
        stop if w25
      }
    }
    frame 8 {
      # Close system
      call "PE Close.gvi"(peHandle=w27, error in (no error)=w26) -> (peHandle out=w34, error out=w35)
    }
    frame 9 {
      # Destroy system
      call "PE Destroy.gvi"(peHandle=w34, error in (no error)=w35)
    }
  }
