vi "Monochromator Initialization Sequence.gvi"   [LabVIEW NXG 3.1.0]
inputs:
  "Error In": error
  "Configuration File": path
outputs:
  "Error Out": error
  "peHandle out": u64
  "Current System": string
uses:
  PE_Filter_SDK::PE Create.gvi
  PE_Filter_SDK::PE Get System Name.gvi
  PE_Filter_SDK::PE Open.gvi
  PE_Filter_SDK::PE Close.gvi
  PE_Filter_SDK::PE Destroy.gvi
diagram:
  case ($"Error In") {
    frame Error, Default {
      w1 = $"Error In"
    }
    frame No Error {
      while (iteration -> i1) {
        Wait Until Next Multiple(multiple to wait=500)
        # Create system using specified
        # configuration file
        # Connect to first
        # available system
        Is Greater(x=i1, y=5) -> w2
        Path To String(path=$"Configuration File") -> (string=w3)
        call "PE Create.gvi"(conffile=w3, error in (no error)=$"Error In") -> (peHandle out=w4, error out=w5)
        call "PE Get System Name.gvi"(peHandle=w4, index=0, error in (no error)=w5) -> (peHandle out=w6, name=w7, error out=w8)
        # Open
        # selected system
        call "PE Open.gvi"(peHandle=w6, name=w7, error in (no error)=w8) -> (peHandle out=w9, Open Fail=w10, error out=w11)
        case (w10) {
          frame True {
            call "PE Close.gvi"(peHandle=w9, error in (no error)=w11) -> (peHandle out=w14, error out=w15)
            call "PE Destroy.gvi"(peHandle=w14, error in (no error)=w15) -> (error out=w1)
            case (w2) {
              frame True {
                w16 = """It looks like you are having trouble
connecting the fiannium, do you 
want to proceed anyway? (Warning,
the program might crash and the 
results will be completely unreliable!)"""
                Two Button Dialog(F button name ("Cancel")="Oh dear no, I \nwill go ask for help", T button name ("OK")="I will take the risk,\nI know what I'm doing", message=w16) -> (T Button?=w12)
              }
              frame False {
                w17 = "It looks like the Fiannium\nmonochromator is not \nconnected. please connect\nit and try again."
                One Button Dialog(button name ("OK")="Okay, I will make\nsure it is connected :)", message=w17)
                w12 = FALSE
              }
            }
            w13 = 0
          }
          frame False {
            w1 = w11
            w12 = TRUE
            w13 = w9
          }
        }
        $"peHandle out" <- w13
        $"Current System" <- w7
        stop if w12
      }
    }
  }
  $"Error Out" <- w1
