vi "PE Close.gvi"   [LabVIEW NXG 3.1.0]
# PEFILTERSDK_API PE_STATUS PE_Close(PE_HANDLE peHandle);
inputs:
  "peHandle": u64  # PE_HANDLE
  "error in (no error)": error
outputs:
  "peHandle out": u64  # PE_HANDLE
  "error out": error
uses:
  PE_Filter_SDK::PE_Filter_SDK.sli::PE_Close
  PE_Filter_SDK::Error Converter (ErrCode or Status).gvi
diagram:
  # PEFILTERSDK_API PE_STATUS PE_Close(PE_HANDLE peHandle);
  call "PE_Close"(peHandle in=$peHandle, error in=$"error in (no error)") -> (return=w1, error out=w2)
  call "Error Converter (ErrCode or Status).gvi"(error code=w1, error in (no error)=w2) -> (error out=w3)
  $"error out" <- w3
