vi "PE Create.gvi"   [LabVIEW NXG 3.1.0]
# PEFILTERSDK_API PE_STATUS PE_Create(const char* conffile, PE_HANDLE* peHandle);
inputs:
  "conffile": string
  "error in (no error)": error
outputs:
  "peHandle out": u64  # PE_HANDLE
  "error out": error
uses:
  PE_Filter_SDK::PE_Filter_SDK.sli::PE_Create
  PE_Filter_SDK::Error Converter (ErrCode or Status).gvi
diagram:
  call "PE_Create"(conffile in=$conffile, peHandle in=0, error in=$"error in (no error)") -> (return=w1, peHandle out=w2, error out=w3)
  # PEFILTERSDK_API PE_STATUS PE_Create(const char* conffile, PE_HANDLE* peHandle);
  call "Error Converter (ErrCode or Status).gvi"(error code=w1, error in (no error)=w3) -> (error out=w4)
  $"error out" <- w4
  $"peHandle out" <- w2
