vi "PE Destroy.gvi"   [LabVIEW NXG 3.1.0]
# PEFILTERSDK_API PE_STATUS PE_Destroy(PE_HANDLE peHandle);
inputs:
  "peHandle": u64  # PE_HANDLE
  "error in (no error)": error
outputs:
  "error out": error
uses:
  PE_Filter_SDK::PE_Filter_SDK.sli::PE_Destroy
  PE_Filter_SDK::Error Converter (ErrCode or Status).gvi
diagram:
  call "PE_Destroy"(peHandle in=$peHandle, error in=$"error in (no error)") -> (return=w1, error out=w2)
  # PEFILTERSDK_API PE_STATUS PE_Destroy(PE_HANDLE peHandle);
  call "Error Converter (ErrCode or Status).gvi"(error code=w1, error in (no error)=w2) -> (error out=w3)
  $"error out" <- w3
