vi "PE Get Grating Count.gvi"   [LabVIEW NXG 3.1.0]
# PEFILTERSDK_API PE_STATUS PE_GetGratingCount(CPE_HANDLE peHandle, int* count);
inputs:
  "peHandle": u64  # CPE_HANDLE
  "error in (no error)": error
outputs:
  "peHandle out": u64  # PE_HANDLE
  "count": i64  # int
  "error out": error
uses:
  PE_Filter_SDK::PE_Filter_SDK.sli::PE_GetGratingCount
  PE_Filter_SDK::Error Converter (ErrCode or Status).gvi
diagram:
  call "PE_GetGratingCount"(peHandle in=$peHandle, count in=0, error in=$"error in (no error)") -> (return=w1, peHandle out=w2, count out=w3, error out=w4)
  $"peHandle out" <- w2
  # PEFILTERSDK_API PE_STATUS PE_GetGratingCount(CPE_HANDLE peHandle, int* count);
  call "Error Converter (ErrCode or Status).gvi"(error code=w1, error in (no error)=w4) -> (error out=w5)
  $"error out" <- w5
  $count <- w3
