vi "PE Get Grating Name.gvi"   [LabVIEW NXG 3.1.0]
# PEFILTERSDK_API PE_STATUS PE_GetGratingName(CPE_HANDLE peHandle, int gratingIndex, char* name, int size);
inputs:
  "peHandle": u64  # CPE_HANDLE
  "gratingIndex": i64  # int
  "error in (no error)": error
outputs:
  "peHandle out": u64  # PE_HANDLE
  "name": string
  "error out": error
uses:
  PE_Filter_SDK::PE_Filter_SDK.sli::PE_GetGratingName
  PE_Filter_SDK::Error Converter (ErrCode or Status).gvi
diagram:
  Initialize Array(element=0, size=4097) -> w1
  Byte Array To String(encoding="Extended ASCII", unsigned byte array=w1) -> (string=w2)
  call "PE_GetGratingName"(peHandle in=$peHandle, gratingIndex in=$gratingIndex, name in=w2, size in=4097, error in=$"error in (no error)") -> (return=w3, peHandle out=w4, name out=w5, error out=w6)
  $"peHandle out" <- w4
  # PEFILTERSDK_API PE_STATUS PE_GetGratingName(CPE_HANDLE peHandle, int gratingIndex, char* name, int size);
  call "Error Converter (ErrCode or Status).gvi"(error code=w3, error in (no error)=w6) -> (error out=w7)
  $"error out" <- w7
  $name <- w5
