vi "PE Get Grating Wavelength Extended Range.gvi"   [LabVIEW NXG 3.1.0]
# PEFILTERSDK_API PE_STATUS PE_GetGratingWavelengthExtendedRange(CPE_HANDLE peHandle, int gratingIndex, double* extMinimum, double* extMaximum);
inputs:
  "peHandle": u64  # CPE_HANDLE
  "gratingIndex": i64  # int
  "error in (no error)": error
outputs:
  "peHandle out": u64  # PE_HANDLE
  "extMinimum": f64  # double
  "extMaximum": f64  # double
  "error out": error
uses:
  PE_Filter_SDK::PE_Filter_SDK.sli::PE_GetGratingWavelengthExtendedRange
  PE_Filter_SDK::Error Converter (ErrCode or Status).gvi
diagram:
  call "PE_GetGratingWavelengthExtendedRange"(peHandle in=$peHandle, gratingIndex in=$gratingIndex, extMinimum in=0, extMaximum in=0, error in=$"error in (no error)") -> (return=w1, peHandle out=w2, extMinimum out=w3, extMaximum out=w4, error out=w5)
  $"peHandle out" <- w2
  # PEFILTERSDK_API PE_STATUS PE_GetGratingWavelengthExtendedRange(CPE_HANDLE peHandle, int gratingIndex, double* extMinimum, double* extMaximum);
  call "Error Converter (ErrCode or Status).gvi"(error code=w1, error in (no error)=w5) -> (error out=w6)
  $"error out" <- w6
  $extMinimum <- w3
  $extMaximum <- w4
