vi "PE Get Grating Wavelength Range.gvi"   [LabVIEW NXG 3.1.0]
# PEFILTERSDK_API PE_STATUS PE_GetGratingWavelengthRange(CPE_HANDLE peHandle, int gratingIndex, double* minimum, double* maximum);
inputs:
  "peHandle": u64  # CPE_HANDLE
  "gratingIndex": i64  # int
  "error in (no error)": error
outputs:
  "minimum": f64  # double
  "maximum": f64  # double
  "error out": error
panel indicators:
  "peHandle out": u64  # PE_HANDLE
uses:
  PE_Filter_SDK::PE_Filter_SDK.sli::PE_GetGratingWavelengthRange
  PE_Filter_SDK::Error Converter (ErrCode or Status).gvi
diagram:
  call "PE_GetGratingWavelengthRange"(peHandle in=$peHandle, gratingIndex in=$gratingIndex, minimum in=0, maximum in=0, error in=$"error in (no error)") -> (return=w1, peHandle out=w2, minimum out=w3, maximum out=w4, error out=w5)
  $"peHandle out" <- w2
  # PEFILTERSDK_API PE_STATUS PE_GetGratingWavelengthRange(CPE_HANDLE peHandle, int gratingIndex, double* minimum, double* maximum);
  call "Error Converter (ErrCode or Status).gvi"(error code=w1, error in (no error)=w5) -> (error out=w6)
  $"error out" <- w6
  $minimum <- w3
  $maximum <- w4
