vi "PE Get Grating.gvi"   [LabVIEW NXG 3.1.0]
# PEFILTERSDK_API PE_STATUS PE_GetGrating(PE_HANDLE peHandle, int* gratingIndex);
inputs:
  "peHandle": u64  # PE_HANDLE
  "error in (no error)": error
outputs:
  "peHandle out": u64  # PE_HANDLE
  "gratingIndex": i64  # int
  "error out": error
uses:
  PE_Filter_SDK::PE_Filter_SDK.sli::PE_GetGrating
  PE_Filter_SDK::Error Converter (ErrCode or Status).gvi
diagram:
  call "PE_GetGrating"(peHandle in=$peHandle, gratingIndex in=0, error in=$"error in (no error)") -> (return=w1, peHandle out=w2, gratingIndex out=w3, error out=w4)
  $"peHandle out" <- w2
  # PEFILTERSDK_API PE_STATUS PE_GetGrating(PE_HANDLE peHandle, int* gratingIndex);
  call "Error Converter (ErrCode or Status).gvi"(error code=w1, error in (no error)=w4) -> (error out=w5)
  $"error out" <- w5
  $gratingIndex <- w3
