vi "PE Get Harmonic Filter Enabled.gvi"   [LabVIEW NXG 3.1.0]
# PEFILTERSDK_API PE_STATUS PE_GetHarmonicFilterEnabled(CPE_HANDLE peHandle, int* enable);
inputs:
  "peHandle": u64  # CPE_HANDLE
  "error in (no error)": error
outputs:
  "enable": i64  # int
  "error out": error
panel indicators:
  "peHandle out": u64  # PE_HANDLE
uses:
  PE_Filter_SDK::PE_Filter_SDK.sli::PE_GetHarmonicFilterEnabled
  PE_Filter_SDK::Error Converter (ErrCode or Status).gvi
diagram:
  call "PE_GetHarmonicFilterEnabled"(peHandle in=$peHandle, enable in=0, error in=$"error in (no error)") -> (return=w1, peHandle out=w2, enable out=w3, error out=w4)
  $"peHandle out" <- w2
  # PEFILTERSDK_API PE_STATUS PE_GetHarmonicFilterEnabled(CPE_HANDLE peHandle, int* enable);
  call "Error Converter (ErrCode or Status).gvi"(error code=w1, error in (no error)=w4) -> (error out=w5)
  $"error out" <- w5
  $enable <- w3
