vi "PE Get Library Version.gvi"   [LabVIEW NXG 3.1.0]
# PEFILTERSDK_API int PE_GetLibraryVersion(void);
inputs:
  "error in (no error)": error
outputs:
  "function return": i64  # int
  "error out": error
uses:
  PE_Filter_SDK::PE_Filter_SDK.sli::PE_GetLibraryVersion
  PE_Filter_SDK::Error Converter (ErrCode or Status).gvi
diagram:
  call "PE_GetLibraryVersion"(error in=$"error in (no error)") -> (return=w1, error out=w2)
  # PEFILTERSDK_API int PE_GetLibraryVersion(void);
  $"function return" <- w1
  call "Error Converter (ErrCode or Status).gvi"(error code=w1, error in (no error)=w2) -> (error out=w3)
  $"error out" <- w3
