vi "PE Get Status Str.gvi"   [LabVIEW NXG 3.1.0]
# PEFILTERSDK_API const char* PE_GetStatusStr(PE_STATUS code);
inputs:
  "code": i64  # PE_STATUS
  "error in (no error)": error
outputs:
  "function return": string
  "error out": error
uses:
  PE_Filter_SDK::PE_Filter_SDK.sli::PE_GetStatusStr
  PE_Filter_SDK::Error Converter (ErrCode or Status).gvi
diagram:
  call "PE_GetStatusStr"(code in=$code, error in=$"error in (no error)") -> (return=w1, error out=w2)
  # PEFILTERSDK_API const char* PE_GetStatusStr(PE_STATUS code);
  $"function return" <- w1
  call "Error Converter (ErrCode or Status).gvi"(error in (no error)=w2) -> (error out=w3)
  $"error out" <- w3
