vi "PE Get System Count.gvi"   [LabVIEW NXG 3.1.0]
# PEFILTERSDK_API int PE_GetSystemCount(CPE_HANDLE peHandle);
inputs:
  "peHandle": u64  # CPE_HANDLE
  "error in (no error)": error
outputs:
  "peHandle out": u64  # PE_HANDLE
  "System Counts": i64  # int
  "error out": error
uses:
  PE_Filter_SDK::PE_Filter_SDK.sli::PE_GetSystemCount
  PE_Filter_SDK::Error Converter (ErrCode or Status).gvi
diagram:
  call "PE_GetSystemCount"(peHandle in=$peHandle, error in=$"error in (no error)") -> (return=w1, peHandle out=w2, error out=w3)
  $"System Counts" <- w1
  $"peHandle out" <- w2
  # PEFILTERSDK_API int PE_GetSystemCount(CPE_HANDLE peHandle);
  call "Error Converter (ErrCode or Status).gvi"(error code=w1, error in (no error)=w3) -> (error out=w4)
  $"error out" <- w4
