vi "PE Get Wavelength Range.gvi"   [LabVIEW NXG 3.1.0]
# PEFILTERSDK_API PE_STATUS PE_GetWavelengthRange(CPE_HANDLE peHandle, double* minimum, double* maximum);
inputs:
  "peHandle": u64  # CPE_HANDLE
  "error in (no error)": error
outputs:
  "peHandle out": u64  # CPE_HANDLE
  "minimum": f64  # double
  "maximum": f64  # double
  "error out": error
uses:
  PE_Filter_SDK::PE_Filter_SDK.sli::PE_GetWavelengthRange
  PE_Filter_SDK::Error Converter (ErrCode or Status).gvi
diagram:
  call "PE_GetWavelengthRange"(peHandle in=$peHandle, minimum in=0, maximum in=0, error in=$"error in (no error)") -> (return=w1, peHandle out=w2, minimum out=w3, maximum out=w4, error out=w5)
  $"peHandle out" <- w2
  # PEFILTERSDK_API PE_STATUS PE_GetWavelengthRange(CPE_HANDLE peHandle, double* minimum, double* maximum);
  call "Error Converter (ErrCode or Status).gvi"(error code=w1, error in (no error)=w5) -> (error out=w6)
  $"error out" <- w6
  $minimum <- w3
  $maximum <- w4
