vi "PE Get Wavelength.gvi"   [LabVIEW NXG 3.1.0]
# PEFILTERSDK_API PE_STATUS PE_GetWavelength(CPE_HANDLE peHandle, double* wavelength);
inputs:
  "peHandle": u64  # CPE_HANDLE
  "error in (no error)": error
outputs:
  "peHandle out": u64  # PE_HANDLE
  "wavelength": f64  # double
  "error out": error
uses:
  PE_Filter_SDK::PE_Filter_SDK.sli::PE_GetWavelength
  PE_Filter_SDK::Error Converter (ErrCode or Status).gvi
diagram:
  call "PE_GetWavelength"(peHandle in=$peHandle, wavelength in=0, error in=$"error in (no error)") -> (return=w1, peHandle out=w2, wavelength out=w3, error out=w4)
  $"peHandle out" <- w2
  # PEFILTERSDK_API PE_STATUS PE_GetWavelength(CPE_HANDLE peHandle, double* wavelength);
  call "Error Converter (ErrCode or Status).gvi"(error code=w1, error in (no error)=w4) -> (error out=w5)
  $"error out" <- w5
  $wavelength <- w3
