vi "PE Has Harmonic Filter.gvi"   [LabVIEW NXG 3.1.0]
# PEFILTERSDK_API int PE_HasHarmonicFilter(CPE_HANDLE peHandle);
inputs:
  "peHandle": u64  # CPE_HANDLE
  "error in (no error)": error
outputs:
  "error out": error
panel indicators:
  "peHandle out": u64  # PE_HANDLE
uses:
  PE_Filter_SDK::PE_Filter_SDK.sli::PE_HasHarmonicFilter
  PE_Filter_SDK::Error Converter (ErrCode or Status).gvi
diagram:
  call "PE_HasHarmonicFilter"(peHandle in=$peHandle, error in=$"error in (no error)") -> (return=w1, peHandle out=w2, error out=w3)
  $"peHandle out" <- w2
  # PEFILTERSDK_API int PE_HasHarmonicFilter(CPE_HANDLE peHandle);
  call "Error Converter (ErrCode or Status).gvi"(error code=w1, error in (no error)=w3) -> (error out=w4)
  $"error out" <- w4
