vi "PE Open.gvi"   [LabVIEW NXG 3.1.0]
# PEFILTERSDK_API PE_STATUS PE_Open(PE_HANDLE peHandle, const char* name);
inputs:
  "peHandle": u64  # PE_HANDLE
  "name": string
  "error in (no error)": error
outputs:
  "peHandle out": u64
  "error out": error
  "Open Fail": bool
uses:
  PE_Filter_SDK::PE_Filter_SDK.sli::PE_Open
  PE_Filter_SDK::Error Converter (ErrCode or Status).gvi
diagram:
  call "PE_Open"(peHandle in=$peHandle, name in=$name, error in=$"error in (no error)") -> (return=w1, peHandle out=w2, error out=w3)
  # PEFILTERSDK_API PE_STATUS PE_Open(PE_HANDLE peHandle, const char* name);
  call "Error Converter (ErrCode or Status).gvi"(error code=w1, error in (no error)=w3) -> (error out=w4)
  $"error out" <- w4
  Is Equal(x=w1, y=2) -> w5
  $"Open Fail" <- w5
  $"peHandle out" <- w2
