vi "PE Set Harmonic Filter Enabled.gvi"   [LabVIEW NXG 3.1.0]
# PEFILTERSDK_API PE_STATUS PE_SetHarmonicFilterEnabled(PE_HANDLE peHandle, int enable);
inputs:
  "peHandle": u64  # PE_HANDLE
  "enable": i64  # int
  "error in (no error)": error
outputs:
  "error out": error
panel indicators:
  "peHandle out": u64  # PE_HANDLE
uses:
  PE_Filter_SDK::PE_Filter_SDK.sli::PE_SetHarmonicFilterEnabled
  PE_Filter_SDK::Error Converter (ErrCode or Status).gvi
diagram:
  call "PE_SetHarmonicFilterEnabled"(peHandle in=$peHandle, enable in=$enable, error in=$"error in (no error)") -> (return=w1, peHandle out=w2, error out=w3)
  $"peHandle out" <- w2
  # PEFILTERSDK_API PE_STATUS PE_SetHarmonicFilterEnabled(PE_HANDLE peHandle, int enable);
  call "Error Converter (ErrCode or Status).gvi"(error code=w1, error in (no error)=w3) -> (error out=w4)
  $"error out" <- w4
