vi "PE Set Wavelength On Grating.gvi"   [LabVIEW NXG 3.1.0]
# PEFILTERSDK_API PE_STATUS PE_SetWavelengthOnGrating(PE_HANDLE peHandle, int gratingIndex, double wavelength);
inputs:
  "peHandle": u64  # PE_HANDLE
  "gratingIndex": i64  # int
  "wavelength": f64  # double
  "error in (no error)": error
outputs:
  "peHandle out": u64  # PE_HANDLE
  "error out": error
uses:
  PE_Filter_SDK::PE_Filter_SDK.sli::PE_SetWavelengthOnGrating
  PE_Filter_SDK::Error Converter (ErrCode or Status).gvi
diagram:
  call "PE_SetWavelengthOnGrating"(peHandle in=$peHandle, gratingIndex in=$gratingIndex, wavelength in=$wavelength, error in=$"error in (no error)") -> (return=w1, peHandle out=w2, error out=w3)
  # PEFILTERSDK_API PE_STATUS PE_SetWavelengthOnGrating(PE_HANDLE peHandle, int gratingIndex, double wavelength);
  call "Error Converter (ErrCode or Status).gvi"(error code=w1, error in (no error)=w3) -> (error out=w4)
  $"error out" <- w4
  $"peHandle out" <- w2
