vi "PE Set Wavelength.gvi"   [LabVIEW NXG 3.1.0]
# PEFILTERSDK_API PE_STATUS PE_SetWavelength(PE_HANDLE peHandle, double wavelength);
inputs:
  "peHandle": u64  # PE_HANDLE
  "wavelength": f64  # double
  "error in (no error)": error
outputs:
  "peHandle out": u64  # PE_HANDLE
  "error out": error
uses:
  PE_Filter_SDK::PE_Filter_SDK.sli::PE_SetWavelength
  PE_Filter_SDK::Error Converter (ErrCode or Status).gvi
diagram:
  call "PE_SetWavelength"(peHandle in=$peHandle, wavelength in=$wavelength, error in=$"error in (no error)") -> (return=w1, peHandle out=w2, error out=w3)
  $"peHandle out" <- w2
  # PEFILTERSDK_API PE_STATUS PE_SetWavelength(PE_HANDLE peHandle, double wavelength);
  call "Error Converter (ErrCode or Status).gvi"(error code=w1, error in (no error)=w3) -> (error out=w4)
  $"error out" <- w4
